# Grasshopper definition Model125.gh (Grasshopper 1.0.7)
# Copyright: Wickerson Studios
# plug-ins: MeshEdit Components, Bifocals

# Wickerson Studio
# 
# created by: Michael Wickerson
# 
# Grasshopper for Rhino 3D Algorithmic Modeling
# 
# www.wickersonstudios.com
# www.michaelwickerson.com
# https://www.youtube.com/channel/UC7J48Ppcsa6oncp6d29R0xw
# https://github.com/mwickerson
# https://www.facebook.com/michael.wickerson
# https://www.linkedin.com/in/michael-wickerson-696a80156/
# Wickerson Studio
# created by: Michael Wickerson
# Grasshopper for Rhino 3D Algorithmic Modeling
# www.wickersonstudios.com
# www.michaelwickerson.com
# https://www.youtube.com/channel/UC7J48Ppcsa6oncp6d29R0xw
# https://github.com/mwickerson
# https://www.facebook.com/michael.wickerson
# https://www.linkedin.com/in/michael-wickerson-696a80156/
image_sampler = ImageSampler(
    FilePath="C:\Users\Sculpture\Documents\2020Grasshopper\ScreenShots2019\Screenshots2020\SurfaceEditAlgorithm.PNG",
    Filter="Value",
    Interpolate=False,
    Umax=1,
    Umin=0,
    Vmax=1,
    Vmin=0,
    Wrap=1)
# Wheel
construct_point = ConstructPoint(XCoordinate=0, YCoordinate=0, ZCoordinate=0)
number_slider = Slider(7, range=0..10)
number_slider_2 = Slider(2, range=0..2)
sphere = Sphere(Base=construct_point, Radius=Slider(0.4, range=0..1))
division = Division(A=number_slider_2, B=number_slider)
unit_z = UnitZ(Factor=Slider(1.09, range=0..2))
yz_plane = YZPlane(Origin=Point(0, 0, 0))
move = Move(Geometry=construct_point, Motion=unit_z)  # -> Geometry, Transform
pi = Pi(Factor=number_slider_2)
polar_array = PolarArray(Geometry=move.Geometry, Plane=yz_plane, Count=number_slider, Angle=pi)  # -> Geometry, Transform
interpolate = Interpolate(Vertices=polar_array.Geometry, Degree=Slider(1, range=1..5), Periodic=Toggle(True), KnotStyle=1)  # -> Curve, Length, Domain
line = Line(StartPoint=construct_point, EndPoint=polar_array.Geometry)
explode = Explode(Curve=interpolate.Curve, Recursive=True)  # -> Segments, Vertices
curve_middle = CurveMiddle(Curve=line)  # -> flatten(Midpoint)
line_pt = LinePt(Line=explode.Segments, Point=curve_middle)
pipe = Pipe(Curve=line, Radius=Slider(0.21, range=0..1), Caps=1)
center_box = CenterBox(Base=line_pt, X=1, Y=division, Z=division)
merge = Merge(Data1=center_box, Data2=pipe)  # -> flatten(Result)
solid_union = SolidUnion(Breps=merge)
deconstruct_brep = DeconstructBrep(Brep=solid_union)  # -> Faces, Edges, Vertices
item_index = ItemIndex(List=deconstruct_brep.Faces, Item=deconstruct_brep.Faces)
cull_pattern = CullPattern(List=item_index, CullPattern=deconstruct_brep.Faces)
clean_tree = CleanTree(RemoveNulls=True, RemoveInvalid=True, RemoveEmpty=Slider(1, range=0..1), Tree=cull_pattern)
fillet_edge = FilletEdge(Shape=center_box, Blend=0, Metric=0, Edges=clean_tree, Radii=Slider(0.14, range=0..0.3))
brep = Brep(flatten(fillet_edge))
geometry = Geometry(flatten(pipe))
geometry_2 = Geometry(sphere)
merge_2 = Merge(Data1=brep, Data2=geometry, Data3=geometry_2)
param_viewer = ParamViewer()
solid_union_2 = SolidUnion(Breps=merge_2)
number_slider_3 = Slider(5, range=1..11)
populate_geometry = PopulateGeometry(Geometry=solid_union_2, Count=Slider(158, range=0..200), Seed=Slider(12, range=0..100))
panel = Panel(solid_union_2)
mesh_sphere = MeshSphere(Base=populate_geometry, Radius=".1", UCount=number_slider_3, VCount=number_slider_3)
construct_domain = ConstructDomain(DomainStart=Slider(0.3, range=0..1), DomainEnd=Slider(2, range=0..10))
list_length = ListLength(List=mesh_sphere)
mesh_volume = MeshVolume(Mesh=mesh_sphere)  # -> Volume, Centroid
range = Range(Domain=construct_domain, Steps=expr("x-1", list_length))
jitter = Jitter(List=range, Jitter=".3", Seed=2)  # -> Values, Indices
scale = Scale(Geometry=mesh_sphere, Center=mesh_volume.Centroid, Factor=jitter.Values)  # -> flatten(Geometry), Transform
mesh_brep = MeshBrep(
    Brep=solid_union_2,
    Settings={GridMaxCount=0, GridMinCount=16, JaggedSeams=False, MaxEdgeLength=0, MinEdgeLength=0.0001, MinTolerance=0, Refine=True, RefineAngle=0, RelativeTolerance=0.65, SimplePlanes=True, Tolerance=0})
mesh_difference = MeshDifference(MeshesA=mesh_brep, MeshesB=scale.Geometry)
panel_2 = Panel(scale.Geometry)
