# Grasshopper definition ProvingGround170LunchBox.gh (Grasshopper 1.0.7)
# Copyright: Wickerson Studios
# plug-ins: Human, LunchBoxML, Bifocals

# 1001 GRASSHOPPER DEFINITIONS
# Wickerson Studio
# 
# created by: Michael Wickerson
# 
# Grasshopper for Rhino 3D Algorithmic Modeling
# 
# www.wickersonstudios.com
# www.michaelwickerson.com
# https://www.youtube.com/channel/UC7J48Ppcsa6oncp6d29R0xw
# https://github.com/mwickerson
# https://www.facebook.com/michael.wickerson
# https://www.linkedin.com/in/michael-wickerson-696a80156/
# https://www.grasshopper3d.com/profile/MichaelWickerson
image_sampler = ImageSampler(
    FilePath="C:\Users\Sculpture\Documents\2020Grasshopper\ScreenShots2019\Screenshots2020\SurfaceEditAlgorithm.PNG",
    Filter="Value",
    Interpolate=False,
    Umax=1,
    Umin=0,
    Vmax=1,
    Vmin=0,
    Wrap=1)  # disabled

# ---- group: LBML_NonlinearRegression-CurvePlot / Sample Points
pt = Point([Point(25.0973048, 20.94949138, 0), Point(26.33156766, 20.61724581, 0), Point(30.5683667, 18.61734927, 0), Point(29.70665446, 19.958941, 0), Point(33.87801945, 19.41892409, 0), Point(35.13680678, 17.85952601, 0)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])
pdecon = Deconstruct(Point=pt)  # -> graft(XComponent), YComponent, ZComponent
preview = CustomPreview(Geometry=pt, Shader=ColourSwatch(SwatchColor=RGB(255, 124, 115)))

# ---- group: LBML_LinearRegression-LinePlot / Input points
# Wickerson Studio
# created by: Michael Wickerson
# Grasshopper for Rhino 3D Algorithmic Modeling
# www.wickersonstudios.com
# www.michaelwickerson.com
# https://www.youtube.com/channel/UC7J48Ppcsa6oncp6d29R0xw
# https://github.com/mwickerson
# https://www.facebook.com/michael.wickerson
# https://www.linkedin.com/in/michael-wickerson-696a80156/
# https://www.grasshopper3d.com/profile/MichaelWickerson
pt_2 = Point([Point(48.85484087, 42.93944115, 0), Point(47.54230675, 39.26946931, 0), Point(46.48351837, 36.27833523, 0), Point(17.5074815, 13.16084453, 0), Point(31.61152177, 22.39151598, 0), Point(36.3971641, 22.07227592, 0)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])
pdecon_2 = Deconstruct(Point=pt_2)  # -> XComponent, YComponent, ZComponent
preview_2 = CustomPreview(Geometry=pt_2, Shader=ColourSwatch(SwatchColor=RGB(255, 0, 115)))

# ---- group: LBML_NonlinearRegression-CurvePlot
# Nonlinear Regression
# Version:  2017.7.23
# Company Info: Authored by Proving Ground
# 
# http://ProvingGround.io
# Copyright (c) 2017 Proving Ground LLC
number_slider = Slider(64, range=0..100)
number_slider_2 = Slider(15.867, range=0..50)

# ---- group: LBML_LinearRegression-LinePlot / X Test
# Proving Ground 170 LunchBoxML
# https://www.youtube.com/watch?v=e6WglyUB-7A&list=PLDVYAfUbTKd6G31x1C_U4kIQFlp0Z1nAr
series = Series(Start=0, Step=5, Count=10)

# ---- group: LBML_NonlinearRegression-CurvePlot / Test X Value
series_2 = Series(Start=0, Step=2, Count=25)  # -> graft(Series)

# ---- group: LBML_LinearRegression-LinePlot
# Linear Regression
# Version:  2017/07/21
# Company Info: Authored by Proving Ground
# 
# http://ProvingGround.io
# Copyright (c) 2017 Proving Ground LLC
linereg = LinearRegression(TestData=series, Inputs=pdecon_2.XComponent, Output=pdecon_2.YComponent, RandomSeed=5)

# ---- group: LBML_NonlinearRegression-CurvePlot / Nonlinear Solver
seqminreg = SequentialMinimalOptimizationRegression(
    TestData=series_2,
    Inputs=pdecon.XComponent,
    Output=pdecon.YComponent,
    Degree=number_slider_2,
    Complexity=number_slider,
    RandomSeed=5)  # -> Result, Score, Error

# ---- group: LBML_LinearRegression-LinePlot / LIne Plot
pt_3 = ConstructPoint(XCoordinate=series, YCoordinate=linereg, ZCoordinate=0)
pline = PolyLine(Vertices=pt_3, Closed=False)
previewlw = CustomPreviewLineweights(Geometry=pline, Shader=ColourSwatch(SwatchColor=RGB(255, 255, 255)), Thickness=Slider(3, range=0..10), Absolute=False)

# ---- group: LBML_NonlinearRegression-CurvePlot / Fit Curve
pt_4 = ConstructPoint(XCoordinate=flatten(series_2), YCoordinate=flatten(seqminreg.Result), ZCoordinate=0)
intcrv = Interpolate(Vertices=pt_4, Degree=3, Periodic=False, KnotStyle=1)  # -> Curve, Length, Domain
# rc
# Full multiplicity knots at start
# Simple knots
# Full multiplicity knots at end
# P1
# A=0.2*P1+ 0.8*P2
# D=0.2*A + 0.8*B
# P2
# B=0.47*P2 + 0.53*P3
# Full multiplicity knots at start
# E=0.7*B + 0.3*C
# P3
# Full multiplicity knots in the middle
# C=0.8*P3 + 0.2*P4
# P4
# Full multiplicity knots at end
# Compare knot spacing
previewlw_2 = CustomPreviewLineweights(
    Geometry=intcrv.Curve,
    Shader=ColourSwatch(SwatchColor=RGB(0, 119, 255)),
    Thickness=Slider(5, range=0..5),
    Absolute=False)
