# Grasshopper definition ProvingGround170bLunchBox.gh (Grasshopper 1.0.7)
# Copyright: Wickerson Studios
# plug-ins: LunchBoxML, Bifocals

# 1001 GRASSHOPPER DEFINITIONS
image_sampler = ImageSampler(
    FilePath="C:\Users\Sculpture\Documents\2020Grasshopper\ScreenShots2019\Screenshots2020\SurfaceEditAlgorithm.PNG",
    Filter="Value",
    Interpolate=False,
    Umax=1,
    Umin=0,
    Vmax=1,
    Vmin=0,
    Wrap=1)  # disabled

# ----
# Wickerson Studio
# created by: Michael Wickerson
# Grasshopper for Rhino 3D Algorithmic Modeling
# www.wickersonstudios.com
# www.michaelwickerson.com
# https://www.youtube.com/channel/UC7J48Ppcsa6oncp6d29R0xw
# https://github.com/mwickerson
# https://www.facebook.com/michael.wickerson
# https://www.linkedin.com/in/michael-wickerson-696a80156/
# https://www.grasshopper3d.com/profile/MichaelWickerson
number_slider = Slider(5, range=0..20)
# Wickerson Studio
# 
# created by: Michael Wickerson
# 
# Grasshopper for Rhino 3D Algorithmic Modeling
# 
# www.wickersonstudios.com
# www.michaelwickerson.com
# https://www.youtube.com/channel/UC7J48Ppcsa6oncp6d29R0xw
# https://github.com/mwickerson
# https://www.facebook.com/michael.wickerson
# https://www.linkedin.com/in/michael-wickerson-696a80156/
# https://www.grasshopper3d.com/profile/MichaelWickerson
# Proving Ground 170 LunchBoxML
number_slider_2 = Slider(0, range=0..100)
center_box = CenterBox(Base=PlaneXY(0, 0, 0), X=number_slider, Y=number_slider, Z=number_slider)
populate_3d = Populate3D(Region=center_box, Count=100, Seed=1)
series = Series(Start=number_slider_2, Step=Slider(2.854, range=0..3), Count=number_slider)  # -> graft(Series)
pdecon = Deconstruct(Point=populate_3d)  # -> graft(XComponent), YComponent, ZComponent
seqminreg = SequentialMinimalOptimizationRegression(
    TestData=series,
    Inputs=pdecon.XComponent,
    Output=pdecon.YComponent,
    Degree=Slider(3, range=3..50),
    Complexity=Slider(20, range=3..50),
    RandomSeed=5)  # -> Result, Score, Error
addition = Addition(A="1", B=seqminreg.Result)
construct_point = ConstructPoint(XCoordinate=0, YCoordinate=0, ZCoordinate=0)
unit_z = UnitZ(Factor=1)
pt = ConstructPoint(XCoordinate=flatten(addition), YCoordinate=seqminreg.Result, ZCoordinate=flatten(series))
intcrv = Interpolate(Vertices=pt, Degree=3, Periodic=False, KnotStyle=1)  # -> Curve, Length, Domain
line_sdl = LineSDL(Start=construct_point, Direction=unit_z, Length=Slider(100, range=0..100))
revolution = Revolution(Curve=intcrv.Curve, Axis=line_sdl, Domain=Domain(0, 6.283185307))

surface = Surface(reparameterize(revolution))
number_slider_3 = Slider(37, range=0..100)
deconstruct_brep = DeconstructBrep(Brep=surface)  # -> Faces, Edges, Vertices
divide_surface = DivideSurface(Surface=deconstruct_brep.Faces, UCount=number_slider_3, VCount=number_slider_3)  # -> Points, Normals, Parameters
move = Move(Geometry=divide_surface.Points, Motion=divide_surface.Normals)  # -> flatten(Geometry), Transform
addition_2 = Addition(A=number_slider_3, B="1")
surface_from_points = SurfaceFromPoints(Points=move.Geometry, UCount=addition_2, Interpolate=False)
deconstruct_brep_2 = DeconstructBrep(Brep=surface_from_points)  # -> Faces, Edges, Vertices
unit_z_2 = UnitZ(Factor=Slider(2, range=0..2))
list_item = ListItem(List=deconstruct_brep_2.Edges, Index=0, Wrap=True)
list_item_2 = ListItem(List=deconstruct_brep.Edges, Index="2", Wrap=True)
list_item_3 = ListItem(List=deconstruct_brep_2.Edges, Index="2", Wrap=True)
boundary_surfaces = BoundarySurfaces(Edges=list_item)
divide_curve = DivideCurve(Curve=list_item_2, Count=10, Kinks=False)  # -> Points, Tangents, Parameters
negative = Negative(Value=unit_z_2)
divide_curve_2 = DivideCurve(Curve=list_item_3, Count=10, Kinks=False)  # -> Points, Tangents, Parameters
line = Line(StartPoint=divide_curve.Points, EndPoint=divide_curve_2.Points)  # -> flatten(Line)
merge = Merge(Data1=list_item_2, Data2=list_item_3)  # -> flatten(Result)
extrude = Extrude(Base=boundary_surfaces, Direction=negative)
network_surface = NetworkSurface(CurvesU=merge, CurvesV=line, Continuity=2)
# rc
# Full multiplicity knots at start
# Simple knots
# Full multiplicity knots at end
# P1
# A=0.2*P1+ 0.8*P2
# D=0.2*A + 0.8*B
# P2
# B=0.47*P2 + 0.53*P3
# Full multiplicity knots at start
# E=0.7*B + 0.3*C
# P3
# Full multiplicity knots in the middle
# C=0.8*P3 + 0.2*P4
# P4
# Full multiplicity knots at end
# Compare knot spacing
merge_2 = Merge(Data1=surface_from_points, Data2=network_surface, Data3=extrude, Data4=surface)
