# Grasshopper definition ProvingGround170cLunchBox.gh (Grasshopper 1.0.7)
# Copyright: Wickerson Studios
# plug-ins: LunchBoxML, Bifocals

# 1001 GRASSHOPPER DEFINITIONS
image_sampler = ImageSampler(
    FilePath="C:\Users\Sculpture\Documents\2020Grasshopper\ScreenShots2019\Screenshots2020\SurfaceEditAlgorithm.PNG",
    Filter="Value",
    Interpolate=False,
    Umax=1,
    Umin=0,
    Vmax=1,
    Vmin=0,
    Wrap=1)  # disabled
number_slider = Slider(37, range=0..100)
# Wickerson Studio
# created by: Michael Wickerson
# Grasshopper for Rhino 3D Algorithmic Modeling
# www.wickersonstudios.com
# www.michaelwickerson.com
# https://www.youtube.com/channel/UC7J48Ppcsa6oncp6d29R0xw
# https://github.com/mwickerson
# https://www.facebook.com/michael.wickerson
# https://www.linkedin.com/in/michael-wickerson-696a80156/
# https://www.grasshopper3d.com/profile/MichaelWickerson
number_slider_2 = Slider(8, range=0..10)
# Wickerson Studio
# 
# created by: Michael Wickerson
# 
# Grasshopper for Rhino 3D Algorithmic Modeling
# 
# www.wickersonstudios.com
# www.michaelwickerson.com
# https://www.youtube.com/channel/UC7J48Ppcsa6oncp6d29R0xw
# https://github.com/mwickerson
# https://www.facebook.com/michael.wickerson
# https://www.linkedin.com/in/michael-wickerson-696a80156/
# https://www.grasshopper3d.com/profile/MichaelWickerson
# Proving Ground 170 LunchBoxML
number_slider_3 = Slider(2.6, range=0..10)
addition = Addition(A=number_slider, B="1")
center_box = CenterBox(Base=PlaneXY(0, 0, 0), X=number_slider_2, Y=number_slider_2, Z=number_slider_2)
populate_3d = Populate3D(Region=center_box, Count=100, Seed=1)
series = Series(Start=0, Step=number_slider_3, Count=number_slider_2)  # -> graft(Series)
deconstruct = Deconstruct(Point=populate_3d)  # -> graft(XComponent), YComponent, ZComponent
unit_z = UnitZ(Factor=1)
nonlinear_regression = NonlinearRegression(
    TestData=series,
    TrainingInputs=deconstruct.XComponent,
    TrainingOutput=deconstruct.YComponent,
    Sigma=Slider(3, range=0..10),
    Complexity=Slider(20, range=0..100),
    RandomSeed=5)  # -> Result, Score, Error
negative = Negative(Value=unit_z)
addition_2 = Addition(A="1", B=nonlinear_regression.Result)
construct_point = ConstructPoint(XCoordinate=flatten(addition_2), YCoordinate=nonlinear_regression.Result, ZCoordinate=flatten(series))
construct_point_2 = ConstructPoint(XCoordinate=0, YCoordinate=0, ZCoordinate=0)
unit_z_2 = UnitZ(Factor=1)
interpolate = Interpolate(Vertices=construct_point, Degree=3, Periodic=False, KnotStyle=1)  # -> Curve, Length, Domain
line_sdl = LineSDL(Start=construct_point_2, Direction=unit_z_2, Length=Slider(2, range=0..10))
revolution = Revolution(Curve=interpolate.Curve, Axis=line_sdl, Domain=Domain(0, 6.283185307))
surface = Surface(reparameterize(revolution))
deconstruct_brep = DeconstructBrep(Brep=surface)  # -> Faces, Edges, Vertices
divide_surface = DivideSurface(Surface=deconstruct_brep.Faces, UCount=number_slider, VCount=number_slider)  # -> Points, Normals, Parameters
move = Move(Geometry=divide_surface.Points, Motion=divide_surface.Normals)  # -> flatten(Geometry), Transform
surface_from_points = SurfaceFromPoints(Points=move.Geometry, UCount=addition, Interpolate=False)
deconstruct_brep_2 = DeconstructBrep(Brep=surface_from_points)  # -> Faces, Edges, Vertices
list_item = ListItem(List=deconstruct_brep.Edges, Index="2", Wrap=True)
list_item_2 = ListItem(List=deconstruct_brep_2.Edges, Index=Slider(0, range=0..100), Wrap=True)
list_item_3 = ListItem(List=deconstruct_brep_2.Edges, Index="2", Wrap=True)
boundary_surfaces = BoundarySurfaces(Edges=list_item_2)
divide_curve = DivideCurve(Curve=list_item, Count=10, Kinks=False)  # -> Points, Tangents, Parameters
divide_curve_2 = DivideCurve(Curve=list_item_3, Count=10, Kinks=False)  # -> Points, Tangents, Parameters
merge = Merge(Data1=list_item, Data2=list_item_3)
line = Line(StartPoint=divide_curve.Points, EndPoint=divide_curve_2.Points)
extrude = Extrude(Base=boundary_surfaces, Direction=negative)
network_surface = NetworkSurface(CurvesU=flatten(merge), CurvesV=flatten(line), Continuity=2)
# rc
# Full multiplicity knots at start
# Simple knots
# Full multiplicity knots at end
# P1
# A=0.2*P1+ 0.8*P2
# D=0.2*A + 0.8*B
# P2
# B=0.47*P2 + 0.53*P3
# Full multiplicity knots at start
# E=0.7*B + 0.3*C
# P3
# Full multiplicity knots in the middle
# C=0.8*P3 + 0.2*P4
# P4
# Full multiplicity knots at end
# Compare knot spacing
merge_2 = Merge(Data1=network_surface, Data2=surface_from_points, Data3=surface, Data4=extrude)
