# Grasshopper definition ProvingGround171LunchBox.gh (Grasshopper 1.0.7)
# Copyright: Wickerson Studios
# plug-ins: LunchBoxML, Bifocals

# 1001 GRASSHOPPER DEFINITIONS
image_sampler = ImageSampler(
    FilePath="C:\Users\Sculpture\Documents\2020Grasshopper\ScreenShots2019\Screenshots2020\SurfaceEditAlgorithm.PNG",
    Filter="Value",
    Interpolate=False,
    Umax=1,
    Umin=0,
    Vmax=1,
    Vmin=0,
    Wrap=1)  # disabled

point = Point(<point referenced from the Rhino model>)
point_2 = Point([<point referenced from the Rhino model> x61])
deconstruct = Deconstruct(Point=point)  # -> XComponent, YComponent, ZComponent
deconstruct_2 = Deconstruct(Point=point_2)  # -> graft(XComponent), YComponent, ZComponent
series = Series(Start=0, Step=1, Count=Slider(69, range=0..100))  # -> graft(Series)
nonlinear_regression = NonlinearRegression(
    TestData=series,
    TrainingInputs=deconstruct_2.XComponent,
    TrainingOutput=deconstruct_2.YComponent,
    Sigma=Slider(10, range=0..10),
    Complexity=100,
    RandomSeed=5)  # -> Result, Score, Error
construct_point = ConstructPoint(XCoordinate=flatten(series), YCoordinate=nonlinear_regression.Result, ZCoordinate=0)
panel = Panel(nonlinear_regression.Result)
# rc
# Full multiplicity knots at start
# Simple knots
# Full multiplicity knots at end
# P1
# A=0.2*P1+ 0.8*P2
# D=0.2*A + 0.8*B
# P2
# B=0.47*P2 + 0.53*P3
# Full multiplicity knots at start
# E=0.7*B + 0.3*C
# P3
# Full multiplicity knots in the middle
# C=0.8*P3 + 0.2*P4
# P4
# Full multiplicity knots at end
# Compare knot spacing
interpolate = Interpolate(Vertices=construct_point, Degree=3, Periodic=False, KnotStyle=1)  # -> Curve, Length, Domain

# ----
# Wickerson Studio
# created by: Michael Wickerson
# Grasshopper for Rhino 3D Algorithmic Modeling
# www.wickersonstudios.com
# www.michaelwickerson.com
# https://www.youtube.com/channel/UC7J48Ppcsa6oncp6d29R0xw
# https://github.com/mwickerson
# https://www.facebook.com/michael.wickerson
# https://www.linkedin.com/in/michael-wickerson-696a80156/
# https://www.grasshopper3d.com/profile/MichaelWickerson
point_3 = Point(<point referenced from the Rhino model>)
point_4 = Point([<point referenced from the Rhino model> x61])
# Wickerson Studio
# 
# created by: Michael Wickerson
# 
# Grasshopper for Rhino 3D Algorithmic Modeling
# 
# www.wickersonstudios.com
# www.michaelwickerson.com
# https://www.youtube.com/channel/UC7J48Ppcsa6oncp6d29R0xw
# https://github.com/mwickerson
# https://www.facebook.com/michael.wickerson
# https://www.linkedin.com/in/michael-wickerson-696a80156/
# https://www.grasshopper3d.com/profile/MichaelWickerson
# Proving Ground 171 LunchBoxML
deconstruct_3 = Deconstruct(Point=point_3)  # -> XComponent, YComponent, ZComponent
deconstruct_4 = Deconstruct(Point=point_4)  # -> graft(XComponent), YComponent, ZComponent
nonlinear_regression_2 = NonlinearRegression(
    TestData=deconstruct_3.XComponent,
    TrainingInputs=deconstruct_4.XComponent,
    TrainingOutput=deconstruct_4.YComponent,
    Sigma=2,
    Complexity=100,
    RandomSeed=5)  # -> Result, Score, Error
construct_point_2 = ConstructPoint(XCoordinate=flatten(deconstruct_3.XComponent), YCoordinate=nonlinear_regression_2.Result, ZCoordinate=0)
panel_2 = Panel(nonlinear_regression_2.Result)
