# Grasshopper definition ProvingGround172LunchBox.gh (Grasshopper 1.0.7)
# Copyright: Wickerson Studios
# plug-ins: LunchBoxML, Bifocals

# 1001 GRASSHOPPER DEFINITIONS
image_sampler = ImageSampler(
    FilePath="C:\Users\Sculpture\Documents\2020Grasshopper\ScreenShots2019\Screenshots2020\SurfaceEditAlgorithm.PNG",
    Filter="Value",
    Interpolate=False,
    Umax=1,
    Umin=0,
    Vmax=1,
    Vmin=0,
    Wrap=1)  # disabled
# Wickerson Studio
# created by: Michael Wickerson
# Grasshopper for Rhino 3D Algorithmic Modeling
# www.wickersonstudios.com
# www.michaelwickerson.com
# https://www.youtube.com/channel/UC7J48Ppcsa6oncp6d29R0xw
# https://github.com/mwickerson
# https://www.facebook.com/michael.wickerson
# https://www.linkedin.com/in/michael-wickerson-696a80156/
# https://www.grasshopper3d.com/profile/MichaelWickerson
number_slider = Slider(37, range=0..50)
# Wickerson Studio
# 
# created by: Michael Wickerson
# 
# Grasshopper for Rhino 3D Algorithmic Modeling
# 
# www.wickersonstudios.com
# www.michaelwickerson.com
# https://www.youtube.com/channel/UC7J48Ppcsa6oncp6d29R0xw
# https://github.com/mwickerson
# https://www.facebook.com/michael.wickerson
# https://www.linkedin.com/in/michael-wickerson-696a80156/
# https://www.grasshopper3d.com/profile/MichaelWickerson
# Proving Ground 172 LunchBoxML
number_slider_2 = Slider(50, range=0..50)
random = Random(Range="0 to 5", Number=number_slider, Seed="10")
random_2 = Random(Range="0 to 30", Number=number_slider, Seed="5")
random_3 = Random(Range="0 to 30", Number=number_slider, Seed="8")
range = Range(Domain="0 to 30", Steps=number_slider_2)
range_2 = Range(Domain="0 to 30", Steps=number_slider_2)
cross_reference = CrossReference(ListA=range, ListB=range_2, CrossMode=1)  # -> ListA, ListB
entwine = Entwine(Branch00=random_2, Branch01=random_3, FlattenInputs=True)
construct_point = ConstructPoint(XCoordinate=random_2, YCoordinate=random_3, ZCoordinate=random)
entwine_2 = Entwine(Branch00=cross_reference.ListA, Branch01=cross_reference.ListB, FlattenInputs=True)
flip_matrix = FlipMatrix(Data=entwine)
flip_matrix_2 = FlipMatrix(Data=entwine_2)
dot_display = DotDisplay(Point=construct_point, Colour=ColourSwatch(SwatchColor=RGB(255, 255, 80)), Size=Slider(0.178, range=0..1))
sigma = Slider(1.761, range=0..50)
nonlinear_regression = NonlinearRegression(TestData=flip_matrix_2, TrainingInputs=flip_matrix, TrainingOutput=random, Degree=sigma, Complexity=100, RandomSeed=5)  # -> Result, Score, Error
construct_point_2 = ConstructPoint(XCoordinate=cross_reference.ListA, YCoordinate=cross_reference.ListB, ZCoordinate=flatten(nonlinear_regression.Result))
addition = Addition(A=number_slider_2, B="1")
# rc
# Full multiplicity knots at start
# Simple knots
# Full multiplicity knots at end
# P1
# A=0.2*P1+ 0.8*P2
# D=0.2*A + 0.8*B
# P2
# B=0.47*P2 + 0.53*P3
# Full multiplicity knots at start
# E=0.7*B + 0.3*C
# P3
# Full multiplicity knots in the middle
# C=0.8*P3 + 0.2*P4
# P4
# Full multiplicity knots at end
# Compare knot spacing
surface_from_points = SurfaceFromPoints(Points=construct_point_2, UCount=addition, Interpolate=False)
