# Grasshopper definition ProvingGround172bLunchBox.gh (Grasshopper 1.0.7)
# Copyright: Wickerson Studios
# plug-ins: LunchBoxML, Bifocals

# 1001 GRASSHOPPER DEFINITIONS
image_sampler = ImageSampler(
    FilePath="C:\Users\Sculpture\Documents\2020Grasshopper\ScreenShots2019\Screenshots2020\SurfaceEditAlgorithm.PNG",
    Filter="Value",
    Interpolate=False,
    Umax=1,
    Umin=0,
    Vmax=1,
    Vmin=0,
    Wrap=1)  # disabled
# Wickerson Studio
# created by: Michael Wickerson
# Grasshopper for Rhino 3D Algorithmic Modeling
# www.wickersonstudios.com
# www.michaelwickerson.com
# https://www.youtube.com/channel/UC7J48Ppcsa6oncp6d29R0xw
# https://github.com/mwickerson
# https://www.facebook.com/michael.wickerson
# https://www.linkedin.com/in/michael-wickerson-696a80156/
# https://www.grasshopper3d.com/profile/MichaelWickerson
number_slider = Slider(10, range=0..10)
panel = Panel("0 to 5")
construct_domain = ConstructDomain(DomainStart=0, DomainEnd=number_slider)
number_slider_2 = Slider(37, range=0..50)
# Proving Ground 172 LunchBoxML
number_slider_3 = Slider(25, range=0..50)
random = Random(Range=construct_domain, Number=number_slider_2, Seed="10")
random_2 = Random(Range="0 to 30", Number=number_slider_2, Seed="5")
random_3 = Random(Range="0 to 30", Number=number_slider_2, Seed="8")
range = Range(Domain="0 to 30", Steps=number_slider_3)
# Wickerson Studio
# 
# created by: Michael Wickerson
# 
# Grasshopper for Rhino 3D Algorithmic Modeling
# 
# www.wickersonstudios.com
# www.michaelwickerson.com
# https://www.youtube.com/channel/UC7J48Ppcsa6oncp6d29R0xw
# https://github.com/mwickerson
# https://www.facebook.com/michael.wickerson
# https://www.linkedin.com/in/michael-wickerson-696a80156/
# https://www.grasshopper3d.com/profile/MichaelWickerson
range_2 = Range(Domain="0 to 30", Steps=number_slider_3)
cross_reference = CrossReference(ListA=range_2, ListB=range, CrossMode=1)  # -> ListA, ListB
entwine = Entwine(Branch00=random_2, Branch01=random_3, FlattenInputs=True)
construct_point = ConstructPoint(XCoordinate=random_2, YCoordinate=random_3, ZCoordinate=random)
entwine_2 = Entwine(Branch00=cross_reference.ListA, Branch01=cross_reference.ListB, FlattenInputs=True)
flip_matrix = FlipMatrix(Data=entwine)
flip_matrix_2 = FlipMatrix(Data=entwine_2)
dot_display = DotDisplay(Point=construct_point, Colour=ColourSwatch(SwatchColor=RGB(255, 255, 80)), Size=Slider(0.178, range=0..1))
sigma = Slider(4.809, range=0..50)
nonlinear_regression = NonlinearRegression(TestData=flip_matrix_2, TrainingInputs=flip_matrix, TrainingOutput=random, Degree=sigma, Complexity=100, RandomSeed=5)  # -> Result, Score, Error
construct_point_2 = ConstructPoint(XCoordinate=cross_reference.ListA, YCoordinate=cross_reference.ListB, ZCoordinate=flatten(nonlinear_regression.Result))
addition = Addition(A=number_slider_3, B="1")
# rc
# P1
# A=0.2*P1+ 0.8*P2
# D=0.2*A + 0.8*B
# P2
# B=0.47*P2 + 0.53*P3
# E=0.7*B + 0.3*C
# P3
# C=0.8*P3 + 0.2*P4
# P4
surface_from_points = SurfaceFromPoints(Points=construct_point_2, UCount=addition, Interpolate=False)
