# Grasshopper definition ProvingGround173LunchBox.gh (Grasshopper 1.0.7)
# Copyright: Wickerson Studios
# plug-ins: LunchBoxML, Bifocals, LunchBox

# 1001 GRASSHOPPER DEFINITIONS
# Wickerson Studio
# 
# created by: Michael Wickerson
# 
# Grasshopper for Rhino 3D Algorithmic Modeling
# 
# www.wickersonstudios.com
# www.michaelwickerson.com
# https://www.youtube.com/channel/UC7J48Ppcsa6oncp6d29R0xw
# https://github.com/mwickerson
# https://www.facebook.com/michael.wickerson
# https://www.linkedin.com/in/michael-wickerson-696a80156/
# https://www.grasshopper3d.com/profile/MichaelWickerson
image_sampler = ImageSampler(
    FilePath="C:\Users\Sculpture\Documents\2020Grasshopper\ScreenShots2019\Screenshots2020\SurfaceEditAlgorithm.PNG",
    Filter="Value",
    Interpolate=False,
    Umax=1,
    Umin=0,
    Vmax=1,
    Vmin=0,
    Wrap=1)  # disabled
surface = Surface(<surface referenced from the Rhino model>)
# Wickerson Studio
# created by: Michael Wickerson
# Grasshopper for Rhino 3D Algorithmic Modeling
# www.wickersonstudios.com
# www.michaelwickerson.com
# https://www.youtube.com/channel/UC7J48Ppcsa6oncp6d29R0xw
# https://github.com/mwickerson
# https://www.facebook.com/michael.wickerson
# https://www.linkedin.com/in/michael-wickerson-696a80156/
# https://www.grasshopper3d.com/profile/MichaelWickerson
surface_2 = Surface(surface)
quad_panels = QuadPanels(Surface=surface_2, UDivisions=Slider(28, range=0..30), VDivisions=Slider(14, range=0..30))
deconstruct_brep = DeconstructBrep(Brep=quad_panels)  # -> Faces, Edges, Vertices
area = Area(Geometry=quad_panels)  # -> Area, Centroid
join_curves = JoinCurves(Curves=deconstruct_brep.Edges, Preserve=False)  # -> flatten(Curves)
# Proving Ground 173 LunchBoxML
param_viewer = ParamViewer(area.Area)
panel = Panel(area.Area)
flatness_check = FlatnessCheck(PanelList=quad_panels)  # -> FlatPanels, Planes, Deviations
length = Length(Curve=join_curves)
entwine = Entwine(Branch00=area.Area, Branch01=length, Branch02=flatness_check.Deviations, FlattenInputs=True)
panel_2 = Panel(length)
panel_3 = Panel(entwine)
flip_matrix = FlipMatrix(Data=entwine)
number_slider = Slider(4, range=0..10)
panel_4 = Panel(flip_matrix)

# ----
# elliptical
gaussian_mixture = GaussianMixture(TrainingInputs=flip_matrix, Components=number_slider, RandomSeed=5)  # -> Result, Likelihood, Probability

# ----
# circular
k_means_clustering = KMeansClustering(TrainingInputs=flip_matrix, OfClusters=number_slider, RandomSeed=5)  # -> Result, Likelihood, Centroids

point = Point([Point(110, 49, 0), Point(112, 50, 0), Point(112, 50, 0), Point(108, 52, 0), Point(108, 53, 0), Point(105, 53, 0)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])
number = Number(gaussian_mixture.Result)
bounds = Bounds(Numbers=number)
deconstruct_domain = DeconstructDomain(Domain=bounds)  # -> Start, End
gradient = Gradient(
    LowerLimit=deconstruct_domain.End,
    UpperLimit=deconstruct_domain.Start,
    Parameter=number,
    stops=[0: RGB(0, 128, 0), 0.5: RGB(255, 255, 0), 1: RGB(255, 0, 0)])
# rc
# P1
# A=0.2*P1+ 0.8*P2
# D=0.2*A + 0.8*B
# P2
# B=0.47*P2 + 0.53*P3
# E=0.7*B + 0.3*C
# P3
# C=0.8*P3 + 0.2*P4
# P4
custom_preview = CustomPreview(Geometry=quad_panels, Material=gradient)
