# Grasshopper definition ProvingGround174LunchBox.gh (Grasshopper 1.0.7)
# Copyright: Wickerson Studios
# plug-ins: Bifocals, LunchBox

# 1001 GRASSHOPPER DEFINITIONS
# Wickerson Studio
# 
# created by: Michael Wickerson
# 
# Grasshopper for Rhino 3D Algorithmic Modeling
# 
# www.wickersonstudios.com
# www.michaelwickerson.com
# https://www.youtube.com/channel/UC7J48Ppcsa6oncp6d29R0xw
# https://github.com/mwickerson
# https://www.facebook.com/michael.wickerson
# https://www.linkedin.com/in/michael-wickerson-696a80156/
# https://www.grasshopper3d.com/profile/MichaelWickerson
image_sampler = ImageSampler(
    FilePath="C:\Users\Sculpture\Documents\2020Grasshopper\ScreenShots2019\Screenshots2020\SurfaceEditAlgorithm.PNG",
    Filter="Value",
    Interpolate=False,
    Umax=1,
    Umin=0,
    Vmax=1,
    Vmin=0,
    Wrap=1)  # disabled

# ----
# Data Drives Geometry 174 LunchBoxML
# Data
# Wickerson Studio
# created by: Michael Wickerson
# Grasshopper for Rhino 3D Algorithmic Modeling
# www.wickersonstudios.com
# www.michaelwickerson.com
# https://www.youtube.com/channel/UC7J48Ppcsa6oncp6d29R0xw
# https://github.com/mwickerson
# https://www.facebook.com/michael.wickerson
# https://www.linkedin.com/in/michael-wickerson-696a80156/
# https://www.grasshopper3d.com/profile/MichaelWickerson
boolean_toggle = BooleanToggle(True)
series = Series(Start="1", Step=1, Count="2")
excel_reader_legacy = ExcelReaderLEGACY(ReadToggle=boolean_toggle, Worksheet="1", Column=series, RowStart="1", RowEnd="7")  # -> Exceptions, ExcelData

# ----
# Number
explode_tree = ExplodeTree(Data=excel_reader_legacy.ExcelData)  # -> Branch0, Branch1
panel = Panel(explode_tree.Branch0)

param_viewer = ParamViewer(explode_tree.Branch1)

# ----
# Points
construct_point = ConstructPoint(XCoordinate=excel_reader_legacy.ExcelData, YCoordinate=explode_tree.Branch1, ZCoordinate=0)
construct_point_2 = ConstructPoint(XCoordinate=excel_reader_legacy.ExcelData, YCoordinate=explode_tree.Branch0, ZCoordinate=0)
number_slider = Slider(3, range=0..10)
circle = Circle(Plane=construct_point, Radius=construct_point_2)
circle_2 = Circle(Plane=construct_point_2, Radius=construct_point)
divide_curve = DivideCurve(Curve=circle_2, Count=number_slider, Kinks=False)  # -> Points, Tangents, Parameters
divide_curve_2 = DivideCurve(Curve=circle, Count=number_slider, Kinks=False)  # -> Points, Tangents, Parameters

# ----
# Curve
boolean_toggle_2 = BooleanToggle(True)
interpolate = Interpolate(Vertices=divide_curve_2.Points, Degree=3, Periodic=boolean_toggle_2, KnotStyle=1)  # -> flatten(Curve), Length, Domain
interpolate_2 = Interpolate(Vertices=divide_curve.Points, Degree=3, Periodic=boolean_toggle_2, KnotStyle=1)  # -> flatten(Curve), Length, Domain
region_union = RegionUnion(Curves=interpolate_2.Curve)
region_union_2 = RegionUnion(Curves=interpolate.Curve)
region_difference = RegionDifference(CurvesA=region_union, CurvesB=region_union_2, Plane=region_union)

# ----
# Surface
boundary_surfaces = BoundarySurfaces(Edges=region_union)

# ----
# Solid
number_slider_2 = Slider(12, range=0..100)
unit_z = UnitZ(Factor=number_slider_2)
# rc
# P1
# A=0.2*P1+ 0.8*P2
# D=0.2*A + 0.8*B
# P2
# B=0.47*P2 + 0.53*P3
# E=0.7*B + 0.3*C
# P3
# C=0.8*P3 + 0.2*P4
# P4
extrude = Extrude(Base=boundary_surfaces, Direction=unit_z)
