# Grasshopper definition ProvingGround175LunchBox.gh (Grasshopper 1.0.7)
# Copyright: Wickerson Studios

# 1001 GRASSHOPPER DEFINITIONS
# Wickerson Studio
# 
# created by: Michael Wickerson
# 
# Grasshopper for Rhino 3D Algorithmic Modeling
# 
# www.wickersonstudios.com
# www.michaelwickerson.com
# https://www.youtube.com/channel/UC7J48Ppcsa6oncp6d29R0xw
# https://github.com/mwickerson
# https://www.facebook.com/michael.wickerson
# https://www.linkedin.com/in/michael-wickerson-696a80156/
# https://www.grasshopper3d.com/profile/MichaelWickerson
image_sampler = ImageSampler(
    FilePath="C:\Users\Sculpture\Documents\2020Grasshopper\ScreenShots2019\Screenshots2020\SurfaceEditAlgorithm.PNG",
    Filter="Value",
    Interpolate=False,
    Umax=1,
    Umin=0,
    Vmax=1,
    Vmin=0,
    Wrap=1)  # disabled
# Python Scripting
# 175 GHPYTHON
number_slider = Slider(3, range=0..10)
# Rhino Common Library
ghpython_script = GhPythonScript()  # -> out, a
# ---------- ghpython_script: Python ----------
import rhinoscriptsyntax as rs

a = rs.AddPoint(1,2,3)
print a
# ---------- end ghpython_script ----------
python = GhPythonScript(x=number_slider)  # -> out, a; inputs x: Int32
# ---------- python: Python ----------
"""This is a simple component.
    Inputs:
        x: The x script variable
        y: The y script variable
    Output:
        a: The a output variable"""

import rhinoscriptsyntax as rs

a = x
print x
# ---------- end python ----------
ghpython_script_2 = GhPythonScript()  # -> out, a
# ---------- ghpython_script_2: Python ----------
import Rhino.Geometry as rg

a = rg.Point3d(1,2,3)
print a
print type(a)
print a.X
# ---------- end ghpython_script_2 ----------
# Rhinoscript Library
ghpython_script_3 = GhPythonScript()  # -> out, a
# ---------- ghpython_script_3: Python ----------
import rhinoscriptsyntax as rs

var = 0

a = var
# ---------- end ghpython_script_3 ----------
ghpython_script_4 = GhPythonScript()  # -> out, a
# ---------- ghpython_script_4: Python ----------
import rhinoscriptsyntax as rs

var = 1
a = var

print var
# ---------- end ghpython_script_4 ----------
ghpython_script_5 = GhPythonScript()  # -> out, var; same code as ghpython_script_3
ghpython_script_6 = GhPythonScript()  # -> out, a
# ---------- ghpython_script_6: Python ----------
import rhinoscriptsyntax as rs

var = 1
a = var

print var

#using Variable
point = rs.AddPoint(var, 0 , 0)
a = point
# ---------- end ghpython_script_6 ----------
ghpython_script_7 = GhPythonScript()  # -> out, a
# ---------- ghpython_script_7: Python ----------
import rhinoscriptsyntax as rs

var = 1
a = var

print var

#using Variable
point = rs.AddPoint(var, 0 , 0)
a = point

#naming errors
#4var = 1
#%var = 1

_var = 1
hello = 1
Hello = 2

print hello
print Hello

#keywords cannot be used, turns up blue in the script i.e. print and import
# ---------- end ghpython_script_7 ----------
panel = Panel(python.out)
panel_2 = Panel(python.a)
panel_3 = Panel(ghpython_script.out)
panel_4 = Panel(ghpython_script.a)
panel_5 = Panel(ghpython_script_2.out)
panel_6 = Panel(ghpython_script_2.a)
panel_7 = Panel(ghpython_script_4.a)
panel_8 = Panel(ghpython_script_3.a)
panel_9 = Panel(ghpython_script_4.out)
panel_10 = Panel(ghpython_script_6.a)
panel_11 = Panel(ghpython_script_5.var)
panel_12 = Panel(ghpython_script_6.out)
panel_13 = Panel(ghpython_script_7.a)
panel_14 = Panel(ghpython_script_7.out)
# Numbers
ghpython_script_8 = GhPythonScript(x=Slider(2, range=0..10), y=Slider(2.33, range=0..10))  # -> out, a, b; inputs x: Int32
# ---------- ghpython_script_8: Python ----------
import rhinoscriptsyntax as rs


b = y

addition = x + y
a = addition
print a
# ---------- end ghpython_script_8 ----------
# Variables
ghpython_script_9 = GhPythonScript(x=Slider(2, range=0..10), y=Slider(2.33, range=0..10))  # -> out, a, b; inputs x: Int32
# ---------- ghpython_script_9: Python ----------
import rhinoscriptsyntax as rs

a = x
b = y
# ---------- end ghpython_script_9 ----------
# Lists and Tuples
ghpython_script_10 = GhPythonScript()  # -> out, a
# ---------- ghpython_script_10: Python ----------
import rhinoscriptsyntax as rs

emptylist = []
print emptylist

list = [0,1,2,3,4,5, "Point"]
print list

print range(10)
print list[0]
print list[-1]

#replace items
list[0] = "A"
print list

#slice
print list[4:6]

copy = list[:]
print copy

#adding items
list.append(99)
print list

#removing item
list.pop()
print list

list.pop(0)
print list

list.insert(3,9)
print list

list.sort()
print list

#tuples are immutable
tup = (2,5,6,7,9)
print tup

#tup[0] = 2

#comparison opperators
#boolean data type
# ---------- end ghpython_script_10 ----------
# Strings
ghpython_script_11 = GhPythonScript()  # -> out, a
# ---------- ghpython_script_11: Python ----------
import rhinoscriptsyntax as rs

word = "Hello"
print word

#adding strings
geo = "Point "
coord = "123"
point = geo + coord
print point

#index

letter = "Helle"[0]
print letter

slice = "Hello"[0:4]
print slice

print point[0]
print point[-1]
print point[5:]
print point[:5]

#string methods
#formatting
loc = "Point is at {}".format(123)
print loc

#casting one object to another
xyz = 545
#print "Point is at" + xyz
#fix by casting
print "Point is at " + str(xyz)
# ---------- end ghpython_script_11 ----------
construct_point = ConstructPoint(XCoordinate=Slider(3, range=0..10), YCoordinate=Slider(3, range=0..10), ZCoordinate=Slider(1.41, range=0..10))
point = Point(panel_4)
panel_15 = Panel(ghpython_script_8.a)
panel_16 = Panel(ghpython_script_9.a)
panel_17 = Panel(ghpython_script_8.b)
panel_18 = Panel(ghpython_script_9.b)
panel_19 = Panel(ghpython_script_10.out)
construct_point_2 = ConstructPoint(XCoordinate=Slider(7, range=0..10), YCoordinate=Slider(6, range=0..10), ZCoordinate=Slider(3.65, range=0..10))
# Making Decisions
construct_point_3 = ConstructPoint(XCoordinate=Slider(9, range=0..10), YCoordinate=Slider(5, range=0..10), ZCoordinate=Slider(0.71, range=0..10))
construct_point_4 = ConstructPoint(XCoordinate=Slider(0, range=0..10), YCoordinate=Slider(0, range=0..10), ZCoordinate=Slider(20, range=0..25))
construct_point_5 = ConstructPoint(XCoordinate=Slider(0, range=0..10), YCoordinate=Slider(0, range=0..10), ZCoordinate=Slider(0, range=0..10))
panel_20 = Panel(ghpython_script_10.a)
center_box = CenterBox(Base=PlaneXY(0, 0, 0), X=Slider(2.01, range=0..10), Y=1, Z=1)
center_box_2 = CenterBox(Base=PlaneXY(0, 0, 0), X=Slider(2.01, range=0..10), Y=1, Z=1)
center_box_3 = CenterBox(Base=PlaneXY(0, 0, 0), X=Slider(2.01, range=0..10), Y=1, Z=1)
panel_21 = Panel(ghpython_script_11.out)
panel_22 = Panel(ghpython_script_11.a)
# Comparing Operators
ghpython_script_12 = GhPythonScript()  # -> out, a
# ---------- ghpython_script_12: Python ----------
import rhinoscriptsyntax as rs

#boolean true or False
T = True
F = False

print T, F

print bool(0)
print bool(5)

#comparison operators
# ---------- end ghpython_script_12 ----------
ghpython_script_13 = GhPythonScript(point=construct_point)  # -> out, a; inputs point: Point3d
# ---------- ghpython_script_13: Python ----------
import rhinoscriptsyntax as rs

print point.X == 3

print point.X != 4

print point.Y > 3
print point.Y < 3

print point.Y >= 3
print point.Y <= 3
# ---------- end ghpython_script_13 ----------
ghpython_script_14 = GhPythonScript(pt1=construct_point_3, pt2=construct_point_2)  # -> out, a; inputs pt1: Point3d, pt2: Point3d
# ---------- ghpython_script_14: Python ----------
import rhinoscriptsyntax as rs

#if, else, elif
T = True

if T:
    print "This is true."
# ---------- end ghpython_script_14 ----------
ghpython_script_15 = GhPythonScript(pt1=construct_point_5, pt2=construct_point_4)  # -> out, a; inputs pt1: Point3d, pt2: Point3d
# ---------- ghpython_script_15: Python ----------
import Rhino.Geometry as rg

#if, else, elif
T = True

if T:
    print "This is true."
    
line = rg.Line(pt1, pt2)
print line.Length

if line.Length == 10:
    print "Line length is 10"

elif line.Length == 20:
    print "Line length is 20"

else:
    print "Line length is not 10"
# ---------- end ghpython_script_15 ----------
area = Area(Geometry=center_box)  # -> Area, Centroid
volume = Volume(Geometry=center_box)  # -> Volume, Centroid
area_2 = Area(Geometry=center_box_2)  # -> Area, Centroid
area_3 = Area(Geometry=center_box_3)  # -> Area, Centroid
volume_2 = Volume(Geometry=center_box_2)  # -> Volume, Centroid
volume_3 = Volume(Geometry=center_box_3)  # -> Volume, Centroid
# Comparing Booleans
ghpython_script_16 = GhPythonScript(box=center_box)  # -> out, a; inputs box: Box
# ---------- ghpython_script_16: Python ----------
import rhinoscriptsyntax as rs

print type(box)

boxArea = box.Area
boxVolume = box.Volume

print boxArea
print boxVolume

#comparing Booleans
#logical AND operator

print boxArea < 50 and boxVolume > 10

# OR operator
# ---------- end ghpython_script_16 ----------
panel_23 = Panel(ghpython_script_13.out)
ghpython_script_17 = GhPythonScript(box=center_box_2)  # -> out, a; inputs box: Box
# ---------- ghpython_script_17: Python ----------
import rhinoscriptsyntax as rs

print type(box)

boxArea = box.Area
boxVolume = box.Volume

print boxArea
print boxVolume

#comparing Booleans
#logical AND operator

print boxArea < 50 and boxVolume > 10

#logical OR Operator

print boxArea > 30 or boxVolume < 2
# ---------- end ghpython_script_17 ----------
ghpython_script_18 = GhPythonScript(box=center_box_3)  # -> out, a; inputs box: Box
# ---------- ghpython_script_18: Python ----------
import rhinoscriptsyntax as rs

print type(box)

boxArea = box.Area
boxVolume = box.Volume

print boxArea
print boxVolume

#comparing Booleans
#logical AND operator

print boxArea < 50 and boxVolume > 10

#logical OR Operator

print boxArea > 30 or boxVolume < 2

print boxArea == 30
print boxArea != 30
# ---------- end ghpython_script_18 ----------
panel_24 = Panel(ghpython_script_12.a)
panel_25 = Panel(ghpython_script_12.out)
panel_26 = Panel(ghpython_script_13.a)
panel_27 = Panel(ghpython_script_14.a)
panel_28 = Panel(ghpython_script_14.out)
panel_29 = Panel(ghpython_script_15.a)
panel_30 = Panel(ghpython_script_15.out)
panel_31 = Panel(volume.Volume)
panel_32 = Panel(area.Area)
panel_33 = Panel(volume_2.Volume)
panel_34 = Panel(area_2.Area)
panel_35 = Panel(volume_3.Volume)
panel_36 = Panel(area_3.Area)
# While Loop
number_slider_2 = Slider(24, range=20..100)
# for Loop
range = Range(Domain=Slider(10, range=0..10), Steps=10)
range_2 = Range(Domain=Slider(10, range=0..10), Steps=10)
ghpython_script_19 = GhPythonScript(numbers=range)  # -> out, a; inputs numbers: list of Int32
# ---------- ghpython_script_19: Python ----------
import Rhino.Geometry as rg
import math

print numbers

lst = []

#for loop
for var in numbers:
    lst.append(var)

print lst

points = []

for x in numbers:
    point = rg.Point3d(x, math.sin(x), math.cos(x))
    points.append(point)

a = points

print points
# ---------- end ghpython_script_19 ----------
ghpython_script_20 = GhPythonScript(height=number_slider_2)  # -> out, a; inputs height: Int32
# ---------- ghpython_script_20: Python ----------
import rhinoscriptsyntax as rs
import Rhino.Geometry as rg

#while loop
var = 0
lst = []

while var < 5:
    lst.append(var)
    var += 1

print lst

cylinders = []
var = 1

while var < height:
    point = rg.Point3d(var, 0 , 0)
    circle = rg.Circle(point, 0.4)
    cylinder = rg.Cylinder(circle, var)
    cylinders.append(cylinder)
    var += 1

a = cylinders
# ---------- end ghpython_script_20 ----------
ghpython_script_21 = GhPythonScript(numbers=range_2)  # -> out, a; inputs numbers: list of Int32
# ---------- ghpython_script_21: Python ----------
import Rhino.Geometry as rg
import math

print numbers

lst = []

#for loop
for var in numbers:
    lst.append(var)

print lst

points = []

for x in numbers:
    point = rg.Point3d(x, math.sin(x), math.cos(x))
    points.append(point)

a = points

print points

spheres = []

for x in numbers:
    if x > 4:
        point = rg.Point3d(x,math.sin(x), math.cos(x))
        sphere = rg.Sphere(point, 0.3)
        spheres.append(sphere)

a = spheres
# ---------- end ghpython_script_21 ----------
panel_37 = Panel(ghpython_script_19.out)
panel_38 = Panel(ghpython_script_19.a)
# rc
panel_39 = Panel(ghpython_script_21.out)
# P1
# A=0.2*P1+ 0.8*P2
# D=0.2*A + 0.8*B
# P2
# B=0.47*P2 + 0.53*P3
# E=0.7*B + 0.3*C
# P3
# C=0.8*P3 + 0.2*P4
# P4
panel_40 = Panel(ghpython_script_21.a)
