# Grasshopper definition PythonScripting197.gh (Grasshopper 1.0.7)
# Copyright: Wickerson Studios
# plug-ins: Bifocals

# 1001 GRASSHOPPER DEFINITIONS
# Wickerson Studio
# 
# created by: Michael Wickerson
# 
# Grasshopper for Rhino 3D Algorithmic Modeling
# 
# www.wickersonstudios.com
# www.michaelwickerson.com
# https://www.youtube.com/channel/UC7J48Ppcsa6oncp6d29R0xw
# https://github.com/mwickerson
# https://www.facebook.com/michael.wickerson
# https://www.linkedin.com/in/michael-wickerson-696a80156/
# https://www.grasshopper3d.com/profile/MichaelWickerson
image_sampler = ImageSampler(
    FilePath="C:\Users\Sculpture\Documents\2020Grasshopper\ScreenShots2019\Screenshots2020\SurfaceEditAlgorithm.PNG",
    Filter="Value",
    Interpolate=False,
    Umax=1,
    Umin=0,
    Vmax=1,
    Vmin=0,
    Wrap=1)  # disabled
# Python Scripting
# 196/1001
# GhPython002
# import ghpythonlib.components as gh
point = Point([Point(-8, -64, 12), Point(13, -49, -9), Point(37, -93, 0), Point(-42, -76, 20), Point(-25, -124, 15), Point(-28, -71, -14)])
ghpython_script = GhPythonScript(p=point)  # -> out, a; inputs p: list of Point3d
# ---------- ghpython_script: Python ----------
import ghpythonlib.components as gh

d = gh.Circle(p,10)

c = gh.DivideCurve(d,10)

b = c[0]

a = []
for i in b:
    a.append(gh.Circle(i,3))
# ---------- end ghpython_script ----------
# Comparing Booleans
curve = Curve(ghpython_script.a)

number_slider = Slider(20, range=0..30)  # disabled
number_slider_2 = Slider(14, range=0..100)  # disabled
pt = Point([Point(-5.51572, -13.467957, 30), Point(-10.846802, -14.906151, 30), Point(-14.746186, -17.44017, 30), Point(-17.305903, -20.802022, 30), Point(-18.617983, -24.723716, 30), Point(-18.774458, -28.93726, 30)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])  # disabled
pt_2 = Point([Point(-5.51572, -13.467957, 30), Point(-10.846802, -14.906151, 30), Point(-14.746186, -17.44017, 30), Point(-17.305903, -20.802022, 30), Point(-18.617983, -24.723716, 30), Point(-18.774458, -28.93726, 30)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])  # disabled
python = GhPythonScript(points=pt, breakP=number_slider)  # -> out, tree; inputs points: list of Point3d, breakP: Int32; disabled
# ---------- python: Python ----------
"""This is a simple component.
    Inputs:
        x: The x script variable
        y: The y script variable
    Output:
        a: The a output variable"""

from Grasshopper import DataTree
from Grasshopper.Kernel.Data import GH_Path
from Rhino.Geometry import Point3d

import sys
print sys.path

#Data Trees
def treeBranch(points, breakP):
    tree = DataTree[Point3d]()
    
    pathCount = 0
    newPath = GH_Path(pathCount)
    
    for num in range(len(points)):
        if num % breakP == 0 and num != 0:
            pathCount += 1
            newPath = GH_Path(pathCount)
        tree.Add(points[num], newPath)
    return tree

tree = treeBranch(points, breakP)
# ---------- end python ----------
ghpython_script_2 = GhPythonScript(x=pt_2, y=number_slider_2)  # -> out, a; inputs x: list of Point3d, y: Int32; disabled
# ---------- ghpython_script_2: Python ----------
import TreeFunctions as tf
reload(tf)

a = tf.treeBranch(x,y)
# ---------- end ghpython_script_2 ----------
interpolate = Interpolate(Vertices=python.tree, Degree=3, Periodic=False, KnotStyle=1)  # -> flatten(Curve), Length, Domain; disabled
loft = Loft(
    Curves=interpolate.Curve,
    Options={Adjust=False, Closed=False, LoftEnds=0, LoftSimp=0, LoftType=0, Rebuild=10, Refit=0.01})  # disabled
number_slider_3 = Slider(10, range=0..10)  # disabled
number_slider_4 = Slider(12, range=0..100)  # disabled
surface = Surface(loft)  # disabled
ghpython_script_3 = GhPythonScript(surface=surface, uDiv=number_slider_3, vDiv=number_slider_4)  # -> out, surfaces; inputs surface: Surface, uDiv: Int32, vDiv: Int32; disabled
# ---------- ghpython_script_3: Python ----------
import Rhino.Geometry as rg

curves = []



domain = rg.Interval(0,1)
surface.SetDomain(0, domain)
surface.SetDomain(1, domain)

#print surface.Domain(0)

#Isocurve Extraction
for u in range(uDiv):
    if u == 0 or u/uDiv == 1:
        continue
    else:
        uCurve = surface.IsoCurve(1, u/uDiv)
        curves.append(uCurve)

for v in range(vDiv):
    if v == 0 or v/vDiv == 1:
        continue
    else:
        vCurve = surface.IsoCurve(0, v/uDiv)
        curves.append(vCurve)

#Get BrepFace
surfBrep = surface.ToBrep()
brepFace = surfBrep.Faces[0]
#print brepFace
splits = brepFace.Split(curves, 0.001)
#print splits
faces = splits.Faces

#THIS IS SPECIAL AND ADDED LATER/BE SURE TO COMMENT OUT
faces.ShrinkFaces()

#split surfaces
surfaces = []

for i in range(faces.Count):
    surfaces.append(faces.ExtractFace(i))
# ---------- end ghpython_script_3 ----------
number_slider_5 = Slider(15, range=-15..15)  # disabled
number_slider_6 = Slider(0.065, range=0..1)  # disabled
number_slider_7 = Slider(0.519, range=0..1)  # disabled
ghpython_script_4 = GhPythonScript(panels=ghpython_script_3.surfaces)  # -> out, sortedP; inputs panels: list of Surface; disabled
# ---------- ghpython_script_4: Python ----------
import Rhino.Geometry as rg

domain = rg.Interval(0, 1)

#sort panels
def sortFunc(panel):
    panel.SetDomain(0, domain)
    panel.SetDomain(1, domain)
    point = panel.PointAt(0.5, 0.5)
    
    val = (point.Z * 10000) + (point.Y * 100) + point.X
    return val
    
sortedP = sorted(panels, key = sortFunc, reverse = True)

#sorted(panels, key =
# ---------- end ghpython_script_4 ----------
point_2 = Point(Point(-24.97950968, -30, 13))  # disabled
ghpython_script_5 = GhPythonScript(panels=ghpython_script_4.sortedP, attractor=point_2, min=number_slider_6, max=number_slider_7, viewAngle=number_slider_5)  # -> out, frames, frameCtrs; inputs panels: list of Surface, attractor: Point3d, viewAngle: Int32; disabled
# ---------- ghpython_script_5: Python ----------
import Rhino.Geometry as rg
from math import radians
distances = []
frames = []
frameCtrs = []

#Distances
for panel in panels:
    point = panel.PointAt(0.5, 0.5)
    dist = point.DistanceTo(attractor)
    distances.append(dist)
    
distances.sort()
dmin = distances[0]
dmax = distances[-1]
range = dmax - dmin

#Transform
for panel in panels:
    panelC = panel.Duplicate()
    #point = panel.PointAt(0.5, 0.5)
    centerF = panelC.FrameAt(0.5, 0.5)[1]
    dist = centerF.Origin.DistanceTo(attractor)
    scaledist = (dist - dmin)/range * (max - min) + min
    #Scale
    trans = rg.Transform.Scale(centerF.Origin, scaledist)
    #rg.Surface.Transform(
    panelC.Transform(trans)
    
    #Move
    moveDir = centerF.ZAxis
    moveVect = rg.Vector3d.Multiply(scaledist * 3, moveDir)
    moveTrans = rg.Transform.Translation(moveVect)
    panelC.Transform(moveTrans)
    
    #rotate
    #rg.Transform.Rotation(
    rotateTrans = rg.Transform.Rotation(radians(viewAngle), centerF.Origin)
    panelC.Transform(rotateTrans)
    
    centerF = panelC.FrameAt(0.5, 0.5)[1]
    
    #lofting
    panelA = panel.ToBrep()
    panelAedges = panelA.DuplicateEdgeCurves()
    #print panelAedges
    panelAcurve = rg.Curve.JoinCurves(panelAedges)
    #print panelAcurve
    
    panelB = panelC.ToBrep()
    panelBedges = panelB.DuplicateEdgeCurves()
    print panelBedges
    panelBcurve = rg.Curve.JoinCurves(panelBedges)
    #print panelBcurve
    
    edgeCurves = []
    edgeCurves.append(panelAcurve[0])
    edgeCurves.append(panelBcurve[0])
    
    panelBrep = rg.Brep.CreateFromLoft(edgeCurves, rg.Point3d.Unset, rg.Point3d.Unset, rg.LoftType.Normal, False)
    
    
    
    frames.append(panelBrep[0])
    frameCtrs.append(centerF)
    
    #rg.Surface.Duplicate(
# ---------- end ghpython_script_5 ----------
colour_swatch = ColourSwatch(SwatchColor=RGB(21, 241, 162))  # disabled
colour_swatch_2 = ColourSwatch(SwatchColor=RGB(237, 89, 255))  # disabled
boolean_toggle = BooleanToggle(True)  # disabled
geometry = Geometry([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])  # disabled
ghpython_script_6 = GhPythonScript(
    bake=boolean_toggle,
    frames=ghpython_script_5.frames,
    frameCtrs=ghpython_script_5.frameCtrs,
    context=geometry,
    col1=colour_swatch,
    col2=colour_swatch_2,
    viewAngle=number_slider_5)  # -> out, intPoints, hitPercent, layers; inputs bake: Boolean, frames: list of Brep, frameCtrs: list of Plane, context: list of Brep, col1: Color, col2: Color, viewAngle: Int32; disabled
# ---------- ghpython_script_6: Python ----------
import Rhino.Geometry as rg
import Rhino.DocObjects as rd
import scriptcontext as sc
import Rhino as r

intPoints = []

#Rhino Doc
sc.doc = r.RhinoDoc.ActiveDoc

#Layer Names
layercol1 = "Panel Green"
layercol2 = "panel Orange"
layers = [layercol1, layercol2]

for framePlane, frame in zip(frameCtrs, frames):
    #rayzip
    ray = rg.Ray3d(framePlane.Origin, framePlane.ZAxis)
    
    #shoot Ray
    intP = rg.Intersect.Intersection.RayShoot(ray, context, 1)
    print intP
    
    if intP == None:
        intPoints.append(None)
    else:
        intPoints.append(intP[0])
        
    #Baking
    if bake:
        objA = rd.ObjectAttributes()
        objA.ColorSource = rd.ObjectColorSource.ColorFromObject
        
        if intP == None:
            objA.ObjectColor = col1
            
            layeri = sc.doc.Layers.Find(layercol1, True)
            if layeri < 0:
                layer = rd.Layer()
                layer.Name = layercol1
                layeri = sc.doc.Layers.Add(layer)
            objA.LayerIndex = layeri
            sc.doc.Objects.AddBrep(frame, objA)
        else:
            objA.ObjectColor = col2
            
            layeri = sc.doc.Layers.Find(layercol2, True)
            if layeri < 0:
                layer = rd.Layer()
                layer.Name = layercol2
                layeri = sc.doc.Layers.Add(layer)
            objA.LayerIndex = layeri
            sc.doc.Objects.AddBrep(frame, objA)

#Hit Percentage
noHits = intPoints.count(None)
hits = len(frameCtrs) - noHits
hitP = hits/len(frameCtrs) * 100

hitPercent = "Hit Ratio: {}%".format(hitP)

angleT = "View Angle: {}".format(viewAngle)

if bake:
    #Create Text
    hitTxt = r.Display.Text3d(hitPercent, rg.Plane.WorldYZ, 5)
    plane = rg.Plane(rg.Point3d(0,0,7), rg.Plane.WorldXY.XAxis)
    angleTxt = r.Display.Text3d(angleT, plane, 5)
    
    #Object Attributes
    objA = rd.ObjectAttributes()
    layeri = sc.doc.Layers.Find(layercol2, True)
    objA.LayerIndex = layeri
    
    #Bake Text
    sc.doc.Objects.AddText(hitTxt, objA)
    sc.doc.Objects.AddText(angleTxt, objA)
    

sc.doc = ghdoc
# ---------- end ghpython_script_6 ----------
boolean_toggle_2 = BooleanToggle(True)  # disabled
# rc
# P1
# A=0.2*P1+ 0.8*P2
# D=0.2*A + 0.8*B
# P2
# B=0.47*P2 + 0.53*P3
# E=0.7*B + 0.3*C
# P3
# C=0.8*P3 + 0.2*P4
# P4
ghpython_script_7 = GhPythonScript(go=boolean_toggle_2, count=number_slider_5, layers=ghpython_script_6.layers)  # -> out, a; inputs go: Boolean, count: Int32, layers: list; disabled
# ---------- ghpython_script_7: Python ----------
import rhinoscriptsyntax as rs
import scriptcontext as sc
import Rhino as r

#Save Path
savePath = r"C:\Users\Sculpture\Desktop\Animation\\" + str(count) + ".png"


#Rendering
if go:
    rs.Command("_Render")
    rs.Command("_-SaveRenderWindowAs" + " " + savePath)
    rs.Command("_-CloseREnderWindow")
    
    sc.doc = r.RhinoDoc.ActiveDoc
    for layer in layers:
        geo = rs.ObjectsByLayer(layer)
        rs.DeleteObjects(geo)
    sc.doc = ghdoc
# ---------- end ghpython_script_7 ----------
