# Grasshopper definition Sets122.gh (Grasshopper 1.0.7)
# Copyright: Wickerson Studios
# plug-ins: Bifocals

# 1001 GRASSHOPPER DEFINITIONS
# Wickerson Studio
# 
# created by: Michael Wickerson
# 
# Grasshopper for Rhino 3D Algorithmic Modeling
# 
# www.wickersonstudios.com
# www.michaelwickerson.com
# https://www.youtube.com/channel/UC7J48Ppcsa6oncp6d29R0xw
# https://github.com/mwickerson
# https://www.facebook.com/michael.wickerson
# https://www.linkedin.com/in/michael-wickerson-696a80156/
# https://www.grasshopper3d.com/profile/MichaelWickerson
image_sampler = ImageSampler(
    FilePath="C:\Users\Sculpture\Documents\2020Grasshopper\ScreenShots2019\Screenshots2020\SurfaceEditAlgorithm.PNG",
    Filter="Value",
    Interpolate=False,
    Umax=1,
    Umin=0,
    Vmax=1,
    Vmin=0,
    Wrap=1)

split_tree = SplitTree()  # -> Positive, Negative
relative_item = RelativeItem(WrapPaths=False, WrapItems=False)  # -> ItemA, ItemB
relative_items = RelativeItems(WrapPaths=False, WrapItems=False)  # -> ItemA, ItemB
# Wickerson Studio
# created by: Michael Wickerson
# Grasshopper for Rhino 3D Algorithmic Modeling
# www.wickersonstudios.com
# www.michaelwickerson.com
# https://www.youtube.com/channel/UC7J48Ppcsa6oncp6d29R0xw
# https://github.com/mwickerson
# https://www.facebook.com/michael.wickerson
# https://www.linkedin.com/in/michael-wickerson-696a80156/
# https://www.grasshopper3d.com/profile/MichaelWickerson
path_mapper = PathMapper()

# ----
# and and and but not negative notation yet
number_slider = Slider(54, range=0..100)
circle = Circle(Plane=PlaneXY(0, 0, 0), Radius=number_slider)
boundary_surfaces = BoundarySurfaces(Edges=circle)
panel = Panel("{(0,2,3,...) and !2}")
panel_2 = Panel("{(0,2,...)}[0,2,...]")
panel_3 = Panel("{(0,2,3,...) or 1}")
panel_4 = Panel("{(0,2,3,...)}")
divide_surface = DivideSurface(Surface=boundary_surfaces, UCount=10, VCount=10)  # -> simplify(Points), Normals, Parameters
split_tree_2 = SplitTree(Data=divide_surface.Points, Masks=flatten("{(0,2,3,...,5)}"))  # -> Positive, Negative
point_list = PointList(Points=divide_surface.Points, Size=4)
point = Point(split_tree_2.Positive)
# Full multiplicity knots at start
# Simple knots
# Full multiplicity knots at end
# P1
# A=0.2*P1+ 0.8*P2
# D=0.2*A + 0.8*B
# P2
# B=0.47*P2 + 0.53*P3
# Full multiplicity knots at start
# E=0.7*B + 0.3*C
panel_5 = Panel(divide_surface.Points)
# P3
# Full multiplicity knots in the middle
# C=0.8*P3 + 0.2*P4
# P4
# Full multiplicity knots at end
param_viewer = ParamViewer(divide_surface.Points)

panel_6 = Panel("{0;0;3}[3]")
panel_7 = Panel("{0;0;4}[3]")
divide_surface_2 = DivideSurface(Surface=boundary_surfaces, UCount=10, VCount=10)  # -> Points, Normals, Parameters
panel_8 = Panel("{*;4}[3]")
panel_9 = Panel("{*;4;*}[3]")
panel_10 = Panel("{*;0;*}[3]")
divide_surface_3 = DivideSurface(Surface=boundary_surfaces, UCount=10, VCount=10)  # -> simplify(Points), Normals, Parameters
param_viewer_2 = ParamViewer(divide_surface_2.Points)
path_mapper_2 = PathMapper(divide_surface_2.Points, source="{A;B;C}", target="{A;B;C}")
path_mapper_3 = PathMapper(divide_surface_2.Points, source="{A;B;C}(i)", target="{A;B;C}(i)")
split_tree_3 = SplitTree(Data=divide_surface_2.Points, Masks=flatten("{*;*;1}[3]"))  # -> Positive, Negative
point_2 = Point(split_tree_3.Positive)

square = Square(
    Plane=[Plane(origin=(-2.882122761, 0.4642550159, 0), x=(0.9234866683, 0.383630517, 0), y=(-0.3245992871, 0.7813849549, 0.5329848545)), Plane(origin=(61.24302054, 53.66382364, 0), x=(0.8740999723, 0.4857460637, 0), y=(-0.438278139, 0.7886814485, 0.4311540858))],
    Size=[12, 8],
    ExtentX=[5, 8],
    ExtentY=[6, 10])  # -> Cells, simplify(Points); disabled
flip_matrix = FlipMatrix(Data=square.Points)  # disabled
reverse_list = ReverseList(List=square.Points)  # disabled
path_mapper_4 = PathMapper(square.Points, source="{A;B}(i)", target="{A;B}(i)")  # disabled
path_mapper_5 = PathMapper(square.Points, source="{A;B}", target="{A;B}")  # disabled
path_mapper_6 = PathMapper(square.Points, source="{A;B}", target="{0}")  # disabled
path_mapper_7 = PathMapper(square.Points, source="{A;B}", target="{A}")  # disabled
path_mapper_8 = PathMapper(square.Points, source="{A;B}(i)", target="{A;B}(0)")  # disabled
path_mapper_9 = PathMapper(square.Points, source="{A;B}(i)", target="{A;B}(i*2)")  # disabled
path_mapper_10 = PathMapper(square.Points, source="{A;B}(i)", target="{A;i}(B)")  # disabled
path_mapper_11 = PathMapper(square.Points, source="{A;B}", target="{0}")  # disabled
path_mapper_12 = PathMapper(square.Points, source="{A;B}(i)", target="{A;B;i}")  # disabled
path_mapper_13 = PathMapper(square.Points, source="{A;B}", target="{A}")  # disabled
path_mapper_14 = PathMapper(square.Points, source="{A;B}", target="{path_index}")  # disabled
path_mapper_15 = PathMapper(square.Points, source="{A;B}", target="{7+path_index}")  # disabled
path_mapper_16 = PathMapper(square.Points, source="{A;B}", target="{path_index^2}")  # disabled
path_mapper_17 = PathMapper(square.Points, source="{A;B}(i)", target="{A;B}(item_count - 1 - i)")  # disabled
param_viewer_3 = ParamViewer(path_mapper_6)  # disabled
param_viewer_4 = ParamViewer(path_mapper_10)  # disabled
param_viewer_5 = ParamViewer(path_mapper_7)  # disabled
param_viewer_6 = ParamViewer(path_mapper_9)  # disabled
param_viewer_7 = ParamViewer(path_mapper_15)  # disabled
point_list_2 = PointList(Points=path_mapper_9, Size=4)
param_viewer_8 = ParamViewer(path_mapper_8)  # disabled
param_viewer_9 = ParamViewer(path_mapper_16)  # disabled
panel_11 = Panel(path_mapper_9)  # disabled

square_2 = Square(
    Plane=Plane(origin=(10.31985163, 16.61598031, 0), x=(0.9989207629, 0.04644684545, 0), y=(-0.04173933786, 0.897677567, 0.4386716464)),
    Size=12,
    ExtentX=5,
    ExtentY=6)  # -> Cells, Points; disabled
panel_12 = Panel("{0;0;+1}[0]")  # disabled
panel_13 = Panel("{0;0;+1}[+1]")  # disabled
panel_14 = Panel("""{0;0;+1}[+1]
{0;0;+1}[-1]
{0;0;+1}[0]
{0;0;+1}[+1]""")  # disabled
panel_15 = Panel("""{0;0;+1}[+1]
{0;0;+1}[-1]""")  # disabled
boolean_toggle = BooleanToggle(False)  # disabled
point_3 = Point(square_2.Points)  # disabled
path_mapper_18 = PathMapper(point_3, source="{A;B;C}", target="{A;B;C}")  # disabled
param_viewer_10 = ParamViewer(square_2.Points)  # disabled
relative_item_2 = RelativeItem(Tree=point_3, Offset=panel_14, WrapPaths=boolean_toggle, WrapItems=boolean_toggle)  # -> ItemA, ItemB; disabled
line = Line(StartPoint=relative_item_2.ItemA, EndPoint=relative_item_2.ItemB)  # disabled
number_slider_2 = Slider(0.469, range=0..1)  # disabled
point_list_3 = PointList(Points=relative_item_2.ItemA, Size=4)  # disabled
pipe = Pipe(Curve=line, Radius=number_slider_2, Caps=0)  # disabled

# ----
# Sets 122/1001 DATA TREES NODE: PathMapper/relative Items/Split Tree/Masks
# https://www.youtube.com/watch?v=q_MFx9-WO90&list=PL8q47GMo0JM-IdgOBe_AxkOb-B4P1u6Cc&index=4
# https://www.grasshopper3d.com/forum/topics/datatree-selection-rules?fbclid=IwAR031wK8MPYRdS-irDEKFU0agbaiamM7gD25BCOR_0qG7oqg6rjmlDYywO8
number_slider_3 = Slider(4, range=0..10)

square_3 = Square(
    Plane=[Plane(origin=(-2.882122761, 0.4642550159, 0), x=(0.9234866683, 0.383630517, 0), y=(-0.3245992871, 0.7813849549, 0.5329848545)), Plane(origin=(61.24302054, 53.66382364, 0), x=(0.8740999723, 0.4857460637, 0), y=(-0.438278139, 0.7886814485, 0.4311540858))],
    Size=[12, 8],
    ExtentX=[5, 8],
    ExtentY=[6, 10])  # -> Cells, simplify(Points); disabled
graft_tree = GraftTree(Tree=square_3.Points, IncludeEmptyLists=True, IncludeNullItems=True)  # disabled
flatten_tree = FlattenTree(Tree=square_3.Points, Path="{0}")  # disabled
point_list_4 = PointList(Points=graft_tree, Size=number_slider_3)  # disabled
param_viewer_11 = ParamViewer(graft_tree)  # disabled

gene_pool = GenePool(Decimals=0, Maximum=10, Minimum=0, Value=[1, 5, 9])
construct_path = ConstructPath(Indices=gene_pool)
# must change [ ] to ( ) in old files ****
path_mapper_19 = PathMapper(divide_surface_2.Points, source="{A;B;C}", target="{item_count}")
path_mapper_20 = PathMapper(divide_surface_2.Points, source="{A;B;C}", target="{path_count}")
path_mapper_21 = PathMapper(divide_surface_2.Points, source="{A;B;C}", target="{path_index}")
panel_16 = Panel(construct_path)
deconstruct_path = DeconstructPath(Branch=construct_path)
panel_17 = Panel(deconstruct_path)

number_slider_4 = Slider(0.25, range=0..1)
number_slider_5 = Slider(0.488, range=0..1)
number_slider_6 = Slider(0.78, range=0..1)

np = Slider(0.525, range=0..1)
expression = Expression(Expression="Format(\"{0}, {1}\", x, y)")
path_mapper_22 = PathMapper(source="{A}", target="{A + NP}")

integer = Integer(gene_pool)
concatenate = Concatenate()
text_join = TextJoin(Text=integer, Join=";")
panel_18 = Panel(text_join)
format = Format(Culture=127)

dispatch = Dispatch(DispatchPattern=[True, False])  # -> ListA, ListB
weave = Weave(Pattern=[0, 1], NullGaps=False)
pick_n_choose = PickNChoose(Pattern=[0, 1])
sift_pattern = SiftPattern(SiftPattern=[0, 0, 1, 1])  # -> Output0, Output1

entwine = Entwine(Branch00=number_slider_4, Branch01=number_slider_5, Branch02=number_slider_6, FlattenInputs=True)
merge = Merge(Data1=number_slider_4, Data2=number_slider_5, Data3=number_slider_6)

# ----
# Steve Baer
ghpython_script = GhPythonScript()  # -> Out, A

panel_19 = Panel("{?;(0,2,N,6,8)}")
N = Slider(0.25, range=0..1)

param_viewer_12 = ParamViewer(path_mapper_5)  # disabled
point_list_5 = PointList(Points=path_mapper_14, Size=number_slider_3)  # disabled
# GH solution
# VB
# C#
# Python with RhinoCommon Only
# Pythong with RhinoScriptSyntax
# GH solution
# VB
# C#
# Python
# VB
jitter = Jitter(Jitter=1, Seed=2)  # -> Values, Indices
panel_20 = Panel(merge)
panel_21 = Panel(entwine)

point_4 = Point(Point(-6.717399916, -8.803248453, 0))
mesh = Mesh(<mesh referenced from the Rhino model>)
# Compare knot spacing
orient = Orient(Geometry=mesh, Source=point_4, Target=point_2)  # -> Geometry, Transform

# ----
# rs
# rc
clean_tree = CleanTree(RemoveNulls=True, RemoveInvalid=True, RemoveEmpty=False)  # disabled

# ----
# Three grids don't work
# without ? mark
panel_22 = Panel("{0;0}")
panel_23 = Panel("""{0;0}
{0;2}
{0;4}
{1;0}
{1;2}
{1;4}""")
panel_24 = Panel("""{0,1;0}
{0,1;2}
{0,1;4}""")
panel_25 = Panel("""{(0,1);0}
{(0,1);2}
{(0,1);4}""")
panel_26 = Panel("""{?;0}
{?;2}
{?;4}""")
panel_27 = Panel("{?;(0,2,...)}")
panel_28 = Panel("{?;(0,2,4,6,8)}")
square_4 = Square(
    Plane=[Plane(origin=(-2.882122761, 0.4642550159, 0), x=(0.9234866683, 0.383630517, 0), y=(-0.3245992871, 0.7813849549, 0.5329848545)), Plane(origin=(61.24302054, 53.66382364, 0), x=(0.8740999723, 0.4857460637, 0), y=(-0.438278139, 0.7886814485, 0.4311540858))],
    Size=[12, 8],
    ExtentX=[5, 8],
    ExtentY=[6, 10])  # -> Cells, simplify(Points)
panel_29 = Panel("{?;(2 to 4)}")
panel_30 = Panel("{?;(>3)}")
panel_31 = Panel("{?;(1 to 8) and !5}")
panel_32 = Panel("{?;!(0,2,4,6,8)}")
panel_33 = Panel("{?;(<=3)}")
param_viewer_13 = ParamViewer(square_4.Points)

split_tree_4 = SplitTree(Data=square_4.Points, Masks=flatten("{?;(0,2,...)}[0,2,...]"))  # -> Positive, Negative

point_list_6 = PointList(Points=split_tree_4.Positive, Size=4)
