# Grasshopper definition Sets123PathMapperModelab.gh (Grasshopper 1.0.7)
# Copyright: Wickerson Studios
# plug-ins: Bifocals

# 1001 GRASSHOPPER DEFINITIONS
# Wickerson Studio
# 
# created by: Michael Wickerson
# 
# Grasshopper for Rhino 3D Algorithmic Modeling
# 
# www.wickersonstudios.com
# www.michaelwickerson.com
# https://www.youtube.com/channel/UC7J48Ppcsa6oncp6d29R0xw
# https://github.com/mwickerson
# https://www.facebook.com/michael.wickerson
# https://www.linkedin.com/in/michael-wickerson-696a80156/
# https://www.grasshopper3d.com/profile/MichaelWickerson
image_sampler = ImageSampler(
    FilePath="C:\Users\Sculpture\Documents\2020Grasshopper\ScreenShots2019\Screenshots2020\SurfaceEditAlgorithm.PNG",
    Filter="Value",
    Interpolate=False,
    Umax=1,
    Umin=0,
    Vmax=1,
    Vmin=0,
    Wrap=1)

split_tree = SplitTree()  # -> Positive, Negative
path_mapper = PathMapper()
relative_item = RelativeItem(WrapPaths=False, WrapItems=False)  # -> ItemA, ItemB
relative_items = RelativeItems(WrapPaths=False, WrapItems=False)  # -> ItemA, ItemB

# ----
# Wickerson Studio
# created by: Michael Wickerson
# Grasshopper for Rhino 3D Algorithmic Modeling
# www.wickersonstudios.com
# www.michaelwickerson.com
# https://www.youtube.com/channel/UC7J48Ppcsa6oncp6d29R0xw
# https://github.com/mwickerson
# https://www.facebook.com/michael.wickerson
# https://www.linkedin.com/in/michael-wickerson-696a80156/
# https://www.grasshopper3d.com/profile/MichaelWickerson
tree_statistics = TreeStatistics()  # -> Paths, Length, Count

shift_paths = ShiftPaths(Offset=-1)
simplify_tree = SimplifyTree(Front=False)
flatten_tree = FlattenTree(Path="{0}")
graft_tree = GraftTree(IncludeEmptyLists=True, IncludeNullItems=True)

prune_tree = PruneTree(Minimum=0, Maximum=0)
tree_branch = TreeBranch(MaintainPaths=True)
stream_filter = StreamFilter(Gate=0)

# ----
# Data Trie(s)
number_slider = Slider(5.8, range=0..10)
start = Start(0)
series = Series(Start=start, Step=number_slider, Count=Slider(7, range=0..10))
series_2 = Series(Start=start, Step=Slider(4, range=0..10), Count=Slider(10, range=0..10))
graft_tree_2 = GraftTree(Tree=series, IncludeEmptyLists=True, IncludeNullItems=True)
construct_point = ConstructPoint(XCoordinate=graft_tree_2, YCoordinate=series_2, ZCoordinate=0)
graft_tree_3 = GraftTree(Tree=construct_point, IncludeEmptyLists=True, IncludeNullItems=True)
point_list = PointList(Points=construct_point, Size=3)
param_viewer = ParamViewer(graft_tree_3)
tree_statistics_2 = TreeStatistics(Tree=graft_tree_3)  # -> Paths, Length, Count
panel = Panel(graft_tree_3)
param_viewer_2 = ParamViewer(graft_tree_3)
panel_2 = Panel(tree_statistics_2.Count)
graft_tree_4 = GraftTree(Tree=tree_statistics_2.Paths, IncludeEmptyLists=True, IncludeNullItems=True)
panel_3 = Panel(tree_statistics_2.Length)
panel_4 = Panel(tree_statistics_2.Paths)
text_tag_3d = TextTag3D(Location=graft_tree_3, Text=graft_tree_4, Size=1, Justification=7)
panel_5 = Panel(graft_tree_4)

# ----
# Sets 123/1001 DATA TREES NODE: Sets Tree Nodes
# https://www.youtube.com/watch?v=kNYe_f4ux4w&list=PLGV167zE8gnV-mffyzD3mDhOrSM-CXaYW
number_slider_2 = Slider(8, range=0..100)
construct_point_2 = ConstructPoint(XCoordinate=number_slider_2, YCoordinate=Slider(30, range=0..100), ZCoordinate=Slider(0, range=0..100))
panel_6 = Panel(construct_point_2)

start_2 = Start(0)
series_3 = Series(Start=start_2, Step=Slider(5.8, range=0..10), Count=Slider(7, range=0..10))
construct_point_3 = ConstructPoint(XCoordinate=series_3, YCoordinate=Slider(5, range=0..10), ZCoordinate=0)
panel_7 = Panel(construct_point_3)

start_3 = Start(0)
series_4 = Series(Start=start_3, Step=Slider(5.8, range=0..10), Count=Slider(7, range=0..10))
series_5 = Series(Start=start_3, Step=Slider(4, range=0..10), Count=Slider(10, range=0..10))
path_mapper_2 = PathMapper(series_4, source="{A;B}(i)", target="{A;B;i}")
longest_list = LongestList(ListListA=series_4, ListListB=series_5, PaddingMode=2)  # -> ListListA, ListListB
shortest_list = ShortestList(ListListA=series_4, ListListB=series_5, TrimMode=2)  # -> ListListA, ListListB
cross_reference = CrossReference(ListListA=series_4, ListListB=series_5, CrossMode=1)  # -> ListListA, ListListB
construct_point_4 = ConstructPoint(XCoordinate=path_mapper_2, YCoordinate=series_5, ZCoordinate=0)
construct_point_5 = ConstructPoint(XCoordinate=series_5, YCoordinate=path_mapper_2, ZCoordinate=0)
construct_point_6 = ConstructPoint(XCoordinate=cross_reference.ListListA, YCoordinate=cross_reference.ListListB, ZCoordinate=0)
construct_point_7 = ConstructPoint(XCoordinate=longest_list.ListListA, YCoordinate=longest_list.ListListB, ZCoordinate=0)
construct_point_8 = ConstructPoint(XCoordinate=shortest_list.ListListA, YCoordinate=shortest_list.ListListB, ZCoordinate=0)
panel_8 = Panel(construct_point_6)
param_viewer_3 = ParamViewer(construct_point_4)
param_viewer_4 = ParamViewer(construct_point_6)

start_4 = Start(0)
series_6 = Series(Start=start_4, Step=Slider(4, range=0..10), Count=Slider(10, range=0..10))
series_7 = Series(Start=start_4, Step=Slider(5.8, range=0..10), Count=Slider(7, range=0..10))
path_mapper_3 = PathMapper(series_7, source="{A;B}(i)", target="{A;B;i}")
construct_point_9 = ConstructPoint(XCoordinate=path_mapper_3, YCoordinate=series_6, ZCoordinate=0)  # -> simplify(Point)
panel_9 = Panel(construct_point_9)

number_slider_3 = Slider(4, range=0..10)
start_5 = Start(0)
series_8 = Series(Start=start_5, Step=Slider(5.8, range=0..10), Count=Slider(7, range=0..10))
path_mapper_4 = PathMapper(series_8, source="{A;B}(i)", target="{A;B;i}")
construct_point_10 = ConstructPoint(XCoordinate=path_mapper_4, YCoordinate=series_8, ZCoordinate=0)
panel_10 = Panel(path_mapper_4)

# ----
# Path Mapper
number_slider_4 = Slider(7, range=0..10)
circle = Circle(Plane=PlaneXY(0, 0, 0), Radius=Slider(12, range=0..100))
cluster = Cluster(closedcrv=circle, ucount=Slider(10, range=0..10), vcount=number_slider_4)
untrimmedsurfacefromuvcount = Cluster()
surface = Surface(cluster)

# ----
# Relative Item(s)
square = Square(Plane=PlaneXY(0, 0, 0), Size=1, ExtentX=5, ExtentY=5)  # -> Cells, Points
point = Point(square.Points)
graft_tree_5 = GraftTree(Tree=point, IncludeEmptyLists=True, IncludeNullItems=True)
simplify_tree_2 = SimplifyTree(Tree=graft_tree_5, Front=False)
param_viewer_5 = ParamViewer(graft_tree_5)
number_slider_5 = Slider(0.14, range=0..1)
param_viewer_6 = ParamViewer(simplify_tree_2)
tree_statistics_3 = TreeStatistics(Tree=simplify_tree_2)  # -> graft(Paths), Length, Count
text_tag_3d_2 = TextTag3D(Location=graft_tree_5, Text=graft(param_viewer_5), Size=number_slider_5, Justification=7)
text_tag_3d_3 = TextTag3D(Location=simplify_tree_2, Text=tree_statistics_3.Paths, Size=number_slider_5, Justification=7)
panel_11 = Panel("""{1;1}
{0;1}""")
panel_12 = Panel("""{0;0}
{1;1}
{1;2}
{0;1}""")
relative_item_2 = RelativeItem(Tree=simplify_tree_2, Offset=panel_11, WrapPaths=False, WrapItems=False)  # -> ItemA, ItemB
line = Line(StartPoint=relative_item_2.ItemA, EndPoint=relative_item_2.ItemB)

path_mapper_5 = PathMapper(series_8, source="{A;B}", target="{A;B}")
param_viewer_7 = ParamViewer(construct_point_2)

# ---- group: Toggle for Flip Matrix
boolean_toggle = BooleanToggle(True)

# ----
# Toggle for Flip Matrix
number_slider_6 = Slider(11, range=1..25)
# Advanced Data Trees
reference_surface = Surface(reparameterize(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))
divide_surface = DivideSurface(Surface=reference_surface, UCount=Slider(8, range=1..25), VCount=number_slider_6)  # -> Points, Normals, Parameters
simplify_tree_3 = SimplifyTree(Tree=divide_surface.Normals, Front=False)
point_list_2 = PointList(Points=divide_surface.Points, Size=1)
simplify_tree_4 = SimplifyTree(Tree=divide_surface.Points, Front=False)
flip_matrix = FlipMatrix(Data=simplify_tree_4)
flip_matrix_2 = FlipMatrix(Data=simplify_tree_3)
param_viewer_8 = ParamViewer(divide_surface.Points)
flip_matrix_3 = FlipMatrix(Data=divide_surface.Parameters)
interpolate = Interpolate(Vertices=flip_matrix, Degree=3, Periodic=False, KnotStyle=1)  # -> Curve, Length, Domain
param_viewer_9 = ParamViewer(simplify_tree_4)
interpolate_2 = Interpolate(Vertices=simplify_tree_4, Degree=3, Periodic=False, KnotStyle=1)  # -> Curve, Length, Domain
stream_filter_2 = StreamFilter(Gate=boolean_toggle, Stream0=simplify_tree_3, Stream1=flip_matrix_2)
stream_filter_3 = StreamFilter(Gate=boolean_toggle, Stream0=divide_surface.Points, Stream1=flip_matrix)
stream_filter_4 = StreamFilter(Gate=boolean_toggle, Stream0=divide_surface.Parameters, Stream1=flip_matrix_3)  # -> simplify(Stream)
param_viewer_10 = ParamViewer(stream_filter_4)
param_viewer_11 = ParamViewer(stream_filter_3)
image_sampler_2 = ImageSampler(
    stream_filter_4,
    FilePath="C:\Users\Sculpture\Documents\2020Grasshopper\ScreenShots2019\BlackandWhiteMax.PNG",
    Filter="Value",
    Interpolate=True,
    Umax=1,
    Umin=0,
    Vmax=1,
    Vmin=0,
    Wrap=1)
panel_13 = Panel(stream_filter_3)
panel_14 = Panel(stream_filter_4)
multiplication = Multiplication(A=stream_filter_2, B=image_sampler_2)
addition = Addition(A=stream_filter_3, B=multiplication)
interpolate_3 = Interpolate(Vertices=addition, Degree=3, Periodic=False, KnotStyle=1)  # -> Curve, Length, Domain
interpolate_4 = Interpolate(Vertices=stream_filter_3, Degree=3, Periodic=False, KnotStyle=1)  # -> Curve, Length, Domain

# ---- group: Toggle for Flip Matrix
boolean_toggle_2 = BooleanToggle(True)

# ----
# Toggle for Flip Matrix
number_slider_7 = Slider(11, range=1..25)
reference_surface_2 = Surface(reparameterize(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))
divide_surface_2 = DivideSurface(Surface=reference_surface_2, UCount=Slider(8, range=1..25), VCount=number_slider_7)  # -> Points, Normals, Parameters
simplify_tree_5 = SimplifyTree(Tree=divide_surface_2.Normals, Front=False)
point_list_3 = PointList(Points=divide_surface_2.Points, Size=1)
simplify_tree_6 = SimplifyTree(Tree=divide_surface_2.Points, Front=False)
flip_matrix_4 = FlipMatrix(Data=simplify_tree_6)
flip_matrix_5 = FlipMatrix(Data=simplify_tree_5)
param_viewer_12 = ParamViewer(divide_surface_2.Points)
flip_matrix_6 = FlipMatrix(Data=divide_surface_2.Parameters)
interpolate_5 = Interpolate(Vertices=flip_matrix_4, Degree=3, Periodic=False, KnotStyle=1)  # -> Curve, Length, Domain
interpolate_6 = Interpolate(Vertices=simplify_tree_6, Degree=3, Periodic=False, KnotStyle=1)  # -> Curve, Length, Domain
param_viewer_13 = ParamViewer(simplify_tree_6)
stream_filter_5 = StreamFilter(Gate=boolean_toggle_2, Stream0=simplify_tree_5, Stream1=flip_matrix_5)
stream_filter_6 = StreamFilter(Gate=boolean_toggle_2, Stream0=divide_surface_2.Points, Stream1=flip_matrix_4)
stream_filter_7 = StreamFilter(Gate=boolean_toggle_2, Stream0=divide_surface_2.Parameters, Stream1=flip_matrix_6)  # -> simplify(Stream)
param_viewer_14 = ParamViewer(stream_filter_7)
param_viewer_15 = ParamViewer(stream_filter_6)
image_sampler_3 = ImageSampler(
    stream_filter_7,
    FilePath="C:\Users\Sculpture\Documents\2020Grasshopper\ScreenShots2019\BlackandWhiteMax.PNG",
    Filter="Value",
    Interpolate=True,
    Umax=1,
    Umin=0,
    Vmax=1,
    Vmin=0,
    Wrap=1)
panel_15 = Panel(stream_filter_6)
panel_16 = Panel(stream_filter_7)
multiplication_2 = Multiplication(A=stream_filter_5, B=image_sampler_3)
addition_2 = Addition(A=stream_filter_6, B=multiplication_2)
graft_tree_6 = GraftTree(Tree=stream_filter_6, IncludeEmptyLists=True, IncludeNullItems=True)
graft_tree_7 = GraftTree(Tree=addition_2, IncludeEmptyLists=True, IncludeNullItems=True)
panel_17 = Panel("""{0;0}
{0;1}
{1;1}""")
boolean_toggle_3 = BooleanToggle(True)
relative_items_2 = RelativeItems(TreeA=graft_tree_6, TreeB=graft_tree_7, Offset=panel_17, WrapPaths=False, WrapItems=False)  # -> ItemA, ItemB
relative_item_3 = RelativeItem(Tree=graft_tree_6, Offset=panel_17, WrapPaths=False, WrapItems=False)  # -> ItemA, ItemB
polyline = PolyLine(Vertices=relative_items_2.ItemB, Closed=boolean_toggle_3)
line_2 = Line(StartPoint=relative_items_2.ItemA, EndPoint=relative_items_2.ItemB)
# GH solution
# VB
# C#
# Python with RhinoCommon Only
# Pythong with RhinoScriptSyntax
# GH solution
# VB
# C#
# Python
# VB
polyline_2 = PolyLine(Vertices=relative_item_3.ItemB, Closed=boolean_toggle_3)

curve = Curve([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])
cluster_2 = Cluster(closedcrv=curve, ucount=Slider(10, range=0..10), vcount=Slider(7, range=0..10))
untrimmedsurfacefromuvcount_2 = Cluster()
surface_2 = Surface(cluster_2)

param_viewer_16 = ParamViewer(path_mapper_5)
point_list_4 = PointList(Points=construct_point_4, Size=2)
param_viewer_17 = ParamViewer(construct_point_9)

number_slider_8 = Slider(1, range=0..1)
param_viewer_18 = ParamViewer(number_slider_8)
construct_point_11 = ConstructPoint(XCoordinate=[number_slider_8, Slider(0, range=0..1)], YCoordinate=0, ZCoordinate=0)
series_9 = Series(Start=0, Step=1, Count=10)
param_viewer_19 = ParamViewer(construct_point_11)
polar_array = PolarArray(Geometry=construct_point_11, Plane=PlaneXY(0, 0, 0), Count=10, Angle=6.283185307)  # -> Geometry, Transform
unit_z = UnitZ(Factor=series_9)
param_viewer_20 = ParamViewer(polar_array.Geometry)
move = Move(Geometry=polar_array.Geometry, Motion=unit_z)  # -> Geometry, Transform
param_viewer_21 = ParamViewer(move.Geometry)
path_mapper_6 = PathMapper(move.Geometry, source="{A;B}(i)", target="{A;i}(B)")
param_viewer_22 = ParamViewer(path_mapper_6)
dispatch = Dispatch(List=path_mapper_6, DispatchPattern=[True, False])  # -> ListA, ListB
param_viewer_23 = ParamViewer(dispatch.ListA)
param_viewer_24 = ParamViewer(dispatch.ListB)
line_3 = Line(StartPoint=dispatch.ListA, EndPoint=dispatch.ListB)
param_viewer_25 = ParamViewer(line_3)
path_mapper_7 = PathMapper(line_3, source="{A;B}", target="{0}")
param_viewer_26 = ParamViewer(path_mapper_7)
loft = Loft(Curves=path_mapper_7, Options={Adjust=False, Closed=False, LoftEnds=0, LoftSimp=0, LoftType=0, Rebuild=10, Refit=0.01})
# rc
# Full multiplicity knots at start
# Simple knots
# Full multiplicity knots at end
# P1
# A=0.2*P1+ 0.8*P2
# D=0.2*A + 0.8*B
# P2
# B=0.47*P2 + 0.53*P3
# Full multiplicity knots at start
# E=0.7*B + 0.3*C
# P3
# Full multiplicity knots in the middle
# C=0.8*P3 + 0.2*P4
# P4
# Full multiplicity knots at end
# Compare knot spacing
param_viewer_27 = ParamViewer(loft)

polyline_3 = PolyLine(Vertices=relative_item_2.ItemB, Closed=Toggle(True))

line_4 = Line(StartPoint=relative_item_2.ItemA, EndPoint=simplify_tree_2)
line_5 = Line(StartPoint=simplify_tree_2, EndPoint=relative_item_2.ItemB)

# ----
# Manipulating Data Trees
number_slider_9 = Slider(5.8, range=0..10)
start_6 = Start(0)
series_10 = Series(Start=start_6, Step=number_slider_9, Count=Slider(7, range=0..10))
series_11 = Series(Start=start_6, Step=Slider(4, range=0..10), Count=Slider(10, range=0..10))
graft_tree_8 = GraftTree(Tree=series_10, IncludeEmptyLists=True, IncludeNullItems=True)
param_viewer_28 = ParamViewer(series_10)
construct_point_12 = ConstructPoint(XCoordinate=graft_tree_8, YCoordinate=series_11, ZCoordinate=0)  # -> graft(Point)
panel_18 = Panel("-2")
param_viewer_29 = ParamViewer(construct_point_12)
shift_paths_2 = ShiftPaths(Data=construct_point_12, Offset="-1")
param_viewer_30 = ParamViewer(shift_paths_2)

square_2 = Square(Plane=PlaneXY(0, 0, 0), Size=1, ExtentX=5, ExtentY=5)  # -> Cells, Points
point_2 = Point(square_2.Points)
param_viewer_31 = ParamViewer(point_2)
param_viewer_32 = ParamViewer(point_2)
graft_tree_9 = GraftTree(Tree=point_2, IncludeEmptyLists=True, IncludeNullItems=True)
param_viewer_33 = ParamViewer(graft_tree_9)
param_viewer_34 = ParamViewer(graft_tree_9)
shift_paths_3 = ShiftPaths(Data=graft_tree_9, Offset="-1")
param_viewer_35 = ParamViewer(shift_paths_3)
param_viewer_36 = ParamViewer(shift_paths_3)

simplify_tree_7 = SimplifyTree(Tree=shift_paths_3, Front=False)
param_viewer_37 = ParamViewer(simplify_tree_7)
param_viewer_38 = ParamViewer(simplify_tree_7)
flatten_tree_2 = FlattenTree(Tree=simplify_tree_7, Path="{0}")
param_viewer_39 = ParamViewer(flatten_tree_2)
param_viewer_40 = ParamViewer(flatten_tree_2)

# ----
# Creating Clusters
number_slider_10 = Slider(12, range=0..100)
circle_2 = Circle(Plane=PlaneXY(0, 0, 0), Radius=number_slider_10)

# ---- group: Inputs
ucount = Integer(Slider(10, range=0..10))
vcount = Integer(Slider(8, range=0..10))
closedcrv = Curve(circle_2)

# ----
reference_surface_3 = Surface(reparameterize(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))
divide_surface_3 = DivideSurface(Surface=reference_surface_3, UCount=Slider(8, range=1..25), VCount=Slider(11, range=1..25))  # -> Points, Normals, Parameters
flip_matrix_7 = FlipMatrix(Data=divide_surface_3.Points)
point_list_5 = PointList(Points=flip_matrix_7, Size=1)
point_list_6 = PointList(Points=divide_surface_3.Points, Size=1)
interpolate_7 = Interpolate(Vertices=divide_surface_3.Points, Degree=3, Periodic=False, KnotStyle=1)  # -> Curve, Length, Domain
interpolate_8 = Interpolate(Vertices=flip_matrix_7, Degree=3, Periodic=False, KnotStyle=1)  # -> Curve, Length, Domain
param_viewer_41 = ParamViewer(interpolate_7.Curve)
param_viewer_42 = ParamViewer(interpolate_8.Curve)
path_mapper_8 = PathMapper(interpolate_8.Curve, source="{A;B;C}(i)", target="{A;B;C}(i)")
param_viewer_43 = ParamViewer(path_mapper_8)
path_mapper_9 = PathMapper(interpolate_3.Curve, source="{A}", target="{A+2}")
merge = Merge(Data1=interpolate_4.Curve, Data2=path_mapper_9)
param_viewer_44 = ParamViewer(interpolate_3.Curve)
param_viewer_45 = ParamViewer(interpolate_4.Curve)

prune_tree_2 = PruneTree(Tree=merge, Minimum="2", Maximum=0)

loft_2 = Loft(Curves=prune_tree_2, Options={Adjust=False, Closed=False, LoftEnds=0, LoftSimp=0, LoftType=0, Rebuild=10, Refit=0.01})
panel_19 = Panel(loft_2)

square_3 = Square(Plane=PlaneXY(0, 0, 0), Size=1, ExtentX=5, ExtentY=5)  # -> Cells, Points
point_3 = Point(square_3.Points)
graft_tree_10 = GraftTree(Tree=point_3, IncludeEmptyLists=True, IncludeNullItems=True)
simplify_tree_8 = SimplifyTree(Tree=graft_tree_10, Front=False)
param_viewer_46 = ParamViewer(simplify_tree_8)
param_viewer_47 = ParamViewer(graft_tree_10)
number_slider_11 = Slider(0.14, range=0..1)
tree_statistics_4 = TreeStatistics(Tree=simplify_tree_8)  # -> graft(Paths), Length, Count
text_tag_3d_4 = TextTag3D(Location=simplify_tree_8, Text=tree_statistics_4.Paths, Size=number_slider_11, Justification=7)
text_tag_3d_5 = TextTag3D(Location=graft_tree_10, Text=graft(param_viewer_47), Size=number_slider_11, Justification=7)
panel_20 = Panel("""1
1
0""")
tree_statistics_5 = TreeStatistics(Tree=simplify_tree_8)  # -> Paths, Length, Count
cull_pattern = CullPattern(List=tree_statistics_5.Paths, CullPattern=panel_20)
panel_21 = Panel("""{2;*}
{*;1}""")
panel_22 = Panel(cull_pattern)

split_tree_2 = SplitTree(Data=simplify_tree_8, Masks=flatten(panel_21))  # -> Positive, Negative
tree_branch_2 = TreeBranch(Tree=simplify_tree_8, Path=panel_22, MaintainPaths=True)

point_4 = Point(split_tree_2.Positive)
point_5 = Point(tree_branch_2)

boundary_surfaces = BoundarySurfaces(Edges=closedcrv)
divide_surface_4 = DivideSurface(Surface=boundary_surfaces, UCount=ucount, VCount=vcount)  # -> Points, Normals, Parameters
clean_tree = CleanTree(RemoveNulls=True, RemoveInvalid=True, RemoveEmpty=Slider(1, range=0..1), Tree=divide_surface_4.Points)
interpolate_9 = Interpolate(Vertices=clean_tree, Degree=3, Periodic=False, KnotStyle=1)  # -> flatten(Curve), Length, Domain
loft_3 = Loft(
    Curves=interpolate_9.Curve,
    Options={Adjust=False, Closed=False, LoftEnds=0, LoftSimp=0, LoftType=0, Rebuild=10, Refit=0.01})

# ---- group: Output
untrimmedsurface = Surface(loft_3)

# ----
surface_3 = Surface(untrimmedsurface)

# ==== cluster Cluster
ucount = ClusterInput()
vcount = ClusterInput()
closedcrv = ClusterInput()

# ---- group: Inputs
ucount_2 = Integer(ucount)
vcount_2 = Integer(vcount)
closedcrv_2 = Curve(closedcrv)

# ----
boundary_surfaces = BoundarySurfaces(Edges=closedcrv_2)
divide_surface = DivideSurface(Surface=boundary_surfaces, UCount=ucount_2, VCount=vcount_2)  # -> Points, Normals, Parameters
clean_tree = CleanTree(RemoveNulls=True, RemoveInvalid=True, RemoveEmpty=Slider(1, range=0..1), Tree=divide_surface.Points)
interpolate = Interpolate(Vertices=clean_tree, Degree=3, Periodic=False, KnotStyle=1)  # -> flatten(Curve), Length, Domain
loft = Loft(
    Curves=interpolate.Curve,
    Options={Adjust=False, Closed=False, LoftEnds=0, LoftSimp=0, LoftType=0, Rebuild=10, Refit=0.01})

# ---- group: Output
untrimmedsurface = Surface(loft)

# ----
untrimmedsurface_2 = ClusterOutput(untrimmedsurface)
