# Grasshopper definition Sets124GoingFurtherModelab.gh (Grasshopper 1.0.7)
# Copyright: Wickerson Studios
# plug-ins: Bifocals

# 1001 GRASSHOPPER DEFINITIONS
# Wickerson Studio
# 
# created by: Michael Wickerson
# 
# Grasshopper for Rhino 3D Algorithmic Modeling
# 
# www.wickersonstudios.com
# www.michaelwickerson.com
# https://www.youtube.com/channel/UC7J48Ppcsa6oncp6d29R0xw
# https://github.com/mwickerson
# https://www.facebook.com/michael.wickerson
# https://www.linkedin.com/in/michael-wickerson-696a80156/
# https://www.grasshopper3d.com/profile/MichaelWickerson
image_sampler = ImageSampler(
    FilePath="C:\Users\Sculpture\Documents\2020Grasshopper\ScreenShots2019\Screenshots2020\SurfaceEditAlgorithm.PNG",
    Filter="Value",
    Interpolate=False,
    Umax=1,
    Umin=0,
    Vmax=1,
    Vmin=0,
    Wrap=1)

# ----
# Sets 124/1001 DATA TREES with MODELABS: Going Further Part 1
# https://www.youtube.com/watch?v=kNYe_f4ux4w&list=PLGV167zE8gnV-mffyzD3mDhOrSM-CXaYW
# Weaverbird
# ghPython
# Kangaroo
match_tree = MatchTree()

mesh_sphere_ex = MeshSphereEx(Base=PlaneXY(0, 0, 0), Radius=10, Count=Slider(16, range=0..100))
weld_mesh = WeldMesh(Mesh=mesh_sphere_ex, Angle=3.141592654)
merge = Merge(
    Data1=ColourSwatch(SwatchColor=RGB(255, 255, 255)),
    Data2=ColourSwatch(SwatchColor=RGB(255, 255, 128)),
    Data3=ColourSwatch(SwatchColor=RGB(59, 183, 239)),
    Data4=ColourSwatch(SwatchColor=RGB(174, 44, 5)))
point = Point([Point(38.59330101, 4.383092338, 0), Point(-22.03594136, -5.843930391, 0), Point(-16.44880715, 23.29792559, 0), Point(15.58064271, -12.50959993, 0)])
mesh_colours = MeshColours(Mesh=weld_mesh, Colours=merge)
mesh_spray = MeshSpray(Mesh=weld_mesh, Points=point, Colours=merge, SprayMode=0)
# GH solution
# VB
# C#
# Python with RhinoCommon Only
# Pythong with RhinoScriptSyntax
# GH solution
# VB
# C#
# Python
# VB
blur_mesh = BlurMesh(Mesh=mesh_spray, Iterations=Slider(10, range=0..10))

colour_wheel = ColourWheel(
    "3",
    ColourGrips_Style=20,
    ColourGrips_Grip=[6.166578232, 2.495637771, 5.327416441, 4.066434098],
    ColourGrips_Lum=[0, 0.5483870719],
    ColourGrips_Range=[0.1919936758, 0.1919936758, 0.1919936758, 0.1919936758],
    ColourGrips_Sat=[0.1490028571, 0.9380748443])
curve = Curve([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])
boundary_surfaces = BoundarySurfaces(Edges=curve)
panel = Panel(colour_wheel)
custom_preview = CustomPreview(Geometry=boundary_surfaces, Material=colour_wheel)

mesh_sphere_ex_2 = MeshSphereEx(Base=PlaneXY(0, 0, 0), Radius=10, Count=5)
panel_2 = Panel(mesh_sphere_ex_2)
weld_mesh_2 = WeldMesh(Mesh=mesh_sphere_ex_2, Angle=3.141592654)
point_2 = Point([Point(11.76864413, 15.45880737, 7.63707951), Point(-42.95456489, -3.844501021, 0), Point(-19.35798217, 25.56010093, 7.63707951), Point(11.21329702, -28.43640695, 1.927455095)])
panel_3 = Panel(weld_mesh_2)
mesh_closest_point = MeshClosestPoint(Point=point_2, Mesh=weld_mesh_2)  # -> Point, Index, Parameter
panel_4 = Panel(mesh_closest_point.Parameter)
mesh_eval = MeshEval(Mesh=weld_mesh_2, Parameter=mesh_closest_point.Parameter)  # -> Point, Normal, Colour
mesh_edges = MeshEdges()  # -> NakedEdges, InteriorEdges, NonManifoldEdges
panel_5 = Panel(mesh_closest_point.Index)
panel_6 = Panel(mesh_eval.Point)
vector_display = VectorDisplay(Anchor=mesh_eval.Point, Vector=expr("x*5", mesh_eval.Normal))

polygon = Polygon(Plane=PlaneXY(0, 0, 0), Radius=3, Segments=6, FilletRadius=0)  # -> Polygon, Length
explode = Explode(Curve=polygon.Polygon, Recursive=True)  # -> Segments, Vertices
number_slider = Slider(0.78, range=0..1)
shortest_list = ShortestList(ListA=explode.Segments, ListB=explode.Vertices, TrimMode=2)  # -> ListA, ListB
cull_index = CullIndex(List=explode.Vertices, Indices="0", Wrap=True)
circle = Circle(Plane=shortest_list.ListB, Radius=number_slider)
cross_reference = CrossReference(ListA=shortest_list.ListB, ListB=shortest_list.ListB, CrossMode=1)  # -> ListA, ListB
circle_2 = Circle(Plane=cull_index, Radius=number_slider)
line = Line(StartPoint=cross_reference.ListA, EndPoint=cross_reference.ListB)

square = Square(Plane=PlaneXY(0, 0, 0), Size=1, ExtentX=5, ExtentY=5)  # -> Cells, Points
cherry_picker = CherryPicker(square.Cells, ListIndex=1, TreePath_path="{0;0;1}")
button = Button()
param_viewer = ParamViewer(square.Cells)
dispatch = Dispatch(List=cherry_picker, DispatchPattern=button)  # -> ListA, ListB
panel_7 = Panel(button)
colour_picker = ColourPicker(PickedColour=RGB(227, 206, 95))
boundary_surfaces_2 = BoundarySurfaces(Edges=dispatch.ListB)
custom_preview_2 = CustomPreview(Geometry=boundary_surfaces_2, Material=colour_picker)

curve_2 = Curve(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)
curve_3 = Curve(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)
curve_4 = Curve(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)
number_slider_2 = Slider(28, range=0..100)
curve_array = CurveArray(Geometry=curve_2, Curve=curve_3, Count=number_slider_2)  # -> Geometry, Transform
rectangular_array = RectangularArray(Geometry=curve_4, Cell=curve_2, XCount=number_slider_2, YCount=number_slider_2)  # -> Geometry, Transform
rectangle_mapping = RectangleMapping()  # -> Geometry, Transform
polar_array = PolarArray(Geometry=curve_4, Plane=PlaneXY(0, 0, 0), Count=number_slider_2, Angle=6.283185307)  # -> Geometry, Transform
plane = Plane(PlaneXY(3.601357617, 4.050969343, 0))
kaleidoscope = Kaleidoscope(Geometry=polar_array.Geometry, Plane=plane, Segments=Slider(6, range=0..10))  # -> Geometry, Transform
divide_curve = DivideCurve(Curve=kaleidoscope.Geometry, Count=Slider(10, range=0..10), Kinks=False)  # -> flatten(Points), Tangents, Parameters
# rc
# Full multiplicity knots at start
# Simple knots
# Full multiplicity knots at end
# P1
# A=0.2*P1+ 0.8*P2
# D=0.2*A + 0.8*B
# P2
# B=0.47*P2 + 0.53*P3
# Full multiplicity knots at start
# E=0.7*B + 0.3*C
# P3
# Full multiplicity knots in the middle
# C=0.8*P3 + 0.2*P4
# P4
# Full multiplicity knots at end
# Compare knot spacing
voronoi = Voronoi(Points=divide_curve.Points, Radius=Slider(1.92, range=0..10), BruteForceOverride=False)

panel_8 = Panel("""NewYork
London
Barcelona
Sydney""")
panel_9 = Panel("""0
1
1""")
sift_pattern = SiftPattern(List=panel_8, SiftPattern=panel_9)  # -> Output0, Output1, Output2
replace_nulls = ReplaceNulls(Items=sift_pattern.Output1, Replacements="Berlin")  # -> Items, Count
panel_10 = Panel(sift_pattern.Output0)
panel_11 = Panel(replace_nulls.Items)
panel_12 = Panel(sift_pattern.Output2)

ghpython_script = GhPythonScript()  # -> out, a
# ---------- ghpython_script: Python ----------
__author__ = "Sculpture"
__version__ = "2020.07.29"

import rhinoscriptsyntax as rs

from math import sin, cos, sqrt, acos
from numpy import array,arange
from pylab import plot,xlabel,ylabel,show
import matplotlib.pyplot as plt

a = 1.0
b = 1.8
alpha = 2.8
beta = 1.0

phi0 = 0.0
u0 = 0.4
x0 = sqrt((1-u0*u0)*(alpha-beta*u0)-(b-a*u0)**2)
print(x0)

def f(r,t):
    phi = r[0]
    u = r[1]
    x = r[2]
    fphi = (b-a*u)/(1-u*u)
    fu = x
    fx = 1.5*beta*u*u-(a*a+alpha)*u+a*b-beta/2
    return array([fphi,fu,fx],float)

t1 = 0.0
t2 = 10.0
N = 1000
h = (t2-t1)/N

tpoints = arange(t1,t2,h)
phipoints = []
upoints = []
xpoints = []

r = array([phi0,u0,x0],float)
for t in tpoints:
    phipoints.append(r[0])
    upoints.append(r[1])
    xpoints.append(r[2])
    k1 = h*f(r,t)
    k2 = h*f(r+0.5*k1,t+0.5*h)
    k3 = h*f(r+0.5*k2,t+0.5*h)
    k4 = h*f(r+k3,t+h)
    r += (k1+2*k2+2*k3+k4)/6
    
# Generate list of theta points
thetapoints = list(map(lambda x: acos(x), upoints))
    
plot(thetapoints,phipoints)
xlabel("theta(t)")
ylabel("phi(t)")
show()
# ---------- end ghpython_script ----------

square_2 = Square(Plane=PlaneXY(0, 0, 0), Size=1, ExtentX=5, ExtentY=5)  # -> Cells, simplify(graft(Points))
panel_13 = Panel(square_2.Points)
param_viewer_2 = ParamViewer(square_2.Points)
tree_statistics = TreeStatistics(Tree=square_2.Points)  # -> graft(Paths), Length, Count
panel_14 = Panel(param_viewer_2)
panel_15 = Panel(tree_statistics.Paths)

match_tree_2 = MatchTree(Tree=tree_statistics.Paths, Guide=square_2.Points)

text_tag_3d = TextTag3D(Location=square_2.Points, Text=match_tree_2, Size=Slider(0.18, range=0..1), Justification=7)
panel_17 = Panel(match_tree_2)
