# Grasshopper definition Sets125MODELABS.gh (Grasshopper 1.0.7)
# Copyright: Wickerson Studios
# plug-ins: Bifocals, LunchBox

# 1001 GRASSHOPPER DEFINITIONS
# Wickerson Studio
# 
# created by: Michael Wickerson
# 
# Grasshopper for Rhino 3D Algorithmic Modeling
# 
# www.wickersonstudios.com
# www.michaelwickerson.com
# https://www.youtube.com/channel/UC7J48Ppcsa6oncp6d29R0xw
# https://github.com/mwickerson
# https://www.facebook.com/michael.wickerson
# https://www.linkedin.com/in/michael-wickerson-696a80156/
# https://www.grasshopper3d.com/profile/MichaelWickerson
image_sampler = ImageSampler(
    FilePath="C:\Users\Sculpture\Documents\2020Grasshopper\ScreenShots2019\Screenshots2020\SurfaceEditAlgorithm.PNG",
    Filter="Value",
    Interpolate=False,
    Umax=1,
    Umin=0,
    Vmax=1,
    Vmin=0,
    Wrap=1)

surface = Surface(<surface referenced from the Rhino model>)
divide_surface = DivideSurface(Surface=surface, UCount=Slider(10, range=0..10), VCount=Slider(5, range=0..10))  # -> Points, Normals, Parameters
param_viewer = ParamViewer(divide_surface.Parameters)
param_viewer_2 = ParamViewer(divide_surface.Parameters)
graft_tree = GraftTree(Tree=divide_surface.Points, IncludeEmptyLists=True, IncludeNullItems=True)
param_viewer_3 = ParamViewer(graft_tree)
param_viewer_4 = ParamViewer(graft_tree)
simplify_tree = SimplifyTree(Tree=graft_tree, Front=False)
param_viewer_5 = ParamViewer(simplify_tree)
param_viewer_6 = ParamViewer(simplify_tree)
tree_statistics = TreeStatistics(Tree=simplify_tree)  # -> graft(Paths), Length, Count
text_tag_3d = TextTag3D(Location=simplify_tree, Text=tree_statistics.Paths, Size=Slider(0.2, range=0..1), Justification=7)
panel = Panel("""{0;0}
{1;0}
{+1;1}
{0;1}""")
panel_2 = Panel(simplify_tree)
relative_item = RelativeItem(Tree=simplify_tree, Offset="{+1;+1}", WrapPaths=False, WrapItems=False)  # -> ItemA, ItemB
relative_item_2 = RelativeItem(Tree=simplify_tree, Offset=panel, WrapPaths=False, WrapItems=False)  # -> ItemA, ItemB
line = Line(StartPoint=relative_item.ItemA, EndPoint=relative_item.ItemB)
boolean_toggle = BooleanToggle(True)
prune_tree = PruneTree(Tree=relative_item_2.ItemB, Minimum="3", Maximum=0)
nurbs_curve = NurbsCurve(Vertices=prune_tree, Degree=3, Periodic=boolean_toggle)  # -> Curve, Length, Domain
interpolate = Interpolate(Vertices=prune_tree, Degree=3, Periodic=boolean_toggle, KnotStyle=1)  # -> Curve, Length, Domain
polyline = PolyLine(Vertices=prune_tree, Closed=boolean_toggle)

curve = Curve([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])
graft_tree_2 = GraftTree(Tree=curve, IncludeEmptyLists=True, IncludeNullItems=True)
multiple_curves = MultipleCurves(Curves=curve)  # -> Points, IndexA, IndexB, ParamA, ParamB
curve_curve = CurveCurve(CurveA=graft_tree_2, CurveB=curve)  # -> Points, ParamsA, ParamsB
panel_3 = Panel(multiple_curves.Points)
param_viewer_7 = ParamViewer(curve_curve.Points)
panel_4 = Panel(curve_curve.Points)
simplify_tree_2 = SimplifyTree(Tree=curve_curve.Points, Front=False)
param_viewer_8 = ParamViewer(simplify_tree_2)
tree_statistics_2 = TreeStatistics(Tree=simplify_tree_2)  # -> Paths, Length, Count
panel_5 = Panel(tree_statistics_2.Paths)
deconstruct_path = DeconstructPath(Branch=tree_statistics_2.Paths)
panel_6 = Panel(deconstruct_path)
flip_matrix = FlipMatrix(Data=deconstruct_path)
panel_7 = Panel(flip_matrix)
explode_tree = ExplodeTree(Data=flip_matrix)  # -> Branch0, Branch1
panel_8 = Panel(explode_tree.Branch1)
panel_9 = Panel(explode_tree.Branch0)
equality = Equality(FirstNumber=explode_tree.Branch0, SecondNumber=explode_tree.Branch1)  # -> Equality, Inequality
panel_10 = Panel(equality.Inequality)
cull_pattern = CullPattern(List=tree_statistics_2.Paths, CullPattern=equality.Inequality)
tree_branch = TreeBranch(Tree=simplify_tree_2, Path=cull_pattern, MaintainPaths=True)
param_viewer_9 = ParamViewer(tree_branch)
shift_paths = ShiftPaths(Data=tree_branch, Offset="-1")
curve_2 = Curve(graft_tree_2)
curve_closest_point = CurveClosestPoint(Point=shift_paths, Curve=curve_2)  # -> Point, Parameter, Distance
param_viewer_10 = ParamViewer(shift_paths)
evaluate_curve = EvaluateCurve(Curve=curve_2, Parameter=curve_closest_point.Parameter)  # -> Point, Tangent, Angle
construct_plane = ConstructPlane(Origin=evaluate_curve.Point, XAxis=evaluate_curve.Tangent, YAxis=Vector(0, 1, 0))
vector_display = VectorDisplay(Anchor=evaluate_curve.Point, Vector=expr("x*3", evaluate_curve.Tangent))
rectangle = Rectangle(Plane=construct_plane, XSize=Slider(1.05, range=0..10), YSize=Slider(3.79, range=0..10), Radius=0)  # -> Rectangle, Length

surface_2 = Surface(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)
domain² = Domain²(surface_2)
panel_11 = Panel(domain²)
divide_surface_2 = DivideSurface(Surface=surface_2, UCount=Slider(10, range=0..10), VCount=Slider(8, range=0..10))  # -> Points, Normals, Parameters
panel_12 = Panel(divide_surface_2.Parameters)
param_viewer_11 = ParamViewer(divide_surface_2.Parameters)
flip_matrix_2 = FlipMatrix(Data=divide_surface_2.Points)
simplify_tree_3 = SimplifyTree(Tree=divide_surface_2.Points, Front=False)
interpolate_2 = Interpolate(Vertices=flip_matrix_2, Degree=3, Periodic=False, KnotStyle=1)  # -> Curve, Length, Domain
interpolate_3 = Interpolate(Vertices=divide_surface_2.Points, Degree=3, Periodic=False, KnotStyle=1)  # -> Curve, Length, Domain
flip_matrix_3 = FlipMatrix(Data=simplify_tree_3)
param_viewer_12 = ParamViewer(interpolate_3.Curve)
interpolate_4 = Interpolate(Vertices=simplify_tree_3, Degree=3, Periodic=False, KnotStyle=1)  # -> Curve, Length, Domain
interpolate_5 = Interpolate(Vertices=flip_matrix_3, Degree=3, Periodic=False, KnotStyle=1)  # -> Curve, Length, Domain
param_viewer_13 = ParamViewer(interpolate_4.Curve)
clean_tree = CleanTree(RemoveNulls=True, RemoveInvalid=True, RemoveEmpty=False)
split_tree = SplitTree()  # -> Positive, Negative
prune_tree_2 = PruneTree(Minimum=0, Maximum=0)

# ----
# Sets 125/1001 DATA TREES with MODELABS: Advance Data Trees
# https://www.youtube.com/watch?v=kNYe_f4ux4w&list=PLGV167zE8gnV-mffyzD3mDhOrSM-CXaYW
number_slider = Slider(8, range=0..10)
series = Series(Start=0, Step=1, Count=number_slider)
series_2 = Series(Start=0, Step=1, Count=Slider(8, range=0..10))
path_mapper = PathMapper(series, source="{A;B}(i)", target="{A;B;i}")
cross_reference = CrossReference(ListA=series, ListB=series_2, CrossMode=1)  # -> ListA, ListB
param_viewer_14 = ParamViewer(series)
graft_tree_3 = GraftTree(Tree=series, IncludeEmptyLists=True, IncludeNullItems=True)
number = Number(graft(series))
number_slider_2 = Slider(0.5, range=0..1)
construct_point = ConstructPoint(XCoordinate=cross_reference.ListA, YCoordinate=cross_reference.ListB, ZCoordinate=0)
construct_point_2 = ConstructPoint(XCoordinate=path_mapper, YCoordinate=series_2, ZCoordinate=0)
construct_point_3 = ConstructPoint(XCoordinate=series, YCoordinate=path_mapper, ZCoordinate=0)
point_list = PointList(Points=construct_point, Size=number_slider_2)
point_list_2 = PointList(Points=construct_point_3, Size=number_slider_2)
point_list_3 = PointList(Points=construct_point_2, Size=number_slider_2)
panel_13 = Panel(construct_point)
panel_14 = Panel(construct_point_2)
param_viewer_15 = ParamViewer(construct_point)
param_viewer_16 = ParamViewer(construct_point_2)

# ----
# Try not to use these objects!
flatten_tree = FlattenTree(Path="{0}")
shift_paths_2 = ShiftPaths(Offset=-1)
path_mapper_2 = PathMapper(construct_point_3, source="{A;B;C}", target="{0}")
path_mapper_3 = PathMapper()

tree_statistics_3 = TreeStatistics(Tree=construct_point_2)  # -> Paths, Length, Count
panel_15 = Panel(tree_statistics_3.Count)
panel_16 = Panel(tree_statistics_3.Length)
panel_17 = Panel(tree_statistics_3.Paths)

relative_item_3 = RelativeItem(WrapPaths=False, WrapItems=False)  # -> ItemA, ItemB
relative_items = RelativeItems(WrapPaths=False, WrapItems=False)  # -> ItemA, ItemB

curve_3 = Curve(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)
surface_3 = Surface(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)
divide_surface_3 = DivideSurface(Surface=surface_3, UCount=Slider(10, range=0..10), VCount=Slider(10, range=0..10))  # -> Points, Normals, Parameters
param_viewer_17 = ParamViewer(divide_surface_3.Parameters)
param_viewer_18 = ParamViewer(divide_surface_3.Parameters)
curve_4 = Curve(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)
panel_18 = Panel("""{0;0}
{1;0}
{+1;1}
{0;1}""")
boolean_toggle_2 = BooleanToggle(True)

clean_tree_2 = CleanTree(RemoveNulls=True, RemoveInvalid=True, RemoveEmpty=False, Tree=divide_surface_3.Points)

graft_tree_4 = GraftTree(Tree=clean_tree_2, IncludeEmptyLists=True, IncludeNullItems=True)
param_viewer_19 = ParamViewer(graft_tree_4)
param_viewer_20 = ParamViewer(graft_tree_4)
simplify_tree_4 = SimplifyTree(Tree=graft_tree_4, Front=False)
param_viewer_21 = ParamViewer(simplify_tree_4)
param_viewer_22 = ParamViewer(simplify_tree_4)
tree_statistics_4 = TreeStatistics(Tree=simplify_tree_4)  # -> graft(Paths), Length, Count
text_tag_3d_2 = TextTag3D(Location=simplify_tree_4, Text=tree_statistics_4.Paths, Size=Slider(0.2, range=0..1), Justification=7)
panel_19 = Panel(simplify_tree_4)
relative_item_4 = RelativeItem(Tree=simplify_tree_4, Offset="{+1;+1}", WrapPaths=False, WrapItems=False)  # -> ItemA, ItemB
relative_item_5 = RelativeItem(Tree=simplify_tree_4, Offset=panel_18, WrapPaths=False, WrapItems=False)  # -> ItemA, ItemB
line_2 = Line(StartPoint=relative_item_4.ItemA, EndPoint=relative_item_4.ItemB)
prune_tree_3 = PruneTree(Tree=relative_item_5.ItemB, Minimum="3", Maximum=0)
interpolate_6 = Interpolate(Vertices=prune_tree_3, Degree=3, Periodic=boolean_toggle_2, KnotStyle=1)  # -> Curve, Length, Domain
nurbs_curve_2 = NurbsCurve(Vertices=prune_tree_3, Degree=Slider(2, range=0..10), Periodic=boolean_toggle_2)  # -> Curve, Length, Domain
polyline_2 = PolyLine(Vertices=prune_tree_3, Closed=boolean_toggle_2)
panel_20 = Panel(prune_tree_3)

# ----
# insane to follow!
number_slider_3 = Slider(62, range=0..100)
region = Region({Plane=PlaneXY(0, 0, 0), Size=Domain2(u=0..20, v=0..10)})
populate_2d = Populate2D(Region=region, Count=number_slider_3, Seed=1)
center_box = CenterBox(Base=PlaneXY(0, 0, 0), X=number_slider_3, Y=number_slider_3, Z=number_slider_3)
populate_3d = Populate3D(Region=center_box, Count=Slider(50, range=0..1100), Seed=1)
delaunay_mesh = DelaunayMesh(Points=populate_2d, Plane=PlaneXY(0, 0, 0))
deconstruct_mesh = DeconstructMesh(Mesh=delaunay_mesh)  # -> Vertices, Faces, Colours, Normals
deconstruct_face = DeconstructFace(Face=graft(deconstruct_mesh.Faces))  # -> CornerA, CornerB, CornerC, CornerD
face_normals = FaceNormals(Mesh=delaunay_mesh)  # -> Centers, Normals
point_list_4 = PointList(Points=face_normals.Centers, Size=Slider(1, range=0..10))
panel_21 = Panel(deconstruct_face.CornerA)
merge = Merge(Data1=deconstruct_face.CornerA, Data2=deconstruct_face.CornerB, Data3=deconstruct_face.CornerC)
list_item = ListItem(List=deconstruct_mesh.Vertices, Index=merge, Wrap=True)
polyline_3 = PolyLine(Vertices=list_item, Closed=False)
simplify_tree_5 = SimplifyTree(Tree=polyline_3, Front=False)
point_on_curve = PointOnCurve(region, parameter=0.327)
polygon_center = PolygonCenter(Polyline=simplify_tree_5)  # -> CenterV, CenterE, CenterA
sphere = Sphere(Base=point_on_curve, Radius=1)
distance = Distance(PointA=point_on_curve, PointB=polygon_center.CenterV)
tree_statistics_5 = TreeStatistics(Tree=simplify_tree_5)  # -> Paths, Length, Count
flip_matrix_4 = FlipMatrix(Data=distance)
panel_22 = Panel(distance)
panel_23 = Panel(flip_matrix_4)

sort_list = SortList(Keys=flip_matrix_4, ValuesA=tree_statistics_5.Paths)  # -> reverse(Keys), ValuesA

panel_24 = Panel(sort_list.ValuesA)
replace_paths = ReplacePaths(Data=simplify_tree_5, Search=tree_statistics_5.Paths, Replace=sort_list.ValuesA)
polygon_center_2 = PolygonCenter(Polyline=replace_paths)  # -> CenterV, CenterE, CenterA
point_list_5 = PointList(Points=flatten(polygon_center_2.CenterE), Size=Slider(0.36, range=0..1))
bounds = Bounds(Numbers=sort_list.Keys)
remap_numbers = RemapNumbers(Value=sort_list.Keys, Source=bounds, Target=Slider(6, range=0..10))  # -> Mapped, Clipped
panel_25 = Panel(sort_list.Keys)
deconstruct_path_2 = DeconstructPath(Branch=sort_list.ValuesA)
integer = Integer(graft(remap_numbers.Mapped))
panel_26 = Panel(deconstruct_path_2)
merge_2 = Merge(Data1=integer, Data2=deconstruct_path_2)
construct_path = ConstructPath(Indices=merge_2)
flip_matrix_5 = FlipMatrix(Data=construct_path)
panel_27 = Panel(merge_2)
replace_paths_2 = ReplacePaths(Data=simplify_tree_5, Search=tree_statistics_5.Paths, Replace=flip_matrix_5)
panel_28 = Panel(construct_path)
polygon_center_3 = PolygonCenter(Polyline=replace_paths_2)  # -> CenterV, CenterE, CenterA
tree_statistics_6 = TreeStatistics(Tree=polygon_center_3.CenterE)  # -> graft(Paths), Length, Count
point_list_6 = PointList(Points=flatten(polygon_center_3.CenterE), Size=Slider(0.36, range=0..1))
shift_paths_3 = ShiftPaths(Data=replace_paths_2, Offset=-1)
tree_statistics_7 = TreeStatistics(Tree=shift_paths_3)  # -> Paths, Length, Count
text_tag_3d_3 = TextTag3D(Location=polygon_center_3.CenterE, Text=tree_statistics_6.Paths, Size=Slider(0.3, range=0..1), Justification=7)
repeat_data = RepeatData(
    Data=[ColourSwatch(SwatchColor=RGB(255, 0, 255)), ColourSwatch(SwatchColor=RGB(255, 255, 255))],
    Length=tree_statistics_7.Count)  # -> graft(Data)
# rc
# Full multiplicity knots at start
# Simple knots
# Full multiplicity knots at end
# P1
# A=0.2*P1+ 0.8*P2
# D=0.2*A + 0.8*B
# P2
# B=0.47*P2 + 0.53*P3
# Full multiplicity knots at start
# E=0.7*B + 0.3*C
# P3
# Full multiplicity knots in the middle
# C=0.8*P3 + 0.2*P4
# P4
# Full multiplicity knots at end
# Compare knot spacing
# GH solution
# VB
# C#
# Python with RhinoCommon Only
# Pythong with RhinoScriptSyntax
# GH solution
# VB
# C#
# Python
# VB
custom_preview = CustomPreview(Geometry=shift_paths_3, Material=repeat_data)

region_2 = Region({Plane=PlaneXY(0, 0, 0), Size=Domain2(u=0..20, v=0..10)})
populate_2d_2 = Populate2D(Region=region_2, Count=Slider(86, range=0..100), Seed=1)
delaunay_mesh_2 = DelaunayMesh(Points=populate_2d_2, Plane=PlaneXY(0, 0, 0))
deconstruct_mesh_2 = DeconstructMesh(Mesh=delaunay_mesh_2)  # -> Vertices, Faces, Colours, Normals
deconstruct_face_2 = DeconstructFace(Face=graft(deconstruct_mesh_2.Faces))  # -> CornerA, CornerB, CornerC, CornerD
merge_3 = Merge(Data1=deconstruct_face_2.CornerA, Data2=deconstruct_face_2.CornerB, Data3=deconstruct_face_2.CornerC)
list_item_2 = ListItem(List=deconstruct_mesh_2.Vertices, Index=merge_3, Wrap=True)
polyline_4 = PolyLine(Vertices=list_item_2, Closed=False)
simplify_tree_6 = SimplifyTree(Tree=polyline_4, Front=False)
point_on_curve_2 = PointOnCurve(region_2, parameter=0.339)
polygon_center_4 = PolygonCenter(Polyline=simplify_tree_6)  # -> CenterV, CenterE, CenterA
tree_statistics_8 = TreeStatistics(Tree=simplify_tree_6)  # -> Paths, Length, Count
sphere_2 = Sphere(Base=point_on_curve_2, Radius=1)
distance_2 = Distance(PointA=point_on_curve_2, PointB=polygon_center_4.CenterV)
flip_matrix_6 = FlipMatrix(Data=distance_2)

sort_list_2 = SortList(Keys=flip_matrix_6, ValuesValuesA=tree_statistics_8.Paths)  # -> reverse(Keys), ValuesValuesA

bounds_2 = Bounds(Numbers=sort_list_2.Keys)
remap_numbers_2 = RemapNumbers(Value=sort_list_2.Keys, Source=bounds_2, Target=Slider(6, range=0..10))  # -> Mapped, Clipped
deconstruct_path_3 = DeconstructPath(Branch=sort_list_2.ValuesValuesA)
integer_2 = Integer(graft(remap_numbers_2.Mapped))
merge_4 = Merge(Data1=integer_2, Data2=deconstruct_path_3)
construct_path_2 = ConstructPath(Indices=merge_4)
flip_matrix_7 = FlipMatrix(Data=construct_path_2)
replace_paths_3 = ReplacePaths(Data=simplify_tree_6, Search=tree_statistics_8.Paths, Replace=flip_matrix_7)
graft_tree_5 = GraftTree(Tree=replace_paths_3, IncludeEmptyLists=True, IncludeNullItems=True)
polygon_center_5 = PolygonCenter(Polyline=graft_tree_5)  # -> CenterV, CenterE, CenterA
simplify_tree_7 = SimplifyTree(Tree=graft_tree_5, Front=False)
tree_statistics_9 = TreeStatistics(Tree=simplify_tree_7)  # -> Paths, Length, Count
deconstruct_path_4 = DeconstructPath(Branch=tree_statistics_9.Paths)
weave = Weave(Pattern=[0, 1], Stream0=deconstruct_path_4, Stream1="-", NullGaps=False)
text_join = TextJoin(Text=weave)
text_tag_3d_4 = TextTag3D(Location=polygon_center_5.CenterV, Text=text_join, Size=Slider(0.2, range=0..1), Justification=7)
object_bake = ObjectBake(
    BakeToggle=Button(),
    GeometryObjects=graft_tree_5,
    Layer="GH_Bake",
    ObjectName=text_join,
    ObjectColor=RGB(255, 255, 255),
    LayerColor=RGB(255, 255, 255))
