# Grasshopper definition Sets126ghPython.gh (Grasshopper 1.0.7)
# Copyright: Wickerson Studios
# plug-ins: Bifocals

# 1001 GRASSHOPPER DEFINITIONS
# Wickerson Studio
# 
# created by: Michael Wickerson
# 
# Grasshopper for Rhino 3D Algorithmic Modeling
# 
# www.wickersonstudios.com
# www.michaelwickerson.com
# https://www.youtube.com/channel/UC7J48Ppcsa6oncp6d29R0xw
# https://github.com/mwickerson
# https://www.facebook.com/michael.wickerson
# https://www.linkedin.com/in/michael-wickerson-696a80156/
# https://www.grasshopper3d.com/profile/MichaelWickerson
image_sampler = ImageSampler(
    FilePath="C:\Users\Sculpture\Documents\2020Grasshopper\ScreenShots2019\Screenshots2020\SurfaceEditAlgorithm.PNG",
    Filter="Value",
    Interpolate=False,
    Umax=1,
    Umin=0,
    Vmax=1,
    Vmin=0,
    Wrap=1)

number_slider = Slider(10, range=0..10)
negative = Negative(Value=number_slider)
curve = Curve(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)
construct_domain = ConstructDomain(DomainStart=negative, DomainEnd=number_slider)
ghpython_script = GhPythonScript(sLine=curve, rotDom=construct_domain, branches=Slider(4, range=1..5), levels=Slider(4, range=1..5))  # -> out, Lines; inputs sLine: Curve, rotDom: Int32, branches: Int32, levels: Int32
# ---------- ghpython_script: Python ----------
import rhinoscriptsyntax as rs
import random
import scriptcontext
import math

bLines = []

def drawbranch(x,line):
    scriptcontext.escape_test()
    if x==0:
        return
    else:
        for i in range(0,branches):
            endpt = rs.CurveEndPoint(line)
            stpt = rs.CurveStartPoint(line)
            vect = rs.VectorCreate(endpt,stpt)
            rnd = random.randint(rotDom,rotDom)
            rndrot1 = random.randint(-5,5)
            rndrot2 = random.randint(-5,5)
            vect = rs.VectorRotate(vect,rnd,[rndrot1,rndrot2,0])
            ptadd = rs.PointAdd(endpt,vect)
            bLines.append(rs.AddLine(endpt,ptadd))
            drawbranch(x-1,bLines[-1])

drawbranch(levels,sLine)

Lines = bLines
# ---------- end ghpython_script ----------
# GH solution
# VB
# C#
# Python with RhinoCommon Only
# Pythong with RhinoScriptSyntax
# GH solution
# VB
# C#
# Python
# VB
pipe = Pipe(Curve=[curve, ghpython_script.Lines], Radius=Slider(0.5, range=0..1), Caps=2)
# rc
# Full multiplicity knots at start
# Simple knots
# Full multiplicity knots at end
# P1
# A=0.2*P1+ 0.8*P2
# D=0.2*A + 0.8*B
# P2
# B=0.47*P2 + 0.53*P3
# Full multiplicity knots at start
# E=0.7*B + 0.3*C
# P3
# Full multiplicity knots in the middle
# C=0.8*P3 + 0.2*P4
# P4
# Full multiplicity knots at end
# Compare knot spacing
panel = Panel(ghpython_script.Lines)

ghpython_script_2 = GhPythonScript()  # -> Out, A

sphere_radius = Slider(0.893, range=0..2)
sphere_radius_2 = Slider(2, range=0..2)
# Branching Script
numspheres = Slider(21, range=0..30)
sphere_center = Point(Point(-24.67672268, 25.85723802, 3.355317914))
sphere = Sphere(Base=sphere_center, Radius=sphere_radius)

# ---- group: Python Sphere Create
python_sphere = GhPythonScript(radius=sphere_radius, spacing=sphere_radius_2, num=numspheres)  # -> out, spheres; inputs num: Int32
# ---------- python_sphere: Python ----------
print("Hello World")

import rhinoscriptsyntax as rs

#import math
import math


#create a list to store spheres

myAwesomeList = []


#start our "looping" structure
for i in range(0,num):
    for j in range(0,num):
        #define the center pt
        myPoint = (spacing*i,spacing*j,0)
        
        
        #define the radius
        myRadius = math.sin(i*j)*radius
        
        
        #create the sphere
        #store the sphere
        
        mySphere = rs.AddSphere(myPoint,myRadius)
        
        print(myPoint)
        
        #store current sphere on the list
        myAwesomeList.append(mySphere)

#return list of spheres to the output
spheres = myAwesomeList
# ---------- end python_sphere ----------

# ----
panel_2 = Panel(python_sphere.out)
panel_3 = Panel(python_sphere.spheres)

sphere_radius_3 = Slider(0.421, range=0..2)
# MATH 127/1001 Script: ghPython with MODELABS
# INTRO TO PYTHON SCRIPTING SERIES
# https://www.youtube.com/watch?v=J84DC-cMS6A&list=PLGV167zE8gnVhurBT46afZ1RlK9RzAsLx
sphere_center_2 = Point(Point(-24.67672268, 25.85723802, 3.355317914))
sphere_2 = Sphere(Base=sphere_center_2, Radius=sphere_radius_3)

# ---- group: Python Sphere Create
python_sphere_2 = GhPythonScript(radius=sphere_radius_3)  # -> out, spheres
# ---------- python_sphere_2: Python ----------
print("Hello World")

import rhinoscriptsyntax as rs


#create a list to store spheres

myAwesomeList = []


#start our "looping" structure
for i in range(0,10):
    #define the center pt
    myPoint = (i,0,0)
    
    #define the radius
    myRadius = radius
    
    
    #create the sphere
    #store the sphere
    
    mySphere = rs.AddSphere(myPoint,myRadius)
    
    #store current sphere on the list
    myAwesomeList.append(mySphere)

#return list of spheres to the output
spheres = myAwesomeList
# ---------- end python_sphere_2 ----------

# ----
panel_4 = Panel(python_sphere_2.out)
panel_5 = Panel(python_sphere_2.spheres)

sphere_radius_4 = Slider(2, range=0..2)
sphere_radius_5 = Slider(0.893, range=0..2)
numspheres_2 = Slider(8, range=0..10)
sphere_center_3 = Point(Point(-24.67672268, 25.85723802, 3.355317914))
sphere_3 = Sphere(Base=sphere_center_3, Radius=sphere_radius_5)

# ---- group: Python Sphere Create
python_sphere_3 = GhPythonScript(radius=sphere_radius_5, spacing=sphere_radius_4, num=numspheres_2)  # -> out, spheres; inputs num: Int32
# ---------- python_sphere_3: Python ----------
print("Hello World")

import rhinoscriptsyntax as rs


#create a list to store spheres

myAwesomeList = []


#start our "looping" structure
for i in range(0,num):
    for j in range(0,num):
        #define the center pt
        myPoint = (spacing*i,spacing*j,0)
        
        
        #define the radius
        myRadius = radius
        
        
        #create the sphere
        #store the sphere
        
        mySphere = rs.AddSphere(myPoint,myRadius)
        
        print(myPoint)
        
        #store current sphere on the list
        myAwesomeList.append(mySphere)

#return list of spheres to the output
spheres = myAwesomeList
# ---------- end python_sphere_3 ----------

# ----
panel_6 = Panel(python_sphere_3.out)
panel_7 = Panel(python_sphere_3.spheres)

sphere_radius_6 = Slider(0.893, range=0..2)
sphere_radius_7 = Slider(1.81, range=0..2)
numspheres_3 = Slider(6, range=0..10)
sphere_center_4 = Point(Point(-24.67672268, 25.85723802, 3.355317914))
sphere_4 = Sphere(Base=sphere_center_4, Radius=sphere_radius_6)

# ---- group: Python Sphere Create
python_sphere_4 = GhPythonScript(radius=sphere_radius_6, spacing=sphere_radius_7, num=numspheres_3)  # -> out, spheres; inputs num: Int32
# ---------- python_sphere_4: Python ----------
print("Hello World")

import rhinoscriptsyntax as rs


#create a list to store spheres

myAwesomeList = []


#start our "looping" structure
for i in range(0,num):
    #define the center pt
    myPoint = (spacing*i,0,0)
    
    
    #define the radius
    myRadius = radius
    
    
    #create the sphere
    #store the sphere
    
    mySphere = rs.AddSphere(myPoint,myRadius)
    
    print(myPoint)
    
    #store current sphere on the list
    myAwesomeList.append(mySphere)

#return list of spheres to the output
spheres = myAwesomeList
# ---------- end python_sphere_4 ----------

# ----
panel_8 = Panel(python_sphere_4.out)
panel_9 = Panel(python_sphere_4.spheres)
