# Grasshopper definition Sets128cghPython.gh (Grasshopper 1.0.7)
# Copyright: Wickerson Studios
# plug-ins: Bifocals

# 1001 GRASSHOPPER DEFINITIONS
# Wickerson Studio
# 
# created by: Michael Wickerson
# 
# Grasshopper for Rhino 3D Algorithmic Modeling
# 
# www.wickersonstudios.com
# www.michaelwickerson.com
# https://www.youtube.com/channel/UC7J48Ppcsa6oncp6d29R0xw
# https://github.com/mwickerson
# https://www.facebook.com/michael.wickerson
# https://www.linkedin.com/in/michael-wickerson-696a80156/
# https://www.grasshopper3d.com/profile/MichaelWickerson
# MATH 128c/1001 Script: ghPython
# RHINO PYTHON PRIMER (credit: RUTTEN)
# applied to ghPython scripts
image_sampler = ImageSampler(
    FilePath="C:\Users\Sculpture\Documents\2020Grasshopper\ScreenShots2019\Screenshots2020\SurfaceEditAlgorithm.PNG",
    Filter="Value",
    Interpolate=False,
    Umax=1,
    Umin=0,
    Vmax=1,
    Vmin=0,
    Wrap=1)
number_slider = Slider(0.1, range=0..1)  # disabled
number_slider_2 = Slider(59.1, range=6..60)  # disabled
number_slider_3 = Slider(45, range=0..100)  # disabled
number_slider_4 = Slider(6, range=0..10)  # disabled
number_slider_5 = Slider(3.37, range=0..10)  # disabled
number_slider_6 = Slider(5, range=0..10)  # disabled
ghpython_script = GhPythonScript()  # -> out, a; inputs x: tree; disabled
# ---------- ghpython_script: Python ----------
import rhinoscriptsyntax as rs
#Iteratively scale down a curve until it becomes shorter than a certain length

def fitcurvetolength():
    curve_id = rs.GetObject("Select a curve to fit to length", rs.filter.curve, True, True)
    if curve_id is None: return
    
    length = rs.CurveLength(curve_id)
    
    length_limit = rs.GetReal("Length limit", 0.5*length, 0.01 * length, length)
    if length_limit is None: return
    
    while True:
        if rs.CurveLength(curve_id) <= length_limit: break
        curve_id = rs.ScaleObject(curve_id, (10,10,10), (0.95, 0.95, 0.95))
        if curve_id is None:
            print "Something went wrong..."
            return
    
    print "New curve length: ", rs.CurveLength(curve_id)

if __name__=="__main__":
    fitcurvetolength()
# ---------- end ghpython_script ----------
ghpython_script_2 = GhPythonScript(x=number_slider_5, y=number_slider, p=number_slider_2, q=number_slider_3, r=number_slider_6, s=number_slider_4)  # -> out, a; disabled
# ---------- ghpython_script_2: Python ----------
import rhinoscriptsyntax as rs
import math

HotToco = []

pi = math.pi
dblTwistingAngle = 0.0

rs.EnableRedraw(False)
for z in rs.frange(0.0, x, y):
    dblTwistingAngle = dblTwistingAngle + (pi/p)
    
    for a in rs.frange(0.0,2*pi,(pi/15)):
        x = 5 * math.sin(a + dblTwistingAngle)
        y = 5 * math.cos(a + dblTwistingAngle)
        cool = rs.AddSphere([x,y,z], 0.5)
        
        HotToco.append(cool)

rs.EnableRedraw(True)

a = HotToco
# ---------- end ghpython_script_2 ----------
ghpython_script_3 = GhPythonScript(z=Slider(4, range=0..10))  # -> out, a; inputs x: tree
# ---------- ghpython_script_3: Python ----------
import rhinoscriptsyntax as rs
import math
#Draw a sine wave using points

sinCurvePoints = []


dblA = -8.0
dblB = 8.0
dblStep = 0.25

for x in rs.frange(dblA,dblB,dblStep):
    y = z*math.sin(x)
    cool = rs.AddPoint([x,y,0])
    
    sinCurvePoints.append(cool)

a = sinCurvePoints
# ---------- end ghpython_script_3 ----------
ghpython_script_4 = GhPythonScript()  # -> out, a
# ---------- ghpython_script_4: Python ----------
import rhinoscriptsyntax as rs
import math

HotToco = []

pi = math.pi
dblTwistingAngle = 0.0

rs.EnableRedraw(False)
for z in rs.frange(0.0, 5.0, 0.5):
    dblTwistingAngle = dblTwistingAngle + (pi/30)
    
    for a in rs.frange(0.0,2*pi,(pi/15)):
        x = 5 * math.sin(a + dblTwistingAngle)
        y = 5 * math.cos(a + dblTwistingAngle)
        cool = rs.AddSphere([x,y,z], 0.5)
        
        HotToco.append(cool)

rs.EnableRedraw(True)

a = HotToco
# ---------- end ghpython_script_4 ----------
ghpython_script_5 = GhPythonScript()  # -> out, a; inputs x: tree
# ---------- ghpython_script_5: Python ----------
import rhinoscriptsyntax as rs
import math
#Draw a sine wave using points

sinCurvePoints = []


dblA = -8.0
dblB = 8.0
dblStep = 0.25

for x in rs.frange(dblA,dblB,dblStep):
    y = 2*math.sin(x)
    cool = rs.AddPoint([x,y,0])
    
    sinCurvePoints.append(cool)

a = sinCurvePoints
# ---------- end ghpython_script_5 ----------
panel = Panel(ghpython_script.out)
panel_2 = Panel(ghpython_script_5.a)
panel_3 = Panel(ghpython_script_3.a)
# rc
panel_4 = Panel(ghpython_script_4.a)
# Full multiplicity knots at start
# Simple knots
# Full multiplicity knots at end
# P1
# A=0.2*P1+ 0.8*P2
# D=0.2*A + 0.8*B
# P2
# B=0.47*P2 + 0.53*P3
# Full multiplicity knots at start
# E=0.7*B + 0.3*C
# P3
# Full multiplicity knots in the middle
# C=0.8*P3 + 0.2*P4
# P4
# Full multiplicity knots at end
# Compare knot spacing
# GH solution
# VB
# C#
# Python with RhinoCommon Only
# Pythong with RhinoScriptSyntax
# GH solution
# VB
# C#
# Python
# VB
panel_5 = Panel(ghpython_script_2.a)
