# Grasshopper definition Sets130ghPython.gh (Grasshopper 1.0.7)
# Copyright: Wickerson Studios
# plug-ins: Bifocals

# 1001 GRASSHOPPER DEFINITIONS
# Wickerson Studio
# 
# created by: Michael Wickerson
# 
# Grasshopper for Rhino 3D Algorithmic Modeling
# 
# www.wickersonstudios.com
# www.michaelwickerson.com
# https://www.youtube.com/channel/UC7J48Ppcsa6oncp6d29R0xw
# https://github.com/mwickerson
# https://www.facebook.com/michael.wickerson
# https://www.linkedin.com/in/michael-wickerson-696a80156/
# https://www.grasshopper3d.com/profile/MichaelWickerson
image_sampler = ImageSampler(
    FilePath="C:\Users\Sculpture\Documents\2020Grasshopper\ScreenShots2019\Screenshots2020\SurfaceEditAlgorithm.PNG",
    Filter="Value",
    Interpolate=False,
    Umax=1,
    Umin=0,
    Vmax=1,
    Vmin=0,
    Wrap=1)

ghpython_script = GhPythonScript()  # -> out, a
# ---------- ghpython_script: Python ----------
import rhinoscriptsyntax as rs
import math
#Cann rs.EnableRedraw(False)

listA = []


for t in rs.frange(-10,50,1.25):
    arrPoint = [t * math.sin(15*t), t* math.cos(15*t), t]
    
    print(arrPoint)
    cool = rs.AddPoint(arrPoint)
    
    listA.append(cool)
    
#Call rs.EnableRedraw(True)

a = listA
# ---------- end ghpython_script ----------
param_viewer = ParamViewer(ghpython_script.a)
panel = Panel(ghpython_script.out)
panel_2 = Panel(ghpython_script.a)

ghpython_script_2 = GhPythonScript()  # -> Out, A

ghpython_script_3 = GhPythonScript(seed=Slider(19, range=0..100), time=Slider(104, range=0..1010))  # -> out, a; inputs seed: Int32, time: Int32
# ---------- ghpython_script_3: Python ----------
import rhinoscriptsyntax as rs#time
#randomness
import random as r
r.seed(seed)


#class
class Walker:
    
    def __init__(self):
        self.x = 0
        self.y = 0
        self.z = 0
        
    def point(self):
        shape = rs.AddPoint(self.x, self.y, self.z)
        return shape
    
    def step(self):
        stepX = r.uniform(-1,1)  #you can pass in floats and other numbers
        stepY = r.uniform(-1,1)
        stepZ = r.uniform(-1,1)
        
        self.x += stepX
        self.y += stepY
        self.z += stepZ

#time
w = Walker()


pList = []
for t in range(time):
    #print t
    w.step()
    pList.append(w.point())

a = pList
print pList
# ---------- end ghpython_script_3 ----------
range = Range(Domain=Domain(0, 1), Steps=10)
interpolate = Interpolate(Vertices=ghpython_script_3.a, Degree=3, Periodic=False, KnotStyle=1)  # -> Curve, Length, Domain
graph_mapper = GraphMapper(range, x0=0, x1=1, y0=0, y1=1, Ox=0.5198886395, Oy=0.1821112037, Px=0.75, Py=0.25, container_name="Parabola")
# Full multiplicity knots at start
# Simple knots
# Full multiplicity knots at end
# P1
# A=0.2*P1+ 0.8*P2
# D=0.2*A + 0.8*B
# P2
# B=0.47*P2 + 0.53*P3
# Full multiplicity knots at start
# E=0.7*B + 0.3*C
# P3
# Full multiplicity knots in the middle
# C=0.8*P3 + 0.2*P4
# P4
# Full multiplicity knots at end
# Compare knot spacing
# GH solution
# VB
# C#
# Python with RhinoCommon Only
# Pythong with RhinoScriptSyntax
# GH solution
# VB
# C#
# Python
# VB
pipe_variable = PipeVariable(Curve=reparameterize(interpolate.Curve), Parameters=range, Radii=graph_mapper, Caps=0)

# ----
# MATH 130/1001 Script: ghPython
# credit: Jake Hebbert and NOC
number_slider = Slider(0, range=0..100)
ghpython_script_4 = GhPythonScript(seed=number_slider, time=Slider(173, range=0..300))  # -> out, a; inputs seed: Int32, time: Int32
# ---------- ghpython_script_4: Python ----------
import rhinoscriptsyntax as rs


#randomness
import random as r
r.seed(seed)


#class
class Walker:
    
    def __init__(self):
        self.x = 0
        self.y = 0
        
        
    def point(self):
        shape = rs.AddPoint(self.x, self.y, 0)
        return shape
    
    def step(self):
        choice = r.randint(0,3)
        if (choice == 0):
            self.x += 1
        elif (choice == 1):
            self.x -= 1
        elif (choice ==2):
            self.y += 1
        else:
            self.y -= 1
        

#time
w = Walker()


pList = []
for t in range(time):
    #print t
    w.step()
    pList.append(w.point())

a = pList
print pList
# ---------- end ghpython_script_4 ----------
panel_3 = Panel(ghpython_script_4.a)
panel_4 = Panel(ghpython_script_4.out)
interpolate_2 = Interpolate(Vertices=ghpython_script_4.a, Degree=3, Periodic=False, KnotStyle=1)  # -> Curve, Length, Domain

ghpython_script_5 = GhPythonScript(seed=Slider(13, range=0..100), time=Slider(10, range=0..10))  # -> out, a; inputs seed: Int32, time: Int32
# ---------- ghpython_script_5: Python ----------
import rhinoscriptsyntax as rs#time
#randomness
import random as r
r.seed(seed)


#class
class Walker:
    
    def __init__(self):
        self.x = 0
        self.y = 0
        
        
    def point(self):
        shape = rs.AddPoint(self.x, self.y, self.x * self.y)
        return shape
    
    def step(self):
        choice = r.randint(0,3)
        if (choice == 0):
            self.x += 1
        elif (choice == 1):
            self.x -= 1
        elif (choice ==2):
            self.y += 1
        else:
            self.y -= 1
        

#time
w = Walker()


pList = []
for t in range(time):
    #print t
    w.step()
    pList.append(w.point())

a = pList
print pList
# ---------- end ghpython_script_5 ----------
range_2 = Range(Domain=Domain(0, 1), Steps=10)
nurbs_curve = NurbsCurve(Vertices=ghpython_script_5.a, Degree=3, Periodic=False)  # -> Curve, Length, Domain
panel_5 = Panel(ghpython_script_5.out)
panel_6 = Panel(ghpython_script_5.a)
graph_mapper_2 = GraphMapper(
    range_2,
    x0=0,
    x1=1,
    y0=0,
    y1=1,
    Ox=0.6414476633,
    Oy=0.2231887579,
    Px=0.8248060942,
    Py=0.3542215228,
    container_name="Parabola")
# rc
pipe_variable_2 = PipeVariable(Curve=reparameterize(nurbs_curve.Curve), Parameters=range_2, Radii=graph_mapper_2, Caps=2)
