# Grasshopper definition Sets132ghPython.gh (Grasshopper 1.0.7)
# Copyright: Wickerson Studios
# plug-ins: Bifocals

# Wickerson Studio
# 
# created by: Michael Wickerson
# 
# Grasshopper for Rhino 3D Algorithmic Modeling
# 
# www.wickersonstudios.com
# www.michaelwickerson.com
# https://www.youtube.com/channel/UC7J48Ppcsa6oncp6d29R0xw
# https://github.com/mwickerson
# https://www.facebook.com/michael.wickerson
# https://www.linkedin.com/in/michael-wickerson-696a80156/
# https://www.grasshopper3d.com/profile/MichaelWickerson
image_sampler = ImageSampler(
    FilePath="C:\Users\Sculpture\Documents\2020Grasshopper\ScreenShots2019\Screenshots2020\SurfaceEditAlgorithm.PNG",
    Filter="Value",
    Interpolate=False,
    Umax=1,
    Umin=0,
    Vmax=1,
    Vmin=0,
    Wrap=1)

ghpython_script = GhPythonScript()  # -> out, a
# ---------- ghpython_script: Python ----------
import rhinoscriptsyntax as rs
import math
#Cann rs.EnableRedraw(False)

listA = []


for t in rs.frange(-10,50,1.25):
    arrPoint = [t * math.sin(15*t), t* math.cos(15*t), t]
    
    print(arrPoint)
    cool = rs.AddPoint(arrPoint)
    
    listA.append(cool)
    
#Call rs.EnableRedraw(True)

a = listA
# ---------- end ghpython_script ----------
param_viewer = ParamViewer(ghpython_script.a)
panel = Panel(ghpython_script.out)
panel_2 = Panel(ghpython_script.a)

# ----
# 1001 GRASSHOPPER DEFINITIONS
# MATH 131/1001 Script: ghPython
# credit: Jake Hebbert and NOC
number_slider = Slider(18, range=0..100)
deconstruct = Deconstruct()  # -> XComponent, YComponent, ZComponent
ghpython_script_2 = GhPythonScript(seed=number_slider, count=Slider(55, range=0..1010), mean=Slider(0, range=0..1), sd=Slider(24, range=0..100))  # -> out, a; inputs seed: Int32, count: Int32
# ---------- ghpython_script_2: Python ----------
import rhinoscriptsyntax as rs
#randomness
import random as r
r.seed(seed)


list = []
for c in range(count):
    rand = r.gauss(mean, sd)
    list.append(rand)

a = list
# ---------- end ghpython_script_2 ----------
ghpython_script_3 = GhPythonScript(seed=Slider(30, range=0..100), count=Slider(31, range=0..1010), mean=Slider(0, range=0..1), sd=Slider(17, range=0..100))  # -> out, a; inputs seed: Int32, count: Int32
# ---------- ghpython_script_3: Python ----------
import rhinoscriptsyntax as rs
#randomness
import random as r
r.seed(seed)



list = []
for c in range(count):
    rand = r.gauss(mean, sd)
    list.append(rand)

a = list
# ---------- end ghpython_script_3 ----------
ghpython_script_4 = GhPythonScript(seed=Slider(46, range=0..100), count=Slider(24, range=0..1010), mean=Slider(0, range=0..1), sd=Slider(20, range=0..100))  # -> out, a; inputs seed: Int32, count: Int32; same code as ghpython_script_3
panel_3 = Panel(ghpython_script_2.a)
construct_point = ConstructPoint(XCoordinate=ghpython_script_2.a, YCoordinate=ghpython_script_3.a, ZCoordinate=ghpython_script_4.a)
bounding_box = BoundingBox(Content=construct_point, Plane=PlaneXY(0, 0, 0), UnionBox=True)  # -> Box, Box_2; disabled
populate_3d = Populate3D(Region=bounding_box.Box, Count=100, Seed=1)  # disabled

range = Range(Domain=Domain(0, 1), Steps=10)
interpolate = Interpolate(Vertices=construct_point, Degree=3, Periodic=False, KnotStyle=1)  # -> Curve, Length, Domain
graph_mapper = GraphMapper(
    range,
    x0=0,
    x1=1,
    y0=0,
    y1=1,
    Ox=0.5566910505,
    Oy=0.07758009434,
    Px=0.6794530749,
    Py=0.3162841797,
    container_name="Parabola")
# rc
# Full multiplicity knots at start
# Simple knots
# Full multiplicity knots at end
# P1
# A=0.2*P1+ 0.8*P2
# D=0.2*A + 0.8*B
# P2
# B=0.47*P2 + 0.53*P3
# Full multiplicity knots at start
# E=0.7*B + 0.3*C
# P3
# Full multiplicity knots in the middle
# C=0.8*P3 + 0.2*P4
# P4
# Full multiplicity knots at end
# Compare knot spacing
# GH solution
# VB
# C#
# Python with RhinoCommon Only
# Pythong with RhinoScriptSyntax
# GH solution
# VB
# C#
# Python
# VB
pipe_variable = PipeVariable(Curve=reparameterize(interpolate.Curve), Parameters=range, Radii=graph_mapper, Caps=2)

voronoi_3d = Voronoi3D(Points=populate_3d)  # -> Cells, Boundary; disabled
voronoi_3d_2 = Voronoi3D(Points=construct_point)  # -> Cells, Boundary
