# Grasshopper definition Sets134ghPython.gh (Grasshopper 1.0.7)
# Copyright: Wickerson Studios
# plug-ins: Bifocals

# 1001 GRASSHOPPER DEFINITIONS
# Wickerson Studio
# 
# created by: Michael Wickerson
# 
# Grasshopper for Rhino 3D Algorithmic Modeling
# 
# www.wickersonstudios.com
# www.michaelwickerson.com
# https://www.youtube.com/channel/UC7J48Ppcsa6oncp6d29R0xw
# https://github.com/mwickerson
# https://www.facebook.com/michael.wickerson
# https://www.linkedin.com/in/michael-wickerson-696a80156/
# https://www.grasshopper3d.com/profile/MichaelWickerson
image_sampler = ImageSampler(
    FilePath="C:\Users\Sculpture\Documents\2020Grasshopper\ScreenShots2019\Screenshots2020\SurfaceEditAlgorithm.PNG",
    Filter="Value",
    Interpolate=False,
    Umax=1,
    Umin=0,
    Vmax=1,
    Vmin=0,
    Wrap=1)

ghpython_script = GhPythonScript()  # -> out, a
# ---------- ghpython_script: Python ----------
import rhinoscriptsyntax as rs
import math
#Cann rs.EnableRedraw(False)

listA = []


for t in rs.frange(-10,50,1.25):
    arrPoint = [t * math.sin(15*t), t* math.cos(15*t), t]
    
    print(arrPoint)
    cool = rs.AddPoint(arrPoint)
    
    listA.append(cool)
    
#Call rs.EnableRedraw(True)

a = listA
# ---------- end ghpython_script ----------
param_viewer = ParamViewer(ghpython_script.a)
panel = Panel(ghpython_script.out)
panel_2 = Panel(ghpython_script.a)

number_slider = Slider(0.06, range=0..1)  # disabled
# MATH 134/1001 Script: ghPython
# credit: Jake Hebbert and NOC
# Perlin Noise
# 2D Noise
number_slider_2 = Slider(15, range=0..100)  # disabled
number_slider_3 = Slider(31, range=0..100)  # disabled
number_slider_4 = Slider(0.17, range=0..1)  # disabled
# 3D Noise
number_slider_5 = Slider(11, range=0..100)  # disabled
number_slider_6 = Slider(0, range=0..1)  # disabled
number_slider_7 = Slider(0.28, range=0..1)  # disabled
ghpython_script_2 = GhPythonScript(x=number_slider_2, y=number_slider_3, scaleX=number_slider_4, scaleY=number_slider_4)  # -> out, a; inputs x: Int32, y: Int32; disabled
# ---------- ghpython_script_2: Python ----------
import rhinoscriptsyntax as rs
import perlin

sn = perlin.SimplexNoise()

pList = []
for i in range(x):
    for j in range(y):
        perVal = sn.noise2(i * scaleX,j * scaleY)
        point = rs.AddPoint(i,j,perVal)
        
        pList.append(point)

a = pList
# ---------- end ghpython_script_2 ----------
ghpython_script_3 = GhPythonScript(
    x=number_slider_5,
    y=number_slider_5,
    z=number_slider_5,
    scaleX=number_slider,
    scaleY=number_slider,
    scaleZ=number_slider,
    lowerLim=number_slider_6,
    upperLim=number_slider_7)  # -> out, a; inputs x: Int32, y: Int32, z: Int32; disabled
# ---------- ghpython_script_3: Python ----------
import rhinoscriptsyntax as rs
import perlin

sn = perlin.SimplexNoise()

pList = []
for i in range(x):
    for j in range(y):
        for k in range(z):
            perVal = sn.noise3(i * scaleX,j * scaleY,k * scaleZ)
        
            if (perVal > lowerLim and perVal < upperLim):
                point = rs.AddPoint(i,j,k)
                pList.append(point)

a = pList
# ---------- end ghpython_script_3 ----------

number_slider_8 = Slider(0.1, range=0..0.1)  # disabled
number_slider_9 = Slider(0.76, range=0..1)  # disabled
deconstruct_vector = DeconstructVector(Vector=ghpython_script_2.a)  # -> XComponent, YComponent, ZComponent; disabled
bounds = Bounds(Numbers=deconstruct_vector.ZComponent)  # disabled
construct_domain = ConstructDomain(DomainStart=number_slider_8, DomainEnd=number_slider_9)  # disabled
construct_point = ConstructPoint(XCoordinate=deconstruct_vector.XComponent, YCoordinate=deconstruct_vector.YComponent, ZCoordinate=0)  # disabled
remap_numbers = RemapNumbers(Value=deconstruct_vector.ZComponent, Source=bounds, Target=construct_domain)  # -> Mapped, Clipped; disabled
sphere = Sphere(Base=construct_point, Radius=remap_numbers.Mapped)  # disabled

panel_3 = Panel(ghpython_script_3.a)  # disabled
point = Point(ghpython_script_3.a)  # disabled

number_slider_10 = Slider(0.5, range=0..1)  # disabled
number_slider_11 = Slider(1, range=0..1)  # disabled
center_box = CenterBox(Base=PlaneXY(0, 0, 0), X=number_slider_10, Y=number_slider_10, Z=number_slider_10)  # disabled
mesh_box = MeshBox(Base=center_box, XCount=number_slider_11, YCount=number_slider_11, ZCount=number_slider_11)  # disabled
move = Move(Geometry=mesh_box, Motion=point)  # -> Geometry, Transform; disabled
colour_swatch = ColourSwatch(SwatchColor=RGB(15, 166, 196))  # disabled
# rc
# Full multiplicity knots at start
# Simple knots
# Full multiplicity knots at end
# P1
# A=0.2*P1+ 0.8*P2
# D=0.2*A + 0.8*B
# P2
# B=0.47*P2 + 0.53*P3
# Full multiplicity knots at start
# E=0.7*B + 0.3*C
# P3
# Full multiplicity knots in the middle
# C=0.8*P3 + 0.2*P4
# P4
# Full multiplicity knots at end
# Compare knot spacing
# GH solution
# VB
# C#
# Python with RhinoCommon Only
# Pythong with RhinoScriptSyntax
# GH solution
# VB
# C#
# Python
# VB
custom_preview = CustomPreview(Geometry=move.Geometry, Material=colour_swatch)  # disabled

surface_from_points = SurfaceFromPoints(Points=ghpython_script_2.a, UCount=number_slider_2, Interpolate=False)  # disabled
