# Grasshopper definition Sets135ghPython.gh (Grasshopper 1.0.7)
# Copyright: Wickerson Studios
# plug-ins: Fologram For Grasshopper Utilities, Bifocals

# 1001 GRASSHOPPER DEFINITIONS
# Wickerson Studio
# 
# created by: Michael Wickerson
# 
# Grasshopper for Rhino 3D Algorithmic Modeling
# 
# www.wickersonstudios.com
# www.michaelwickerson.com
# https://www.youtube.com/channel/UC7J48Ppcsa6oncp6d29R0xw
# https://github.com/mwickerson
# https://www.facebook.com/michael.wickerson
# https://www.linkedin.com/in/michael-wickerson-696a80156/
# https://www.grasshopper3d.com/profile/MichaelWickerson
image_sampler = ImageSampler(
    FilePath="C:\Users\Sculpture\Documents\2020Grasshopper\ScreenShots2019\Screenshots2020\SurfaceEditAlgorithm.PNG",
    Filter="Value",
    Interpolate=False,
    Umax=1,
    Umin=0,
    Vmax=1,
    Vmin=0,
    Wrap=1)

ghpython_script = GhPythonScript()  # -> out, a
# ---------- ghpython_script: Python ----------
import rhinoscriptsyntax as rs
import math
#Cann rs.EnableRedraw(False)

listA = []


for t in rs.frange(-10,50,1.25):
    arrPoint = [t * math.sin(15*t), t* math.cos(15*t), t]
    
    print(arrPoint)
    cool = rs.AddPoint(arrPoint)
    
    listA.append(cool)
    
#Call rs.EnableRedraw(True)

a = listA
# ---------- end ghpython_script ----------
param_viewer = ParamViewer(ghpython_script.a)
panel = Panel(ghpython_script.out)
panel_2 = Panel(ghpython_script.a)

vector = Vector(Vector(1, 2, 0))
timer = Timer(TimerInterval=20, Target=counter)
counter = Counter(Reset=Toggle(True))
ghpython_script_2 = GhPythonScript(time=Slider(1000, range=0..1000), velocity=vector)  # -> out, a; inputs time: Int32, velocity: Vector3d
# ---------- ghpython_script_2: Python ----------
import rhinoscriptsyntax as rs


pos = [50,50,0]
#print pos[0]
#print pos[1]
#print pos[2]

upperBounds = 90

vel = velocity

print vel

tlist = []
for t in range(time):
    pos = rs.VectorAdd(pos, vel)
    
    if ((pos[0] < 0) or (pos[0] > upperBounds)):
        vel[0] *= -1
    if ((pos[1] < 0) or (pos[1] > upperBounds)):
        vel[1] *= -1
        
    sph = rs.AddPoint(pos)
    tlist.append(sph)

a = tlist
# ---------- end ghpython_script_2 ----------
panel_3 = Panel(counter)
list_item = ListItem(List=ghpython_script_2.a, Index=counter, Wrap=True)
sphere = Sphere(Base=list_item, Radius=Slider(14, range=0..100))

# ----
# 3D
number_slider = Slider(1058, range=0..10000)
point = Point(Point(2, 4, 3))
vector_2 = Vector(point)
timer_2 = Timer(TimerInterval=20, Target=counter_2)
counter_2 = Counter(Reset=Toggle(False))
ghpython_script_3 = GhPythonScript(time=number_slider, velocity=vector_2)  # -> out, a; inputs time: Int32, velocity: Vector3d
# ---------- ghpython_script_3: Python ----------
import rhinoscriptsyntax as rs


pos = [50,50,0]
#print pos[0]
#print pos[1]
#print pos[2]

upperBounds = 90

vel = velocity

print vel

tlist = []
for t in range(time):
    pos = rs.VectorAdd(pos, vel)
    
    if ((pos[0] < 0) or (pos[0] > upperBounds)):
        vel[0] *= -1
    if ((pos[1] < 0) or (pos[1] > upperBounds)):
        vel[1] *= -1
    if ((pos[2] < 0) or (pos[2] > upperBounds)):
        vel[2] *= -1
        
    sph = rs.AddPoint(pos)
    tlist.append(sph)

a = tlist
# ---------- end ghpython_script_3 ----------
panel_4 = Panel(counter_2)
list_item_2 = ListItem(List=ghpython_script_3.a, Index=counter_2, Wrap=True)
sphere_2 = Sphere(Base=list_item_2, Radius=Slider(15, range=0..100))

# ----
# Efficiency!
number_slider_2 = Slider(1000, range=0..1000)
timer_3 = Timer(TimerInterval=20, Target=counter_3)
counter_3 = Counter(Reset=Toggle(True))
ghpython_script_4 = GhPythonScript(time=number_slider_2)  # -> out, a; inputs time: Int32
# ---------- ghpython_script_4: Python ----------
import rhinoscriptsyntax as rs


x = 50
y = 50

xSpeed = 1
ySpeed = 3

upperBounds = 90

list = []
for t in range(time):
    x += xSpeed
    y += ySpeed
    
    if x < 0 or x > upperBounds:
        xSpeed *= -1
    if y < 0 or y > upperBounds:
        ySpeed *= -1
        
    sph = rs.AddSphere([x,y,0], 10)
    list.append(sph)

a = list
# ---------- end ghpython_script_4 ----------
panel_5 = Panel(counter_3)
list_item_3 = ListItem(List=ghpython_script_4.a, Index=counter_3, Wrap=True)

point_2 = Point(<point referenced from the Rhino model>)
vector_3 = Vector(point)
timer_4 = Timer(TimerInterval=20, Target=counter_4)
counter_4 = Counter(Reset=Toggle(True))
ghpython_script_5 = GhPythonScript(time=Slider(1058, range=0..10000), velocity=vector_3)  # -> out, a; inputs time: Int32, velocity: Vector3d
# ---------- ghpython_script_5: Python ----------
import rhinoscriptsyntax as rs


pos = [50,50,0]
#print pos[0]
#print pos[1]
#print pos[2]

upperBounds = 90

vel = velocity

print vel

tlist = []
for t in range(time):
    pos = rs.VectorAdd(pos, vel)
    
    
    for i in range(3):
        if ((pos[i] < 0) or (pos[i] > upperBounds)):
            vel[i] *= -1
        
    sph = rs.AddPoint(pos)
    tlist.append(sph)

a = tlist
# ---------- end ghpython_script_5 ----------
panel_6 = Panel(counter_4)
list_item_4 = ListItem(List=ghpython_script_5.a, Index=counter_4, Wrap=True)
# Full multiplicity knots at start
# Simple knots
# Full multiplicity knots at end
# P1
# A=0.2*P1+ 0.8*P2
# D=0.2*A + 0.8*B
# P2
# B=0.47*P2 + 0.53*P3
# Full multiplicity knots at start
# E=0.7*B + 0.3*C
# P3
# Full multiplicity knots in the middle
# C=0.8*P3 + 0.2*P4
# P4
# Full multiplicity knots at end
# Compare knot spacing
# GH solution
# VB
# C#
# Python with RhinoCommon Only
# Pythong with RhinoScriptSyntax
# GH solution
# VB
# C#
# Python
# VB
sphere_3 = Sphere(Base=list_item_4, Radius=Slider(8, range=0..100))

# ----
# MATH 135/1001 Script: ghPython
# credit: Jake Hebbert and NOC
number_slider_3 = Slider(349, range=0..1000)
timer_5 = Timer(TimerInterval=50, Target=counter_5)
counter_5 = Counter(Reset=Toggle(True))
ghpython_script_6 = GhPythonScript(time=counter_5)  # -> out, a; inputs time: Int32
# ---------- ghpython_script_6: Python ----------
import rhinoscriptsyntax as rs


x = 50
y = 50

xSpeed = 1
ySpeed = 3

upperBounds = 90


for t in range(time):
    x += xSpeed
    y += ySpeed
    
    if x < 0 or x > upperBounds:
        xSpeed *= -1
    if y < 0 or y > upperBounds:
        ySpeed *= -1

a = rs.AddSphere([x,y,0], 10)
# ---------- end ghpython_script_6 ----------
panel_7 = Panel(counter_5)
geometry = Geometry(ghpython_script_6.a)

# ----
# rc
mesh_sphere = MeshSphere(Base=PlaneXY(0, 0, 0), Radius=10, UCount=10, VCount=20)
