# Grasshopper definition Sets136ghPython.gh (Grasshopper 1.0.7)
# Copyright: Wickerson Studios
# plug-ins: Bifocals

# 1001 GRASSHOPPER DEFINITIONS
# Wickerson Studio
# 
# created by: Michael Wickerson
# 
# Grasshopper for Rhino 3D Algorithmic Modeling
# 
# www.wickersonstudios.com
# www.michaelwickerson.com
# https://www.youtube.com/channel/UC7J48Ppcsa6oncp6d29R0xw
# https://github.com/mwickerson
# https://www.facebook.com/michael.wickerson
# https://www.linkedin.com/in/michael-wickerson-696a80156/
# https://www.grasshopper3d.com/profile/MichaelWickerson
image_sampler = ImageSampler(
    FilePath="C:\Users\Sculpture\Documents\2020Grasshopper\ScreenShots2019\Screenshots2020\SurfaceEditAlgorithm.PNG",
    Filter="Value",
    Interpolate=False,
    Umax=1,
    Umin=0,
    Vmax=1,
    Vmin=0,
    Wrap=1)

ghpython_script = GhPythonScript()  # -> out, a
# ---------- ghpython_script: Python ----------
import rhinoscriptsyntax as rs
import math
#Cann rs.EnableRedraw(False)

listA = []


for t in rs.frange(-10,50,1.25):
    arrPoint = [t * math.sin(15*t), t* math.cos(15*t), t]
    
    print(arrPoint)
    cool = rs.AddPoint(arrPoint)
    
    listA.append(cool)
    
#Call rs.EnableRedraw(True)

a = listA
# ---------- end ghpython_script ----------
# rc
# Full multiplicity knots at start
# Simple knots
# Full multiplicity knots at end
# P1
# A=0.2*P1+ 0.8*P2
# D=0.2*A + 0.8*B
# P2
# B=0.47*P2 + 0.53*P3
# Full multiplicity knots at start
# E=0.7*B + 0.3*C
# P3
# Full multiplicity knots in the middle
# C=0.8*P3 + 0.2*P4
# P4
# Full multiplicity knots at end
# Compare knot spacing
# GH solution
# VB
# C#
# Python with RhinoCommon Only
# Pythong with RhinoScriptSyntax
# GH solution
# VB
# C#
# Python
# VB
param_viewer = ParamViewer(ghpython_script.a)
# MATH 136/1001 Script: ghPython
# credit: Jake Hebbert and NOC
panel = Panel(ghpython_script.out)
panel_2 = Panel(ghpython_script.a)
