# Grasshopper definition Sets137MAXADJUSTMENTParametricBubbleCar002.gh (Grasshopper 1.0.7)
# Copyright: Wickerson Studios
# plug-ins: Bifocals

# 1001 GRASSHOPPER DEFINITIONS
# Wickerson Studio
# 
# created by: Michael Wickerson
# 
# Grasshopper for Rhino 3D Algorithmic Modeling
# 
# www.wickersonstudios.com
# www.michaelwickerson.com
# https://www.youtube.com/channel/UC7J48Ppcsa6oncp6d29R0xw
# https://github.com/mwickerson
# https://www.facebook.com/michael.wickerson
# https://www.linkedin.com/in/michael-wickerson-696a80156/
# https://www.grasshopper3d.com/profile/MichaelWickerson
image_sampler = ImageSampler(
    FilePath="C:\Users\Sculpture\Documents\2020Grasshopper\ScreenShots2019\Screenshots2020\SurfaceEditAlgorithm.PNG",
    Filter="Value",
    Interpolate=False,
    Umax=1,
    Umin=0,
    Vmax=1,
    Vmin=0,
    Wrap=1)

# ----
# SURFACE CREASE
number_slider = Slider(30, range=0..100)
construct_point = ConstructPoint(XCoordinate=0, YCoordinate=0, ZCoordinate=0)
unit_x = UnitX(Factor=number_slider)
# MATH 137/1001
# Parametric Bubble Car
# Inspired by: R.K.C.Cheng
move = Move(Geometry=construct_point, Motion=unit_x)  # -> Geometry, Transform
line = Line(StartPoint=construct_point, EndPoint=move.Geometry)
end_points = EndPoints(Curve=line)  # -> Start, End
division = Division(A=number_slider, B=Slider(2.763, range=0..10))
unit_y = UnitY(Factor=division)
negative = Negative(Value=unit_y)
move_2 = Move(Geometry=construct_point, Motion=[unit_y, negative])  # -> Geometry, Transform
line_2 = Line(StartPoint=construct_point, EndPoint=move_2.Geometry)
join_curves = JoinCurves(Curves=line_2, Preserve=False)
end_points_2 = EndPoints(Curve=join_curves)  # -> Start, End
division_2 = Division(A=number_slider, B=Slider(2, range=0..10))
unit_y_2 = UnitY(Factor=division_2)
negative_2 = Negative(Value=unit_y_2)
move_3 = Move(Geometry=end_points.End, Motion=[unit_y_2, negative_2])  # -> Geometry, Transform
line_3 = Line(StartPoint=end_points.End, EndPoint=move_3.Geometry)
join_curves_2 = JoinCurves(Curves=line_3, Preserve=False)
end_points_3 = EndPoints(Curve=join_curves_2)  # -> Start, End

division_3 = Division(A=number_slider, B=Slider(4.102, range=0..10))
point = Point(end_points_2.End)
unit_y_3 = UnitY(Factor=division_3)
move_4 = Move(Geometry=point, Motion=unit_y_3)  # -> Geometry, Transform
line_4 = Line(StartPoint=move_4.Geometry, EndPoint=point)

# ----
# REVOLVE
number_slider_2 = Slider(1.065, range=0..10)
division_4 = Division(A=division_3, B=number_slider_2)
pi = Pi(Factor=Slider(0.384, range=0..1))
range = Range(Domain=division_3, Steps=10)
multiplication = Multiplication(A=range, B=pi)
sine = Sine(Value=multiplication)
negative_3 = Negative(Value=sine)
vector_xyz = VectorXYZ(XComponent=range, YComponent=negative_3, ZComponent=0)  # -> Vector, Length
end_points_4 = EndPoints(Curve=line_4)  # -> Start, End
negative_4 = Negative(Value=vector_xyz.Vector)
move_5 = Move(Geometry=point, Motion=negative_4)  # -> Geometry, Transform
list_item = ListItem(List=move_5.Geometry, Index="-1", Wrap=True)
point_2 = Point(list_item)
division_5 = Division(A=number_slider, B=Slider(17, range=0..100))
unit_x_2 = UnitX(Factor=division_4)
unit_y_4 = UnitY(Factor=division_5)
negative_5 = Negative(Value=unit_x_2)
interpolate = Interpolate(Vertices=move_5.Geometry, Degree=3, Periodic=False, KnotStyle=1)  # -> Curve, Length, Domain
move_6 = Move(Geometry=list_item, Motion=unit_y_4)  # -> Geometry, Transform
point_3 = Point(move_6.Geometry)
line_5 = Line(StartPoint=point_2, EndPoint=point_3)
curve_middle = CurveMiddle(Curve=line_5)
move_7 = Move(Geometry=curve_middle, Motion=negative_5)  # -> Geometry, Transform
end_points_5 = EndPoints(Curve=interpolate.Curve)  # -> Start, End
line_6 = Line(StartPoint=list_item, EndPoint=move_6.Geometry)
end_points_6 = EndPoints(Curve=line_6)  # -> Start, End
arc_3pt = Arc3Pt(PointA=point_2, PointB=move_7.Geometry, PointC=point_3)  # -> Arc, Plane, Radius
line_7 = Line(StartPoint=end_points_6.End, EndPoint=end_points_4.Start)
merge = Merge(Data1=line_6, Data2=arc_3pt.Arc)
merge_2 = Merge(Data1=interpolate.Curve, Data2=line_6, Data3=line_7)
join_curves_3 = JoinCurves(Curves=merge, Preserve=False)
join_curves_4 = JoinCurves(Curves=merge_2, Preserve=False)
merge_3 = Merge(Data1=join_curves_4, Data2=join_curves_3)
revolution = Revolution(Curve=merge_3, Axis=line_4, Domain=Domain(0, 6.283185307))
construct_point_2 = ConstructPoint(XCoordinate=0, YCoordinate=0, ZCoordinate=0)
orient = Orient(Geometry=revolution, Source=end_points_4.Start, Target=end_points_3.End)  # -> Geometry, Transform
merge_4 = Merge(Data1=revolution, Data2=orient.Geometry)
xz_plane = XZPlane(Origin=construct_point_2)
mirror = Mirror(Geometry=merge_4, Plane=xz_plane)  # -> Geometry, Transform

# ----
# CHASSIS
curve = Curve(line_3)
join_curves_5 = JoinCurves(Curves=curve, Preserve=False)
end_points_7 = EndPoints(Curve=join_curves_5)  # -> Start, End
curve_middle_2 = CurveMiddle(Curve=join_curves_5)
number_slider_3 = Slider(1, range=0..1)
list_item_2 = ListItem(List=end_points_7.End, Index=0, Wrap=True)
xz_plane_2 = XZPlane(Origin=list_item_2)
circle = Circle(Plane=xz_plane_2, Radius=number_slider_3)
division_6 = Division(A=number_slider, B=Slider(2.55, range=0..4))
sphere = Sphere(Base=[end_points_7.Start, end_points_7.End], Radius=1)
sweep1 = Sweep1(Rail=join_curves_5, Sections=circle, Miter=1)
unit_x_3 = UnitX(Factor=division_6)
cap_holes = CapHoles(Brep=sweep1)
negative_6 = Negative(Value=unit_x_3)
move_8 = Move(Geometry=cap_holes, Motion=[unit_x_3, negative_6])  # -> Geometry, Transform
scale = Scale(Geometry=move_8.Geometry, Center=curve_middle_2, Factor=Slider(0.37, range=0..1))  # -> Geometry, Transform
cap_holes_2 = CapHoles(Brep=scale.Geometry)
dispatch = Dispatch(List=cap_holes_2, DispatchPattern=[True, False])  # -> ListA, ListB
volume = Volume(Geometry=dispatch.ListB)  # -> Volume, Centroid
scale_2 = Scale(Geometry=dispatch.ListB, Center=volume.Centroid, Factor=Slider(2, range=0..2))  # -> Geometry, Transform
deconstruct_brep = DeconstructBrep(Brep=[dispatch.ListA, scale_2.Geometry])  # -> Faces, Edges, Vertices
list_item_3 = ListItem(List=deconstruct_brep.Faces, Index=0, Wrap=True)  # -> flatten(Item)
dispatch_2 = Dispatch(List=list_item_3, DispatchPattern=[True, False])  # -> ListA, ListB
area = Area(Geometry=dispatch_2.ListA)  # -> Area, Centroid
area_2 = Area(Geometry=dispatch_2.ListB)  # -> Area, Centroid
line_8 = Line(StartPoint=area.Centroid, EndPoint=area_2.Centroid)
end_points_8 = EndPoints(Curve=line_8)  # -> Start, End
list_item_4 = ListItem(List=end_points_8.Start, Index=0, Wrap=True)
x_size = XSize(Domain(-0.5, 0.5))
yz_plane = YZPlane(Origin=list_item_4)
rectangle = Rectangle(Plane=yz_plane, XSize=x_size, YSize=x_size, Radius=0)  # -> Rectangle, Length
sweep1_2 = Sweep1(Rail=line_8, Sections=rectangle.Rectangle, Miter=1)
cap_holes_3 = CapHoles(Brep=sweep1_2)

construct_domain = ConstructDomain(DomainStart=Slider(100, range=0..100), DomainEnd=Slider(0, range=0..20))
deconstruct_brep_2 = DeconstructBrep(Brep=cap_holes_3)  # -> Faces, Edges, Vertices
range_2 = Range(Domain=construct_domain, Steps=Slider(3, range=0..10))
list_item_5 = ListItem(List=deconstruct_brep_2.Faces, Index=0, Wrap=True)
geometry = Geometry(list_item_5)
graph_mapper = GraphMapper(
    range_2,
    x0=0,
    x1=10,
    y0=0,
    y1=10,
    amplitude=0.3130012155,
    container_name="Perlin",
    decay=0.2702232599,
    frequency=0.1587575078,
    x_offset=0.5,
    y_offset=0.5)
area_3 = Area(Geometry=geometry)  # -> Area, Centroid
vector_xyz_2 = VectorXYZ(XComponent=range_2, YComponent=graph_mapper, ZComponent=0)  # -> Vector, Length
negative_7 = Negative(Value=vector_xyz_2.Vector)
move_9 = Move(Geometry=area_3.Centroid, Motion=negative_7)  # -> Geometry, Transform
interpolate_2 = Interpolate(Vertices=move_9.Geometry, Degree=3, Periodic=False, KnotStyle=1)  # -> Curve, Length, Domain
end_points_9 = EndPoints(Curve=interpolate_2.Curve)  # -> Start, End
orient_2 = Orient(Geometry=interpolate_2.Curve, Source=end_points_9.Start, Target=area_3.Centroid)  # -> Geometry, Transform
sweep1_3 = Sweep1(Rail=orient_2.Geometry, Sections=geometry, Miter=1)
cap_holes_4 = CapHoles(Brep=sweep1_3)
deconstruct_brep_3 = DeconstructBrep(Brep=cap_holes_4)  # -> Faces, Edges, Vertices
curve_middle_3 = CurveMiddle(Curve=line)
merge_5 = Merge(Data1=cap_holes_3, Data2=cap_holes_4)
list_item_6 = ListItem(List=deconstruct_brep_3.Faces, Index=0, Wrap=True)
xz_plane_3 = XZPlane(Origin=curve_middle_3)
area_4 = Area(Geometry=list_item_6)  # -> Area, Centroid
mirror_2 = Mirror(Geometry=merge_5, Plane=xz_plane_3)  # -> Geometry, Transform
dispatch_3 = Dispatch(List=flatten(mirror_2.Geometry), DispatchPattern=[True, False])  # -> ListA, ListB
deconstruct_brep_4 = DeconstructBrep(Brep=dispatch_3.ListB)  # -> Faces, Edges, Vertices
list_item_7 = ListItem(List=deconstruct_brep_4.Faces, Index=0, Wrap=True)
area_5 = Area(Geometry=list_item_7)  # -> Area, Centroid
line_9 = Line(StartPoint=area_4.Centroid, EndPoint=area_5.Centroid)
pipe = Pipe(Curve=line_9, Radius=number_slider_3, Caps=1)

end_points_10 = EndPoints(Curve=line_9)  # -> Start, End
construct_domain_2 = ConstructDomain(DomainStart=0, DomainEnd=Slider(10, range=0..10))
number_slider_4 = Slider(10, range=0..10)
curve_middle_4 = CurveMiddle(Curve=line_9)
point_on_curve = PointOnCurve(line_9, parameter=0.247)
point_4 = Point(end_points_10.End)
range_3 = Range(Domain=construct_domain_2, Steps=Slider(10, range=0..10))
sine_2 = Sine(Value=range_3)
multiplication_2 = Multiplication(A=range_3, B=number_slider_4)
deconstruct_brep_5 = DeconstructBrep(Brep=pipe)  # -> Faces, Edges, Vertices
multiplication_3 = Multiplication(A=sine_2, B=number_slider_4)
vector_xyz_3 = VectorXYZ(XComponent=0, YComponent=multiplication_2, ZComponent=multiplication_3)  # -> Vector, Length
list_item_8 = ListItem(List=deconstruct_brep_5.Faces, Index=Slider(2, range=0..2), Wrap=True)
negative_8 = Negative(Value=vector_xyz_3.Vector)
geometry_2 = Geometry(list_item_8)
move_10 = Move(Geometry=point_4, Motion=negative_8)  # -> Geometry, Transform
nurbs_curve = NurbsCurve(Vertices=move_10.Geometry, Degree=3, Periodic=False)  # -> Curve, Length, Domain
sweep1_4 = Sweep1(Rail=nurbs_curve.Curve, Sections=geometry_2, Miter=1)
cap_holes_5 = CapHoles(Brep=sweep1_4)
negative_9 = Negative(Value=Slider(1, range=0..1))
orient_3 = Orient(Geometry=cap_holes_5, Source=point_4, Target=curve_middle_4)  # -> Geometry, Transform
unit_y_5 = UnitY(Factor=1)
pi_2 = Pi(Factor=negative_9)
pi_3 = Pi(Factor=Slider(0, range=0..1))
rotate_3d = Rotate3D(Geometry=orient_3.Geometry, Angle=pi_2, Center=curve_middle_4, Axis=Vector(0, 0, 1))  # -> Geometry, Transform
line_sdl = LineSDL(Start=curve_middle_4, Direction=unit_y_5, Length=1)
rotate_3d_2 = Rotate3D(Geometry=rotate_3d.Geometry, Angle=pi_3, Center=curve_middle_4, Axis=line_sdl)  # -> Geometry, Transform
deconstruct_brep_6 = DeconstructBrep(Brep=rotate_3d_2.Geometry)  # -> Faces, Edges, Vertices
list_item_9 = ListItem(List=deconstruct_brep_6.Faces, Index=0, Wrap=True)
volume_2 = Volume(Geometry=pipe)  # -> Volume, Centroid
area_6 = Area(Geometry=list_item_9)  # -> Area, Centroid
orient_4 = Orient(Geometry=pipe, Source=volume_2.Centroid, Target=area_6.Centroid)  # -> Geometry, Transform
deconstruct_brep_7 = DeconstructBrep(Brep=orient_4.Geometry)  # -> Faces, Edges, Vertices
list_item_10 = ListItem(List=deconstruct_brep_7.Faces, Index=Slider(2, range=0..10), Wrap=True)
panel = Panel("""4
0""")
divide_curve = DivideCurve(Curve=list_item_10, Count=10, Kinks=False)  # -> Points, Tangents, Parameters
list_item_11 = ListItem(List=divide_curve.Points, Index=panel, Wrap=True)
deconstruct_brep_8 = DeconstructBrep(Brep=revolution)  # -> flatten(Faces), Edges, Vertices
list_item_12 = ListItem(List=deconstruct_brep_8.Faces, Index=Slider(3, range=0..10), Wrap=True)
geometry_3 = Geometry(list_item_12)
surface_closest_point = SurfaceClosestPoint(Point=list_item_11, Surface=geometry_3)  # -> Point, UVPoint, Distance
dispatch_4 = Dispatch(List=surface_closest_point.Point, DispatchPattern=[True, False])  # -> ListA, ListB
line_10 = Line(StartPoint=dispatch_4.ListA, EndPoint=dispatch_4.ListB)
point_on_curve_2 = PointOnCurve(line_10, parameter=0.711)
unit_z = UnitZ(Factor=Slider(0.08, range=0..0.1))
surface_closest_point_2 = SurfaceClosestPoint(Point=point_on_curve_2, Surface=geometry_3)  # -> Point, UVPoint, Distance
move_11 = Move(Geometry=surface_closest_point_2.Point, Motion=unit_z)  # -> Geometry, Transform
arc_3pt_2 = Arc3Pt(PointA=dispatch_4.ListA, PointB=move_11.Geometry, PointC=dispatch_4.ListB)  # -> Arc, Plane, Radius
scale_3 = Scale(Geometry=arc_3pt_2.Arc, Center=surface_closest_point_2.Point, Factor=Slider(30, range=0..30))  # -> Geometry, Transform
area_7 = Area(Geometry=list_item_10)  # -> Area, Centroid
list_item_13 = ListItem(List=divide_curve.Points, Index=0, Wrap=True)
orient_5 = Orient(Geometry=scale_3.Geometry, Source=point_on_curve_2, Target=list_item_13)  # -> Geometry, Transform
unit_y_6 = UnitY(Factor=Slider(7.76, range=0..10))
negative_10 = Negative(Value=unit_y_6)
md_slider = MDSlider(SliderMode=0, slider_value=Point(0.5, 0.5, 0.5), x_domain=Domain(0, 1), y_domain=Domain(0, 1), z_domain=Domain(0, 1))
extrude = Extrude(Base=orient_5.Geometry, Direction=negative_10)
evaluate_surface = EvaluateSurface(Surface=reparameterize(extrude), Point=md_slider)  # -> Point, Normal, UDirection, VDirection, Frame
multiplication_4 = Multiplication(A=Slider(0.36, range=0..2), B=evaluate_surface.Normal)
volume_3 = Volume(Geometry=orient_4.Geometry)  # -> Volume, Centroid
xy_plane = XYPlane(Origin=Point(0, 0, 0))
extrude_2 = Extrude(Base=extrude, Direction=multiplication_4)
construct_plane = ConstructPlane(Origin=volume_3.Centroid, XAxis=Vector(1, 0, 0), YAxis=xy_plane)
mirror_3 = Mirror(Geometry=extrude_2, Plane=construct_plane)  # -> Geometry, Transform
sphere_2 = Sphere(Base=deconstruct_brep_7.Vertices, Radius=Slider(1.71, range=0..10))
merge_6 = Merge(Data1=rotate_3d_2.Geometry, Data2=sweep1_4, Data3=orient_4.Geometry, Data4=extrude_2, Data5=mirror_3.Geometry)

# ----
# REAR AXLE
number_slider_5 = Slider(10, range=0..10)
geometry_4 = Geometry(join_curves)
divide_curve_2 = DivideCurve(Curve=geometry_4, Count=number_slider_5, Kinks=False)  # -> Points, Tangents, Parameters
number_slider_6 = Slider(0.77, range=0..10)
list_item_14 = ListItem(List=divide_curve_2.Points, Index=0, Wrap=True)
list_item_15 = ListItem(List=divide_curve_2.Points, Index=0, Wrap=True)  # -> Item, Item1, Item2
division_7 = Division(A=list_item_15.Item2, B=number_slider_6)
division_8 = Division(A=list_item_15.Item1, B=number_slider_6)
list_item_16 = ListItem(List=divide_curve_2.Points, Index="-1", Wrap=True)
unit_x_4 = UnitX(Factor=division_7)
unit_x_5 = UnitX(Factor=division_8)
unit_x_6 = UnitX(Factor=division_7)
unit_x_7 = UnitX(Factor=division_7)
move_12 = Move(Geometry=division_7, Motion=unit_x_5)  # -> Geometry, Transform
move_13 = Move(Geometry=division_8, Motion=unit_x_6)  # -> Geometry, Transform
move_14 = Move(Geometry=list_item_16, Motion=unit_x_4)  # -> Geometry, Transform
move_15 = Move(Geometry=list_item_14, Motion=unit_x_7)  # -> Geometry, Transform
merge_7 = Merge(Data1=move_15.Geometry, Data2=move_13.Geometry, Data3=move_12.Geometry, Data4=move_14.Geometry)
polyline = PolyLine(Vertices=merge_7, Closed=False)
revolution_2 = Revolution(Curve=polyline, Axis=geometry_4, Domain=Domain(0, 6.283185307))
cap_holes_6 = CapHoles(Brep=revolution_2)

# ----
# REAR SUSPENSION
number_slider_7 = Slider(3, range=0..10)
deconstruct_brep_9 = DeconstructBrep(Brep=cap_holes_4)  # -> Faces, Edges, Vertices
list_item_17 = ListItem(List=deconstruct_brep_9.Faces, Index=0, Wrap=True)
unit_x_8 = UnitX(Factor=number_slider_7)
negative_11 = Negative(Value=unit_x_8)
number_slider_8 = Slider(5, range=0..10)
extrude_3 = Extrude(Base=list_item_17, Direction=negative_11)
deconstruct_brep_10 = DeconstructBrep(Brep=extrude_3)  # -> Faces, Edges, Vertices
list_item_18 = ListItem(List=deconstruct_brep_10.Faces, Index=number_slider_8, Wrap=True)
area_8 = Area(Geometry=list_item_18)  # -> Area, Centroid
unit_x_9 = UnitX(Factor=Slider(6, range=0..10))
scale_4 = Scale(Geometry=list_item_18, Center=area_8.Centroid, Factor=0.5)  # -> Geometry, Transform
negative_12 = Negative(Value=unit_x_9)
extrude_4 = Extrude(Base=scale_4.Geometry, Direction=negative_12)
deconstruct_brep_11 = DeconstructBrep(Brep=extrude_4)  # -> Faces, Edges, Vertices
list_item_19 = ListItem(List=deconstruct_brep_11.Faces, Index=number_slider_8, Wrap=True)
area_9 = Area(Geometry=list_item_19)  # -> Area, Centroid
list_item_20 = ListItem(List=deconstruct_brep_7.Faces, Index=0, Wrap=True)  # -> Item, Item1, Item2
md_slider_2 = MDSlider(
    SliderMode=0,
    slider_value=Point(0, 0.3044016768, 0.5),
    x_domain=Domain(0, 1),
    y_domain=Domain(0, 1),
    z_domain=Domain(0, 1))
surface_closest_point_3 = SurfaceClosestPoint(Point=area_9.Centroid, Surface=list_item_20.Item)  # -> Point, UVPoint, Distance
geometry_5 = Geometry(list_item_20.Item1)
area_10 = Area(Geometry=geometry_5)  # -> Area, Centroid
evaluate_surface_2 = EvaluateSurface(Surface=reparameterize(list_item_20.Item), Point=md_slider_2)  # -> Point, Normal, UDirection, VDirection, Frame
line_11 = Line(StartPoint=area_9.Centroid, EndPoint=surface_closest_point_3.Point)
divide_curve_3 = DivideCurve(Curve=line_11, Count=10, Kinks=False)  # -> Points, Tangents, Parameters
point_5 = Point(evaluate_surface_2.Point)
interpolate_3 = Interpolate(Vertices=divide_curve_3.Points, Degree=3, Periodic=False, KnotStyle=1)  # -> Curve, Length, Domain
list_length = ListLength(List=divide_curve_3.Points)
division_9 = Division(A=list_length, B="2")
split_list = SplitList(List=divide_curve_3.Points, Index=division_9)  # -> ListA, ListB
vector_2pt = Vector2Pt(PointA=area_10.Centroid, PointB=point_5, Unitize=False)  # -> Vector, Length
vector_2pt_2 = Vector2Pt(PointA=area_10.Centroid, PointB=point_5, Unitize=False)  # -> Vector, Length
point_6 = Point(split_list.ListB)
point_7 = Point(split_list.ListA)
multiplication_5 = Multiplication(A=vector_2pt_2.Vector, B="2")
move_16 = Move(Geometry=point_7, Motion=vector_2pt.Vector)  # -> Geometry, Transform
move_17 = Move(Geometry=point_6, Motion=multiplication_5)  # -> Geometry, Transform
polyline_2 = PolyLine(Vertices=[move_16.Geometry, move_17.Geometry], Closed=False)
revolution_3 = Revolution(Curve=polyline_2, Axis=interpolate_3.Curve, Domain=Domain(0, 6.283185307))
cap_holes_7 = CapHoles(Brep=revolution_3)
xy_plane_2 = XYPlane(Origin=Point(0, 0, 0))
merge_8 = Merge(Data1=extrude_3, Data2=extrude_4)
merge_9 = Merge(Data1=merge_8, Data2=cap_holes_7)
construct_plane_2 = ConstructPlane(Origin=Point(0, 0, 0), XAxis=Vector(1, 0, 0), YAxis=xy_plane_2)
mirror_4 = Mirror(Geometry=merge_9, Plane=construct_plane_2)  # -> Geometry, Transform
merge_10 = Merge(Data1=merge_9, Data2=mirror_4.Geometry)
geometry_6 = Geometry(dispatch_3.ListB)
geometry_7 = Geometry(pipe)
volume_4 = Volume(Geometry=[geometry_6, geometry_7])  # -> Volume, Centroid
circle_2 = Circle(Plane=volume_4.Centroid, Radius=Slider(0.3, range=0..1))
boundary_surfaces = BoundarySurfaces(Edges=circle_2)
unit_z_2 = UnitZ(Factor=Slider(4, range=0..10))
extrude_5 = Extrude(Base=boundary_surfaces, Direction=unit_z_2)
dispatch_5 = Dispatch(List=flatten(extrude_5), DispatchPattern=[True, False])  # -> ListA, ListB
geometry_8 = Geometry(dispatch_5.ListB)
deconstruct_brep_12 = DeconstructBrep(Brep=geometry_8)  # -> Faces, Edges, Vertices
point_8 = Point(move_13.Geometry)
geometry_9 = Geometry(pipe)
list_item_21 = ListItem(List=deconstruct_brep_12.Faces, Index=Slider(0, range=0..10), Wrap=True)
deconstruct_brep_13 = DeconstructBrep(Brep=geometry_9)  # -> Faces, Edges, Vertices
area_11 = Area(Geometry=list_item_21)  # -> Area, Centroid
list_item_22 = ListItem(List=deconstruct_brep_13.Faces, Index=0, Wrap=True)
surface_closest_point_4 = SurfaceClosestPoint(Point=point_8, Surface=list_item_22)  # -> Point, UVPoint, Distance
orient_6 = Orient(Geometry=geometry_8, Source=area_11.Centroid, Target=surface_closest_point_4.Point)  # -> Geometry, Transform
merge_11 = Merge(Data1=orient_6.Geometry, Data2=dispatch_5.ListA)

# ----
# FRONT SUSPENSION
geometry_10 = Geometry(sphere)
dispatch_6 = Dispatch(List=geometry_10, DispatchPattern=[True, False])  # -> ListA, ListB
geometry_11 = Geometry(dispatch_6.ListA)
unit_y_7 = UnitY(Factor=Slider(5.23, range=0..11))
deconstruct_brep_14 = DeconstructBrep(Brep=geometry_11)  # -> Faces, Edges, Vertices
negative_13 = Negative(Value=unit_y_7)
geometry_12 = Geometry(deconstruct_brep_14.Vertices)
move_18 = Move(Geometry=graft(geometry_12), Motion=[unit_y_7, negative_13])  # -> Geometry, Transform
dispatch_7 = Dispatch(List=move_18.Geometry, DispatchPattern=[True, False])  # -> ListA, ListB
volume_5 = Volume(Geometry=geometry_11)  # -> Volume, Centroid
unit_x_10 = UnitX(Factor=Slider(6.28, range=0..11))
line_12 = Line(StartPoint=dispatch_7.ListA, EndPoint=dispatch_7.ListB)
negative_14 = Negative(Value=unit_x_10)
move_19 = Move(Geometry=graft(line_12), Motion=[negative_14, unit_x_10])  # -> Geometry, Transform
vector_2pt_3 = Vector2Pt(PointA=geometry_12, PointB=volume_5.Centroid, Unitize=False)  # -> Vector, Length
geometry_13 = Geometry(move_19.Geometry)
flip_matrix = FlipMatrix(Data=geometry_13)
dispatch_8 = Dispatch(List=flatten(flip_matrix), DispatchPattern=[True, False])  # -> flatten(ListA), flatten(ListB)
dispatch_9 = Dispatch(List=move_19.Geometry, DispatchPattern=[True, False])  # -> flatten(ListA), ListB
unit_x_11 = UnitX(Factor=Slider(5.65, range=0..11))
multiplication_6 = Multiplication(A=vector_2pt_3.Vector, B=Slider(0.39, range=0..1))
negative_15 = Negative(Value=unit_x_11)
loft = Loft(
    Curves=dispatch_9.ListA,
    Options={Adjust=False, Closed=False, LoftEnds=0, LoftSimp=0, LoftType=0, Rebuild=10, Refit=0.01})
loft_2 = Loft(
    Curves=dispatch_8.ListA,
    Options={Adjust=False, Closed=False, LoftEnds=0, LoftSimp=0, LoftType=0, Rebuild=10, Refit=0.01})
loft_3 = Loft(
    Curves=dispatch_8.ListB,
    Options={Adjust=False, Closed=False, LoftEnds=0, LoftSimp=0, LoftType=0, Rebuild=10, Refit=0.01})
extrude_6 = Extrude(Base=loft, Direction=negative_15)
extrude_7 = Extrude(Base=[loft_2, loft_3], Direction=multiplication_6)
deconstruct_brep_15 = DeconstructBrep(Brep=extrude_6)  # -> Faces, Edges, Vertices
unit_z_3 = UnitZ(Factor=Slider(0.8, range=0..1))
list_item_23 = ListItem(List=deconstruct_brep_15.Faces, Index=Slider(2, range=0..10), Wrap=True)
list_item_24 = ListItem(List=deconstruct_brep_15.Faces, Index=Slider(4, range=0..10), Wrap=True)
boundary_surfaces_2 = BoundarySurfaces(Edges=list_item_24)
mirror_5 = Mirror(Geometry=extrude_6, Plane=list_item_23)  # -> Geometry, Transform
negative_16 = Negative(Value=unit_z_3)
extrude_8 = Extrude(Base=boundary_surfaces_2, Direction=negative_16)
deconstruct_brep_16 = DeconstructBrep(Brep=mirror_5.Geometry)  # -> Faces, Edges, Vertices
deconstruct_brep_17 = DeconstructBrep(Brep=extrude_8)  # -> Faces, Edges, Vertices
list_item_25 = ListItem(List=deconstruct_brep_16.Faces, Index=Slider(0, range=0..10), Wrap=True)
xy_plane_3 = XYPlane(Origin=Point(0, 0, 0))
area_12 = Area(Geometry=list_item_25)  # -> Area, Centroid
list_item_26 = ListItem(List=deconstruct_brep_17.Faces, Index=Slider(1, range=0..10), Wrap=True)
xz_plane_4 = XZPlane(Origin=Point(0, 0, 0))
area_13 = Area(Geometry=list_item_26)  # -> Area, Centroid
construct_plane_3 = ConstructPlane(Origin=area_12.Centroid, XAxis=xy_plane_3, YAxis=Vector(0, 1, 0))
mirror_6 = Mirror(Geometry=area_13.Centroid, Plane=xz_plane_4)  # -> Geometry, Transform
circle_3 = Circle(Plane=construct_plane_3, Radius=Slider(1.61, range=0..7))
unit_x_12 = UnitX(Factor=Slider(5.36, range=0..10))
boundary_surfaces_3 = BoundarySurfaces(Edges=circle_3)
line_13 = Line(StartPoint=area_13.Centroid, EndPoint=mirror_6.Geometry)
extrude_9 = Extrude(Base=boundary_surfaces_3, Direction=unit_x_12)
sweep1_5 = Sweep1(Rail=line_13, Sections=list_item_26, Miter=1)
curve_middle_5 = CurveMiddle(Curve=line_13)
xz_plane_5 = XZPlane(Origin=Point(0, 0, 0))
xy_plane_4 = XYPlane(Origin=Point(0, 0, 0))
merge_12 = Merge(Data1=extrude_7, Data2=extrude_6, Data3=mirror_5.Geometry, Data4=extrude_9, Data5=extrude_8)
construct_plane_4 = ConstructPlane(Origin=curve_middle_5, XAxis=Vector(1, 0, 0), YAxis=xy_plane_4)
mirror_7 = Mirror(Geometry=merge_12, Plane=construct_plane_4)  # -> Geometry, Transform

# ----
# DRIVE AND STEERING
geometry_14 = Geometry(cap_holes_2)
dispatch_10 = Dispatch(List=geometry_14, DispatchPattern=[True, False])  # -> ListA, ListB
deconstruct_brep_18 = DeconstructBrep(Brep=dispatch_10.ListA)  # -> Faces, Edges, Vertices
list_item_27 = ListItem(List=deconstruct_brep_18.Faces, Index=[Slider(0, range=0..1), Slider(1, range=0..1)], Wrap=True)
area_14 = Area(Geometry=list_item_27)  # -> Area, Centroid
dispatch_11 = Dispatch(List=area_14.Centroid, DispatchPattern=[True, False])  # -> ListA, ListB
line_14 = Line(StartPoint=dispatch_11.ListA, EndPoint=dispatch_11.ListB)
divide_curve_4 = DivideCurve(Curve=line_14, Count=Slider(4, range=0..10), Kinks=False)  # -> Points, Tangents, Parameters
list_item_28 = ListItem(List=divide_curve_4.Points, Index="1", Wrap=True)

xz_plane_6 = XZPlane(Origin=Point(0, 0, 0))
polar_array = PolarArray(Geometry=move_13.Geometry, Plane=xz_plane_6, Count=10, Angle=6.283185307)  # -> Geometry, Transform
list_length_2 = ListLength(List=polar_array.Geometry)
scale_5 = Scale(Geometry=polar_array.Geometry, Center=xz_plane_6, Factor=Slider(1, range=0..10))  # -> Geometry, Transform
division_10 = Division(A=list_length_2, B="2")
shift_list = ShiftList(List=scale_5.Geometry, Shift="-2", Wrap=True)
list_item_29 = ListItem(List=scale_5.Geometry, Index=0, Wrap=True)
split_list_2 = SplitList(List=shift_list, Index=division_10)  # -> ListA, ListB
unit_x_13 = UnitX(Factor=Slider(21, range=0..100))
point_9 = Point(split_list_2.ListA)
move_20 = Move(Geometry=point_9, Motion=unit_x_13)  # -> Geometry, Transform
number_slider_9 = Slider(1, range=0..1)
scale_6 = Scale(Geometry=move_20.Geometry, Center=list_item_29, Factor=0.5)  # -> Geometry, Transform
nurbs_curve_2 = NurbsCurve(Vertices=[split_list_2.ListB, scale_6.Geometry], Degree=Slider(3, range=0..10), Periodic=number_slider_9)  # -> Curve, Length, Domain
unit_y_8 = UnitY(Factor=number_slider_9)
boundary_surfaces_4 = BoundarySurfaces(Edges=nurbs_curve_2.Curve)
pi_4 = Pi(Factor=Slider(0.106, range=-0.5..0.5))
extrude_10 = Extrude(Base=boundary_surfaces_4, Direction=unit_y_8)
construct_point_3 = ConstructPoint(XCoordinate=0, YCoordinate=0, ZCoordinate=0)
rotate_3d_3 = Rotate3D(Geometry=extrude_10, Angle=pi_4, Center=construct_point_3, Axis=geometry_4)  # -> Geometry, Transform
merge_13 = Merge(Data1=rotate_3d_3.Geometry, Data2=cap_holes_6)  # -> flatten(Result)

# ----
# ENGINE UNIT
panel_2 = Panel("""0
-1""")
list_item_30 = ListItem(List=scale_6.Geometry, Index=panel_2, Wrap=True)
dispatch_12 = Dispatch(List=list_item_30, DispatchPattern=[True, False])  # -> ListA, ListB
line_15 = Line(StartPoint=dispatch_12.ListA, EndPoint=dispatch_12.ListB)
unit_y_9 = UnitY(Factor=Slider(4.08, range=0..10))
curve_middle_6 = CurveMiddle(Curve=line_15)
negative_17 = Negative(Value=unit_y_9)
rotate_3d_4 = Rotate3D(Geometry=curve_middle_6, Angle=pi_4, Center=construct_point_3, Axis=geometry_4)  # -> Geometry, Transform
move_21 = Move(Geometry=rotate_3d_4.Geometry, Motion=negative_17)  # -> Geometry, Transform
line_16 = Line(StartPoint=rotate_3d_4.Geometry, EndPoint=move_21.Geometry)
curve_middle_7 = CurveMiddle(Curve=line_16)
end_points_11 = EndPoints(Curve=line_16)  # -> Start, End
xy_plane_5 = XYPlane(Origin=Point(0, 0, 0))
number_slider_10 = Slider(0.7, range=0..1)
scale_7 = Scale(Geometry=line_16, Center=curve_middle_7, Factor=0.5)  # -> Geometry, Transform
construct_plane_5 = ConstructPlane(Origin=[end_points_11.Start, end_points_11.End], XAxis=Vector(1, 0, 0), YAxis=xy_plane_5)
end_points_12 = EndPoints(Curve=scale_7.Geometry)  # -> Start, End
circle_4 = Circle(Plane=construct_plane_5, Radius=number_slider_10)
division_11 = Division(A=number_slider_10, B="2")
vector_2pt_4 = Vector2Pt(PointA=[end_points_11.Start, end_points_11.End], PointB=[end_points_12.Start, end_points_12.End], Unitize=False)  # -> Vector, Length
boundary_surfaces_5 = BoundarySurfaces(Edges=circle_4)
extrude_11 = Extrude(Base=boundary_surfaces_5, Direction=vector_2pt_4.Vector)
pipe_2 = Pipe(Curve=scale_7.Geometry, Radius=division_11, Caps=1)
geometry_15 = Geometry(boundary_surfaces_5)
dispatch_13 = Dispatch(List=flatten(geometry_15), DispatchPattern=[True, False])  # -> ListA, ListB
area_15 = Area(Geometry=dispatch_13.ListB)  # -> Area, Centroid
unit_y_10 = UnitY(Factor=Slider(13.425, range=0..20))
scale_nu = ScaleNU(
    Geometry=dispatch_13.ListB,
    Plane=area_15.Centroid,
    ScaleX=Slider(10, range=0..10),
    ScaleY=1,
    ScaleZ=Slider(10, range=0..10))  # -> Geometry, Transform
negative_18 = Negative(Value=unit_y_10)
xy_plane_6 = XYPlane(Origin=Point(0, 0, 0))
extrude_12 = Extrude(Base=scale_nu.Geometry, Direction=negative_18)
deconstruct_brep_19 = DeconstructBrep(Brep=extrude_12)  # -> Faces, Edges, Vertices
list_item_31 = ListItem(List=deconstruct_brep_19.Faces, Index="2", Wrap=True)
area_16 = Area(Geometry=list_item_31)  # -> Area, Centroid
construct_plane_6 = ConstructPlane(Origin=area_16.Centroid, XAxis=Vector(1, 0, 0), YAxis=xy_plane_6)
volume_6 = Volume(Geometry=extrude_12)  # -> Volume, Centroid
circle_5 = Circle(Plane=construct_plane_6, Radius=Slider(1.462, range=0..2))
list_item_32 = ListItem(List=deconstruct_brep_19.Vertices, Index=Slider(3, range=0..10), Wrap=True)
divide_curve_5 = DivideCurve(Curve=circle_5, Count=10, Kinks=False)  # -> Points, Tangents, Parameters
panel_3 = Panel("""1
2
3
4""")
number_slider_11 = Slider(1.829, range=0..2)
unit_z_4 = UnitZ(Factor=Slider(3, range=0..10))
point_10 = Point(list_item_32)
circle_6 = Circle(Plane=volume_6.Centroid, Radius=1)
cull_index = CullIndex(List=divide_curve_5.Points, Indices=panel_3, Wrap=True)
list_item_33 = ListItem(List=divide_curve_5.Points, Index=[Slider(4, range=0..10), Slider(1, range=0..10)], Wrap=True)
area_17 = Area(Geometry=circle_6)  # -> Area, Centroid
move_22 = Move(Geometry=list_item_33, Motion=unit_z_4)  # -> Geometry, Transform
shift_list_2 = ShiftList(List=cull_index, Shift=1, Wrap=True)
dispatch_14 = Dispatch(List=flatten(move_22.Geometry), DispatchPattern=[True, False])  # -> ListA, ListB
scale_8 = Scale(Geometry=circle_6, Center=area_17.Centroid, Factor=number_slider_11)  # -> Geometry, Transform
geometry_16 = Geometry(dispatch_5.ListA)
unit_z_5 = UnitZ(Factor=number_slider_11)
deconstruct_brep_20 = DeconstructBrep(Brep=geometry_16)  # -> Faces, Edges, Vertices
square = Square(Value=number_slider_11)
interpolate_4 = Interpolate(Vertices=shift_list_2, Degree=3, Periodic=False, KnotStyle=1)  # -> Curve, Length, Domain
line_17 = Line(StartPoint=dispatch_14.ListA, EndPoint=dispatch_14.ListB)
list_item_34 = ListItem(List=deconstruct_brep_20.Faces, Index="2", Wrap=True)
multiplication_7 = Multiplication(A=unit_z_5, B=square)
end_points_13 = EndPoints(Curve=interpolate_4.Curve)  # -> Start, End
area_18 = Area(Geometry=list_item_34)  # -> Area, Centroid
unit_y_11 = UnitY(Factor=Slider(2, range=0..10))
move_23 = Move(Geometry=scale_8.Geometry, Motion=multiplication_7)  # -> Geometry, Transform
line_18 = Line(StartPoint=[end_points_13.Start, end_points_13.End], EndPoint=list_item_33)
area_19 = Area(Geometry=move_23.Geometry)  # -> Area, Centroid
unit_z_6 = UnitZ(Factor=Slider(0.6, range=0..1))
line_19 = Line(StartPoint=[end_points_13.Start, end_points_13.End], EndPoint=list_item_33)
move_24 = Move(Geometry=area_18.Centroid, Motion=unit_y_11)  # -> Geometry, Transform
loft_4 = Loft(
    Curves=[circle_6, move_23.Geometry],
    Options={Adjust=False, Closed=False, LoftEnds=0, LoftSimp=0, LoftType=0, Rebuild=10, Refit=0.01})
end_points_14 = EndPoints(Curve=line_18)  # -> Start, End
move_25 = Move(Geometry=area_19.Centroid, Motion=unit_z_6)  # -> Geometry, Transform
divide_curve_6 = DivideCurve(Curve=move_23.Geometry, Count=10, Kinks=False)  # -> Points, Tangents, Parameters
rectangle_3pt = Rectangle3Pt(PointA=area_18.Centroid, PointB=move_24.Geometry, PointC=point_10)  # -> Rectangle, Length
unit_x_14 = UnitX(Factor=Slider(3, range=0..10))
line_20 = Line(StartPoint=end_points_14.End, EndPoint=move_22.Geometry)
line_21 = Line(StartPoint=divide_curve_6.Points, EndPoint=move_25.Geometry)
boundary_surfaces_6 = BoundarySurfaces(Edges=rectangle_3pt.Rectangle)
negative_19 = Negative(Value=unit_x_14)
merge_14 = Merge(Data1=interpolate_4.Curve, Data2=graft(line_18), Data3=graft(move_22.Geometry), Data4=line_20, Data5=line_17)  # -> flatten(Result)
unit_z_7 = UnitZ(Factor=Slider(0.3, range=0..1))
curve_middle_8 = CurveMiddle(Curve=line_21)
unit_y_12 = UnitY(Factor=Slider(5, range=0..10))
unit_y_13 = UnitY(Factor=1)
extrude_13 = Extrude(Base=boundary_surfaces_6, Direction=negative_19)
move_26 = Move(Geometry=curve_middle_8, Motion=unit_z_7)  # -> Geometry, Transform
join_curves_6 = JoinCurves(Curves=merge_14, Preserve=False)
negative_20 = Negative(Value=unit_y_13)
boundary_surfaces_7 = BoundarySurfaces(Edges=join_curves_6)
extrude_14 = Extrude(Base=boundary_surfaces_7, Direction=unit_y_12)
extrude_15 = Extrude(Base=boundary_surfaces_7, Direction=negative_20)
arc_3pt_3 = Arc3Pt(PointA=move_25.Geometry, PointB=move_26.Geometry, PointC=divide_curve_6.Points)  # -> Arc, Plane, Radius
loft_5 = Loft(Curves=arc_3pt_3.Arc, Options={Adjust=False, Closed=True, LoftEnds=0, LoftSimp=0, LoftType=0, Rebuild=10, Refit=0.01})

# ----
# EXHAUST SYSTEM
md_slider_3 = MDSlider(
    SliderMode=0,
    slider_value=Point(0.5527559606, 0.5386814024, 0.5),
    x_domain=Domain(0, 1),
    y_domain=Domain(0, 1),
    z_domain=Domain(0, 1))
geometry_17 = Geometry(extrude_14)
number_slider_12 = Slider(7, range=0..10)
geometry_18 = Geometry(scale_nu.Geometry)
deconstruct_brep_21 = DeconstructBrep(Brep=geometry_17)  # -> Faces, Edges, Vertices
number_slider_13 = Slider(10, range=0..10)
evaluate_surface_3 = EvaluateSurface(Surface=reparameterize(geometry_18), Point=md_slider_3)  # -> Point, Normal, UDirection, VDirection, Frame
list_item_35 = ListItem(List=deconstruct_brep_21.Faces, Index=number_slider_12, Wrap=True)
unit_z_8 = UnitZ(Factor=1)
area_20 = Area(Geometry=list_item_35)  # -> Area, Centroid
unit_y_14 = UnitY(Factor=number_slider_13)
xy_plane_7 = XYPlane(Origin=Point(0, 0, 0))
negative_21 = Negative(Value=unit_z_8)
move_27 = Move(Geometry=evaluate_surface_3.Point, Motion=unit_y_14)  # -> Geometry, Transform
construct_plane_7 = ConstructPlane(Origin=area_20.Centroid, XAxis=xy_plane_7, YAxis=Vector(0, 1, 0))
move_28 = Move(Geometry=move_27.Geometry, Motion=negative_21)  # -> Geometry, Transform
xy_plane_8 = XYPlane(Origin=Point(0, 0, 0))
center_box = CenterBox(Base=construct_plane_7, X=1, Y=1, Z=Slider(10, range=0..10))
construct_plane_8 = ConstructPlane(Origin=move_28.Geometry, XAxis=xy_plane_8, YAxis=Vector(0, 1, 0))
deconstruct_brep_22 = DeconstructBrep(Brep=center_box)  # -> Faces, Edges, Vertices
list_item_36 = ListItem(List=deconstruct_brep_22.Faces, Index=number_slider_12, Wrap=True)
pi_5 = Pi(Factor=Slider(1, range=0..1))
area_21 = Area(Geometry=list_item_36)  # -> Area, Centroid
polar_array_2 = PolarArray(Geometry=move_27.Geometry, Plane=construct_plane_8, Count=10, Angle=pi_5)  # -> Geometry, Transform
xy_plane_9 = XYPlane(Origin=Point(0, 0, 0))
xz_plane_7 = XZPlane(Origin=Point(0, 0, 0))
interpolate_5 = Interpolate(Vertices=polar_array_2.Geometry, Degree=3, Periodic=False, KnotStyle=1)  # -> Curve, Length, Domain
construct_plane_9 = ConstructPlane(Origin=area_21.Centroid, XAxis=xy_plane_9, YAxis=Vector(0, 1, 0))
interpolate_6 = Interpolate(Vertices=polar_array_2.Geometry, Degree=3, Periodic=False, KnotStyle=1)  # -> Curve, Length, Domain
construct_plane_10 = ConstructPlane(Origin=area_21.Centroid, XAxis=Vector(1, 0, 0), YAxis=xz_plane_7)
line_22 = Line(StartPoint=evaluate_surface_3.Point, EndPoint=move_27.Geometry)
unit_z_9 = UnitZ(Factor=1)
pi_6 = Pi(Factor=Slider(0.5, range=0..1))
pi_7 = Pi(Factor=Slider(0.1, range=0..1))
end_points_15 = EndPoints(Curve=interpolate_5.Curve)  # -> Start, End
rotate_plane = RotatePlane(Plane=construct_plane_10, Angle=pi_6)
end_points_16 = EndPoints(Curve=line_22)  # -> Start, End
xy_plane_10 = XYPlane(Origin=Point(0, 0, 0))
number_slider_14 = Slider(0.25, range=0..1)
rotate_3d_5 = Rotate3D(Geometry=polar_array_2.Geometry, Angle=pi_7, Center=end_points_15.End, Axis=Vector(0, 0, 1))  # -> Geometry, Transform
deconstruct_plane = DeconstructPlane(Plane=rotate_plane)  # -> Origin, XAxis, YAxis, ZAxis
arc = Arc(Plane=rotate_plane, Radius=1, Angle=Domain(0, 3.141592654))  # -> Arc, Length
mirror_8 = Mirror(Geometry=rotate_3d_5.Geometry, Plane=end_points_15.End)  # -> Geometry, Transform
interpolate_7 = Interpolate(Vertices=mirror_8.Geometry, Degree=3, Periodic=False, KnotStyle=1)  # -> Curve, Length, Domain
merge_15 = Merge(Data1=line_22, Data2=interpolate_6.Curve, Data3=interpolate_7.Curve)
end_points_17 = EndPoints(Curve=interpolate_7.Curve)  # -> Start, End
move_29 = Move(Geometry=interpolate_7.Curve, Motion=unit_z_9)  # -> Geometry, Transform
join_curves_7 = JoinCurves(Curves=merge_15, Preserve=False)
construct_plane_11 = ConstructPlane(Origin=end_points_17.Start, XAxis=xy_plane_10, YAxis=Vector(0, 1, 0))
end_points_18 = EndPoints(Curve=arc.Arc)  # -> Start, End
circle_7 = Circle(Plane=construct_plane_11, Radius=Slider(2, range=0..2))
pipe_3 = Pipe(Curve=move_29.Geometry, Radius=number_slider_14, Caps=1)
pipe_4 = Pipe(Curve=join_curves_7, Radius=number_slider_14, Caps=1)
orient_7 = Orient(Geometry=arc.Arc, Source=end_points_18.Start, Target=deconstruct_plane.Origin)  # -> Geometry, Transform
boundary_surfaces_8 = BoundarySurfaces(Edges=circle_7)
unit_x_15 = UnitX(Factor=number_slider_13)
scale_9 = Scale(Geometry=orient_7.Geometry, Center=end_points_18.End, Factor=0.5)  # -> Geometry, Transform
end_points_19 = EndPoints(Curve=orient_7.Geometry)  # -> Start, End
extrude_16 = Extrude(Base=boundary_surfaces_8, Direction=unit_x_15)
circle_8 = Circle(Plane=construct_plane_9, Radius=Slider(1, range=0..1))
mirror_9 = Mirror(Geometry=scale_9.Geometry, Plane=construct_plane_9)  # -> Geometry, Transform
end_points_20 = EndPoints(Curve=mirror_9.Geometry)  # -> Start, End
orient_8 = Orient(Geometry=mirror_9.Geometry, Source=end_points_20.Start, Target=end_points_19.End)  # -> Geometry, Transform

# ----
# INTAKE SYSTEM
join_curves_8 = JoinCurves(Curves=[orient_7.Geometry, orient_8.Geometry], Preserve=False)
divide_curve_7 = DivideCurve(Curve=join_curves_8, Count=10, Kinks=False)  # -> Points, Tangents, Parameters
interpolate_8 = Interpolate(Vertices=divide_curve_7.Points, Degree=3, Periodic=False, KnotStyle=1)  # -> Curve, Length, Domain
sweep1_6 = Sweep1(Rail=interpolate_8.Curve, Sections=circle_8, Miter=1)
cap_holes_8 = CapHoles(Brep=sweep1_6)
end_points_21 = EndPoints(Curve=interpolate_8.Curve)  # -> Start, End
xy_plane_11 = XYPlane(Origin=Point(0, 0, 0))
construct_plane_12 = ConstructPlane(Origin=end_points_21.End, XAxis=Vector(1, 0, 0), YAxis=xy_plane_11)
circle_9 = Circle(Plane=construct_plane_12, Radius=Slider(1.11, range=0..2))
unit_y_15 = UnitY(Factor=Slider(14, range=0..100))
boundary_surfaces_9 = BoundarySurfaces(Edges=circle_9)
extrude_17 = Extrude(Base=boundary_surfaces_9, Direction=unit_y_15)
deconstruct_brep_23 = DeconstructBrep(Brep=extrude_17)  # -> Faces, Edges, Vertices
md_slider_4 = MDSlider(
    SliderMode=0,
    slider_value=Point(0.9062276701, 0.2786537729, 0.5),
    x_domain=Domain(0, 1),
    y_domain=Domain(0, 1),
    z_domain=Domain(0, 1))
list_item_37 = ListItem(List=deconstruct_brep_23.Faces, Index=Slider(1, range=0..1), Wrap=True)
evaluate_surface_4 = EvaluateSurface(Surface=reparameterize(list_item_37), Point=md_slider_4)  # -> Point, Normal, UDirection, VDirection, Frame
number_slider_15 = Slider(1, range=0..1)
multiplication_8 = Multiplication(A=Slider(4.21, range=0..10), B=evaluate_surface_4.Normal)
move_30 = Move(Geometry=evaluate_surface_4.Point, Motion=multiplication_8)  # -> Geometry, Transform
line_23 = Line(StartPoint=evaluate_surface_4.Point, EndPoint=move_30.Geometry)
pipe_5 = Pipe(Curve=line_23, Radius=number_slider_15, Caps=2)

# ----
# FUEL TANK
end_points_22 = EndPoints(Curve=line_23)  # -> Start, End
geometry_19 = Geometry(evaluate_surface_4.Frame)
point_11 = Point(end_points_22.End)
area_22 = Area(Geometry=geometry_19)  # -> Area, Centroid
orient_9 = Orient(Geometry=geometry_19, Source=area_22.Centroid, Target=point_11)  # -> Geometry, Transform
pi_8 = Pi(Factor=Slider(1, range=0..1))
vector_2pt_5 = Vector2Pt(PointA=end_points_22.Start, PointB=end_points_22.End, Unitize=False)  # -> Vector, Length
line_sdl_2 = LineSDL(Start=point_11, Direction=geometry_19, Length=1)
plane_normal = PlaneNormal(Origin=orient_9.Geometry, ZAxis=geometry_19)
rectangle_2 = Rectangle(Plane=plane_normal, XSize=Domain(-1, 1), YSize=Domain(-2, 2), Radius=0)  # -> Rectangle, Length
rotate_3d_6 = Rotate3D(Geometry=rectangle_2.Rectangle, Angle=pi_8, Center=area_22.Centroid, Axis=line_sdl_2)  # -> Geometry, Transform
boundary_surfaces_10 = BoundarySurfaces(Edges=rotate_3d_6.Geometry)
multiplication_9 = Multiplication(A=vector_2pt_5.Vector, B=Slider(4, range=0..4))
extrude_18 = Extrude(Base=boundary_surfaces_10, Direction=multiplication_9)
panel_4 = Panel("""1
3
7
11""")
fillet_edge = FilletEdge(Shape=extrude_18, Blend=0, Metric=0, Edges=panel_4, Radii=Slider(0.42, range=0..1))
deconstruct_brep_24 = DeconstructBrep(Brep=fillet_edge)  # -> Faces, Edges, Vertices
md_slider_5 = MDSlider(
    SliderMode=0,
    slider_value=Point(0.4500598768, 0.5477979707, 0.5),
    x_domain=Domain(0, 1),
    y_domain=Domain(0, 1),
    z_domain=Domain(0, 1))
list_item_38 = ListItem(List=deconstruct_brep_24.Faces, Index=Slider(7, range=0..10), Wrap=True)
evaluate_surface_5 = EvaluateSurface(Surface=reparameterize(list_item_38), Point=md_slider_5)  # -> Point, Normal, UDirection, VDirection, Frame
move_31 = Move(Geometry=evaluate_surface_5.Point, Motion=evaluate_surface_5.Normal)  # -> Geometry, Transform
point_12 = Point(move_13.Geometry)
point_13 = Point(evaluate_surface_5.Point)
line_24 = Line(StartPoint=evaluate_surface_5.Point, EndPoint=move_31.Geometry)
line_25 = Line(StartPoint=point_13, EndPoint=point_12)
pipe_6 = Pipe(Curve=[line_24, line_25], Radius=number_slider_15, Caps=2)

# ----
# Full multiplicity knots at start
# Simple knots
# Full multiplicity knots at end
# P1
# A=0.2*P1+ 0.8*P2
# D=0.2*A + 0.8*B
# P2
# B=0.47*P2 + 0.53*P3
# Full multiplicity knots at start
# E=0.7*B + 0.3*C
# P3
# Full multiplicity knots in the middle
# C=0.8*P3 + 0.2*P4
# P4
# Full multiplicity knots at end
solid_union = SolidUnion(Breps=merge_13)
# Compare knot spacing
merge_16 = Merge(
    Data1=sweep1,
    Data2=sphere,
    Data3=dispatch.ListA,
    Data4=cap_holes_3,
    Data5=merge_5,
    Data6=mirror_2.Geometry,
    Data7=sphere_2,
    Data8=cap_holes_4,
    Data9=pipe,
    Data10=merge_6)
# GH solution
# VB
# C#
merge_17 = Merge(
    Data1=pipe_2,
    Data2=extrude_11,
    Data3=extrude_12,
    Data4=loft_4,
    Data5=loft_5,
    Data6=extrude_13,
    Data7=extrude_15,
    Data8=extrude_14)
# Python with RhinoCommon Only
# Pythong with RhinoScriptSyntax
# GH solution
# VB
# C#
# Python
# VB
merge_18 = Merge(Data1=pipe_4, Data2=extrude_16, Data3=pipe_3, Data4=center_box)
# rc
merge_19 = Merge(Data1=merge_4, Data2=mirror.Geometry)
merge_20 = Merge(Data1=pipe_5, Data2=extrude_17, Data3=cap_holes_8)
merge_21 = Merge(Data1=pipe_6, Data2=fillet_edge)
merge_22 = Merge(Data1=merge_12, Data2=mirror_7.Geometry, Data3=sweep1_5)

merge_23 = Merge(Data1=merge_10, Data2=merge_11)
