# Grasshopper definition Sets137ParametricBubbleCar.gh (Grasshopper 1.0.7)
# Copyright: Wickerson Studios
# plug-ins: Bifocals

# 1001 GRASSHOPPER DEFINITIONS
# Wickerson Studio
# 
# created by: Michael Wickerson
# 
# Grasshopper for Rhino 3D Algorithmic Modeling
# 
# www.wickersonstudios.com
# www.michaelwickerson.com
# https://www.youtube.com/channel/UC7J48Ppcsa6oncp6d29R0xw
# https://github.com/mwickerson
# https://www.facebook.com/michael.wickerson
# https://www.linkedin.com/in/michael-wickerson-696a80156/
# https://www.grasshopper3d.com/profile/MichaelWickerson
image_sampler = ImageSampler(
    FilePath="C:\Users\Sculpture\Documents\2020Grasshopper\ScreenShots2019\Screenshots2020\SurfaceEditAlgorithm.PNG",
    Filter="Value",
    Interpolate=False,
    Umax=1,
    Umin=0,
    Vmax=1,
    Vmin=0,
    Wrap=1)

# ----
# SURFACE CREASE
number_slider = Slider(25, range=0..100)
construct_point = ConstructPoint(XCoordinate=0, YCoordinate=0, ZCoordinate=0)
unit_x = UnitX(Factor=number_slider)
# MATH 137/1001
# Parametric Bubble Car
# Inspired by: R.K.C.Cheng
move = Move(Geometry=construct_point, Motion=unit_x)  # -> Geometry, Transform
line = Line(StartPoint=construct_point, EndPoint=move.Geometry)
end_points = EndPoints(Curve=line)  # -> Start, End
division = Division(A=number_slider, B=Slider(2.32, range=0..10))
unit_y = UnitY(Factor=division)
negative = Negative(Value=unit_y)
move_2 = Move(Geometry=construct_point, Motion=[unit_y, negative])  # -> Geometry, Transform
line_2 = Line(StartPoint=construct_point, EndPoint=move_2.Geometry)
join_curves = JoinCurves(Curves=line_2, Preserve=False)
end_points_2 = EndPoints(Curve=join_curves)  # -> Start, End
division_2 = Division(A=number_slider, B=Slider(2, range=0..10))
unit_y_2 = UnitY(Factor=division_2)
negative_2 = Negative(Value=unit_y_2)
move_3 = Move(Geometry=end_points.End, Motion=[unit_y_2, negative_2])  # -> Geometry, Transform
line_3 = Line(StartPoint=end_points.End, EndPoint=move_3.Geometry)
join_curves_2 = JoinCurves(Curves=line_3, Preserve=False)
end_points_3 = EndPoints(Curve=join_curves_2)  # -> Start, End

curve = Curve(line_3)
# CHASSIS
join_curves_3 = JoinCurves(Curves=curve, Preserve=False)
end_points_4 = EndPoints(Curve=join_curves_3)  # -> Start, End
curve_middle = CurveMiddle(Curve=join_curves_3)
number_slider_2 = Slider(0.52, range=0..1)
list_item = ListItem(List=end_points_4.End, Index=0, Wrap=True)
xz_plane = XZPlane(Origin=list_item)
circle = Circle(Plane=xz_plane, Radius=number_slider_2)
division_3 = Division(A=number_slider, B=Slider(2, range=0..2))
sphere = Sphere(Base=[end_points_4.Start, end_points_4.End], Radius=1)
sweep1 = Sweep1(Rail=join_curves_3, Sections=circle, Miter=1)
unit_x_2 = UnitX(Factor=division_3)
cap_holes = CapHoles(Brep=sweep1)
negative_3 = Negative(Value=unit_x_2)
move_4 = Move(Geometry=cap_holes, Motion=[unit_x_2, negative_3])  # -> Geometry, Transform
scale = Scale(Geometry=move_4.Geometry, Center=curve_middle, Factor=Slider(0.84, range=0..1))  # -> Geometry, Transform
cap_holes_2 = CapHoles(Brep=scale.Geometry)
dispatch = Dispatch(List=cap_holes_2, DispatchPattern=[True, False])  # -> ListA, ListB
volume = Volume(Geometry=dispatch.ListB)  # -> Volume, Centroid
scale_2 = Scale(Geometry=dispatch.ListB, Center=volume.Centroid, Factor=Slider(0.7, range=0..1))  # -> Geometry, Transform
deconstruct_brep = DeconstructBrep(Brep=[dispatch.ListA, scale_2.Geometry])  # -> Faces, Edges, Vertices
list_item_2 = ListItem(List=deconstruct_brep.Faces, Index=0, Wrap=True)  # -> flatten(Item)
dispatch_2 = Dispatch(List=list_item_2, DispatchPattern=[True, False])  # -> ListA, ListB
area = Area(Geometry=dispatch_2.ListA)  # -> Area, Centroid
area_2 = Area(Geometry=dispatch_2.ListB)  # -> Area, Centroid
line_4 = Line(StartPoint=area.Centroid, EndPoint=area_2.Centroid)
end_points_5 = EndPoints(Curve=line_4)  # -> Start, End
list_item_3 = ListItem(List=end_points_5.Start, Index=0, Wrap=True)
x_size = XSize(Domain(-0.5, 0.5))
yz_plane = YZPlane(Origin=list_item_3)
rectangle = Rectangle(Plane=yz_plane, XSize=x_size, YSize=x_size, Radius=0)  # -> Rectangle, Length
sweep1_2 = Sweep1(Rail=line_4, Sections=rectangle.Rectangle, Miter=1)
cap_holes_3 = CapHoles(Brep=sweep1_2)

construct_domain = ConstructDomain(DomainStart=Slider(0, range=0..100), DomainEnd=Slider(10, range=0..10))
deconstruct_brep_2 = DeconstructBrep(Brep=cap_holes_3)  # -> Faces, Edges, Vertices
range = Range(Domain=construct_domain, Steps=Slider(6, range=0..10))
list_item_4 = ListItem(List=deconstruct_brep_2.Faces, Index=0, Wrap=True)
geometry = Geometry(list_item_4)
graph_mapper = GraphMapper(
    range,
    x0=0,
    x1=10,
    y0=0,
    y1=10,
    container_name="Bezier",
    cpx=[0, 0.3680437505, 0.6202901006, 1],
    cpy=[0.3652909994, 0.5328245163, 0.3101435304, 0.4490559697])
area_3 = Area(Geometry=geometry)  # -> Area, Centroid
vector_xyz = VectorXYZ(XComponent=range, YComponent=graph_mapper, ZComponent=0)  # -> Vector, Length
negative_4 = Negative(Value=vector_xyz.Vector)
move_5 = Move(Geometry=area_3.Centroid, Motion=negative_4)  # -> Geometry, Transform
interpolate = Interpolate(Vertices=move_5.Geometry, Degree=3, Periodic=False, KnotStyle=1)  # -> Curve, Length, Domain
end_points_6 = EndPoints(Curve=interpolate.Curve)  # -> Start, End
orient = Orient(Geometry=interpolate.Curve, Source=end_points_6.Start, Target=area_3.Centroid)  # -> Geometry, Transform
sweep1_3 = Sweep1(Rail=orient.Geometry, Sections=geometry, Miter=1)
cap_holes_4 = CapHoles(Brep=sweep1_3)
deconstruct_brep_3 = DeconstructBrep(Brep=cap_holes_4)  # -> Faces, Edges, Vertices
curve_middle_2 = CurveMiddle(Curve=line)
merge = Merge(Data1=cap_holes_3, Data2=cap_holes_4)
list_item_5 = ListItem(List=deconstruct_brep_3.Faces, Index=0, Wrap=True)
xz_plane_2 = XZPlane(Origin=curve_middle_2)
area_4 = Area(Geometry=list_item_5)  # -> Area, Centroid
mirror = Mirror(Geometry=merge, Plane=xz_plane_2)  # -> Geometry, Transform
dispatch_3 = Dispatch(List=flatten(mirror.Geometry), DispatchPattern=[True, False])  # -> ListA, ListB
deconstruct_brep_4 = DeconstructBrep(Brep=dispatch_3.ListB)  # -> Faces, Edges, Vertices
list_item_6 = ListItem(List=deconstruct_brep_4.Faces, Index=0, Wrap=True)
area_5 = Area(Geometry=list_item_6)  # -> Area, Centroid
line_5 = Line(StartPoint=area_4.Centroid, EndPoint=area_5.Centroid)
pipe = Pipe(Curve=line_5, Radius=number_slider_2, Caps=1)

geometry_2 = Geometry(join_curves)
divide_curve = DivideCurve(Curve=geometry_2, Count=Slider(6, range=0..10), Kinks=False)  # -> Points, Tangents, Parameters
number_slider_3 = Slider(2.8, range=0..10)
list_item_7 = ListItem(List=divide_curve.Points, Index=0, Wrap=True)
list_item_8 = ListItem(List=divide_curve.Points, Index=0, Wrap=True)  # -> Item, Item1, Item2
division_4 = Division(A=list_item_8.Item2, B=number_slider_3)
division_5 = Division(A=list_item_8.Item1, B=number_slider_3)
list_item_9 = ListItem(List=divide_curve.Points, Index="-1", Wrap=True)
unit_x_3 = UnitX(Factor=division_4)
unit_x_4 = UnitX(Factor=division_5)
unit_x_5 = UnitX(Factor=division_4)
unit_x_6 = UnitX(Factor=division_4)
move_6 = Move(Geometry=division_4, Motion=unit_x_4)  # -> Geometry, Transform
move_7 = Move(Geometry=division_5, Motion=unit_x_5)  # -> Geometry, Transform
move_8 = Move(Geometry=list_item_9, Motion=unit_x_3)  # -> Geometry, Transform
move_9 = Move(Geometry=list_item_7, Motion=unit_x_6)  # -> Geometry, Transform
merge_2 = Merge(Data1=move_9.Geometry, Data2=move_7.Geometry, Data3=move_6.Geometry, Data4=move_8.Geometry)
polyline = PolyLine(Vertices=merge_2, Closed=False)
revolution = Revolution(Curve=polyline, Axis=geometry_2, Domain=Domain(0, 6.283185307))
cap_holes_5 = CapHoles(Brep=revolution)

# ----
# REVOLVE
number_slider_4 = Slider(6.715, range=0..10)
division_6 = Division(A=number_slider, B=number_slider_4)
point = Point(end_points_2.End)
unit_y_3 = UnitY(Factor=division_6)
move_10 = Move(Geometry=point, Motion=unit_y_3)  # -> Geometry, Transform
line_6 = Line(StartPoint=move_10.Geometry, EndPoint=point)

# ----
# REAR AXLE
number_slider_5 = Slider(0.508, range=0..1)
division_7 = Division(A=division_6, B=Slider(1.315, range=0..10))
pi = Pi(Factor=number_slider_5)
range_2 = Range(Domain=division_6, Steps=10)
multiplication = Multiplication(A=range_2, B=pi)
sine = Sine(Value=multiplication)
negative_5 = Negative(Value=sine)
vector_xyz_2 = VectorXYZ(XComponent=range_2, YComponent=negative_5, ZComponent=0)  # -> Vector, Length

end_points_7 = EndPoints(Curve=line_6)  # -> Start, End
negative_6 = Negative(Value=vector_xyz_2.Vector)
move_11 = Move(Geometry=point, Motion=negative_6)  # -> Geometry, Transform
list_item_10 = ListItem(List=move_11.Geometry, Index="-1", Wrap=True)
point_2 = Point(list_item_10)
division_8 = Division(A=number_slider, B=Slider(11, range=0..100))
unit_x_7 = UnitX(Factor=division_7)
unit_y_4 = UnitY(Factor=division_8)
negative_7 = Negative(Value=unit_x_7)
interpolate_2 = Interpolate(Vertices=move_11.Geometry, Degree=3, Periodic=False, KnotStyle=1)  # -> Curve, Length, Domain
move_12 = Move(Geometry=list_item_10, Motion=unit_y_4)  # -> Geometry, Transform
point_3 = Point(move_12.Geometry)
line_7 = Line(StartPoint=point_2, EndPoint=point_3)
curve_middle_3 = CurveMiddle(Curve=line_7)
move_13 = Move(Geometry=curve_middle_3, Motion=negative_7)  # -> Geometry, Transform
end_points_8 = EndPoints(Curve=interpolate_2.Curve)  # -> Start, End
line_8 = Line(StartPoint=list_item_10, EndPoint=move_12.Geometry)
end_points_9 = EndPoints(Curve=line_8)  # -> Start, End
arc_3pt = Arc3Pt(PointA=point_2, PointB=move_13.Geometry, PointC=point_3)  # -> Arc, Plane, Radius
line_9 = Line(StartPoint=end_points_9.End, EndPoint=end_points_7.Start)
merge_3 = Merge(Data1=line_8, Data2=arc_3pt.Arc)
merge_4 = Merge(Data1=interpolate_2.Curve, Data2=line_8, Data3=line_9)
join_curves_4 = JoinCurves(Curves=merge_3, Preserve=False)
join_curves_5 = JoinCurves(Curves=merge_4, Preserve=False)
merge_5 = Merge(Data1=join_curves_5, Data2=join_curves_4)
revolution_2 = Revolution(Curve=merge_5, Axis=line_6, Domain=Domain(0, 6.283185307))
construct_point_2 = ConstructPoint(XCoordinate=0, YCoordinate=0, ZCoordinate=0)
orient_2 = Orient(Geometry=revolution_2, Source=end_points_7.Start, Target=end_points_3.End)  # -> Geometry, Transform
merge_6 = Merge(Data1=revolution_2, Data2=orient_2.Geometry)
xz_plane_3 = XZPlane(Origin=construct_point_2)
mirror_2 = Mirror(Geometry=merge_6, Plane=xz_plane_3)  # -> Geometry, Transform

xz_plane_4 = XZPlane(Origin=Point(0, 0, 0))
polar_array = PolarArray(Geometry=move_7.Geometry, Plane=xz_plane_4, Count=10, Angle=6.283185307)  # -> Geometry, Transform
list_length = ListLength(List=polar_array.Geometry)
scale_3 = Scale(Geometry=polar_array.Geometry, Center=xz_plane_4, Factor=Slider(2, range=0..10))  # -> Geometry, Transform
division_9 = Division(A=list_length, B="2")
shift_list = ShiftList(List=scale_3.Geometry, Shift="-2", Wrap=True)
list_item_11 = ListItem(List=scale_3.Geometry, Index=0, Wrap=True)
split_list = SplitList(List=shift_list, Index=division_9)  # -> ListA, ListB
unit_x_8 = UnitX(Factor=Slider(21, range=0..100))
point_4 = Point(split_list.ListA)
move_14 = Move(Geometry=point_4, Motion=unit_x_8)  # -> Geometry, Transform
number_slider_6 = Slider(1, range=0..1)
scale_4 = Scale(Geometry=move_14.Geometry, Center=list_item_11, Factor=0.5)  # -> Geometry, Transform
nurbs_curve = NurbsCurve(Vertices=[split_list.ListB, scale_4.Geometry], Degree=Slider(3, range=0..10), Periodic=number_slider_6)  # -> Curve, Length, Domain
unit_y_5 = UnitY(Factor=number_slider_6)
boundary_surfaces = BoundarySurfaces(Edges=nurbs_curve.Curve)
pi_2 = Pi(Factor=Slider(0.185, range=-0.5..0.5))
extrude = Extrude(Base=boundary_surfaces, Direction=unit_y_5)
construct_point_3 = ConstructPoint(XCoordinate=0, YCoordinate=0, ZCoordinate=0)
rotate_3d = Rotate3D(Geometry=extrude, Angle=pi_2, Center=construct_point_3, Axis=geometry_2)  # -> Geometry, Transform
merge_7 = Merge(Data1=rotate_3d.Geometry, Data2=cap_holes_5)  # -> flatten(Result)

solid_union = SolidUnion(Breps=merge_7)
# rc
merge_8 = Merge(Data1=merge_6, Data2=mirror_2.Geometry)
# Full multiplicity knots at start
# Simple knots
# Full multiplicity knots at end
# P1
# A=0.2*P1+ 0.8*P2
# D=0.2*A + 0.8*B
# P2
# B=0.47*P2 + 0.53*P3
# Full multiplicity knots at start
# E=0.7*B + 0.3*C
# P3
# Full multiplicity knots in the middle
# C=0.8*P3 + 0.2*P4
# P4
# Full multiplicity knots at end
# Compare knot spacing
# GH solution
# VB
# C#
# Python with RhinoCommon Only
# Pythong with RhinoScriptSyntax
# GH solution
# VB
# C#
# Python
# VB
merge_9 = Merge(
    Data1=sweep1,
    Data2=sphere,
    Data3=dispatch.ListA,
    Data4=cap_holes_3,
    Data5=merge,
    Data6=mirror.Geometry,
    Data7=cap_holes_4,
    Data8=pipe)
