# Grasshopper definition Sets137fParametricBubbleCar.gh (Grasshopper 1.0.7)
# Copyright: Wickerson Studios
# plug-ins: Bifocals

# 1001 GRASSHOPPER DEFINITIONS
# Wickerson Studio
# 
# created by: Michael Wickerson
# 
# Grasshopper for Rhino 3D Algorithmic Modeling
# 
# www.wickersonstudios.com
# www.michaelwickerson.com
# https://www.youtube.com/channel/UC7J48Ppcsa6oncp6d29R0xw
# https://github.com/mwickerson
# https://www.facebook.com/michael.wickerson
# https://www.linkedin.com/in/michael-wickerson-696a80156/
# https://www.grasshopper3d.com/profile/MichaelWickerson
image_sampler = ImageSampler(
    FilePath="C:\Users\Sculpture\Documents\2020Grasshopper\ScreenShots2019\Screenshots2020\SurfaceEditAlgorithm.PNG",
    Filter="Value",
    Interpolate=False,
    Umax=1,
    Umin=0,
    Vmax=1,
    Vmin=0,
    Wrap=1)
md_slider = MDSlider(
    SliderMode=0,
    slider_value=Point(0.5953168171, 0.1902153201, 0.5),
    x_domain=Domain(0, 1),
    y_domain=Domain(0, 1),
    z_domain=Domain(0, 1))

# ----
# SURFACE CREASE
number_slider = Slider(25, range=0..100)
construct_point = ConstructPoint(XCoordinate=0, YCoordinate=0, ZCoordinate=0)
unit_x = UnitX(Factor=number_slider)
# MATH 137/1001
# Parametric Bubble Car
# Inspired by: R.K.C.Cheng
move = Move(Geometry=construct_point, Motion=unit_x)  # -> Geometry, Transform
line = Line(StartPoint=construct_point, EndPoint=move.Geometry)
end_points = EndPoints(Curve=line)  # -> Start, End
division = Division(A=number_slider, B=Slider(2.763, range=0..10))
unit_y = UnitY(Factor=division)
negative = Negative(Value=unit_y)
move_2 = Move(Geometry=construct_point, Motion=[unit_y, negative])  # -> Geometry, Transform
line_2 = Line(StartPoint=construct_point, EndPoint=move_2.Geometry)
join_curves = JoinCurves(Curves=line_2, Preserve=False)
end_points_2 = EndPoints(Curve=join_curves)  # -> Start, End
division_2 = Division(A=number_slider, B=Slider(2, range=0..10))
unit_y_2 = UnitY(Factor=division_2)
negative_2 = Negative(Value=unit_y_2)
move_3 = Move(Geometry=end_points.End, Motion=[unit_y_2, negative_2])  # -> Geometry, Transform
line_3 = Line(StartPoint=end_points.End, EndPoint=move_3.Geometry)
join_curves_2 = JoinCurves(Curves=line_3, Preserve=False)
end_points_3 = EndPoints(Curve=join_curves_2)  # -> Start, End

curve = Curve(line_3)
# CHASSIS
join_curves_3 = JoinCurves(Curves=curve, Preserve=False)
end_points_4 = EndPoints(Curve=join_curves_3)  # -> Start, End
curve_middle = CurveMiddle(Curve=join_curves_3)
number_slider_2 = Slider(0.45, range=0..1)
list_item = ListItem(List=end_points_4.End, Index=0, Wrap=True)
xz_plane = XZPlane(Origin=list_item)
circle = Circle(Plane=xz_plane, Radius=number_slider_2)
division_3 = Division(A=number_slider, B=Slider(3.77, range=0..4))
sphere = Sphere(Base=[end_points_4.Start, end_points_4.End], Radius=1)
sweep1 = Sweep1(Rail=join_curves_3, Sections=circle, Miter=1)
unit_x_2 = UnitX(Factor=division_3)
cap_holes = CapHoles(Brep=sweep1)
negative_3 = Negative(Value=unit_x_2)
move_4 = Move(Geometry=cap_holes, Motion=[unit_x_2, negative_3])  # -> Geometry, Transform
scale = Scale(Geometry=move_4.Geometry, Center=curve_middle, Factor=Slider(0.44, range=0..1))  # -> Geometry, Transform
cap_holes_2 = CapHoles(Brep=scale.Geometry)
dispatch = Dispatch(List=cap_holes_2, DispatchPattern=[True, False])  # -> ListA, ListB
volume = Volume(Geometry=dispatch.ListB)  # -> Volume, Centroid
scale_2 = Scale(Geometry=dispatch.ListB, Center=volume.Centroid, Factor=Slider(0.922, range=0..2))  # -> Geometry, Transform
deconstruct_brep = DeconstructBrep(Brep=[dispatch.ListA, scale_2.Geometry])  # -> Faces, Edges, Vertices
list_item_2 = ListItem(List=deconstruct_brep.Faces, Index=0, Wrap=True)  # -> flatten(Item)
dispatch_2 = Dispatch(List=list_item_2, DispatchPattern=[True, False])  # -> ListA, ListB
area = Area(Geometry=dispatch_2.ListA)  # -> Area, Centroid
area_2 = Area(Geometry=dispatch_2.ListB)  # -> Area, Centroid
line_4 = Line(StartPoint=area.Centroid, EndPoint=area_2.Centroid)
end_points_5 = EndPoints(Curve=line_4)  # -> Start, End
list_item_3 = ListItem(List=end_points_5.Start, Index=0, Wrap=True)
x_size = XSize(Domain(-0.5, 0.5))
yz_plane = YZPlane(Origin=list_item_3)
rectangle = Rectangle(Plane=yz_plane, XSize=x_size, YSize=x_size, Radius=0)  # -> Rectangle, Length
sweep1_2 = Sweep1(Rail=line_4, Sections=rectangle.Rectangle, Miter=1)
cap_holes_3 = CapHoles(Brep=sweep1_2)

construct_domain = ConstructDomain(DomainStart=Slider(0, range=0..100), DomainEnd=Slider(12, range=0..20))
deconstruct_brep_2 = DeconstructBrep(Brep=cap_holes_3)  # -> Faces, Edges, Vertices
range = Range(Domain=construct_domain, Steps=Slider(6, range=0..10))
list_item_4 = ListItem(List=deconstruct_brep_2.Faces, Index=0, Wrap=True)
geometry = Geometry(list_item_4)
graph_mapper = GraphMapper(
    range,
    x0=0,
    x1=10,
    y0=0,
    y1=10,
    container_name="Bezier",
    cpx=[0, 0.4932551682, 0.6202901006, 1],
    cpy=[0.3652909994, 0.5832095146, 0.3101435304, 0.4490559697])
area_3 = Area(Geometry=geometry)  # -> Area, Centroid
vector_xyz = VectorXYZ(XComponent=range, YComponent=graph_mapper, ZComponent=0)  # -> Vector, Length
negative_4 = Negative(Value=vector_xyz.Vector)
move_5 = Move(Geometry=area_3.Centroid, Motion=negative_4)  # -> Geometry, Transform
interpolate = Interpolate(Vertices=move_5.Geometry, Degree=3, Periodic=False, KnotStyle=1)  # -> Curve, Length, Domain
end_points_6 = EndPoints(Curve=interpolate.Curve)  # -> Start, End
orient = Orient(Geometry=interpolate.Curve, Source=end_points_6.Start, Target=area_3.Centroid)  # -> Geometry, Transform
sweep1_3 = Sweep1(Rail=orient.Geometry, Sections=geometry, Miter=1)
cap_holes_4 = CapHoles(Brep=sweep1_3)
deconstruct_brep_3 = DeconstructBrep(Brep=cap_holes_4)  # -> Faces, Edges, Vertices
curve_middle_2 = CurveMiddle(Curve=line)
merge = Merge(Data1=cap_holes_3, Data2=cap_holes_4)
list_item_5 = ListItem(List=deconstruct_brep_3.Faces, Index=0, Wrap=True)
xz_plane_2 = XZPlane(Origin=curve_middle_2)
area_4 = Area(Geometry=list_item_5)  # -> Area, Centroid
mirror = Mirror(Geometry=merge, Plane=xz_plane_2)  # -> Geometry, Transform
dispatch_3 = Dispatch(List=flatten(mirror.Geometry), DispatchPattern=[True, False])  # -> ListA, ListB
deconstruct_brep_4 = DeconstructBrep(Brep=dispatch_3.ListB)  # -> Faces, Edges, Vertices
list_item_6 = ListItem(List=deconstruct_brep_4.Faces, Index=0, Wrap=True)
area_5 = Area(Geometry=list_item_6)  # -> Area, Centroid
line_5 = Line(StartPoint=area_4.Centroid, EndPoint=area_5.Centroid)
pipe = Pipe(Curve=line_5, Radius=number_slider_2, Caps=1)

geometry_2 = Geometry(join_curves)
divide_curve = DivideCurve(Curve=geometry_2, Count=Slider(6, range=0..10), Kinks=False)  # -> Points, Tangents, Parameters
number_slider_3 = Slider(3.77, range=0..10)
list_item_7 = ListItem(List=divide_curve.Points, Index=0, Wrap=True)
list_item_8 = ListItem(List=divide_curve.Points, Index=0, Wrap=True)  # -> Item, Item1, Item2
division_4 = Division(A=list_item_8.Item2, B=number_slider_3)
division_5 = Division(A=list_item_8.Item1, B=number_slider_3)
list_item_9 = ListItem(List=divide_curve.Points, Index="-1", Wrap=True)
unit_x_3 = UnitX(Factor=division_4)
unit_x_4 = UnitX(Factor=division_5)
unit_x_5 = UnitX(Factor=division_4)
unit_x_6 = UnitX(Factor=division_4)
move_6 = Move(Geometry=division_4, Motion=unit_x_4)  # -> Geometry, Transform
move_7 = Move(Geometry=division_5, Motion=unit_x_5)  # -> Geometry, Transform
move_8 = Move(Geometry=list_item_9, Motion=unit_x_3)  # -> Geometry, Transform
move_9 = Move(Geometry=list_item_7, Motion=unit_x_6)  # -> Geometry, Transform
merge_2 = Merge(Data1=move_9.Geometry, Data2=move_7.Geometry, Data3=move_6.Geometry, Data4=move_8.Geometry)
polyline = PolyLine(Vertices=merge_2, Closed=False)
revolution = Revolution(Curve=polyline, Axis=geometry_2, Domain=Domain(0, 6.283185307))
cap_holes_5 = CapHoles(Brep=revolution)

# ----
# REVOLVE
number_slider_4 = Slider(7.158, range=0..10)
division_6 = Division(A=number_slider, B=number_slider_4)
point = Point(end_points_2.End)
unit_y_3 = UnitY(Factor=division_6)
move_10 = Move(Geometry=point, Motion=unit_y_3)  # -> Geometry, Transform
line_6 = Line(StartPoint=move_10.Geometry, EndPoint=point)

# ----
# REAR AXLE
number_slider_5 = Slider(0.995, range=0..1)
number_slider_6 = Slider(10, range=0..10)
division_7 = Division(A=division_6, B=Slider(0.839, range=0..10))
pi = Pi(Factor=number_slider_5)
range_2 = Range(Domain=division_6, Steps=10)
unit_z = UnitZ(Factor=1)
unit_y_4 = UnitY(Factor=number_slider_6)
multiplication = Multiplication(A=range_2, B=pi)
negative_5 = Negative(Value=unit_z)
sine = Sine(Value=multiplication)
negative_6 = Negative(Value=sine)
xy_plane = XYPlane(Origin=Point(0, 0, 0))
vector_xyz_2 = VectorXYZ(XComponent=range_2, YComponent=negative_6, ZComponent=0)  # -> Vector, Length
pi_2 = Pi(Factor=Slider(0.5, range=0..1))

end_points_7 = EndPoints(Curve=line_6)  # -> Start, End
negative_7 = Negative(Value=vector_xyz_2.Vector)
move_11 = Move(Geometry=point, Motion=negative_7)  # -> Geometry, Transform
list_item_10 = ListItem(List=move_11.Geometry, Index="-1", Wrap=True)
point_2 = Point(list_item_10)
division_8 = Division(A=number_slider, B=Slider(11, range=0..100))
unit_x_7 = UnitX(Factor=division_7)
unit_y_5 = UnitY(Factor=division_8)
negative_8 = Negative(Value=unit_x_7)
interpolate_2 = Interpolate(Vertices=move_11.Geometry, Degree=3, Periodic=False, KnotStyle=1)  # -> Curve, Length, Domain
move_12 = Move(Geometry=list_item_10, Motion=unit_y_5)  # -> Geometry, Transform
point_3 = Point(move_12.Geometry)
line_7 = Line(StartPoint=point_2, EndPoint=point_3)
curve_middle_3 = CurveMiddle(Curve=line_7)
move_13 = Move(Geometry=curve_middle_3, Motion=negative_8)  # -> Geometry, Transform
end_points_8 = EndPoints(Curve=interpolate_2.Curve)  # -> Start, End
line_8 = Line(StartPoint=list_item_10, EndPoint=move_12.Geometry)
end_points_9 = EndPoints(Curve=line_8)  # -> Start, End
arc_3pt = Arc3Pt(PointA=point_2, PointB=move_13.Geometry, PointC=point_3)  # -> Arc, Plane, Radius
line_9 = Line(StartPoint=end_points_9.End, EndPoint=end_points_7.Start)
merge_3 = Merge(Data1=line_8, Data2=arc_3pt.Arc)
merge_4 = Merge(Data1=interpolate_2.Curve, Data2=line_8, Data3=line_9)
join_curves_4 = JoinCurves(Curves=merge_3, Preserve=False)
join_curves_5 = JoinCurves(Curves=merge_4, Preserve=False)
merge_5 = Merge(Data1=join_curves_5, Data2=join_curves_4)
revolution_2 = Revolution(Curve=merge_5, Axis=line_6, Domain=Domain(0, 6.283185307))
construct_point_2 = ConstructPoint(XCoordinate=0, YCoordinate=0, ZCoordinate=0)
orient_2 = Orient(Geometry=revolution_2, Source=end_points_7.Start, Target=end_points_3.End)  # -> Geometry, Transform
merge_6 = Merge(Data1=revolution_2, Data2=orient_2.Geometry)
xz_plane_3 = XZPlane(Origin=construct_point_2)
mirror_2 = Mirror(Geometry=merge_6, Plane=xz_plane_3)  # -> Geometry, Transform

end_points_10 = EndPoints(Curve=line_5)  # -> Start, End
construct_domain_2 = ConstructDomain(DomainStart=0, DomainEnd=Slider(4.48, range=0..10))
number_slider_7 = Slider(2.28, range=0..10)
point_on_curve = PointOnCurve(line_5, parameter=0.247)
curve_middle_4 = CurveMiddle(Curve=line_5)
point_4 = Point(end_points_10.End)
range_3 = Range(Domain=construct_domain_2, Steps=Slider(10, range=0..10))
sine_2 = Sine(Value=range_3)
multiplication_2 = Multiplication(A=range_3, B=number_slider_7)
deconstruct_brep_5 = DeconstructBrep(Brep=pipe)  # -> Faces, Edges, Vertices
multiplication_3 = Multiplication(A=sine_2, B=number_slider_7)
vector_xyz_3 = VectorXYZ(XComponent=0, YComponent=multiplication_2, ZComponent=multiplication_3)  # -> Vector, Length
list_item_11 = ListItem(List=deconstruct_brep_5.Faces, Index=Slider(2, range=0..2), Wrap=True)
negative_9 = Negative(Value=vector_xyz_3.Vector)
geometry_3 = Geometry(list_item_11)
move_14 = Move(Geometry=point_4, Motion=negative_9)  # -> Geometry, Transform
nurbs_curve = NurbsCurve(Vertices=move_14.Geometry, Degree=3, Periodic=False)  # -> Curve, Length, Domain
sweep1_4 = Sweep1(Rail=nurbs_curve.Curve, Sections=geometry_3, Miter=1)
cap_holes_6 = CapHoles(Brep=sweep1_4)
negative_10 = Negative(Value=Slider(0.5, range=0..1))
orient_3 = Orient(Geometry=cap_holes_6, Source=point_4, Target=curve_middle_4)  # -> Geometry, Transform
unit_y_6 = UnitY(Factor=1)
pi_3 = Pi(Factor=negative_10)
pi_4 = Pi(Factor=Slider(0.3, range=0..1))
rotate_3d = Rotate3D(Geometry=orient_3.Geometry, Angle=pi_3, Center=curve_middle_4, Axis=Vector(0, 0, 1))  # -> Geometry, Transform
line_sdl = LineSDL(Start=curve_middle_4, Direction=unit_y_6, Length=1)
rotate_3d_2 = Rotate3D(Geometry=rotate_3d.Geometry, Angle=pi_4, Center=curve_middle_4, Axis=line_sdl)  # -> Geometry, Transform
deconstruct_brep_6 = DeconstructBrep(Brep=rotate_3d_2.Geometry)  # -> Faces, Edges, Vertices
list_item_12 = ListItem(List=deconstruct_brep_6.Faces, Index=0, Wrap=True)
volume_2 = Volume(Geometry=pipe)  # -> Volume, Centroid
area_6 = Area(Geometry=list_item_12)  # -> Area, Centroid
orient_4 = Orient(Geometry=pipe, Source=volume_2.Centroid, Target=area_6.Centroid)  # -> Geometry, Transform
deconstruct_brep_7 = DeconstructBrep(Brep=orient_4.Geometry)  # -> Faces, Edges, Vertices
list_item_13 = ListItem(List=deconstruct_brep_7.Faces, Index=Slider(2, range=0..10), Wrap=True)
panel = Panel("""4
0""")
divide_curve_2 = DivideCurve(Curve=list_item_13, Count=10, Kinks=False)  # -> Points, Tangents, Parameters
list_item_14 = ListItem(List=divide_curve_2.Points, Index=panel, Wrap=True)
deconstruct_brep_8 = DeconstructBrep(Brep=revolution_2)  # -> flatten(Faces), Edges, Vertices
list_item_15 = ListItem(List=deconstruct_brep_8.Faces, Index=Slider(3, range=0..10), Wrap=True)
geometry_4 = Geometry(list_item_15)
surface_closest_point = SurfaceClosestPoint(Point=list_item_14, Surface=geometry_4)  # -> Point, UVPoint, Distance
dispatch_4 = Dispatch(List=surface_closest_point.Point, DispatchPattern=[True, False])  # -> ListA, ListB
line_10 = Line(StartPoint=dispatch_4.ListA, EndPoint=dispatch_4.ListB)
point_on_curve_2 = PointOnCurve(line_10, parameter=0.711)
unit_z_2 = UnitZ(Factor=Slider(0.08, range=0..0.1))
surface_closest_point_2 = SurfaceClosestPoint(Point=point_on_curve_2, Surface=geometry_4)  # -> Point, UVPoint, Distance
move_15 = Move(Geometry=surface_closest_point_2.Point, Motion=unit_z_2)  # -> Geometry, Transform
arc_3pt_2 = Arc3Pt(PointA=dispatch_4.ListA, PointB=move_15.Geometry, PointC=dispatch_4.ListB)  # -> Arc, Plane, Radius
scale_3 = Scale(Geometry=arc_3pt_2.Arc, Center=surface_closest_point_2.Point, Factor=Slider(30, range=0..30))  # -> Geometry, Transform
area_7 = Area(Geometry=list_item_13)  # -> Area, Centroid
list_item_16 = ListItem(List=divide_curve_2.Points, Index=0, Wrap=True)
orient_5 = Orient(Geometry=scale_3.Geometry, Source=point_on_curve_2, Target=list_item_16)  # -> Geometry, Transform
unit_y_7 = UnitY(Factor=Slider(7.76, range=0..10))
negative_11 = Negative(Value=unit_y_7)
md_slider_2 = MDSlider(SliderMode=0, slider_value=Point(0.5, 0.5, 0.5), x_domain=Domain(0, 1), y_domain=Domain(0, 1), z_domain=Domain(0, 1))
extrude = Extrude(Base=orient_5.Geometry, Direction=negative_11)
evaluate_surface = EvaluateSurface(Surface=reparameterize(extrude), Point=md_slider_2)  # -> Point, Normal, UDirection, VDirection, Frame
multiplication_4 = Multiplication(A=Slider(0.36, range=0..2), B=evaluate_surface.Normal)
volume_3 = Volume(Geometry=orient_4.Geometry)  # -> Volume, Centroid
xy_plane_2 = XYPlane(Origin=Point(0, 0, 0))
extrude_2 = Extrude(Base=extrude, Direction=multiplication_4)
construct_plane = ConstructPlane(Origin=volume_3.Centroid, XAxis=Vector(1, 0, 0), YAxis=xy_plane_2)
mirror_3 = Mirror(Geometry=extrude_2, Plane=construct_plane)  # -> Geometry, Transform
sphere_2 = Sphere(Base=deconstruct_brep_7.Vertices, Radius=Slider(1.71, range=0..10))
merge_7 = Merge(Data1=rotate_3d_2.Geometry, Data2=sweep1_4, Data3=orient_4.Geometry, Data4=extrude_2, Data5=mirror_3.Geometry)

# ----
# REAR SUSPENSION
deconstruct_brep_9 = DeconstructBrep(Brep=cap_holes_4)  # -> Faces, Edges, Vertices
list_item_17 = ListItem(List=deconstruct_brep_9.Faces, Index=0, Wrap=True)
unit_x_8 = UnitX(Factor=Slider(4, range=0..10))
negative_12 = Negative(Value=unit_x_8)
number_slider_8 = Slider(5, range=0..10)
extrude_3 = Extrude(Base=list_item_17, Direction=negative_12)
deconstruct_brep_10 = DeconstructBrep(Brep=extrude_3)  # -> Faces, Edges, Vertices
list_item_18 = ListItem(List=deconstruct_brep_10.Faces, Index=number_slider_8, Wrap=True)
area_8 = Area(Geometry=list_item_18)  # -> Area, Centroid
unit_x_9 = UnitX(Factor=Slider(4, range=0..10))
scale_4 = Scale(Geometry=list_item_18, Center=area_8.Centroid, Factor=0.5)  # -> Geometry, Transform
negative_13 = Negative(Value=unit_x_9)
extrude_4 = Extrude(Base=scale_4.Geometry, Direction=negative_13)
deconstruct_brep_11 = DeconstructBrep(Brep=extrude_4)  # -> Faces, Edges, Vertices
list_item_19 = ListItem(List=deconstruct_brep_11.Faces, Index=number_slider_8, Wrap=True)
area_9 = Area(Geometry=list_item_19)  # -> Area, Centroid
list_item_20 = ListItem(List=deconstruct_brep_7.Faces, Index=Slider(0, range=0..10), Wrap=True)  # -> Item, Item1, Item2
md_slider_3 = MDSlider(
    SliderMode=0,
    slider_value=Point(0, 0.3048780488, 0.5),
    x_domain=Domain(0, 1),
    y_domain=Domain(0, 1),
    z_domain=Domain(0, 1))
surface_closest_point_3 = SurfaceClosestPoint(Point=area_9.Centroid, Surface=list_item_20.Item)  # -> Point, UVPoint, Distance
geometry_5 = Geometry(list_item_20.Item1)
area_10 = Area(Geometry=geometry_5)  # -> Area, Centroid
evaluate_surface_2 = EvaluateSurface(Surface=reparameterize(list_item_20.Item), Point=md_slider_3)  # -> Point, Normal, UDirection, VDirection, Frame
line_11 = Line(StartPoint=area_9.Centroid, EndPoint=surface_closest_point_3.Point)
divide_curve_3 = DivideCurve(Curve=line_11, Count=10, Kinks=False)  # -> Points, Tangents, Parameters
point_5 = Point(evaluate_surface_2.Point)
interpolate_3 = Interpolate(Vertices=divide_curve_3.Points, Degree=3, Periodic=False, KnotStyle=1)  # -> Curve, Length, Domain
list_length = ListLength(List=divide_curve_3.Points)
division_9 = Division(A=list_length, B="2")
split_list = SplitList(List=divide_curve_3.Points, Index=division_9)  # -> ListA, ListB
vector_2pt = Vector2Pt(PointA=area_10.Centroid, PointB=point_5, Unitize=False)  # -> Vector, Length
vector_2pt_2 = Vector2Pt(PointA=area_10.Centroid, PointB=point_5, Unitize=False)  # -> Vector, Length
point_6 = Point(split_list.ListB)
point_7 = Point(split_list.ListA)
multiplication_5 = Multiplication(A=vector_2pt_2.Vector, B="2")
move_16 = Move(Geometry=point_7, Motion=vector_2pt.Vector)  # -> Geometry, Transform
move_17 = Move(Geometry=point_6, Motion=multiplication_5)  # -> Geometry, Transform
polyline_2 = PolyLine(Vertices=[move_16.Geometry, move_17.Geometry], Closed=False)
revolution_3 = Revolution(Curve=polyline_2, Axis=interpolate_3.Curve, Domain=Domain(0, 6.283185307))
cap_holes_7 = CapHoles(Brep=revolution_3)
xy_plane_3 = XYPlane(Origin=Point(0, 0, 0))
merge_8 = Merge(Data1=extrude_3, Data2=extrude_4)
merge_9 = Merge(Data1=merge_8, Data2=cap_holes_7)
construct_plane_2 = ConstructPlane(Origin=Point(0, 0, 0), XAxis=Vector(1, 0, 0), YAxis=xy_plane_3)
mirror_4 = Mirror(Geometry=merge_9, Plane=construct_plane_2)  # -> Geometry, Transform
merge_10 = Merge(Data1=merge_9, Data2=mirror_4.Geometry)
geometry_6 = Geometry(dispatch_3.ListB)
geometry_7 = Geometry(pipe)
volume_4 = Volume(Geometry=[geometry_6, geometry_7])  # -> Volume, Centroid
circle_2 = Circle(Plane=volume_4.Centroid, Radius=Slider(0.3, range=0..1))
boundary_surfaces = BoundarySurfaces(Edges=circle_2)
unit_z_3 = UnitZ(Factor=Slider(4, range=0..10))
extrude_5 = Extrude(Base=boundary_surfaces, Direction=unit_z_3)
dispatch_5 = Dispatch(List=flatten(extrude_5), DispatchPattern=[True, False])  # -> ListA, ListB
geometry_8 = Geometry(dispatch_5.ListB)
deconstruct_brep_12 = DeconstructBrep(Brep=geometry_8)  # -> Faces, Edges, Vertices
point_8 = Point(move_7.Geometry)
geometry_9 = Geometry(pipe)
list_item_21 = ListItem(List=deconstruct_brep_12.Faces, Index=Slider(0, range=0..10), Wrap=True)
deconstruct_brep_13 = DeconstructBrep(Brep=geometry_9)  # -> Faces, Edges, Vertices
area_11 = Area(Geometry=list_item_21)  # -> Area, Centroid
list_item_22 = ListItem(List=deconstruct_brep_13.Faces, Index=0, Wrap=True)
surface_closest_point_4 = SurfaceClosestPoint(Point=point_8, Surface=list_item_22)  # -> Point, UVPoint, Distance
orient_6 = Orient(Geometry=geometry_8, Source=area_11.Centroid, Target=surface_closest_point_4.Point)  # -> Geometry, Transform
merge_11 = Merge(Data1=orient_6.Geometry, Data2=dispatch_5.ListA)

pi_5 = Pi(Factor=Slider(0.5, range=0..1))

xz_plane_4 = XZPlane(Origin=Point(0, 0, 0))
polar_array = PolarArray(Geometry=move_7.Geometry, Plane=xz_plane_4, Count=10, Angle=6.283185307)  # -> Geometry, Transform
list_length_2 = ListLength(List=polar_array.Geometry)
scale_5 = Scale(Geometry=polar_array.Geometry, Center=xz_plane_4, Factor=Slider(1, range=0..10))  # -> Geometry, Transform
division_10 = Division(A=list_length_2, B="2")
shift_list = ShiftList(List=scale_5.Geometry, Shift="-2", Wrap=True)
list_item_23 = ListItem(List=scale_5.Geometry, Index=0, Wrap=True)
split_list_2 = SplitList(List=shift_list, Index=division_10)  # -> ListA, ListB
unit_x_10 = UnitX(Factor=Slider(21, range=0..100))
point_9 = Point(split_list_2.ListA)
move_18 = Move(Geometry=point_9, Motion=unit_x_10)  # -> Geometry, Transform
number_slider_9 = Slider(1, range=0..1)
scale_6 = Scale(Geometry=move_18.Geometry, Center=list_item_23, Factor=0.5)  # -> Geometry, Transform
nurbs_curve_2 = NurbsCurve(Vertices=[split_list_2.ListB, scale_6.Geometry], Degree=Slider(3, range=0..10), Periodic=number_slider_9)  # -> Curve, Length, Domain
unit_y_8 = UnitY(Factor=number_slider_9)
boundary_surfaces_2 = BoundarySurfaces(Edges=nurbs_curve_2.Curve)
pi_6 = Pi(Factor=Slider(0.106, range=-0.5..0.5))
extrude_6 = Extrude(Base=boundary_surfaces_2, Direction=unit_y_8)
construct_point_3 = ConstructPoint(XCoordinate=0, YCoordinate=0, ZCoordinate=0)
rotate_3d_3 = Rotate3D(Geometry=extrude_6, Angle=pi_6, Center=construct_point_3, Axis=geometry_2)  # -> Geometry, Transform
merge_12 = Merge(Data1=rotate_3d_3.Geometry, Data2=cap_holes_5)  # -> flatten(Result)

panel_2 = Panel("""0
-1""")
# ENGINE UNIT
list_item_24 = ListItem(List=scale_6.Geometry, Index=panel_2, Wrap=True)
dispatch_6 = Dispatch(List=list_item_24, DispatchPattern=[True, False])  # -> ListA, ListB
line_12 = Line(StartPoint=dispatch_6.ListA, EndPoint=dispatch_6.ListB)
unit_y_9 = UnitY(Factor=Slider(5.26, range=0..10))
curve_middle_5 = CurveMiddle(Curve=line_12)
negative_14 = Negative(Value=unit_y_9)
rotate_3d_4 = Rotate3D(Geometry=curve_middle_5, Angle=pi_6, Center=construct_point_3, Axis=geometry_2)  # -> Geometry, Transform
move_19 = Move(Geometry=rotate_3d_4.Geometry, Motion=negative_14)  # -> Geometry, Transform
line_13 = Line(StartPoint=rotate_3d_4.Geometry, EndPoint=move_19.Geometry)
curve_middle_6 = CurveMiddle(Curve=line_13)
end_points_11 = EndPoints(Curve=line_13)  # -> Start, End
xy_plane_4 = XYPlane(Origin=Point(0, 0, 0))
number_slider_10 = Slider(0.7, range=0..1)
scale_7 = Scale(Geometry=line_13, Center=curve_middle_6, Factor=0.5)  # -> Geometry, Transform
construct_plane_3 = ConstructPlane(Origin=[end_points_11.Start, end_points_11.End], XAxis=Vector(1, 0, 0), YAxis=xy_plane_4)
end_points_12 = EndPoints(Curve=scale_7.Geometry)  # -> Start, End
circle_3 = Circle(Plane=construct_plane_3, Radius=number_slider_10)
division_11 = Division(A=number_slider_10, B="2")
vector_2pt_3 = Vector2Pt(PointA=[end_points_11.Start, end_points_11.End], PointB=[end_points_12.Start, end_points_12.End], Unitize=False)  # -> Vector, Length
boundary_surfaces_3 = BoundarySurfaces(Edges=circle_3)
extrude_7 = Extrude(Base=boundary_surfaces_3, Direction=vector_2pt_3.Vector)
pipe_2 = Pipe(Curve=scale_7.Geometry, Radius=division_11, Caps=1)
geometry_10 = Geometry(boundary_surfaces_3)
dispatch_7 = Dispatch(List=flatten(geometry_10), DispatchPattern=[True, False])  # -> ListA, ListB
area_12 = Area(Geometry=dispatch_7.ListB)  # -> Area, Centroid
unit_y_10 = UnitY(Factor=Slider(13.425, range=0..20))
scale_nu = ScaleNU(
    Geometry=dispatch_7.ListB,
    Plane=area_12.Centroid,
    ScaleX=Slider(4.77, range=0..10),
    ScaleY=1,
    ScaleZ=Slider(3.66, range=0..10))  # -> Geometry, Transform
negative_15 = Negative(Value=unit_y_10)
xy_plane_5 = XYPlane(Origin=Point(0, 0, 0))
extrude_8 = Extrude(Base=scale_nu.Geometry, Direction=negative_15)
deconstruct_brep_14 = DeconstructBrep(Brep=extrude_8)  # -> Faces, Edges, Vertices
list_item_25 = ListItem(List=deconstruct_brep_14.Faces, Index="2", Wrap=True)
area_13 = Area(Geometry=list_item_25)  # -> Area, Centroid
construct_plane_4 = ConstructPlane(Origin=area_13.Centroid, XAxis=Vector(1, 0, 0), YAxis=xy_plane_5)
volume_5 = Volume(Geometry=extrude_8)  # -> Volume, Centroid
circle_4 = Circle(Plane=construct_plane_4, Radius=Slider(1.462, range=0..2))
list_item_26 = ListItem(List=deconstruct_brep_14.Vertices, Index=Slider(3, range=0..10), Wrap=True)
divide_curve_4 = DivideCurve(Curve=circle_4, Count=10, Kinks=False)  # -> Points, Tangents, Parameters
panel_3 = Panel("""1
2
3
4""")
number_slider_11 = Slider(1.829, range=0..2)
unit_z_4 = UnitZ(Factor=Slider(3, range=0..10))
point_10 = Point(list_item_26)
circle_5 = Circle(Plane=volume_5.Centroid, Radius=1)
cull_index = CullIndex(List=divide_curve_4.Points, Indices=panel_3, Wrap=True)
list_item_27 = ListItem(List=divide_curve_4.Points, Index=[Slider(4, range=0..10), Slider(1, range=0..10)], Wrap=True)
area_14 = Area(Geometry=circle_5)  # -> Area, Centroid
move_20 = Move(Geometry=list_item_27, Motion=unit_z_4)  # -> Geometry, Transform
shift_list_2 = ShiftList(List=cull_index, Shift=1, Wrap=True)
dispatch_8 = Dispatch(List=flatten(move_20.Geometry), DispatchPattern=[True, False])  # -> ListA, ListB
scale_8 = Scale(Geometry=circle_5, Center=area_14.Centroid, Factor=number_slider_11)  # -> Geometry, Transform
geometry_11 = Geometry(dispatch_5.ListA)
unit_z_5 = UnitZ(Factor=number_slider_11)
deconstruct_brep_15 = DeconstructBrep(Brep=geometry_11)  # -> Faces, Edges, Vertices
square = Square(Value=number_slider_11)
interpolate_4 = Interpolate(Vertices=shift_list_2, Degree=3, Periodic=False, KnotStyle=1)  # -> Curve, Length, Domain
line_14 = Line(StartPoint=dispatch_8.ListA, EndPoint=dispatch_8.ListB)
list_item_28 = ListItem(List=deconstruct_brep_15.Faces, Index="2", Wrap=True)
multiplication_6 = Multiplication(A=unit_z_5, B=square)
end_points_13 = EndPoints(Curve=interpolate_4.Curve)  # -> Start, End
area_15 = Area(Geometry=list_item_28)  # -> Area, Centroid
unit_y_11 = UnitY(Factor=Slider(2, range=0..10))
move_21 = Move(Geometry=scale_8.Geometry, Motion=multiplication_6)  # -> Geometry, Transform
line_15 = Line(StartPoint=[end_points_13.Start, end_points_13.End], EndPoint=list_item_27)
area_16 = Area(Geometry=move_21.Geometry)  # -> Area, Centroid
unit_z_6 = UnitZ(Factor=Slider(0.6, range=0..1))
line_16 = Line(StartPoint=[end_points_13.Start, end_points_13.End], EndPoint=list_item_27)
move_22 = Move(Geometry=area_15.Centroid, Motion=unit_y_11)  # -> Geometry, Transform
loft = Loft(
    Curves=[circle_5, move_21.Geometry],
    Options={Adjust=False, Closed=False, LoftEnds=0, LoftSimp=0, LoftType=0, Rebuild=10, Refit=0.01})
end_points_14 = EndPoints(Curve=line_15)  # -> Start, End
move_23 = Move(Geometry=area_16.Centroid, Motion=unit_z_6)  # -> Geometry, Transform
divide_curve_5 = DivideCurve(Curve=move_21.Geometry, Count=10, Kinks=False)  # -> Points, Tangents, Parameters
rectangle_3pt = Rectangle3Pt(PointA=area_15.Centroid, PointB=move_22.Geometry, PointC=point_10)  # -> Rectangle, Length
unit_x_11 = UnitX(Factor=Slider(3, range=0..10))
line_17 = Line(StartPoint=end_points_14.End, EndPoint=move_20.Geometry)
line_18 = Line(StartPoint=divide_curve_5.Points, EndPoint=move_23.Geometry)
boundary_surfaces_4 = BoundarySurfaces(Edges=rectangle_3pt.Rectangle)
negative_16 = Negative(Value=unit_x_11)
merge_13 = Merge(Data1=interpolate_4.Curve, Data2=graft(line_15), Data3=graft(move_20.Geometry), Data4=line_17, Data5=line_14)  # -> flatten(Result)
unit_z_7 = UnitZ(Factor=Slider(0.3, range=0..1))
curve_middle_7 = CurveMiddle(Curve=line_18)
unit_y_12 = UnitY(Factor=Slider(5, range=0..10))
unit_y_13 = UnitY(Factor=1)
extrude_9 = Extrude(Base=boundary_surfaces_4, Direction=negative_16)
move_24 = Move(Geometry=curve_middle_7, Motion=unit_z_7)  # -> Geometry, Transform
join_curves_6 = JoinCurves(Curves=merge_13, Preserve=False)
negative_17 = Negative(Value=unit_y_13)
boundary_surfaces_5 = BoundarySurfaces(Edges=join_curves_6)
extrude_10 = Extrude(Base=boundary_surfaces_5, Direction=unit_y_12)
extrude_11 = Extrude(Base=boundary_surfaces_5, Direction=negative_17)
arc_3pt_3 = Arc3Pt(PointA=move_23.Geometry, PointB=move_24.Geometry, PointC=divide_curve_5.Points)  # -> Arc, Plane, Radius
loft_2 = Loft(Curves=arc_3pt_3.Arc, Options={Adjust=False, Closed=True, LoftEnds=0, LoftSimp=0, LoftType=0, Rebuild=10, Refit=0.01})

# ----
# EXHAUST SYSTEM
geometry_12 = Geometry(scale_nu.Geometry)
evaluate_surface_3 = EvaluateSurface(Surface=reparameterize(geometry_12), Point=md_slider)  # -> Point, Normal, UDirection, VDirection, Frame
move_25 = Move(Geometry=evaluate_surface_3.Point, Motion=unit_y_4)  # -> Geometry, Transform
move_26 = Move(Geometry=move_25.Geometry, Motion=negative_5)  # -> Geometry, Transform
construct_plane_5 = ConstructPlane(Origin=move_26.Geometry, XAxis=xy_plane, YAxis=Vector(0, 1, 0))
polar_array_2 = PolarArray(Geometry=move_25.Geometry, Plane=construct_plane_5, Count=10, Angle=pi_2)  # -> Geometry, Transform
interpolate_5 = Interpolate(Vertices=polar_array_2.Geometry, Degree=3, Periodic=False, KnotStyle=1)  # -> Curve, Length, Domain
line_19 = Line(StartPoint=evaluate_surface_3.Point, EndPoint=move_25.Geometry)
end_points_15 = EndPoints(Curve=interpolate_5.Curve)  # -> Start, End
end_points_16 = EndPoints(Curve=line_19)  # -> Start, End
rotate_3d_5 = Rotate3D(Geometry=polar_array_2.Geometry, Angle=pi_5, Center=end_points_15.End, Axis=Vector(0, 0, 1))  # -> Geometry, Transform
mirror_5 = Mirror(Geometry=rotate_3d_5.Geometry, Plane=end_points_15.End)  # -> Geometry, Transform
interpolate_6 = Interpolate(Vertices=mirror_5.Geometry, Degree=3, Periodic=False, KnotStyle=1)  # -> Curve, Length, Domain
interpolate_7 = Interpolate(Vertices=polar_array_2.Geometry, Degree=3, Periodic=False, KnotStyle=1)  # -> Curve, Length, Domain
unit_z_8 = UnitZ(Factor=1)
merge_14 = Merge(Data1=line_19, Data2=interpolate_7.Curve, Data3=interpolate_6.Curve)
end_points_17 = EndPoints(Curve=interpolate_6.Curve)  # -> Start, End
xy_plane_6 = XYPlane(Origin=Point(0, 0, 0))
move_27 = Move(Geometry=interpolate_6.Curve, Motion=unit_z_8)  # -> Geometry, Transform
number_slider_12 = Slider(0.25, range=0..1)
join_curves_7 = JoinCurves(Curves=merge_14, Preserve=False)
construct_plane_6 = ConstructPlane(Origin=end_points_17.Start, XAxis=xy_plane_6, YAxis=Vector(0, 1, 0))
circle_6 = Circle(Plane=construct_plane_6, Radius=Slider(1.35, range=0..2))
pipe_3 = Pipe(Curve=move_27.Geometry, Radius=number_slider_12, Caps=1)
pipe_4 = Pipe(Curve=join_curves_7, Radius=number_slider_12, Caps=1)
boundary_surfaces_6 = BoundarySurfaces(Edges=circle_6)
unit_x_12 = UnitX(Factor=number_slider_6)
extrude_12 = Extrude(Base=boundary_surfaces_6, Direction=unit_x_12)
merge_15 = Merge(Data1=pipe_4, Data2=extrude_12, Data3=pipe_3)

# ----
# Full multiplicity knots at start
# Simple knots
# Full multiplicity knots at end
# P1
# A=0.2*P1+ 0.8*P2
# D=0.2*A + 0.8*B
# P2
# B=0.47*P2 + 0.53*P3
# Full multiplicity knots at start
# E=0.7*B + 0.3*C
# P3
# Full multiplicity knots in the middle
# C=0.8*P3 + 0.2*P4
# P4
# Full multiplicity knots at end
solid_union = SolidUnion(Breps=merge_12)
# GH solution
# VB
# C#
# Python with RhinoCommon Only
# Pythong with RhinoScriptSyntax
# GH solution
# VB
# C#
# Python
# VB
merge_16 = Merge(
    Data1=pipe_2,
    Data2=extrude_7,
    Data3=extrude_8,
    Data4=loft,
    Data5=loft_2,
    Data6=extrude_9,
    Data7=extrude_11,
    Data8=extrude_10,
    Data9=merge_15)
# rc
merge_17 = Merge(Data1=merge_6, Data2=mirror_2.Geometry)
# Compare knot spacing
merge_18 = Merge(
    Data1=sweep1,
    Data2=sphere,
    Data3=dispatch.ListA,
    Data4=cap_holes_3,
    Data5=merge,
    Data6=mirror.Geometry,
    Data7=sphere_2,
    Data8=cap_holes_4,
    Data9=pipe,
    Data10=merge_7,
    Data11=merge_10,
    Data12=merge_11)
