# Grasshopper definition Sets141eParametricBubbleCar.gh (Grasshopper 1.0.7)
# Copyright: Wickerson Studios
# plug-ins: Bifocals

# ----
# SURFACE CREASE
number_slider = Slider(20, range=0..100)
construct_point = ConstructPoint(XCoordinate=0, YCoordinate=0, ZCoordinate=0)
unit_x = UnitX(Factor=number_slider)
move = Move(Geometry=construct_point, Motion=unit_x)  # -> Geometry, Transform
line = Line(StartPoint=construct_point, EndPoint=move.Geometry)
end_points = EndPoints(Curve=line)  # -> Start, End
division = Division(A=number_slider, B=Slider(7.907, range=0..10))
unit_y = UnitY(Factor=division)
negative = Negative(Value=unit_y)
move_2 = Move(Geometry=construct_point, Motion=[unit_y, negative])  # -> Geometry, Transform
line_2 = Line(StartPoint=construct_point, EndPoint=move_2.Geometry)
join_curves = JoinCurves(Curves=line_2, Preserve=False)
end_points_2 = EndPoints(Curve=join_curves)  # -> Start, End
division_2 = Division(A=number_slider, B=Slider(1.252, range=0..10))
unit_y_2 = UnitY(Factor=division_2)
negative_2 = Negative(Value=unit_y_2)
move_3 = Move(Geometry=end_points.End, Motion=[unit_y_2, negative_2])  # -> Geometry, Transform
line_3 = Line(StartPoint=end_points.End, EndPoint=move_3.Geometry)
join_curves_2 = JoinCurves(Curves=line_3, Preserve=False)
end_points_3 = EndPoints(Curve=join_curves_2)  # -> Start, End

curve = Curve(line_3)
join_curves_3 = JoinCurves(Curves=curve, Preserve=False)
end_points_4 = EndPoints(Curve=join_curves_3)  # -> Start, End
curve_middle = CurveMiddle(Curve=join_curves_3)
number_slider_2 = Slider(0.72, range=0..1)
list_item = ListItem(List=end_points_4.End, Index=0, Wrap=True)
xz_plane = XZPlane(Origin=list_item)
circle = Circle(Plane=xz_plane, Radius=number_slider_2)
division_3 = Division(A=number_slider, B=Slider(3.03, range=0..4))
sphere = Sphere(Base=[end_points_4.Start, end_points_4.End], Radius=1)
sweep1 = Sweep1(Rail=join_curves_3, Sections=circle, Miter=1)
unit_x_2 = UnitX(Factor=division_3)
cap_holes = CapHoles(Brep=sweep1)
negative_3 = Negative(Value=unit_x_2)
move_4 = Move(Geometry=cap_holes, Motion=[unit_x_2, negative_3])  # -> Geometry, Transform
scale = Scale(Geometry=move_4.Geometry, Center=curve_middle, Factor=Slider(0.11, range=0..1))  # -> Geometry, Transform
cap_holes_2 = CapHoles(Brep=scale.Geometry)
dispatch = Dispatch(List=cap_holes_2, DispatchPattern=[True, False])  # -> ListA, ListB
volume = Volume(Geometry=dispatch.ListB)  # -> Volume, Centroid
scale_2 = Scale(Geometry=dispatch.ListB, Center=volume.Centroid, Factor=Slider(2, range=0..2))  # -> Geometry, Transform
deconstruct_brep = DeconstructBrep(Brep=[dispatch.ListA, scale_2.Geometry])  # -> Faces, Edges, Vertices
list_item_2 = ListItem(List=deconstruct_brep.Faces, Index=0, Wrap=True)  # -> flatten(Item)
dispatch_2 = Dispatch(List=list_item_2, DispatchPattern=[True, False])  # -> ListA, ListB
area = Area(Geometry=dispatch_2.ListA)  # -> Area, Centroid
area_2 = Area(Geometry=dispatch_2.ListB)  # -> Area, Centroid
line_4 = Line(StartPoint=area.Centroid, EndPoint=area_2.Centroid)
end_points_5 = EndPoints(Curve=line_4)  # -> Start, End
list_item_3 = ListItem(List=end_points_5.Start, Index=0, Wrap=True)
x_size = XSize(Domain(-0.5, 0.5))
yz_plane = YZPlane(Origin=list_item_3)
rectangle = Rectangle(Plane=yz_plane, XSize=x_size, YSize=x_size, Radius=0)  # -> Rectangle, Length
sweep1_2 = Sweep1(Rail=line_4, Sections=rectangle.Rectangle, Miter=1)
cap_holes_3 = CapHoles(Brep=sweep1_2)

construct_domain = ConstructDomain(DomainStart=Slider(0, range=0..100), DomainEnd=Slider(20, range=0..20))
deconstruct_brep_2 = DeconstructBrep(Brep=cap_holes_3)  # -> Faces, Edges, Vertices
range = Range(Domain=construct_domain, Steps=Slider(6, range=0..10))
list_item_4 = ListItem(List=deconstruct_brep_2.Faces, Index=0, Wrap=True)
geometry = Geometry(list_item_4)
graph_mapper = GraphMapper(
    range,
    x0=0,
    x1=10,
    y0=0,
    y1=10,
    container_name="Bezier",
    cpx=[0, 0.3942030668, 0.1391309649, 1],
    cpy=[0.3652909994, 0.6913036108, 0.2275355458, 0.4490559697])
area_3 = Area(Geometry=geometry)  # -> Area, Centroid
vector_xyz = VectorXYZ(XComponent=range, YComponent=graph_mapper, ZComponent=0)  # -> Vector, Length
negative_4 = Negative(Value=vector_xyz.Vector)
move_5 = Move(Geometry=area_3.Centroid, Motion=negative_4)  # -> Geometry, Transform
interpolate = Interpolate(Vertices=move_5.Geometry, Degree=3, Periodic=False, KnotStyle=1)  # -> Curve, Length, Domain
end_points_6 = EndPoints(Curve=interpolate.Curve)  # -> Start, End
orient = Orient(Geometry=interpolate.Curve, Source=end_points_6.Start, Target=area_3.Centroid)  # -> Geometry, Transform
sweep1_3 = Sweep1(Rail=orient.Geometry, Sections=geometry, Miter=1)
cap_holes_4 = CapHoles(Brep=sweep1_3)
deconstruct_brep_3 = DeconstructBrep(Brep=cap_holes_4)  # -> Faces, Edges, Vertices
curve_middle_2 = CurveMiddle(Curve=line)
merge = Merge(Data1=cap_holes_3, Data2=cap_holes_4)
list_item_5 = ListItem(List=deconstruct_brep_3.Faces, Index=0, Wrap=True)
xz_plane_2 = XZPlane(Origin=curve_middle_2)
area_4 = Area(Geometry=list_item_5)  # -> Area, Centroid
mirror = Mirror(Geometry=merge, Plane=xz_plane_2)  # -> Geometry, Transform
dispatch_3 = Dispatch(List=flatten(mirror.Geometry), DispatchPattern=[True, False])  # -> ListA, ListB
deconstruct_brep_4 = DeconstructBrep(Brep=dispatch_3.ListB)  # -> Faces, Edges, Vertices
list_item_6 = ListItem(List=deconstruct_brep_4.Faces, Index=0, Wrap=True)
area_5 = Area(Geometry=list_item_6)  # -> Area, Centroid
line_5 = Line(StartPoint=area_4.Centroid, EndPoint=area_5.Centroid)
pipe = Pipe(Curve=line_5, Radius=number_slider_2, Caps=1)

# ----
# REAR AXLE
number_slider_3 = Slider(6, range=0..10)
geometry_2 = Geometry(join_curves)
divide_curve = DivideCurve(Curve=geometry_2, Count=number_slider_3, Kinks=False)  # -> Points, Tangents, Parameters
number_slider_4 = Slider(9.35, range=0..10)
list_item_7 = ListItem(List=divide_curve.Points, Index=0, Wrap=True)
list_item_8 = ListItem(List=divide_curve.Points, Index=0, Wrap=True)  # -> Item, Item1, Item2
division_4 = Division(A=list_item_8.Item2, B=number_slider_4)
division_5 = Division(A=list_item_8.Item1, B=number_slider_4)
list_item_9 = ListItem(List=divide_curve.Points, Index="-1", Wrap=True)
unit_x_3 = UnitX(Factor=division_4)
unit_x_4 = UnitX(Factor=division_5)
unit_x_5 = UnitX(Factor=division_4)
unit_x_6 = UnitX(Factor=division_4)
move_6 = Move(Geometry=division_4, Motion=unit_x_4)  # -> Geometry, Transform
move_7 = Move(Geometry=division_5, Motion=unit_x_5)  # -> Geometry, Transform
move_8 = Move(Geometry=list_item_9, Motion=unit_x_3)  # -> Geometry, Transform
move_9 = Move(Geometry=list_item_7, Motion=unit_x_6)  # -> Geometry, Transform
merge_2 = Merge(Data1=move_9.Geometry, Data2=move_7.Geometry, Data3=move_6.Geometry, Data4=move_8.Geometry)
polyline = PolyLine(Vertices=merge_2, Closed=False)
revolution = Revolution(Curve=polyline, Axis=geometry_2, Domain=Domain(0, 6.283185307))
cap_holes_5 = CapHoles(Brep=revolution)

division_6 = Division(A=number_slider, B=Slider(2.158, range=0..10))
point = Point(end_points_2.End)
unit_y_3 = UnitY(Factor=division_6)
move_10 = Move(Geometry=point, Motion=unit_y_3)  # -> Geometry, Transform
line_6 = Line(StartPoint=move_10.Geometry, EndPoint=point)

# ----
# REVOLVE
number_slider_5 = Slider(7.035, range=0..10)
division_7 = Division(A=division_6, B=number_slider_5)
pi = Pi(Factor=Slider(0.15, range=0..1))
range_2 = Range(Domain=division_6, Steps=10)
multiplication = Multiplication(A=range_2, B=pi)
sine = Sine(Value=multiplication)
negative_5 = Negative(Value=sine)
vector_xyz_2 = VectorXYZ(XComponent=range_2, YComponent=negative_5, ZComponent=0)  # -> Vector, Length
end_points_7 = EndPoints(Curve=line_6)  # -> Start, End
negative_6 = Negative(Value=vector_xyz_2.Vector)
move_11 = Move(Geometry=point, Motion=negative_6)  # -> Geometry, Transform
list_item_10 = ListItem(List=move_11.Geometry, Index="-1", Wrap=True)
point_2 = Point(list_item_10)
division_8 = Division(A=number_slider, B=Slider(3, range=0..100))
unit_x_7 = UnitX(Factor=division_7)
unit_y_4 = UnitY(Factor=division_8)
negative_7 = Negative(Value=unit_x_7)
interpolate_2 = Interpolate(Vertices=move_11.Geometry, Degree=3, Periodic=False, KnotStyle=1)  # -> Curve, Length, Domain
move_12 = Move(Geometry=list_item_10, Motion=unit_y_4)  # -> Geometry, Transform
point_3 = Point(move_12.Geometry)
line_7 = Line(StartPoint=point_2, EndPoint=point_3)
curve_middle_3 = CurveMiddle(Curve=line_7)
move_13 = Move(Geometry=curve_middle_3, Motion=negative_7)  # -> Geometry, Transform
end_points_8 = EndPoints(Curve=interpolate_2.Curve)  # -> Start, End
line_8 = Line(StartPoint=list_item_10, EndPoint=move_12.Geometry)
end_points_9 = EndPoints(Curve=line_8)  # -> Start, End
arc_3pt = Arc3Pt(PointA=point_2, PointB=move_13.Geometry, PointC=point_3)  # -> Arc, Plane, Radius
line_9 = Line(StartPoint=end_points_9.End, EndPoint=end_points_7.Start)
merge_3 = Merge(Data1=line_8, Data2=arc_3pt.Arc)
merge_4 = Merge(Data1=interpolate_2.Curve, Data2=line_8, Data3=line_9)
join_curves_4 = JoinCurves(Curves=merge_3, Preserve=False)
join_curves_5 = JoinCurves(Curves=merge_4, Preserve=False)
merge_5 = Merge(Data1=join_curves_5, Data2=join_curves_4)
revolution_2 = Revolution(Curve=merge_5, Axis=line_6, Domain=Domain(0, 6.283185307))
construct_point_2 = ConstructPoint(XCoordinate=0, YCoordinate=0, ZCoordinate=0)
orient_2 = Orient(Geometry=revolution_2, Source=end_points_7.Start, Target=end_points_3.End)  # -> Geometry, Transform
merge_6 = Merge(Data1=revolution_2, Data2=orient_2.Geometry)
xz_plane_3 = XZPlane(Origin=construct_point_2)
mirror_2 = Mirror(Geometry=merge_6, Plane=xz_plane_3)  # -> Geometry, Transform

# ----
# CHASSIS
number_slider_6 = Slider(2.61, range=0..10)
end_points_10 = EndPoints(Curve=line_5)  # -> Start, End
construct_domain_2 = ConstructDomain(DomainStart=0, DomainEnd=number_slider_6)
number_slider_7 = Slider(7.83, range=0..10)
curve_middle_4 = CurveMiddle(Curve=line_5)
point_on_curve = PointOnCurve(line_5, parameter=0.852)
point_4 = Point(end_points_10.End)
range_3 = Range(Domain=construct_domain_2, Steps=Slider(10, range=0..10))
sine_2 = Sine(Value=range_3)
multiplication_2 = Multiplication(A=range_3, B=number_slider_7)
deconstruct_brep_5 = DeconstructBrep(Brep=pipe)  # -> Faces, Edges, Vertices
multiplication_3 = Multiplication(A=sine_2, B=number_slider_7)
vector_xyz_3 = VectorXYZ(XComponent=0, YComponent=multiplication_2, ZComponent=multiplication_3)  # -> Vector, Length
list_item_11 = ListItem(List=deconstruct_brep_5.Faces, Index=Slider(2, range=0..2), Wrap=True)
negative_8 = Negative(Value=vector_xyz_3.Vector)
geometry_3 = Geometry(list_item_11)
move_14 = Move(Geometry=point_4, Motion=negative_8)  # -> Geometry, Transform
nurbs_curve = NurbsCurve(Vertices=move_14.Geometry, Degree=3, Periodic=False)  # -> Curve, Length, Domain
sweep1_4 = Sweep1(Rail=nurbs_curve.Curve, Sections=geometry_3, Miter=1)
cap_holes_6 = CapHoles(Brep=sweep1_4)
negative_9 = Negative(Value=Slider(0.5, range=0..1))
orient_3 = Orient(Geometry=cap_holes_6, Source=point_4, Target=curve_middle_4)  # -> Geometry, Transform
unit_y_5 = UnitY(Factor=1)
pi_2 = Pi(Factor=negative_9)
pi_3 = Pi(Factor=Slider(0.1, range=0..1))
rotate_3d = Rotate3D(Geometry=orient_3.Geometry, Angle=pi_2, Center=curve_middle_4, Axis=Vector(0, 0, 1))  # -> Geometry, Transform
line_sdl = LineSDL(Start=curve_middle_4, Direction=unit_y_5, Length=1)
rotate_3d_2 = Rotate3D(Geometry=rotate_3d.Geometry, Angle=pi_3, Center=curve_middle_4, Axis=line_sdl)  # -> Geometry, Transform
deconstruct_brep_6 = DeconstructBrep(Brep=rotate_3d_2.Geometry)  # -> Faces, Edges, Vertices
list_item_12 = ListItem(List=deconstruct_brep_6.Faces, Index=0, Wrap=True)
volume_2 = Volume(Geometry=pipe)  # -> Volume, Centroid
area_6 = Area(Geometry=list_item_12)  # -> Area, Centroid
orient_4 = Orient(Geometry=pipe, Source=volume_2.Centroid, Target=area_6.Centroid)  # -> Geometry, Transform
deconstruct_brep_7 = DeconstructBrep(Brep=orient_4.Geometry)  # -> Faces, Edges, Vertices
list_item_13 = ListItem(List=deconstruct_brep_7.Faces, Index=Slider(2, range=0..10), Wrap=True)
panel = Panel("""4
0""")
divide_curve_2 = DivideCurve(Curve=list_item_13, Count=10, Kinks=False)  # -> Points, Tangents, Parameters
list_item_14 = ListItem(List=divide_curve_2.Points, Index=panel, Wrap=True)
deconstruct_brep_8 = DeconstructBrep(Brep=revolution_2)  # -> flatten(Faces), Edges, Vertices
list_item_15 = ListItem(List=deconstruct_brep_8.Faces, Index=Slider(3, range=0..10), Wrap=True)
geometry_4 = Geometry(list_item_15)
surface_closest_point = SurfaceClosestPoint(Point=list_item_14, Surface=geometry_4)  # -> Point, UVPoint, Distance
dispatch_4 = Dispatch(List=surface_closest_point.Point, DispatchPattern=[True, False])  # -> ListA, ListB
line_10 = Line(StartPoint=dispatch_4.ListA, EndPoint=dispatch_4.ListB)
point_on_curve_2 = PointOnCurve(line_10, parameter=0.186)
unit_z = UnitZ(Factor=Slider(0.1, range=0..0.1))
surface_closest_point_2 = SurfaceClosestPoint(Point=point_on_curve_2, Surface=geometry_4)  # -> Point, UVPoint, Distance
move_15 = Move(Geometry=surface_closest_point_2.Point, Motion=unit_z)  # -> Geometry, Transform
arc_3pt_2 = Arc3Pt(PointA=dispatch_4.ListA, PointB=move_15.Geometry, PointC=dispatch_4.ListB)  # -> Arc, Plane, Radius
scale_3 = Scale(Geometry=arc_3pt_2.Arc, Center=surface_closest_point_2.Point, Factor=Slider(30, range=0..30))  # -> Geometry, Transform
area_7 = Area(Geometry=list_item_13)  # -> Area, Centroid
list_item_16 = ListItem(List=divide_curve_2.Points, Index=0, Wrap=True)
orient_5 = Orient(Geometry=scale_3.Geometry, Source=point_on_curve_2, Target=list_item_16)  # -> Geometry, Transform
unit_y_6 = UnitY(Factor=Slider(20, range=0..20))
negative_10 = Negative(Value=unit_y_6)
md_slider = MDSlider(
    SliderMode=0,
    slider_value=Point(0.5065527922, 0.4729926877, 0.5),
    x_domain=Domain(0, 1),
    y_domain=Domain(0, 1),
    z_domain=Domain(0, 1))
extrude = Extrude(Base=orient_5.Geometry, Direction=negative_10)
evaluate_surface = EvaluateSurface(Surface=reparameterize(extrude), Point=md_slider)  # -> Point, Normal, UDirection, VDirection, Frame
multiplication_4 = Multiplication(A=Slider(2, range=0..2), B=evaluate_surface.Normal)
volume_3 = Volume(Geometry=orient_4.Geometry)  # -> Volume, Centroid
xy_plane = XYPlane(Origin=Point(0, 0, 0))
extrude_2 = Extrude(Base=extrude, Direction=multiplication_4)
construct_plane = ConstructPlane(Origin=volume_3.Centroid, XAxis=Vector(1, 0, 0), YAxis=xy_plane)
mirror_3 = Mirror(Geometry=extrude_2, Plane=construct_plane)  # -> Geometry, Transform
sphere_2 = Sphere(Base=deconstruct_brep_7.Vertices, Radius=Slider(5.92, range=0..10))
merge_7 = Merge(Data1=rotate_3d_2.Geometry, Data2=sweep1_4, Data3=orient_4.Geometry, Data4=extrude_2, Data5=mirror_3.Geometry)

# ----
# REAR SUSPENSION
number_slider_8 = Slider(5, range=0..10)
deconstruct_brep_9 = DeconstructBrep(Brep=cap_holes_4)  # -> Faces, Edges, Vertices
list_item_17 = ListItem(List=deconstruct_brep_9.Faces, Index=0, Wrap=True)
unit_x_8 = UnitX(Factor=number_slider_8)
negative_11 = Negative(Value=unit_x_8)
number_slider_9 = Slider(4, range=0..10)
extrude_3 = Extrude(Base=list_item_17, Direction=negative_11)
deconstruct_brep_10 = DeconstructBrep(Brep=extrude_3)  # -> Faces, Edges, Vertices
list_item_18 = ListItem(List=deconstruct_brep_10.Faces, Index=number_slider_9, Wrap=True)
area_8 = Area(Geometry=list_item_18)  # -> Area, Centroid
unit_x_9 = UnitX(Factor=Slider(10, range=0..10))
scale_4 = Scale(Geometry=list_item_18, Center=area_8.Centroid, Factor=0.5)  # -> Geometry, Transform
negative_12 = Negative(Value=unit_x_9)
extrude_4 = Extrude(Base=scale_4.Geometry, Direction=negative_12)
deconstruct_brep_11 = DeconstructBrep(Brep=extrude_4)  # -> Faces, Edges, Vertices
list_item_19 = ListItem(List=deconstruct_brep_11.Faces, Index=number_slider_9, Wrap=True)
area_9 = Area(Geometry=list_item_19)  # -> Area, Centroid
list_item_20 = ListItem(List=deconstruct_brep_7.Faces, Index=0, Wrap=True)  # -> Item, Item1, Item2
md_slider_2 = MDSlider(
    SliderMode=0,
    slider_value=Point(0.9928856826, 0.3489632955, 0.5),
    x_domain=Domain(0, 1),
    y_domain=Domain(0, 1),
    z_domain=Domain(0, 1))
surface_closest_point_3 = SurfaceClosestPoint(Point=area_9.Centroid, Surface=list_item_20.Item)  # -> Point, UVPoint, Distance
geometry_5 = Geometry(list_item_20.Item1)
area_10 = Area(Geometry=geometry_5)  # -> Area, Centroid
evaluate_surface_2 = EvaluateSurface(Surface=reparameterize(list_item_20.Item), Point=md_slider_2)  # -> Point, Normal, UDirection, VDirection, Frame
line_11 = Line(StartPoint=area_9.Centroid, EndPoint=surface_closest_point_3.Point)
divide_curve_3 = DivideCurve(Curve=line_11, Count=10, Kinks=False)  # -> Points, Tangents, Parameters
point_5 = Point(evaluate_surface_2.Point)
interpolate_3 = Interpolate(Vertices=divide_curve_3.Points, Degree=3, Periodic=False, KnotStyle=1)  # -> Curve, Length, Domain
list_length = ListLength(List=divide_curve_3.Points)
division_9 = Division(A=list_length, B="2")
split_list = SplitList(List=divide_curve_3.Points, Index=division_9)  # -> ListA, ListB
vector_2pt = Vector2Pt(PointA=area_10.Centroid, PointB=point_5, Unitize=False)  # -> Vector, Length
vector_2pt_2 = Vector2Pt(PointA=area_10.Centroid, PointB=point_5, Unitize=False)  # -> Vector, Length
point_6 = Point(split_list.ListB)
point_7 = Point(split_list.ListA)
multiplication_5 = Multiplication(A=vector_2pt_2.Vector, B="2")
move_16 = Move(Geometry=point_7, Motion=vector_2pt.Vector)  # -> Geometry, Transform
move_17 = Move(Geometry=point_6, Motion=multiplication_5)  # -> Geometry, Transform
polyline_2 = PolyLine(Vertices=[move_16.Geometry, move_17.Geometry], Closed=False)
revolution_3 = Revolution(Curve=polyline_2, Axis=interpolate_3.Curve, Domain=Domain(0, 6.283185307))
cap_holes_7 = CapHoles(Brep=revolution_3)
xy_plane_2 = XYPlane(Origin=Point(0, 0, 0))
merge_8 = Merge(Data1=extrude_3, Data2=extrude_4)
merge_9 = Merge(Data1=merge_8, Data2=cap_holes_7)
construct_plane_2 = ConstructPlane(Origin=Point(0, 0, 0), XAxis=Vector(1, 0, 0), YAxis=xy_plane_2)
mirror_4 = Mirror(Geometry=merge_9, Plane=construct_plane_2)  # -> Geometry, Transform
merge_10 = Merge(Data1=merge_9, Data2=mirror_4.Geometry)
geometry_6 = Geometry(dispatch_3.ListB)
geometry_7 = Geometry(pipe)
volume_4 = Volume(Geometry=[geometry_6, geometry_7])  # -> Volume, Centroid
circle_2 = Circle(Plane=volume_4.Centroid, Radius=Slider(0.5, range=0..1))
boundary_surfaces = BoundarySurfaces(Edges=circle_2)
unit_z_2 = UnitZ(Factor=Slider(4.32, range=0..10))
extrude_5 = Extrude(Base=boundary_surfaces, Direction=unit_z_2)
dispatch_5 = Dispatch(List=flatten(extrude_5), DispatchPattern=[True, False])  # -> ListA, ListB
geometry_8 = Geometry(dispatch_5.ListB)
deconstruct_brep_12 = DeconstructBrep(Brep=geometry_8)  # -> Faces, Edges, Vertices
point_8 = Point(move_7.Geometry)
geometry_9 = Geometry(pipe)
list_item_21 = ListItem(List=deconstruct_brep_12.Faces, Index=Slider(0, range=0..10), Wrap=True)
deconstruct_brep_13 = DeconstructBrep(Brep=geometry_9)  # -> Faces, Edges, Vertices
area_11 = Area(Geometry=list_item_21)  # -> Area, Centroid
list_item_22 = ListItem(List=deconstruct_brep_13.Faces, Index=0, Wrap=True)
surface_closest_point_4 = SurfaceClosestPoint(Point=point_8, Surface=list_item_22)  # -> Point, UVPoint, Distance
orient_6 = Orient(Geometry=geometry_8, Source=area_11.Centroid, Target=surface_closest_point_4.Point)  # -> Geometry, Transform
merge_11 = Merge(Data1=orient_6.Geometry, Data2=dispatch_5.ListA)

xz_plane_4 = XZPlane(Origin=Point(0, 0, 0))
polar_array = PolarArray(Geometry=move_7.Geometry, Plane=xz_plane_4, Count=10, Angle=6.283185307)  # -> Geometry, Transform
list_length_2 = ListLength(List=polar_array.Geometry)
scale_5 = Scale(Geometry=polar_array.Geometry, Center=xz_plane_4, Factor=Slider(6, range=0..10))  # -> Geometry, Transform
division_10 = Division(A=list_length_2, B="2")
shift_list = ShiftList(List=scale_5.Geometry, Shift="-2", Wrap=True)
list_item_23 = ListItem(List=scale_5.Geometry, Index=0, Wrap=True)
split_list_2 = SplitList(List=shift_list, Index=division_10)  # -> ListA, ListB
unit_x_10 = UnitX(Factor=Slider(63, range=0..100))
point_9 = Point(split_list_2.ListA)
move_18 = Move(Geometry=point_9, Motion=unit_x_10)  # -> Geometry, Transform
number_slider_10 = Slider(1, range=0..1)
scale_6 = Scale(Geometry=move_18.Geometry, Center=list_item_23, Factor=0.5)  # -> Geometry, Transform
nurbs_curve_2 = NurbsCurve(Vertices=[split_list_2.ListB, scale_6.Geometry], Degree=Slider(3, range=0..10), Periodic=number_slider_10)  # -> Curve, Length, Domain
unit_y_7 = UnitY(Factor=number_slider_10)
boundary_surfaces_2 = BoundarySurfaces(Edges=nurbs_curve_2.Curve)
pi_4 = Pi(Factor=Slider(0.354, range=-0.5..0.5))
extrude_6 = Extrude(Base=boundary_surfaces_2, Direction=unit_y_7)
construct_point_3 = ConstructPoint(XCoordinate=0, YCoordinate=0, ZCoordinate=0)
rotate_3d_3 = Rotate3D(Geometry=extrude_6, Angle=pi_4, Center=construct_point_3, Axis=geometry_2)  # -> Geometry, Transform
merge_12 = Merge(Data1=rotate_3d_3.Geometry, Data2=cap_holes_5)  # -> flatten(Result)

# ----
# ENGINE UNIT
panel_2 = Panel("""0
-1""")
list_item_24 = ListItem(List=scale_6.Geometry, Index=panel_2, Wrap=True)
dispatch_6 = Dispatch(List=list_item_24, DispatchPattern=[True, False])  # -> ListA, ListB
line_12 = Line(StartPoint=dispatch_6.ListA, EndPoint=dispatch_6.ListB)
unit_y_8 = UnitY(Factor=Slider(10, range=0..10))
curve_middle_5 = CurveMiddle(Curve=line_12)
negative_13 = Negative(Value=unit_y_8)
rotate_3d_4 = Rotate3D(Geometry=curve_middle_5, Angle=pi_4, Center=construct_point_3, Axis=geometry_2)  # -> Geometry, Transform
move_19 = Move(Geometry=rotate_3d_4.Geometry, Motion=negative_13)  # -> Geometry, Transform
line_13 = Line(StartPoint=rotate_3d_4.Geometry, EndPoint=move_19.Geometry)
curve_middle_6 = CurveMiddle(Curve=line_13)
end_points_11 = EndPoints(Curve=line_13)  # -> Start, End
xy_plane_3 = XYPlane(Origin=Point(0, 0, 0))
number_slider_11 = Slider(1, range=0..1)
scale_7 = Scale(Geometry=line_13, Center=curve_middle_6, Factor=0.5)  # -> Geometry, Transform
construct_plane_3 = ConstructPlane(Origin=[end_points_11.Start, end_points_11.End], XAxis=Vector(1, 0, 0), YAxis=xy_plane_3)
end_points_12 = EndPoints(Curve=scale_7.Geometry)  # -> Start, End
circle_3 = Circle(Plane=construct_plane_3, Radius=number_slider_11)
division_11 = Division(A=number_slider_11, B="2")
vector_2pt_3 = Vector2Pt(PointA=[end_points_11.Start, end_points_11.End], PointB=[end_points_12.Start, end_points_12.End], Unitize=False)  # -> Vector, Length
boundary_surfaces_3 = BoundarySurfaces(Edges=circle_3)
extrude_7 = Extrude(Base=boundary_surfaces_3, Direction=vector_2pt_3.Vector)
pipe_2 = Pipe(Curve=scale_7.Geometry, Radius=division_11, Caps=1)
geometry_10 = Geometry(boundary_surfaces_3)
dispatch_7 = Dispatch(List=flatten(geometry_10), DispatchPattern=[True, False])  # -> ListA, ListB
area_12 = Area(Geometry=dispatch_7.ListB)  # -> Area, Centroid
unit_y_9 = UnitY(Factor=Slider(3.556, range=0..20))
scale_nu = ScaleNU(
    Geometry=dispatch_7.ListB,
    Plane=area_12.Centroid,
    ScaleX=Slider(10, range=0..10),
    ScaleY=1,
    ScaleZ=Slider(2.25, range=0..10))  # -> Geometry, Transform
negative_14 = Negative(Value=unit_y_9)
xy_plane_4 = XYPlane(Origin=Point(0, 0, 0))
extrude_8 = Extrude(Base=scale_nu.Geometry, Direction=negative_14)
deconstruct_brep_14 = DeconstructBrep(Brep=extrude_8)  # -> Faces, Edges, Vertices
list_item_25 = ListItem(List=deconstruct_brep_14.Faces, Index="2", Wrap=True)
area_13 = Area(Geometry=list_item_25)  # -> Area, Centroid
construct_plane_4 = ConstructPlane(Origin=area_13.Centroid, XAxis=Vector(1, 0, 0), YAxis=xy_plane_4)
volume_5 = Volume(Geometry=extrude_8)  # -> Volume, Centroid
circle_4 = Circle(Plane=construct_plane_4, Radius=Slider(2, range=0..2))
list_item_26 = ListItem(List=deconstruct_brep_14.Vertices, Index=Slider(3, range=0..10), Wrap=True)
divide_curve_4 = DivideCurve(Curve=circle_4, Count=10, Kinks=False)  # -> Points, Tangents, Parameters
panel_3 = Panel("""1
2
3
4""")
number_slider_12 = Slider(2, range=0..2)
unit_z_3 = UnitZ(Factor=Slider(8.49, range=0..10))
point_10 = Point(list_item_26)
circle_5 = Circle(Plane=volume_5.Centroid, Radius=1)
cull_index = CullIndex(List=divide_curve_4.Points, Indices=panel_3, Wrap=True)
list_item_27 = ListItem(List=divide_curve_4.Points, Index=[Slider(4, range=0..10), Slider(1, range=0..10)], Wrap=True)
area_14 = Area(Geometry=circle_5)  # -> Area, Centroid
move_20 = Move(Geometry=list_item_27, Motion=unit_z_3)  # -> Geometry, Transform
shift_list_2 = ShiftList(List=cull_index, Shift=1, Wrap=True)
dispatch_8 = Dispatch(List=flatten(move_20.Geometry), DispatchPattern=[True, False])  # -> ListA, ListB
scale_8 = Scale(Geometry=circle_5, Center=area_14.Centroid, Factor=number_slider_12)  # -> Geometry, Transform
geometry_11 = Geometry(dispatch_5.ListA)
unit_z_4 = UnitZ(Factor=number_slider_12)
deconstruct_brep_15 = DeconstructBrep(Brep=geometry_11)  # -> Faces, Edges, Vertices
square = Square(Value=number_slider_12)
interpolate_4 = Interpolate(Vertices=shift_list_2, Degree=3, Periodic=False, KnotStyle=1)  # -> Curve, Length, Domain
line_14 = Line(StartPoint=dispatch_8.ListA, EndPoint=dispatch_8.ListB)
list_item_28 = ListItem(List=deconstruct_brep_15.Faces, Index="2", Wrap=True)
multiplication_6 = Multiplication(A=unit_z_4, B=square)
end_points_13 = EndPoints(Curve=interpolate_4.Curve)  # -> Start, End
area_15 = Area(Geometry=list_item_28)  # -> Area, Centroid
unit_y_10 = UnitY(Factor=Slider(10, range=0..10))
move_21 = Move(Geometry=scale_8.Geometry, Motion=multiplication_6)  # -> Geometry, Transform
line_15 = Line(StartPoint=[end_points_13.Start, end_points_13.End], EndPoint=list_item_27)
area_16 = Area(Geometry=move_21.Geometry)  # -> Area, Centroid
unit_z_5 = UnitZ(Factor=Slider(0.3, range=0..1))
line_16 = Line(StartPoint=[end_points_13.Start, end_points_13.End], EndPoint=list_item_27)
move_22 = Move(Geometry=area_15.Centroid, Motion=unit_y_10)  # -> Geometry, Transform
loft = Loft(
    Curves=[circle_5, move_21.Geometry],
    Options={Adjust=False, Closed=False, LoftEnds=0, LoftSimp=0, LoftType=0, Rebuild=10, Refit=0.01})
end_points_14 = EndPoints(Curve=line_15)  # -> Start, End
move_23 = Move(Geometry=area_16.Centroid, Motion=unit_z_5)  # -> Geometry, Transform
divide_curve_5 = DivideCurve(Curve=move_21.Geometry, Count=10, Kinks=False)  # -> Points, Tangents, Parameters
rectangle_3pt = Rectangle3Pt(PointA=area_15.Centroid, PointB=move_22.Geometry, PointC=point_10)  # -> Rectangle, Length
unit_x_11 = UnitX(Factor=Slider(10, range=0..10))
line_17 = Line(StartPoint=end_points_14.End, EndPoint=move_20.Geometry)
line_18 = Line(StartPoint=divide_curve_5.Points, EndPoint=move_23.Geometry)
boundary_surfaces_4 = BoundarySurfaces(Edges=rectangle_3pt.Rectangle)
negative_15 = Negative(Value=unit_x_11)
merge_13 = Merge(Data1=interpolate_4.Curve, Data2=graft(line_15), Data3=graft(move_20.Geometry), Data4=line_17, Data5=line_14)  # -> flatten(Result)
unit_z_6 = UnitZ(Factor=Slider(0.7, range=0..1))
curve_middle_7 = CurveMiddle(Curve=line_18)
unit_y_11 = UnitY(Factor=Slider(9.49, range=0..10))
unit_y_12 = UnitY(Factor=1)
extrude_9 = Extrude(Base=boundary_surfaces_4, Direction=negative_15)
move_24 = Move(Geometry=curve_middle_7, Motion=unit_z_6)  # -> Geometry, Transform
join_curves_6 = JoinCurves(Curves=merge_13, Preserve=False)
negative_16 = Negative(Value=unit_y_12)
boundary_surfaces_5 = BoundarySurfaces(Edges=join_curves_6)
extrude_10 = Extrude(Base=boundary_surfaces_5, Direction=unit_y_11)
extrude_11 = Extrude(Base=boundary_surfaces_5, Direction=negative_16)
arc_3pt_3 = Arc3Pt(PointA=move_23.Geometry, PointB=move_24.Geometry, PointC=divide_curve_5.Points)  # -> Arc, Plane, Radius
loft_2 = Loft(Curves=arc_3pt_3.Arc, Options={Adjust=False, Closed=True, LoftEnds=0, LoftSimp=0, LoftType=0, Rebuild=10, Refit=0.01})

# ----
# 1001 GRASSHOPPER DEFINITIONS
# MATH 137/1001
# Parametric Bubble Car
# Inspired by: R.K.C.Cheng
image_sampler = ImageSampler(
    FilePath="C:\Users\Sculpture\Documents\2020Grasshopper\ScreenShots2019\Screenshots2020\SurfaceEditAlgorithm.PNG",
    Filter="Value",
    Interpolate=False,
    Umax=1,
    Umin=0,
    Vmax=1,
    Vmin=0,
    Wrap=1)
# rc
solid_union = SolidUnion(Breps=merge_12)
merge_14 = Merge(
    Data1=sweep1,
    Data2=sphere,
    Data3=dispatch.ListA,
    Data4=cap_holes_3,
    Data5=merge,
    Data6=mirror.Geometry,
    Data7=sphere_2,
    Data8=cap_holes_4,
    Data9=pipe,
    Data10=merge_7)
merge_15 = Merge(
    Data1=pipe_2,
    Data2=extrude_7,
    Data3=extrude_8,
    Data4=loft,
    Data5=loft_2,
    Data6=extrude_9,
    Data7=extrude_11,
    Data8=extrude_10)
merge_16 = Merge(Data1=merge_6, Data2=mirror_2.Geometry)
merge_17 = Merge(Data1=merge_10, Data2=merge_11)

# ----
# FRONT SUSPENSION
geometry_12 = Geometry(sphere)
dispatch_9 = Dispatch(List=geometry_12, DispatchPattern=[True, False])  # -> ListA, ListB
geometry_13 = Geometry(dispatch_9.ListA)
unit_y_13 = UnitY(Factor=Slider(0.16, range=0..1))
deconstruct_brep_16 = DeconstructBrep(Brep=geometry_13)  # -> Faces, Edges, Vertices
negative_17 = Negative(Value=unit_y_13)
geometry_14 = Geometry(deconstruct_brep_16.Vertices)
move_25 = Move(Geometry=graft(geometry_14), Motion=[unit_y_13, negative_17])  # -> Geometry, Transform
dispatch_10 = Dispatch(List=move_25.Geometry, DispatchPattern=[True, False])  # -> ListA, ListB
volume_6 = Volume(Geometry=geometry_13)  # -> Volume, Centroid
unit_x_12 = UnitX(Factor=Slider(0.11, range=0..1))
line_19 = Line(StartPoint=dispatch_10.ListA, EndPoint=dispatch_10.ListB)
negative_18 = Negative(Value=unit_x_12)
move_26 = Move(Geometry=graft(line_19), Motion=[negative_18, unit_x_12])  # -> Geometry, Transform
vector_2pt_4 = Vector2Pt(PointA=geometry_14, PointB=volume_6.Centroid, Unitize=False)  # -> Vector, Length
geometry_15 = Geometry(move_26.Geometry)
flip_matrix = FlipMatrix(Data=geometry_15)
dispatch_11 = Dispatch(List=flatten(flip_matrix), DispatchPattern=[True, False])  # -> flatten(ListA), flatten(ListB)
dispatch_12 = Dispatch(List=move_26.Geometry, DispatchPattern=[True, False])  # -> flatten(ListA), ListB
unit_x_13 = UnitX(Factor=Slider(0.21, range=0..1))
multiplication_7 = Multiplication(A=vector_2pt_4.Vector, B=Slider(0.85, range=0..1))
negative_19 = Negative(Value=unit_x_13)
loft_3 = Loft(
    Curves=dispatch_12.ListA,
    Options={Adjust=False, Closed=False, LoftEnds=0, LoftSimp=0, LoftType=0, Rebuild=10, Refit=0.01})
loft_4 = Loft(
    Curves=dispatch_11.ListA,
    Options={Adjust=False, Closed=False, LoftEnds=0, LoftSimp=0, LoftType=0, Rebuild=10, Refit=0.01})
loft_5 = Loft(
    Curves=dispatch_11.ListB,
    Options={Adjust=False, Closed=False, LoftEnds=0, LoftSimp=0, LoftType=0, Rebuild=10, Refit=0.01})
extrude_12 = Extrude(Base=loft_3, Direction=negative_19)
extrude_13 = Extrude(Base=[loft_4, loft_5], Direction=multiplication_7)
deconstruct_brep_17 = DeconstructBrep(Brep=extrude_12)  # -> Faces, Edges, Vertices
unit_z_7 = UnitZ(Factor=Slider(0.8, range=0..1))
list_item_29 = ListItem(List=deconstruct_brep_17.Faces, Index=Slider(2, range=0..10), Wrap=True)
list_item_30 = ListItem(List=deconstruct_brep_17.Faces, Index=Slider(4, range=0..10), Wrap=True)
boundary_surfaces_6 = BoundarySurfaces(Edges=list_item_30)
mirror_5 = Mirror(Geometry=extrude_12, Plane=list_item_29)  # -> Geometry, Transform
negative_20 = Negative(Value=unit_z_7)
extrude_14 = Extrude(Base=boundary_surfaces_6, Direction=negative_20)
deconstruct_brep_18 = DeconstructBrep(Brep=mirror_5.Geometry)  # -> Faces, Edges, Vertices
deconstruct_brep_19 = DeconstructBrep(Brep=extrude_14)  # -> Faces, Edges, Vertices
list_item_31 = ListItem(List=deconstruct_brep_18.Faces, Index=Slider(0, range=0..10), Wrap=True)
xy_plane_5 = XYPlane(Origin=Point(0, 0, 0))
area_17 = Area(Geometry=list_item_31)  # -> Area, Centroid
list_item_32 = ListItem(List=deconstruct_brep_19.Faces, Index=Slider(1, range=0..10), Wrap=True)
xz_plane_5 = XZPlane(Origin=Point(0, 0, 0))
area_18 = Area(Geometry=list_item_32)  # -> Area, Centroid
construct_plane_5 = ConstructPlane(Origin=area_17.Centroid, XAxis=xy_plane_5, YAxis=Vector(0, 1, 0))
mirror_6 = Mirror(Geometry=area_18.Centroid, Plane=xz_plane_5)  # -> Geometry, Transform
circle_6 = Circle(Plane=construct_plane_5, Radius=Slider(0.19, range=0..1))
unit_x_14 = UnitX(Factor=Slider(8.96, range=0..10))
boundary_surfaces_7 = BoundarySurfaces(Edges=circle_6)
line_20 = Line(StartPoint=area_18.Centroid, EndPoint=mirror_6.Geometry)
extrude_15 = Extrude(Base=boundary_surfaces_7, Direction=unit_x_14)
sweep1_5 = Sweep1(Rail=line_20, Sections=list_item_32, Miter=1)
curve_middle_8 = CurveMiddle(Curve=line_20)
xz_plane_6 = XZPlane(Origin=Point(0, 0, 0))
xy_plane_6 = XYPlane(Origin=Point(0, 0, 0))
merge_18 = Merge(Data1=extrude_13, Data2=extrude_12, Data3=mirror_5.Geometry, Data4=extrude_15, Data5=extrude_14)
construct_plane_6 = ConstructPlane(Origin=curve_middle_8, XAxis=Vector(1, 0, 0), YAxis=xy_plane_6)
# Full multiplicity knots at start
# Simple knots
# Full multiplicity knots at end
# Full multiplicity knots at start
# Full multiplicity knots in the middle
# Full multiplicity knots at end
mirror_7 = Mirror(Geometry=merge_18, Plane=construct_plane_6)  # -> Geometry, Transform

# ----
# EXHAUST SYSTEM
md_slider_3 = MDSlider(
    SliderMode=0,
    slider_value=Point(0.600193675, 0.5658252995, 0.5),
    x_domain=Domain(0, 1),
    y_domain=Domain(0, 1),
    z_domain=Domain(0, 1))
geometry_16 = Geometry(extrude_10)
number_slider_13 = Slider(7, range=0..10)
geometry_17 = Geometry(scale_nu.Geometry)
deconstruct_brep_20 = DeconstructBrep(Brep=geometry_16)  # -> Faces, Edges, Vertices
number_slider_14 = Slider(5.28, range=0..10)
evaluate_surface_3 = EvaluateSurface(Surface=reparameterize(geometry_17), Point=md_slider_3)  # -> Point, Normal, UDirection, VDirection, Frame
list_item_33 = ListItem(List=deconstruct_brep_20.Faces, Index=number_slider_13, Wrap=True)
unit_z_8 = UnitZ(Factor=1)
area_19 = Area(Geometry=list_item_33)  # -> Area, Centroid
unit_y_14 = UnitY(Factor=number_slider_14)
xy_plane_7 = XYPlane(Origin=Point(0, 0, 0))
negative_21 = Negative(Value=unit_z_8)
move_27 = Move(Geometry=evaluate_surface_3.Point, Motion=unit_y_14)  # -> Geometry, Transform
construct_plane_7 = ConstructPlane(Origin=area_19.Centroid, XAxis=xy_plane_7, YAxis=Vector(0, 1, 0))
move_28 = Move(Geometry=move_27.Geometry, Motion=negative_21)  # -> Geometry, Transform
xy_plane_8 = XYPlane(Origin=Point(0, 0, 0))
center_box = CenterBox(Base=construct_plane_7, X=1, Y=1, Z=Slider(8.56, range=0..10))
construct_plane_8 = ConstructPlane(Origin=move_28.Geometry, XAxis=xy_plane_8, YAxis=Vector(0, 1, 0))
deconstruct_brep_21 = DeconstructBrep(Brep=center_box)  # -> Faces, Edges, Vertices
list_item_34 = ListItem(List=deconstruct_brep_21.Faces, Index=number_slider_13, Wrap=True)
pi_5 = Pi(Factor=Slider(1, range=0..1))
area_20 = Area(Geometry=list_item_34)  # -> Area, Centroid
polar_array_2 = PolarArray(Geometry=move_27.Geometry, Plane=construct_plane_8, Count=10, Angle=pi_5)  # -> Geometry, Transform
xy_plane_9 = XYPlane(Origin=Point(0, 0, 0))
xz_plane_7 = XZPlane(Origin=Point(0, 0, 0))
interpolate_5 = Interpolate(Vertices=polar_array_2.Geometry, Degree=3, Periodic=False, KnotStyle=1)  # -> Curve, Length, Domain
construct_plane_9 = ConstructPlane(Origin=area_20.Centroid, XAxis=xy_plane_9, YAxis=Vector(0, 1, 0))
interpolate_6 = Interpolate(Vertices=polar_array_2.Geometry, Degree=3, Periodic=False, KnotStyle=1)  # -> Curve, Length, Domain
construct_plane_10 = ConstructPlane(Origin=area_20.Centroid, XAxis=Vector(1, 0, 0), YAxis=xz_plane_7)
line_21 = Line(StartPoint=evaluate_surface_3.Point, EndPoint=move_27.Geometry)
unit_z_9 = UnitZ(Factor=1)
pi_6 = Pi(Factor=Slider(0.8, range=0..1))
pi_7 = Pi(Factor=Slider(1, range=0..1))
end_points_15 = EndPoints(Curve=interpolate_5.Curve)  # -> Start, End
rotate_plane = RotatePlane(Plane=construct_plane_10, Angle=pi_6)
end_points_16 = EndPoints(Curve=line_21)  # -> Start, End
xy_plane_10 = XYPlane(Origin=Point(0, 0, 0))
number_slider_15 = Slider(0.91, range=0..1)
# Wickerson Studio
# 
# created by: Michael Wickerson
# 
# Grasshopper for Rhino 3D Algorithmic Modeling
# 
# www.wickersonstudios.com
# www.michaelwickerson.com
# https://www.youtube.com/channel/UC7J48Ppcsa6oncp6d29R0xw
# https://github.com/mwickerson
# https://www.facebook.com/michael.wickerson
# https://www.linkedin.com/in/michael-wickerson-696a80156/
# https://www.grasshopper3d.com/profile/MichaelWickerson
rotate_3d_5 = Rotate3D(Geometry=polar_array_2.Geometry, Angle=pi_7, Center=end_points_15.End, Axis=Vector(0, 0, 1))  # -> Geometry, Transform
deconstruct_plane = DeconstructPlane(Plane=rotate_plane)  # -> Origin, XAxis, YAxis, ZAxis
arc = Arc(Plane=rotate_plane, Radius=1, Angle=Domain(0, 3.141592654))  # -> Arc, Length
mirror_8 = Mirror(Geometry=rotate_3d_5.Geometry, Plane=end_points_15.End)  # -> Geometry, Transform
interpolate_7 = Interpolate(Vertices=mirror_8.Geometry, Degree=3, Periodic=False, KnotStyle=1)  # -> Curve, Length, Domain
merge_19 = Merge(Data1=line_21, Data2=interpolate_6.Curve, Data3=interpolate_7.Curve)
end_points_17 = EndPoints(Curve=interpolate_7.Curve)  # -> Start, End
move_29 = Move(Geometry=interpolate_7.Curve, Motion=unit_z_9)  # -> Geometry, Transform
join_curves_7 = JoinCurves(Curves=merge_19, Preserve=False)
construct_plane_11 = ConstructPlane(Origin=end_points_17.Start, XAxis=xy_plane_10, YAxis=Vector(0, 1, 0))
end_points_18 = EndPoints(Curve=arc.Arc)  # -> Start, End
circle_7 = Circle(Plane=construct_plane_11, Radius=Slider(2, range=0..2))
pipe_3 = Pipe(Curve=move_29.Geometry, Radius=number_slider_15, Caps=1)
pipe_4 = Pipe(Curve=join_curves_7, Radius=number_slider_15, Caps=1)
orient_7 = Orient(Geometry=arc.Arc, Source=end_points_18.Start, Target=deconstruct_plane.Origin)  # -> Geometry, Transform
boundary_surfaces_8 = BoundarySurfaces(Edges=circle_7)
unit_x_15 = UnitX(Factor=number_slider_14)
scale_9 = Scale(Geometry=orient_7.Geometry, Center=end_points_18.End, Factor=0.5)  # -> Geometry, Transform
end_points_19 = EndPoints(Curve=orient_7.Geometry)  # -> Start, End
extrude_16 = Extrude(Base=boundary_surfaces_8, Direction=unit_x_15)
circle_8 = Circle(Plane=construct_plane_9, Radius=Slider(0.73, range=0..1))
mirror_9 = Mirror(Geometry=scale_9.Geometry, Plane=construct_plane_9)  # -> Geometry, Transform
end_points_20 = EndPoints(Curve=mirror_9.Geometry)  # -> Start, End
orient_8 = Orient(Geometry=mirror_9.Geometry, Source=end_points_20.Start, Target=end_points_19.End)  # -> Geometry, Transform

# ----
# INTAKE SYSTEM
join_curves_8 = JoinCurves(Curves=[orient_7.Geometry, orient_8.Geometry], Preserve=False)
divide_curve_6 = DivideCurve(Curve=join_curves_8, Count=10, Kinks=False)  # -> Points, Tangents, Parameters
interpolate_8 = Interpolate(Vertices=divide_curve_6.Points, Degree=3, Periodic=False, KnotStyle=1)  # -> Curve, Length, Domain
sweep1_6 = Sweep1(Rail=interpolate_8.Curve, Sections=circle_8, Miter=1)
cap_holes_8 = CapHoles(Brep=sweep1_6)
end_points_21 = EndPoints(Curve=interpolate_8.Curve)  # -> Start, End
xy_plane_11 = XYPlane(Origin=Point(0, 0, 0))
construct_plane_12 = ConstructPlane(Origin=end_points_21.End, XAxis=Vector(1, 0, 0), YAxis=xy_plane_11)
circle_9 = Circle(Plane=construct_plane_12, Radius=Slider(1.86, range=0..2))
unit_y_15 = UnitY(Factor=Slider(8, range=0..100))
boundary_surfaces_9 = BoundarySurfaces(Edges=circle_9)
extrude_17 = Extrude(Base=boundary_surfaces_9, Direction=unit_y_15)
deconstruct_brep_22 = DeconstructBrep(Brep=extrude_17)  # -> Faces, Edges, Vertices
md_slider_4 = MDSlider(
    SliderMode=0,
    slider_value=Point(0.1799703458, 0.5948590534, 0.5),
    x_domain=Domain(0, 1),
    y_domain=Domain(0, 1),
    z_domain=Domain(0, 1))
list_item_35 = ListItem(List=deconstruct_brep_22.Faces, Index=Slider(1, range=0..1), Wrap=True)
evaluate_surface_4 = EvaluateSurface(Surface=reparameterize(list_item_35), Point=md_slider_4)  # -> Point, Normal, UDirection, VDirection, Frame
multiplication_8 = Multiplication(A=Slider(8.16, range=0..10), B=evaluate_surface_4.Normal)
move_30 = Move(Geometry=evaluate_surface_4.Point, Motion=multiplication_8)  # -> Geometry, Transform
line_22 = Line(StartPoint=evaluate_surface_4.Point, EndPoint=move_30.Geometry)
pipe_5 = Pipe(Curve=line_22, Radius=Slider(0.9, range=0..1), Caps=2)

# ----
# FUEL TANK
end_points_22 = EndPoints(Curve=line_22)  # -> Start, End
geometry_18 = Geometry(evaluate_surface_4.Frame)
point_11 = Point(end_points_22.End)
area_21 = Area(Geometry=geometry_18)  # -> Area, Centroid
orient_9 = Orient(Geometry=geometry_18, Source=area_21.Centroid, Target=point_11)  # -> Geometry, Transform
pi_8 = Pi(Factor=Slider(0.8, range=0..1))
vector_2pt_5 = Vector2Pt(PointA=end_points_22.Start, PointB=end_points_22.End, Unitize=False)  # -> Vector, Length
line_sdl_2 = LineSDL(Start=point_11, Direction=geometry_18, Length=1)
plane_normal = PlaneNormal(Origin=orient_9.Geometry, ZAxis=geometry_18)
rectangle_2 = Rectangle(Plane=plane_normal, XSize=Domain(-1, 1), YSize=Domain(-2, 2), Radius=0)  # -> Rectangle, Length
rotate_3d_6 = Rotate3D(Geometry=rectangle_2.Rectangle, Angle=pi_8, Center=area_21.Centroid, Axis=line_sdl_2)  # -> Geometry, Transform
boundary_surfaces_10 = BoundarySurfaces(Edges=rotate_3d_6.Geometry)
multiplication_9 = Multiplication(A=vector_2pt_5.Vector, B=Slider(1.761, range=0..2))
extrude_18 = Extrude(Base=boundary_surfaces_10, Direction=multiplication_9)
panel_4 = Panel("""1
3
7
11""")
fillet_edge = FilletEdge(Shape=extrude_18, Blend=0, Metric=0, Edges=panel_4, Radii=Slider(1, range=0..1))
deconstruct_brep_23 = DeconstructBrep(Brep=fillet_edge)  # -> Faces, Edges, Vertices
md_slider_5 = MDSlider(
    SliderMode=0,
    slider_value=Point(0.7723967838, 0.778388791, 0.5),
    x_domain=Domain(0, 1),
    y_domain=Domain(0, 1),
    z_domain=Domain(0, 1))
list_item_36 = ListItem(List=deconstruct_brep_23.Faces, Index=Slider(7, range=0..10), Wrap=True)
evaluate_surface_5 = EvaluateSurface(Surface=reparameterize(list_item_36), Point=md_slider_5)  # -> Point, Normal, UDirection, VDirection, Frame
multiplication_10 = Multiplication(A=evaluate_surface_5.Normal, B=Slider(10, range=0..10))
move_31 = Move(Geometry=evaluate_surface_5.Point, Motion=multiplication_10)  # -> Geometry, Transform
# Compare knot spacing
number_slider_16 = Slider(1, range=0..1)
point_12 = Point(move_7.Geometry)
point_13 = Point(evaluate_surface_5.Point)
line_23 = Line(StartPoint=evaluate_surface_5.Point, EndPoint=move_31.Geometry)
end_points_23 = EndPoints(Curve=line_23)  # -> Start, End
line_24 = Line(StartPoint=point_13, EndPoint=point_12)
cone = Cone(Base=end_points_23.End, Radius=0.5, Length=1)  # -> Cone, Tip
pipe_6 = Pipe(Curve=[line_23, line_24], Radius=number_slider_16, Caps=2)

# ----
# DRIVE AND STEERING
geometry_19 = Geometry(cap_holes_2)
dispatch_13 = Dispatch(List=geometry_19, DispatchPattern=[True, False])  # -> ListA, ListB
number_slider_17 = Slider(1, range=0..1)
deconstruct_brep_24 = DeconstructBrep(Brep=dispatch_13.ListA)  # -> Faces, Edges, Vertices
list_item_37 = ListItem(List=deconstruct_brep_24.Faces, Index=[Slider(0, range=0..1), number_slider_17], Wrap=True)
area_22 = Area(Geometry=list_item_37)  # -> Area, Centroid
dispatch_14 = Dispatch(List=area_22.Centroid, DispatchPattern=[True, False])  # -> ListA, ListB
line_25 = Line(StartPoint=dispatch_14.ListA, EndPoint=dispatch_14.ListB)
divide_curve_7 = DivideCurve(Curve=line_25, Count=Slider(9, range=0..10), Kinks=False)  # -> Points, Tangents, Parameters
list_item_38 = ListItem(List=divide_curve_7.Points, Index="1", Wrap=True)
unit_y_16 = UnitY(Factor=Slider(9.93, range=0..10))
point_14 = Point(move_31.Geometry)
line_26 = Line(StartPoint=list_item_38, EndPoint=point_14)
center_box_2 = CenterBox(Base=list_item_38, X=1, Y=1, Z=1)
negative_22 = Negative(Value=unit_y_16)
point_on_curve_3 = PointOnCurve(line_26, parameter=0.996)
move_32 = Move(Geometry=center_box_2, Motion=[negative_22, unit_y_16])  # -> Geometry, Transform
line_27 = Line(StartPoint=list_item_38, EndPoint=point_on_curve_3)
number_slider_18 = Slider(0.84, range=0..1)
scale_10 = Scale(Geometry=move_32.Geometry, Center=list_item_38, Factor=0.5)  # -> Geometry, Transform
merge_20 = Merge(Data1=center_box_2, Data2=scale_10.Geometry)
deconstruct_brep_25 = DeconstructBrep(Brep=merge_20)  # -> Faces, Edges, Vertices
pipe_7 = Pipe(Curve=line_27, Radius=number_slider_18, Caps=0)
end_points_24 = EndPoints(Curve=line_27)  # -> Start, End
list_item_39 = ListItem(List=deconstruct_brep_25.Faces, Index=Slider(3, range=0..5), Wrap=True)
pi_9 = Pi(Factor=Slider(0.93, range=0..1))
sphere_3 = Sphere(Base=end_points_24.End, Radius=number_slider_17)
area_23 = Area(Geometry=list_item_39)  # -> Area, Centroid
number_slider_19 = Slider(0.5, range=0..2)
construct_plane_13 = ConstructPlane(Origin=end_points_24.End, XAxis=line_27, YAxis=Vector(0, 1, 0))
rotate_3d_7 = Rotate3D(Geometry=list_item_39, Angle=pi_9, Center=area_23.Centroid, Axis=line_25)  # -> Geometry, Transform
md_slider_6 = MDSlider(
    SliderMode=0,
    slider_value=Point(0.787806069, 0.7682926829, 0.5),
    x_domain=Domain(0, 1),
    y_domain=Domain(0, 1),
    z_domain=Domain(0, 1))
plane_normal_2 = PlaneNormal(Origin=construct_plane_13, ZAxis=line_27)
scale_nu_2 = ScaleNU(Geometry=rotate_3d_7.Geometry, Plane=list_item_39, ScaleX=number_slider_19, ScaleY=1, ScaleZ=number_slider_19)  # -> Geometry, Transform
evaluate_surface_6 = EvaluateSurface(Surface=scale_nu_2.Geometry, Point=md_slider_6)  # -> Point, Normal, UDirection, VDirection, Frame
multiplication_11 = Multiplication(A=Slider(0.89, range=0..1), B=evaluate_surface_6.Normal)
circle_10 = Circle(Plane=plane_normal_2, Radius=Slider(0.54, range=0..3))
extrude_19 = Extrude(Base=scale_nu_2.Geometry, Direction=multiplication_11)
curve_middle_9 = CurveMiddle(Curve=reparameterize(circle_10))
line_28 = Line(StartPoint=end_points_24.End, EndPoint=curve_middle_9)
merge_21 = Merge(Data1=line_28, Data2=circle_10)
divide_curve_8 = DivideCurve(Curve=circle_10, Count=10, Kinks=False)  # -> Points, Tangents, Parameters
panel_5 = Panel("""0
1
2""")
pipe_8 = Pipe(Curve=merge_21, Radius=number_slider_18, Caps=0)
cull_index_2 = CullIndex(List=divide_curve_8.Points, Indices=panel_5, Wrap=True)
interpolate_9 = Interpolate(Vertices=cull_index_2, Degree=3, Periodic=False, KnotStyle=1)  # -> Curve, Length, Domain
pipe_9 = Pipe(Curve=interpolate_9.Curve, Radius=Slider(1, range=0..1), Caps=2)

# ----
# FLOOR PANEL AND SEAT
curve_2 = Curve(line_25)
curve_3 = Curve(line_27)
end_points_25 = EndPoints(Curve=curve_3)  # -> Start, End
vector_2pt_6 = Vector2Pt(PointA=end_points_25.Start, PointB=end_points_25.End, Unitize=False)  # -> Vector, Length
negative_23 = Negative(Value=vector_2pt_6.Vector)
division_12 = Division(A=negative_23, B="3")
xy_plane_12 = XYPlane(Origin=Point(0, 0, 0))
move_33 = Move(Geometry=curve_2, Motion=division_12)  # -> Geometry, Transform
construct_plane_14 = ConstructPlane(Origin=end_points_25.Start, XAxis=xy_plane_12, YAxis=Vector(0, 1, 0))
mirror_10 = Mirror(Geometry=move_33.Geometry, Plane=construct_plane_14)  # -> Geometry, Transform
deconstruct_brep_26 = DeconstructBrep(Brep=extrude_19)  # -> Faces, Edges, Vertices
list_item_40 = ListItem(List=deconstruct_brep_26.Edges, Index=Slider(8, range=0..10), Wrap=True)
end_points_26 = EndPoints(Curve=list_item_40)  # -> Start, End
list_item_41 = ListItem(List=flatten(end_points_26.End), Index=Slider(4, range=0..10), Wrap=True)
unit_z_10 = UnitZ(Factor=Slider(7.92, range=0..10))
curve_closest_point = CurveClosestPoint(Point=list_item_41, Curve=[move_33.Geometry, mirror_10.Geometry])  # -> Point, Parameter, Distance
point_15 = Point(list_item_41)
negative_24 = Negative(Value=unit_z_10)
dispatch_15 = Dispatch(List=flatten(curve_closest_point.Point), DispatchPattern=[True, False])  # -> ListA, ListB
move_34 = Move(Geometry=point_15, Motion=negative_24)  # -> Geometry, Transform
unit_y_17 = UnitY(Factor=Slider(9.8, range=0..20))
arc_3pt_4 = Arc3Pt(PointA=dispatch_15.ListA, PointB=move_34.Geometry, PointC=dispatch_15.ListB)  # -> Arc, Plane, Radius
negative_25 = Negative(Value=unit_y_17)
extrude_20 = Extrude(Base=arc_3pt_4.Arc, Direction=[negative_25, unit_y_17])
deconstruct_brep_27 = DeconstructBrep(Brep=extrude_20)  # -> Faces, Edges, Vertices
pi_10 = Pi(Factor=Slider(1.176, range=0..2))
line_29 = Line(StartPoint=dispatch_15.ListA, EndPoint=dispatch_15.ListB)
list_item_42 = ListItem(List=flatten(deconstruct_brep_27.Edges), Index=Slider(2, range=0..10), Wrap=True)
list_item_43 = ListItem(List=flatten(deconstruct_brep_27.Edges), Index=Slider(0, range=0..10), Wrap=True)
pi_11 = Pi(Factor=Slider(1, range=0..1))
deconstruct_brep_28 = DeconstructBrep(Brep=orient_2.Geometry)  # -> Faces, Edges, Vertices
list_item_44 = ListItem(List=deconstruct_brep_28.Edges, Index=0, Wrap=True)
negative_26 = Negative(Value=pi_11)
curve_middle_10 = CurveMiddle(Curve=line_29)
dispatch_16 = Dispatch(List=flatten(list_item_44), DispatchPattern=[True, False])  # -> ListA, ListB
rotate_axis = RotateAxis(Geometry=extrude_20, Angle=pi_10, Axis=list_item_42)  # -> Geometry, Transform
rotate_axis_2 = RotateAxis(Geometry=extrude_20, Angle=negative_26, Axis=list_item_43)  # -> Geometry, Transform
geometry_20 = Geometry(dispatch_16.ListB)
pi_12 = Pi(Factor=Slider(1, range=0..1))
deconstruct_brep_29 = DeconstructBrep(Brep=rotate_axis.Geometry)  # -> Faces, Edges, Vertices
area_24 = Area(Geometry=geometry_20)  # -> Area, Centroid
scale_11 = Scale(Geometry=geometry_20, Center=area_24.Centroid, Factor=Slider(6.92, range=0..10))  # -> Geometry, Transform
list_item_45 = ListItem(List=flatten(deconstruct_brep_29.Edges), Index=Slider(0, range=0..10), Wrap=True)
unit_y_18 = UnitY(Factor=Slider(0.49, range=0..3))
negative_27 = Negative(Value=pi_12)
xy_plane_13 = XYPlane(Origin=Point(0, 0, 0))
boundary_surfaces_11 = BoundarySurfaces(Edges=scale_11.Geometry)
rotate_axis_3 = RotateAxis(Geometry=rotate_axis.Geometry, Angle=negative_27, Axis=list_item_45)  # -> Geometry, Transform
negative_28 = Negative(Value=unit_y_18)
construct_plane_15 = ConstructPlane(Origin=curve_middle_10, XAxis=Vector(1, 0, 0), YAxis=xy_plane_13)
extrude_21 = Extrude(Base=boundary_surfaces_11, Direction=[negative_28, unit_y_18])
pi_13 = Pi(Factor=Slider(0.093, range=0..1))
deconstruct_brep_30 = DeconstructBrep(Brep=rotate_axis_3.Geometry)  # -> Faces, Edges, Vertices
mirror_11 = Mirror(Geometry=extrude_21, Plane=construct_plane_15)  # -> Geometry, Transform
list_item_46 = ListItem(List=flatten(deconstruct_brep_30.Edges), Index=Slider(2, range=0..10), Wrap=True)
negative_29 = Negative(Value=pi_13)
rotate_axis_4 = RotateAxis(Geometry=rotate_axis_3.Geometry, Angle=negative_29, Axis=list_item_46)  # -> Geometry, Transform
merge_22 = Merge(Data1=extrude_21, Data2=mirror_11.Geometry)
merge_23 = Merge(
    Data1=extrude_20,
    Data2=rotate_axis.Geometry,
    Data3=rotate_axis_2.Geometry,
    Data4=rotate_axis_3.Geometry,
    Data5=rotate_axis_4.Geometry)
brep_join = BrepJoin(Breps=merge_23)  # -> Breps, Closed

# ----
# CUSHION
geometry_21 = Geometry(rotate_axis_3.Geometry)
dispatch_17 = Dispatch(List=geometry_21, DispatchPattern=[True, False])  # -> ListA, ListB
cap_holes_9 = CapHoles(Brep=loft)
md_slider_7 = MDSlider(
    SliderMode=0,
    slider_value=Point(0.0926826291, 0.4512195122, 0.5),
    x_domain=Domain(0, 1),
    y_domain=Domain(0, 1),
    z_domain=Domain(0, 1))
area_25 = Area(Geometry=cap_holes_9)  # -> Area, Centroid
merge_24 = Merge(Data1=cap_holes_9, Data2=loft_2)
evaluate_surface_7 = EvaluateSurface(Surface=reparameterize(dispatch_17.ListB), Point=md_slider_7)  # -> Point, Normal, UDirection, VDirection, Frame
orient_10 = Orient(Geometry=merge_24, Source=area_25.Centroid, Target=evaluate_surface_7.Point)  # -> Geometry, Transform
solid_difference = SolidDifference(BrepsA=brep_join.Breps, BrepsB=merge_22)
scale_nu_3 = ScaleNU(
    Geometry=orient_10.Geometry,
    Plane=evaluate_surface_7.Point,
    ScaleX=Slider(2, range=0..2),
    ScaleY=Slider(1.49, range=0..2),
    ScaleZ=Slider(0.27, range=0..2))  # -> Geometry, Transform

merge_25 = Merge(Data1=pipe_4, Data2=extrude_16, Data3=pipe_3, Data4=center_box)
merge_26 = Merge(Data1=pipe_5, Data2=extrude_17, Data3=cap_holes_8)
merge_27 = Merge(Data1=pipe_6, Data2=fillet_edge, Data3=cone.Cone)
# P1
# A=0.2*P1+ 0.8*P2
# D=0.2*A + 0.8*B
# P2
# B=0.47*P2 + 0.53*P3
# E=0.7*B + 0.3*C
# P3
# C=0.8*P3 + 0.2*P4
# P4
merge_28 = Merge(Data1=merge_18, Data2=mirror_7.Geometry, Data3=sweep1_5)
merge_29 = Merge(Data1=merge_20, Data2=scale_10.Geometry, Data3=extrude_19, Data4=pipe_7, Data5=pipe_8, Data6=pipe_9, Data7=sphere_3)

# ----
# MAIN BODY
geometry_22 = Geometry(merge_23)
merge_30 = Merge(Data2=[geometry_22, merge_22])
explode_tree = ExplodeTree(Data=graft(merge_30))  # -> Branch0, Branch1, Branch2, Branch3, Branch4, Branch5, Branch6, Branch7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
geometry_23 = Geometry(explode_tree.Branch0)
geometry_24 = Geometry(explode_tree.Branch1)
geometry_25 = Geometry(explode_tree.Branch2)
geometry_26 = Geometry(explode_tree.Branch7)
geometry_27 = Geometry(explode_tree.Branch9)
geometry_28 = Geometry(explode_tree.Branch10)
geometry_29 = Geometry(explode_tree.Branch12)
geometry_30 = Geometry(explode_tree.Branch13)
geometry_31 = Geometry(explode_tree.Branch11)
number_slider_20 = Slider(2, range=0..2)
geometry_32 = Geometry(explode_tree.Branch8)
deconstruct_brep_31 = DeconstructBrep(Brep=geometry_31)  # -> Faces, Edges, Vertices
deconstruct_brep_32 = DeconstructBrep(Brep=geometry_30)  # -> Faces, Edges, Vertices
unit_z_11 = UnitZ(Factor=Slider(8.73, range=0..10))
deconstruct_brep_33 = DeconstructBrep(Brep=geometry_32)  # -> Faces, Edges, Vertices
md_slider_8 = MDSlider(
    SliderMode=0,
    slider_value=Point(0.1973251715, 0.8809546494, 0.5),
    x_domain=Domain(0, 1),
    y_domain=Domain(0, 1),
    z_domain=Domain(0, 1))
list_item_47 = ListItem(List=deconstruct_brep_31.Faces, Index=number_slider_20, Wrap=True)
negative_30 = Negative(Value=unit_z_11)
list_item_48 = ListItem(List=deconstruct_brep_32.Faces, Index=number_slider_20, Wrap=True)
list_item_49 = ListItem(List=deconstruct_brep_33.Vertices, Index=Slider(0, range=0..3), Wrap=True)
geometry_33 = Geometry(explode_tree.Branch3)
geometry_34 = Geometry(explode_tree.Branch6)
geometry_35 = Geometry(explode_tree.Branch4)
geometry_36 = Geometry(explode_tree.Branch5)
move_35 = Move(Geometry=list_item_49, Motion=negative_30)  # -> Geometry, Transform
evaluate_surface_8 = EvaluateSurface(Surface=reparameterize([list_item_47, list_item_48]), Point=md_slider_8)  # -> Point, Normal, UDirection, VDirection, Frame
dispatch_18 = Dispatch(List=flatten(evaluate_surface_8.Point), DispatchPattern=[True, False])  # -> ListA, ListB
deconstruct_brep_34 = DeconstructBrep(Brep=[geometry_35, geometry_36])  # -> Faces, Edges, Vertices
point_16 = Point(move_35.Geometry)
list_item_50 = ListItem(List=deconstruct_brep_34.Edges, Index=Slider(2, range=0..10), Wrap=True)
list_item_51 = ListItem(List=deconstruct_brep_34.Vertices, Index=Slider(3, range=0..3), Wrap=True)
curve_middle_11 = CurveMiddle(Curve=list_item_50)
dispatch_19 = Dispatch(List=flatten(curve_middle_11), DispatchPattern=[True, False])  # -> ListA, ListB
construct_domain_3 = ConstructDomain(DomainStart=0, DomainEnd=Slider(0.76, range=0..10))
unit_x_16 = UnitX(Factor=Slider(7.42, range=0..10))
line_30 = Line(StartPoint=dispatch_19.ListA, EndPoint=dispatch_19.ListB)
range_4 = Range(Domain=construct_domain_3, Steps=10)
square_2 = Square(Value=range_4)
xy_plane_14 = XYPlane(Origin=Point(0, 0, 0))
curve_middle_12 = CurveMiddle(Curve=line_30)
multiplication_12 = Multiplication(A=range_4, B=Slider(1.15, range=0..10))
multiplication_13 = Multiplication(A=square_2, B=Slider(4.91, range=0..10))
construct_plane_16 = ConstructPlane(Origin=curve_middle_12, XAxis=Vector(1, 0, 0), YAxis=xy_plane_14)
vector_xyz_4 = VectorXYZ(XComponent=0, YComponent=multiplication_12, ZComponent=multiplication_13)  # -> Vector, Length
move_36 = Move(Geometry=dispatch_19.ListB, Motion=vector_xyz_4.Vector)  # -> Geometry, Transform
mirror_12 = Mirror(Geometry=move_36.Geometry, Plane=construct_plane_16)  # -> Geometry, Transform
construct_domain_4 = ConstructDomain(DomainStart=0, DomainEnd=Slider(0.36, range=0..10))
interpolate_10 = Interpolate(Vertices=move_36.Geometry, Degree=3, Periodic=False, KnotStyle=1)  # -> Curve, Length, Domain
range_5 = Range(Domain=construct_domain_4, Steps=10)
interpolate_11 = Interpolate(Vertices=mirror_12.Geometry, Degree=3, Periodic=False, KnotStyle=1)  # -> Curve, Length, Domain
square_3 = Square(Value=range_5)
merge_31 = Merge(Data1=interpolate_11.Curve, Data2=line_30, Data3=interpolate_10.Curve)  # -> flatten(Result)
xy_plane_15 = XYPlane(Origin=Point(0, 0, 0))
multiplication_14 = Multiplication(A=range_5, B=Slider(1.02, range=0..10))
join_curves_9 = JoinCurves(Curves=merge_31, Preserve=False)
multiplication_15 = Multiplication(A=square_3, B=Slider(0.35, range=0..10))
vector_xyz_5 = VectorXYZ(XComponent=0, YComponent=multiplication_14, ZComponent=multiplication_15)  # -> Vector, Length
unit_z_12 = UnitZ(Factor=Slider(2.66, range=0..10))
curve_middle_13 = CurveMiddle(Curve=join_curves_9)
end_points_27 = EndPoints(Curve=join_curves_9)  # -> Start, End
point_17 = Point(end_points_27.End)
point_18 = Point(end_points_27.Start)
arc_3pt_5 = Arc3Pt(PointA=point_17, PointB=dispatch_18.ListB, PointC=point_16)  # -> Arc, Plane, Radius
arc_3pt_6 = Arc3Pt(PointA=point_18, PointB=dispatch_18.ListA, PointC=point_16)  # -> Arc, Plane, Radius
point_on_curve_4 = PointOnCurve([arc_3pt_6.Arc, arc_3pt_5.Arc], parameter=0.513)
dispatch_20 = Dispatch(List=flatten(point_on_curve_4), DispatchPattern=[True, False])  # -> ListA, ListB
line_31 = Line(StartPoint=dispatch_20.ListA, EndPoint=dispatch_20.ListB)
curve_middle_14 = CurveMiddle(Curve=line_31)
end_points_28 = EndPoints(Curve=line_31)  # -> Start, End
curve_middle_15 = CurveMiddle(Curve=line_31)
construct_plane_17 = ConstructPlane(Origin=curve_middle_15, XAxis=Vector(1, 0, 0), YAxis=xy_plane_15)
move_37 = Move(Geometry=end_points_28.End, Motion=vector_xyz_5.Vector)  # -> Geometry, Transform
move_38 = Move(Geometry=curve_middle_13, Motion=unit_z_12)  # -> Geometry, Transform
mirror_13 = Mirror(Geometry=join_curves_9, Plane=move_38.Geometry)  # -> Geometry, Transform
mirror_14 = Mirror(Geometry=move_37.Geometry, Plane=construct_plane_17)  # -> Geometry, Transform
interpolate_12 = Interpolate(Vertices=mirror_14.Geometry, Degree=3, Periodic=False, KnotStyle=1)  # -> Curve, Length, Domain
interpolate_13 = Interpolate(Vertices=move_37.Geometry, Degree=3, Periodic=False, KnotStyle=1)  # -> Curve, Length, Domain
curve_middle_16 = CurveMiddle(Curve=mirror_13.Geometry)
point_19 = Point(curve_middle_16)
scale_12 = Scale(Geometry=mirror_13.Geometry, Center=curve_middle_16, Factor=Slider(0.1, range=0..1))  # -> Geometry, Transform
merge_32 = Merge(Data1=interpolate_12.Curve, Data2=line_31, Data3=interpolate_13.Curve)
end_points_29 = EndPoints(Curve=scale_12.Geometry)  # -> Start, End
scale_13 = Scale(Geometry=merge_32, Center=curve_middle_14, Factor=Slider(0.9, range=0..1))  # -> flatten(Geometry), Transform
join_curves_10 = JoinCurves(Curves=scale_13.Geometry, Preserve=False)
line_32 = Line(StartPoint=end_points_27.Start, EndPoint=end_points_29.Start)
line_33 = Line(StartPoint=end_points_27.End, EndPoint=end_points_29.End)
unit_z_13 = UnitZ(Factor=Slider(2.88, range=0..10))
curve_middle_17 = CurveMiddle(Curve=join_curves_10)
end_points_30 = EndPoints(Curve=join_curves_10)  # -> Start, End
merge_33 = Merge(
    Data1=interpolate_11.Curve,
    Data2=line_30,
    Data3=interpolate_10.Curve,
    Data4=line_32,
    Data5=line_33,
    Data6=scale_12.Geometry)  # -> flatten(Result)
pi_14 = Pi(Factor=Slider(0.022, range=-0.8..0.2))
move_39 = Move(Geometry=curve_middle_17, Motion=unit_z_13)  # -> Geometry, Transform
join_curves_11 = JoinCurves(Curves=merge_33, Preserve=False)
negative_31 = Negative(Value=pi_14)
mirror_15 = Mirror(Geometry=join_curves_10, Plane=move_39.Geometry)  # -> Geometry, Transform
curve_middle_18 = CurveMiddle(Curve=mirror_15.Geometry)
scale_14 = Scale(Geometry=mirror_15.Geometry, Center=curve_middle_18, Factor=Slider(0.9, range=0..1))  # -> Geometry, Transform
end_points_31 = EndPoints(Curve=scale_14.Geometry)  # -> Start, End
point_20 = Point(end_points_27.Start)
point_21 = Point(end_points_27.End)
line_34 = Line(StartPoint=end_points_30.Start, EndPoint=end_points_31.Start)
line_35 = Line(StartPoint=end_points_30.End, EndPoint=end_points_31.End)
merge_34 = Merge(Data1=join_curves_10, Data2=line_34, Data3=line_35, Data4=scale_14.Geometry)  # -> flatten(Result)
pi_15 = Pi(Factor=Slider(-0.565, range=-0.8..0.2))
point_22 = Point(end_points_30.Start)
point_23 = Point(end_points_30.End)
join_curves_12 = JoinCurves(Curves=merge_34, Preserve=False)
point_24 = Point(point_16)
end_points_32 = EndPoints(Curve=mirror_15.Geometry)  # -> Start, End
curve_middle_19 = CurveMiddle(Curve=mirror_15.Geometry)
curve_middle_20 = CurveMiddle(Curve=line_31)
number_slider_21 = Slider(0.5, range=0..1)
xz_plane_8 = XZPlane(Origin=Point(0, 0, 0))
curve_middle_21 = CurveMiddle(Curve=scale_14.Geometry)
curve_middle_22 = CurveMiddle(Curve=mirror_15.Geometry)
number_slider_22 = Slider(3, range=0..3)

# ----
# Door
unit_x_17 = UnitX(Factor=1)
pi_16 = Pi(Factor=Slider(2, range=0..2))

rotate_axis_5 = RotateAxis(Geometry=join_curves_12, Angle=pi_15, Axis=line_31)  # -> Geometry, Transform
rotate_axis_6 = RotateAxis(Geometry=join_curves_11, Angle=negative_31, Axis=line_30)  # -> Geometry, Transform

curve_4 = Curve(rotate_axis_6.Geometry)
curve_closest_point_2 = CurveClosestPoint(Point=point_19, Curve=curve_4)  # -> Point, Parameter, Distance
line_36 = Line(StartPoint=curve_closest_point_2.Point, EndPoint=list_item_51)
point_on_curve_5 = PointOnCurve(line_36, parameter=0.831)
move_40 = Move(Geometry=point_on_curve_5, Motion=unit_x_16)  # -> Geometry, Transform
curve_closest_point_3 = CurveClosestPoint(Point=point_20, Curve=rotate_axis_6.Geometry)  # -> Point, Parameter, Distance
curve_closest_point_4 = CurveClosestPoint(Point=point_21, Curve=rotate_axis_6.Geometry)  # -> Point, Parameter, Distance
curve_closest_point_5 = CurveClosestPoint(Point=[point_22, point_23], Curve=rotate_axis_5.Geometry)  # -> Point, Parameter, Distance
dispatch_21 = Dispatch(List=curve_closest_point_5.Point, DispatchPattern=[True, False])  # -> ListA, ListB
curve_closest_point_6 = CurveClosestPoint(Point=curve_middle_19, Curve=rotate_axis_5.Geometry)  # -> Point, Parameter, Distance
point_on_curve_6 = PointOnCurve(rotate_axis_5.Geometry, parameter=0.176)
point_on_curve_7 = PointOnCurve(rotate_axis_6.Geometry, parameter=0.102)
curve_5 = Curve(rotate_axis_5.Geometry)
curve_closest_point_7 = CurveClosestPoint(Point=[end_points_32.Start, end_points_32.End], Curve=rotate_axis_6.Geometry)  # -> Point, Parameter, Distance
curve_closest_point_8 = CurveClosestPoint(Point=[end_points_32.Start, end_points_32.End], Curve=rotate_axis_5.Geometry)  # -> Point, Parameter, Distance
curve_closest_point_9 = CurveClosestPoint(Point=curve_middle_22, Curve=rotate_axis_6.Geometry)  # -> Point, Parameter, Distance
curve_closest_point_10 = CurveClosestPoint(Point=curve_middle_21, Curve=rotate_axis_5.Geometry)  # -> Point, Parameter, Distance
geometry_37 = Geometry(rotate_axis_6.Geometry)
geometry_38 = Geometry(rotate_axis_5.Geometry)
rebuild_curve = RebuildCurve(Curve=geometry_37, Degree=number_slider_22, Count=10, Tangents=False)
rebuild_curve_2 = RebuildCurve(Curve=geometry_38, Degree=number_slider_22, Count=10, Tangents=False)

arc_3pt_7 = Arc3Pt(PointA=curve_closest_point_3.Point, PointB=dispatch_21.ListA, PointC=point_24)  # -> Arc, Plane, Radius
arc_3pt_8 = Arc3Pt(PointA=curve_closest_point_4.Point, PointB=dispatch_21.ListB, PointC=point_24)  # -> Arc, Plane, Radius
arc_3pt_9 = Arc3Pt(PointA=curve_closest_point_2.Point, PointB=move_40.Geometry, PointC=list_item_51)  # -> Arc, Plane, Radius

divide_curve_9 = DivideCurve(Curve=geometry_37, Count=10, Kinks=False)  # -> Points, Tangents, Parameters
point_on_curve_8 = PointOnCurve(arc_3pt_9.Arc, parameter=0.5)
line_37 = Line(StartPoint=divide_curve_9.Points, EndPoint=point_on_curve_8)
curve_middle_23 = CurveMiddle(Curve=line_37)
move_41 = Move(Geometry=curve_middle_23, Motion=unit_x_17)  # -> Geometry, Transform
arc_3pt_10 = Arc3Pt(PointA=divide_curve_9.Points, PointB=move_41.Geometry, PointC=point_on_curve_8)  # -> Arc, Plane, Radius
loft_6 = Loft(Curves=arc_3pt_10.Arc, Options={Adjust=False, Closed=True, LoftEnds=0, LoftSimp=0, LoftType=0, Rebuild=10, Refit=0.01})
point_25 = Point(curve_closest_point_10.Point)
point_26 = Point(curve_closest_point_9.Point)
line_38 = Line(StartPoint=point_25, EndPoint=point_26)
rotate_3d_8 = Rotate3D(Geometry=loft_6, Angle=pi_16, Center=point_26, Axis=line_38)  # -> Geometry, Transform
end_points_33 = EndPoints(Curve=line_38)  # -> Start, End
sphere_4 = Sphere(Base=end_points_33.End, Radius=1)

end_points_34 = EndPoints(Curve=arc_3pt_7.Arc)  # -> Start, End
end_points_35 = EndPoints(Curve=arc_3pt_9.Arc)  # -> Start, End
point_27 = Point(end_points_35.End)
line_39 = Line(StartPoint=point_27, EndPoint=curve_middle_20)
dispatch_22 = Dispatch(List=flatten(end_points_35.Start), DispatchPattern=[True, False])  # -> ListA, ListB
arc_3pt_11 = Arc3Pt(PointA=dispatch_22.ListA, PointB=curve_closest_point_6.Point, PointC=end_points_34.End)  # -> Arc, Plane, Radius
point_on_curve_9 = PointOnCurve(arc_3pt_11.Arc, parameter=0.843)
arc_3pt_12 = Arc3Pt(PointA=point_on_curve_7, PointB=point_on_curve_6, PointC=point_on_curve_9)  # -> Arc, Plane, Radius
geometry_39 = Geometry([arc_3pt_7.Arc, arc_3pt_8.Arc])
mirror_16 = Mirror(Geometry=arc_3pt_12.Arc, Plane=xz_plane_8)  # -> Geometry, Transform
point_on_curve_10 = PointOnCurve(geometry_39, parameter=0.706)
arc_3pt_13 = Arc3Pt(PointA=curve_closest_point_7.Point, PointB=curve_closest_point_8.Point, PointC=point_on_curve_10)  # -> Arc, Plane, Radius
merge_35 = Merge(
    Data1=rotate_axis_6.Geometry,
    Data2=arc_3pt_7.Arc,
    Data3=arc_3pt_8.Arc,
    Data4=rotate_axis_5.Geometry,
    Data5=arc_3pt_9.Arc,
    Data6=arc_3pt_11.Arc,
    Data7=line_39,
    Data8=arc_3pt_12.Arc,
    Data9=mirror_16.Geometry,
    Data10=arc_3pt_13.Arc)
explode_tree_2 = ExplodeTree(Data=graft(merge_35))  # -> Branch0, Branch1, _0400, _0401, _0500, _0501, _0800, _0801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
curve_6 = Curve(explode_tree_2._0500)
curve_7 = Curve(explode_tree_2._0401)
curve_8 = Curve(explode_tree_2._0501)
curve_9 = Curve(explode_tree_2.Branch1)
curve_10 = Curve(explode_tree_2.Branch10)
curve_11 = Curve(explode_tree_2._0802)
curve_12 = Curve(explode_tree_2.Branch11)
curve_13 = Curve(explode_tree_2.Branch12)
curve_14 = Curve(explode_tree_2._0803)
curve_15 = Curve(explode_tree_2._0801)
curve_16 = Curve(explode_tree_2._0800)
dispatch_23 = Dispatch(List=flatten(arc_3pt_13.Arc), DispatchPattern=[True, False])  # -> ListA, ListB
curve_17 = Curve(explode_tree_2.Branch0)
curve_18 = Curve(explode_tree_2._0400)
sweep2 = Sweep2(Rail1=curve_17, Rail2=curve_9, Sections=curve_11, SameHeight=False)
sweep2_2 = Sweep2(Rail1=curve_17, Rail2=curve_9, Sections=[curve_14, curve_10], SameHeight=False)
curve_19 = Curve(arc_3pt_12.Arc)
curve_20 = Curve(dispatch_23.ListA)
curve_21 = Curve(mirror_16.Geometry)
geometry_40 = Geometry(arc_3pt_7.Arc)
geometry_41 = Geometry(arc_3pt_8.Arc)
curve_22 = Curve(dispatch_23.ListB)
curve_23 = Curve(arc_3pt_11.Arc)
brep_join_2 = BrepJoin(Breps=flatten([sweep2, sweep2_2]))  # -> Breps, Closed
pipe_10 = Pipe(
    Curve=[curve_22, curve_23, curve_20, geometry_37, geometry_38, curve_19, curve_21, geometry_40, geometry_41],
    Radius=Slider(0.25, range=0..1),
    Caps=0)
rebuild_curve_3 = RebuildCurve(Curve=geometry_40, Count=10, Tangents=False)
rebuild_curve_4 = RebuildCurve(Curve=geometry_41, Count=10, Tangents=False)
rebuild_curve_5 = RebuildCurve(Curve=curve_19, Degree=number_slider_22, Count=10, Tangents=False)
rebuild_curve_6 = RebuildCurve(Curve=curve_21, Degree=number_slider_22, Count=10, Tangents=False)

sweep2_3 = Sweep2(Rail1=rebuild_curve_5, Rail2=rebuild_curve_6, Sections=[rebuild_curve, rebuild_curve_2], SameHeight=loft_6)

deconstruct_brep_35 = DeconstructBrep(Brep=rotate_3d_8.Geometry)  # -> Faces, Edges, Vertices
surface = Surface(deconstruct_brep_35.Faces)
number_slider_23 = Slider(0.48, range=0..1)

# ---- group: Isotrim
md_slider_9 = MDSlider(
    SliderMode=0,
    slider_value=Point(0.5303434977, 0.4929191775, 0.5),
    x_domain=Domain(0, 1),
    y_domain=Domain(0, 1),
    z_domain=Domain(0, 1))
construct_domain_5 = ConstructDomain(DomainU=md_slider_9, DomainV=md_slider_9)
isotrim = Isotrim(Surface=reparameterize(surface), Domain=construct_domain_5)

# ----
deconstruct_brep_36 = DeconstructBrep(Brep=brep_join_2.Breps)  # -> Faces, Edges, Vertices
surface_2 = Surface(deconstruct_brep_36.Faces)
number_slider_24 = Slider(1, range=0..1)

# ---- group: Isotrim
md_slider_10 = MDSlider(
    SliderMode=0,
    slider_value=Point(0.5303434977, 0.4929191775, 0.5),
    x_domain=Domain(0, 1),
    y_domain=Domain(0, 1),
    z_domain=Domain(0, 1))
construct_domain_6 = ConstructDomain(DomainU=md_slider_10, DomainV=md_slider_10)
isotrim_2 = Isotrim(Surface=reparameterize(surface_2), Domain=construct_domain_6)

# ----
deconstruct_brep_37 = DeconstructBrep(Brep=isotrim)  # -> Faces, Edges, Vertices
list_item_52 = ListItem(List=deconstruct_brep_37.Vertices, Index="2", Wrap=True)

surface_closest_point_5 = SurfaceClosestPoint(Point=list_item_52, Surface=surface)  # -> Point, UVPoint, Distance
evaluate_surface_9 = EvaluateSurface(Surface=surface, Point=surface_closest_point_5.UVPoint)  # -> Point, Normal, UDirection, VDirection, Frame

amplitude = Amplitude(Vector=evaluate_surface_9.Normal, Amplitude=number_slider_23)
multiplication_16 = Multiplication(A=evaluate_surface_9.Normal, B=number_slider_23)
extrude_22 = Extrude(Base=surface, Direction=multiplication_16)
vector_display = VectorDisplay(Anchor=evaluate_surface_9.Point, Vector=amplitude)

deconstruct_brep_38 = DeconstructBrep(Brep=isotrim_2)  # -> Faces, Edges, Vertices
list_item_53 = ListItem(List=deconstruct_brep_38.Vertices, Index="2", Wrap=True)

surface_closest_point_6 = SurfaceClosestPoint(Point=list_item_53, Surface=surface_2)  # -> Point, UVPoint, Distance
evaluate_surface_10 = EvaluateSurface(Surface=surface_2, Point=surface_closest_point_6.UVPoint)  # -> Point, Normal, UDirection, VDirection, Frame

amplitude_2 = Amplitude(Vector=evaluate_surface_10.Normal, Amplitude=number_slider_24)
multiplication_17 = Multiplication(A=evaluate_surface_10.Normal, B=number_slider_24)
extrude_23 = Extrude(Base=surface_2, Direction=multiplication_17)
vector_display_2 = VectorDisplay(Anchor=evaluate_surface_10.Point, Vector=amplitude_2)

merge_36 = Merge(Data1=extrude_23, Data2=pipe_10, Data3=rotate_3d_8.Geometry, Data4=extrude_22, Data5=sphere_4)

deconstruct_brep_39 = DeconstructBrep(Brep=solid_difference)  # -> Faces, Edges, Vertices
surface_3 = Surface(deconstruct_brep_39.Faces)
number_slider_25 = Slider(0.115, range=0..1)

# ---- group: Isotrim
md_slider_11 = MDSlider(
    SliderMode=0,
    slider_value=Point(0.5303434977, 0.4929191775, 0.5),
    x_domain=Domain(0, 1),
    y_domain=Domain(0, 1),
    z_domain=Domain(0, 1))
construct_domain_7 = ConstructDomain(DomainU=md_slider_11, DomainV=md_slider_11)
isotrim_3 = Isotrim(Surface=reparameterize(surface_3), Domain=construct_domain_7)

# ----
deconstruct_brep_40 = DeconstructBrep(Brep=isotrim_3)  # -> Faces, Edges, Vertices
list_item_54 = ListItem(List=deconstruct_brep_40.Vertices, Index="2", Wrap=True)

surface_closest_point_7 = SurfaceClosestPoint(Point=list_item_54, Surface=surface_3)  # -> Point, UVPoint, Distance
evaluate_surface_11 = EvaluateSurface(Surface=surface_3, Point=surface_closest_point_7.UVPoint)  # -> Point, Normal, UDirection, VDirection, Frame

amplitude_3 = Amplitude(Vector=evaluate_surface_11.Normal, Amplitude=number_slider_25)
multiplication_18 = Multiplication(A=evaluate_surface_11.Normal, B=number_slider_25)
extrude_24 = Extrude(Base=surface_3, Direction=multiplication_18)
vector_display_3 = VectorDisplay(Anchor=evaluate_surface_11.Point, Vector=amplitude_3)

merge_37 = Merge(Data1=extrude_24, Data2=scale_nu_3.Geometry)
