# Grasshopper definition Sets142SmallObjects.gh (Grasshopper 1.0.7)
# Copyright: Wickerson Studios
# plug-ins: Bifocals

# 1001 GRASSHOPPER DEFINITIONS
# Wickerson Studio
# 
# created by: Michael Wickerson
# 
# Grasshopper for Rhino 3D Algorithmic Modeling
# 
# www.wickersonstudios.com
# www.michaelwickerson.com
# https://www.youtube.com/channel/UC7J48Ppcsa6oncp6d29R0xw
# https://github.com/mwickerson
# https://www.facebook.com/michael.wickerson
# https://www.linkedin.com/in/michael-wickerson-696a80156/
# https://www.grasshopper3d.com/profile/MichaelWickerson
image_sampler = ImageSampler(
    FilePath="C:\Users\Sculpture\Documents\2020Grasshopper\ScreenShots2019\Screenshots2020\SurfaceEditAlgorithm.PNG",
    Filter="Value",
    Interpolate=False,
    Umax=1,
    Umin=0,
    Vmax=1,
    Vmin=0,
    Wrap=1)

# ----
# BOTTLE OPENER
number_slider = Slider(4, range=0..10)
construct_point = ConstructPoint(XCoordinate=0, YCoordinate=0, ZCoordinate=0)
multiplication = Multiplication(A=number_slider, B=["2", Slider(4.49, range=0..10)])
circle = Circle(Plane=construct_point, Radius=number_slider)
number_slider_2 = Slider(16, range=0..30)
multiplication_2 = Multiplication(A=number_slider, B=Slider(1, range=0..1))
unit_x = UnitX(Factor=multiplication)
curve = Curve(reparameterize(circle))
unit_x_2 = UnitX(Factor=multiplication_2)
# MATH 142/1001
# Small Objects
# Inspired by: R.K.C.Cheng
divide_curve = DivideCurve(Curve=curve, Count=10, Kinks=False)  # -> Points, Tangents, Parameters
move = Move(Geometry=construct_point, Motion=unit_x)  # -> graft(Geometry), Transform
construct_domain = ConstructDomain(DomainStart=0, DomainEnd=number_slider_2)
cull_index = CullIndex(List=divide_curve.Points, Indices="0", Wrap=True)
explode_tree = ExplodeTree(Data=move.Geometry)  # -> Branch0, Branch1
move_2 = Move(Geometry=explode_tree.Branch1, Motion=unit_x_2)  # -> Geometry, Transform
range = Range(Domain=construct_domain, Steps=Slider(100, range=0..100))
interpolate = Interpolate(Vertices=cull_index, Degree=3, Periodic=False, KnotStyle=1)  # -> Curve, Length, Domain
line = Line(StartPoint=explode_tree.Branch0, EndPoint=explode_tree.Branch1)
sine = Sine(Value=range)
cosine = Cosine(Value=range)
end_points = EndPoints(Curve=interpolate.Curve)  # -> Start, End
vector_xyz = VectorXYZ(XComponent=range, YComponent=sine, ZComponent=cosine)  # -> Vector, Length
vector_xyz_2 = VectorXYZ(XComponent=number_slider_2, YComponent=0, ZComponent=0)  # -> Vector, Length
move_3 = Move(Geometry=move_2.Geometry, Motion=vector_xyz_2.Vector)  # -> Geometry, Transform
move_4 = Move(Geometry=move_2.Geometry, Motion=vector_xyz.Vector)  # -> Geometry, Transform
interpolate_2 = Interpolate(Vertices=move_4.Geometry, Degree=3, Periodic=False, KnotStyle=1)  # -> Curve, Length, Domain
end_points_2 = EndPoints(Curve=interpolate_2.Curve)  # -> Start, End
point = Point(construct_point)
point_2 = Point(end_points.Start)
point_3 = Point(end_points.End)
point_4 = Point(explode_tree.Branch0)
point_5 = Point(explode_tree.Branch1)
point_6 = Point(move_2.Geometry)
point_7 = Point(move_3.Geometry)
point_8 = Point(end_points_2.Start)
number_slider_3 = Slider(0.4, range=0..1)
curve_2 = Curve(line)
curve_3 = Curve(interpolate.Curve)
curve_4 = Curve(interpolate_2.Curve)
curve_5 = Curve(curve_2)
blend_curve = BlendCurve(CurveA=curve_5, CurveB=curve_4, BulgeA=number_slider_3, BulgeB=number_slider_3, Continuity=Slider(2, range=0..2))
blend_curve_2 = BlendCurve(CurveA=curve_3, CurveB=curve_2, BulgeA=Slider(0.42, range=0..1), BulgeB=1, Continuity=Slider(2, range=0..2))
construct_domain_2 = ConstructDomain(DomainStart=Slider(0.9, range=0..1), DomainEnd=Slider(1, range=0..1))
number_slider_4 = Slider(10, range=0..10)
number_slider_5 = Slider(0.5, range=0..1)
merge = Merge(Data1=curve_3, Data2=blend_curve_2, Data3=curve_2, Data4=blend_curve, Data5=curve_4)  # -> flatten(Result)
range_2 = Range(Domain=construct_domain_2, Steps=number_slider_4)
join_curves = JoinCurves(Curves=merge, Preserve=False)
multiplication_3 = Multiplication(A="2", B=number_slider_5)
construct_domain_3 = ConstructDomain(DomainStart=number_slider_5, DomainEnd=Slider(0.01, range=0..1))
evaluate_curve = EvaluateCurve(Curve=reparameterize(join_curves), Parameter=Slider(0, range=0..1))  # -> Point, Tangent, Angle
evaluate_curve_2 = EvaluateCurve(Curve=reparameterize(join_curves), Parameter=range_2)  # -> Point, Tangent, Angle
evaluate_curve_3 = EvaluateCurve(Curve=reparameterize(join_curves), Parameter=Slider(0.9, range=0..1))  # -> Point, Tangent, Angle
range_3 = Range(Domain=construct_domain_3, Steps=number_slider_4)
plane_normal = PlaneNormal(Origin=evaluate_curve.Point, ZAxis=evaluate_curve.Tangent)
plane_normal_2 = PlaneNormal(Origin=evaluate_curve_2.Point, ZAxis=evaluate_curve_2.Tangent)
plane_normal_3 = PlaneNormal(Origin=evaluate_curve_3.Point, ZAxis=evaluate_curve_3.Tangent)
circle_2 = Circle(Plane=plane_normal, Radius=number_slider_5)
circle_3 = Circle(Plane=plane_normal_3, Radius=number_slider_5)
circle_4 = Circle(Plane=plane_normal_2, Radius=range_3)
sweep1 = Sweep1(Rail=join_curves, Sections=circle_2, Miter=1)
sweep1_2 = Sweep1(Rail=join_curves, Sections=circle_3, Miter=1)
loft = Loft(Curves=circle_4, Options={Adjust=True, Closed=False, LoftEnds=0, LoftSimp=0, LoftType=0, Rebuild=10, Refit=0.01})
cap_holes = CapHoles(Brep=sweep1_2)
cap_holes_2 = CapHoles(Brep=sweep1)
sphere = Sphere(Base=point_2, Radius=multiplication_3)
solid_difference = SolidDifference(BrepsA=cap_holes_2, BrepsB=cap_holes)
cap_holes_3 = CapHoles(Brep=loft)
unit_y = UnitY(Factor=1)
merge_2 = Merge(Data1=sphere, Data2=solid_difference, Data3=cap_holes_3)
point_9 = Point(construct_point)
move_5 = Move(Geometry=point_9, Motion=unit_y)  # -> Geometry, Transform
line_2 = Line(StartPoint=point_9, EndPoint=move_5.Geometry)
# rc
# Full multiplicity knots at start
# Simple knots
# Full multiplicity knots at end
# P1
# A=0.2*P1+ 0.8*P2
# D=0.2*A + 0.8*B
# P2
# B=0.47*P2 + 0.53*P3
# Full multiplicity knots at start
# E=0.7*B + 0.3*C
# P3
# Full multiplicity knots in the middle
# C=0.8*P3 + 0.2*P4
# P4
# Full multiplicity knots at end
# Compare knot spacing
rotate_3d = Rotate3D(Geometry=merge_2, Angle=1.570796327, Center=construct_point, Axis=line_2)  # -> Geometry, Transform
