# Grasshopper definition Sets143SmallObjects.gh (Grasshopper 1.0.7)
# Copyright: Wickerson Studios
# plug-ins: Bifocals

# 1001 GRASSHOPPER DEFINITIONS
# Wickerson Studio
# 
# created by: Michael Wickerson
# 
# Grasshopper for Rhino 3D Algorithmic Modeling
# 
# www.wickersonstudios.com
# www.michaelwickerson.com
# https://www.youtube.com/channel/UC7J48Ppcsa6oncp6d29R0xw
# https://github.com/mwickerson
# https://www.facebook.com/michael.wickerson
# https://www.linkedin.com/in/michael-wickerson-696a80156/
# https://www.grasshopper3d.com/profile/MichaelWickerson
image_sampler = ImageSampler(
    FilePath="C:\Users\Sculpture\Documents\2020Grasshopper\ScreenShots2019\Screenshots2020\SurfaceEditAlgorithm.PNG",
    Filter="Value",
    Interpolate=False,
    Umax=1,
    Umin=0,
    Vmax=1,
    Vmin=0,
    Wrap=1)
number_slider = Slider(100, range=0..100)
# ELECTRIC CABLE
number_slider_2 = Slider(10, range=0..10)
pi = Pi(Factor=number_slider_2)
range = Range(Domain=pi, Steps=number_slider)
pi_2 = Pi(Factor=1)
center_box = CenterBox(Base=PlaneXY(0, 0, 0), X=number_slider_2, Y=number_slider_2, Z=number_slider_2)
sine = Sine(Value=range)
cosine = Cosine(Value=range)
populate_3d = Populate3D(Region=center_box, Count=Slider(8, range=4..10), Seed=Slider(67, range=0..100))
# MATH 143/1001
# Small Objects
# Inspired by: R.K.C.Cheng
multiplication = Multiplication(A=range, B=pi_2)
construct_point = ConstructPoint(XCoordinate=multiplication, YCoordinate=sine, ZCoordinate=cosine)
unit_x = UnitX(Factor=number_slider)
construct_point_2 = ConstructPoint(XCoordinate=0, YCoordinate=0, ZCoordinate=0)
interpolate = Interpolate(Vertices=construct_point, Degree=3, Periodic=False, KnotStyle=1)  # -> Curve, Length, Domain
yz_plane = YZPlane(Origin=Point(0, 0, 0))
move = Move(Geometry=construct_point_2, Motion=unit_x)  # -> Geometry, Transform
nurbs_curve = NurbsCurve(Vertices=populate_3d, Degree=Slider(3, range=0..10), Periodic=False)  # -> Curve, Length, Domain
polar_array = PolarArray(Geometry=interpolate.Curve, Plane=yz_plane, Count=Slider(5, range=0..10), Angle=6.283185307)  # -> Geometry, Transform
line = Line(StartPoint=construct_point_2, EndPoint=move.Geometry)
flow = Flow(
    Geometry=polar_array.Geometry,
    Base=line,
    Target=nurbs_curve.Curve,
    ReverseBase=False,
    ReverseTarget=False,
    Stretch=True,
    Rigid=False)
merge = Merge(Data1=flow, Data2=nurbs_curve.Curve)
division = Division(A=number_slider_2, B="40")
# rc
# Full multiplicity knots at start
# Simple knots
# Full multiplicity knots at end
# P1
# A=0.2*P1+ 0.8*P2
# D=0.2*A + 0.8*B
# P2
# B=0.47*P2 + 0.53*P3
# Full multiplicity knots at start
# E=0.7*B + 0.3*C
# P3
# Full multiplicity knots in the middle
# C=0.8*P3 + 0.2*P4
# P4
# Full multiplicity knots at end
# Compare knot spacing
pipe = Pipe(Curve=merge, Radius=division, Caps=1)
