# Grasshopper definition Sets144bSmallObjects.gh (Grasshopper 1.0.7)
# Copyright: Wickerson Studios
# plug-ins: Pufferfish, Bifocals

# 1001 GRASSHOPPER DEFINITIONS
# Wickerson Studio
# 
# created by: Michael Wickerson
# 
# Grasshopper for Rhino 3D Algorithmic Modeling
# 
# www.wickersonstudios.com
# www.michaelwickerson.com
# https://www.youtube.com/channel/UC7J48Ppcsa6oncp6d29R0xw
# https://github.com/mwickerson
# https://www.facebook.com/michael.wickerson
# https://www.linkedin.com/in/michael-wickerson-696a80156/
# https://www.grasshopper3d.com/profile/MichaelWickerson
image_sampler = ImageSampler(
    FilePath="C:\Users\Sculpture\Documents\2020Grasshopper\ScreenShots2019\Screenshots2020\SurfaceEditAlgorithm.PNG",
    Filter="Value",
    Interpolate=False,
    Umax=1,
    Umin=0,
    Vmax=1,
    Vmin=0,
    Wrap=1)
# SPOON
circle = Circle(Plane=PlaneXY(0, 0, 0), Radius=1)
scale_nu = ScaleNU(Geometry=circle, Plane=PlaneXY(0, 0, 0), ScaleX=Slider(1.48, range=0..3), ScaleY=Slider(1, range=0..1), ScaleZ=1)  # -> Geometry, Transform
yz_plane = YZPlane(Origin=Point(0, 0, 0))
rotate_3d = Rotate3D(Geometry=scale_nu.Geometry, Angle=1.570796327, Center=Point(0, 0, 0), Axis=yz_plane)  # -> Geometry, Transform
# MATH 144/1001
# Small Objects
# Inspired by: R.K.C.Cheng
boundary_surfaces = BoundarySurfaces(Edges=scale_nu.Geometry)
number_slider = Slider(8, range=0..10)
scale_nu_2 = ScaleNU(Geometry=rotate_3d.Geometry, Plane=PlaneXY(0, 0, 0), ScaleX=1, ScaleY=1, ScaleZ=Slider(0.21, range=0..1))  # -> Geometry, Transform
boundary_surfaces_2 = BoundarySurfaces(Edges=scale_nu_2.Geometry)
divide_curve = DivideCurve(Curve=scale_nu.Geometry, Count=number_slider, Kinks=False)  # -> Points, Tangents, Parameters
divide_curve_2 = DivideCurve(Curve=scale_nu_2.Geometry, Count=number_slider, Kinks=False)  # -> Points, Tangents, Parameters
split_with_brep = SplitWithBrep(Curve=scale_nu.Geometry, Brep=boundary_surfaces_2)  # -> Curve, Points
split_with_brep_2 = SplitWithBrep(Curve=scale_nu_2.Geometry, Brep=boundary_surfaces)  # -> Curve, Points
explode_tree = ExplodeTree(Data=graft(divide_curve.Points))  # -> Branch0, Branch1, Branch2, Branch3, Branch4, Branch5, Branch6, Branch7
explode_tree_2 = ExplodeTree(Data=graft(divide_curve_2.Points))  # -> Branch0, Branch1, Branch2, Branch3, Branch4, Branch5, Branch6, Branch7
point = Point(explode_tree.Branch5)
point_2 = Point(explode_tree.Branch7)
point_3 = Point(explode_tree_2.Branch5)
point_4 = Point(explode_tree_2.Branch7)
point_5 = Point(explode_tree.Branch1)
point_6 = Point(explode_tree.Branch4)
point_7 = Point(explode_tree.Branch6)
point_8 = Point(explode_tree_2.Branch1)
point_9 = Point(explode_tree_2.Branch3)
point_10 = Point(explode_tree_2.Branch4)
point_11 = Point(explode_tree_2.Branch6)
point_12 = Point(explode_tree.Branch0)
point_13 = Point(explode_tree.Branch2)
point_14 = Point(explode_tree_2.Branch0)
point_15 = Point(explode_tree_2.Branch2)
point_16 = Point(explode_tree.Branch3)
arc_3pt = Arc3Pt(PointA=point_5, PointB=point_8, PointC=point_2)  # -> Arc, Plane, Radius
arc_3pt_2 = Arc3Pt(PointA=point_5, PointB=point_4, PointC=point_2)  # -> Arc, Plane, Radius
explode_tree_3 = ExplodeTree(Data=graft(split_with_brep.Curve))  # -> Branch0, Branch1
explode_tree_4 = ExplodeTree(Data=graft(split_with_brep_2.Curve))  # -> Branch0, Branch1
arc_3pt_3 = Arc3Pt(PointA=point_13, PointB=point_15, PointC=point_7)  # -> Arc, Plane, Radius
arc_3pt_4 = Arc3Pt(PointA=point_13, PointB=point_11, PointC=point_7)  # -> Arc, Plane, Radius
arc_3pt_5 = Arc3Pt(PointA=point_16, PointB=point_3, PointC=point)  # -> Arc, Plane, Radius
arc_3pt_6 = Arc3Pt(PointA=point_16, PointB=point_9, PointC=point)  # -> Arc, Plane, Radius
curve = Curve(explode_tree_4.Branch0)
join_curves = JoinCurves(Curves=[arc_3pt.Arc, arc_3pt_2.Arc], Preserve=False)
join_curves_2 = JoinCurves(Curves=[arc_3pt_3.Arc, arc_3pt_4.Arc], Preserve=False)
join_curves_3 = JoinCurves(Curves=[arc_3pt_6.Arc, arc_3pt_5.Arc], Preserve=False)
scale_nu_3 = ScaleNU(Geometry=curve, Plane=PlaneXY(0, 0, 0), ScaleX=1, ScaleY=1, ScaleZ=expr("-x", Slider(0.28, range=0..1)))  # -> Geometry, Transform
number_slider_2 = Slider(1, range=0..1)
number_slider_3 = Slider(5, range=0..5)
merge = Merge(Data1=join_curves_3, Data2=join_curves_2, Data3=join_curves)  # -> flatten(Result)
merge_2 = Merge(Data1=explode_tree_3.Branch0, Data2=explode_tree_4.Branch0, Data3=explode_tree_3.Branch1, Data4=explode_tree_4.Branch1)  # -> flatten(Result)
line = Line(StartPoint=point_12, EndPoint=point_6)
unit_z = UnitZ(Factor=1)
curve_middle = CurveMiddle(Curve=line)
rebuild_curve = RebuildCurve(Curve=merge_2, Degree=number_slider_3, EndTangents=number_slider_2)
rebuild_curve_2 = RebuildCurve(Curve=merge, Degree=number_slider_3, EndTangents=number_slider_2)
negative = Negative(Value=unit_z)
end_points = EndPoints(Curve=line)  # -> Start, End
curve_2 = Curve(explode_tree_4.Branch1)
move = Move(Geometry=curve_middle, Motion=negative)  # -> Geometry, Transform
arc_3pt_7 = Arc3Pt(PointA=end_points.Start, PointB=move.Geometry, PointC=end_points.End)  # -> Arc, Plane, Radius
network_surface = NetworkSurface(CurvesU=rebuild_curve, CurvesV=rebuild_curve_2, Continuity=Slider(3, range=0..10))
# rc
# Full multiplicity knots at start
# Simple knots
# Full multiplicity knots at end
# P1
# A=0.2*P1+ 0.8*P2
# D=0.2*A + 0.8*B
# P2
# B=0.47*P2 + 0.53*P3
# Full multiplicity knots at start
# E=0.7*B + 0.3*C
# P3
# Full multiplicity knots in the middle
# C=0.8*P3 + 0.2*P4
# P4
# Full multiplicity knots at end
# Compare knot spacing
flow = Flow(
    Geometry=network_surface,
    Base=line,
    Target=arc_3pt_7.Arc,
    ReverseBase=False,
    ReverseTarget=False,
    Stretch=Slider(0, range=0..100),
    Rigid=False)
