# Grasshopper definition Sets145SmallObjects.gh (Grasshopper 1.0.7)
# Copyright: Wickerson Studios
# plug-ins: Bifocals

# 1001 GRASSHOPPER DEFINITIONS
# Wickerson Studio
# 
# created by: Michael Wickerson
# 
# Grasshopper for Rhino 3D Algorithmic Modeling
# 
# www.wickersonstudios.com
# www.michaelwickerson.com
# https://www.youtube.com/channel/UC7J48Ppcsa6oncp6d29R0xw
# https://github.com/mwickerson
# https://www.facebook.com/michael.wickerson
# https://www.linkedin.com/in/michael-wickerson-696a80156/
# https://www.grasshopper3d.com/profile/MichaelWickerson
image_sampler = ImageSampler(
    FilePath="C:\Users\Sculpture\Documents\2020Grasshopper\ScreenShots2019\Screenshots2020\SurfaceEditAlgorithm.PNG",
    Filter="Value",
    Interpolate=False,
    Umax=1,
    Umin=0,
    Vmax=1,
    Vmin=0,
    Wrap=1)

# ----
# JEWELRY
number_slider = Slider(10, range=0..10)
number_slider_2 = Slider(29, range=0..100)
construct_point = ConstructPoint(XCoordinate=0, YCoordinate=0, ZCoordinate=0)
unit_x = UnitX(Factor=number_slider)
circle = Circle(Plane=construct_point, Radius=number_slider)
move = Move(Geometry=construct_point, Motion=unit_x)  # -> Geometry, Transform
line = Line(StartPoint=construct_point, EndPoint=move.Geometry)
perp_frames = PerpFrames(Curve=line, Count=number_slider_2, Align=True)  # -> Frames, Parameters
pi = Pi(Factor=Slider(10, range=0..12))
radius_1 = Radius1(1)
division = Division(A=radius_1, B="2")
# MATH 145/1001
# Small Objects
number_slider_3 = Slider(0.151, range=0..0.3)
ellipse = Ellipse(Plane=perp_frames.Frames, Radius1=radius_1, Radius2=division)  # -> Ellipse, Focus1, Focus2
range = Range(Domain=pi, Steps=number_slider_2)
rotate_axis = RotateAxis(Geometry=ellipse.Ellipse, Angle=range, Axis=line)  # -> Geometry, Transform
loft = Loft(
    Curves=rotate_axis.Geometry,
    Options={Adjust=False, Closed=False, LoftEnds=0, LoftSimp=0, LoftType=0, Rebuild=10, Refit=0.01})
pipe = Pipe(Curve=ellipse.Ellipse, Radius=number_slider_3, Caps=0)
merge = Merge(Data1=pipe, Data2=loft)
# rc
# Full multiplicity knots at start
# Simple knots
# Full multiplicity knots at end
# P1
# A=0.2*P1+ 0.8*P2
# D=0.2*A + 0.8*B
# P2
# B=0.47*P2 + 0.53*P3
# Full multiplicity knots at start
# E=0.7*B + 0.3*C
# P3
# Full multiplicity knots in the middle
# C=0.8*P3 + 0.2*P4
# P4
# Full multiplicity knots at end
# Compare knot spacing
flow = Flow(Geometry=merge, Base=line, Target=circle, ReverseBase=False, ReverseTarget=False, Stretch=True, Rigid=False)
