# Grasshopper definition Sets146NURBScurvesAndPointObjects.gh (Grasshopper 1.0.7)
# Copyright: Wickerson Studios
# plug-ins: Bifocals

# 1001 GRASSHOPPER DEFINITIONS
# Wickerson Studio
# 
# created by: Michael Wickerson
# 
# Grasshopper for Rhino 3D Algorithmic Modeling
# 
# www.wickersonstudios.com
# www.michaelwickerson.com
# https://www.youtube.com/channel/UC7J48Ppcsa6oncp6d29R0xw
# https://github.com/mwickerson
# https://www.facebook.com/michael.wickerson
# https://www.linkedin.com/in/michael-wickerson-696a80156/
# https://www.grasshopper3d.com/profile/MichaelWickerson
image_sampler = ImageSampler(
    FilePath="C:\Users\Sculpture\Documents\2020Grasshopper\ScreenShots2019\Screenshots2020\SurfaceEditAlgorithm.PNG",
    Filter="Value",
    Interpolate=False,
    Umax=1,
    Umin=0,
    Vmax=1,
    Vmin=0,
    Wrap=1)

# ----
# CONSTRUCTED SURFACE
number_slider = Slider(26, range=0..100)
number_slider_2 = Slider(10, range=0..100)
center_box = CenterBox(Base=PlaneXY(0, 0, 0), X=number_slider, Y=number_slider, Z=number_slider)
populate_3d = Populate3D(Region=center_box, Count=Slider(2, range=0..10), Seed=Slider(58, range=0..100))
unit_x = UnitX(Factor=number_slider_2)
move = Move(Geometry=populate_3d, Motion=unit_x)  # -> Geometry, Transform
# MATH 146/1001
# NURBS CURVES AND POINT OBJECTS
unit_z = UnitZ(Factor=number_slider_2)
interpolate = Interpolate(Vertices=move.Geometry, Degree=3, Periodic=False, KnotStyle=1)  # -> Curve, Length, Domain
curve_middle = CurveMiddle(Curve=interpolate.Curve)
move_2 = Move(Geometry=curve_middle, Motion=unit_z)  # -> Geometry, Transform
end_points = EndPoints(Curve=interpolate.Curve)  # -> Start, End
merge = Merge(Data1=end_points.Start, Data2=move_2.Geometry, Data3=end_points.End)
interpolate_2 = Interpolate(Vertices=merge, Degree=3, Periodic=False, KnotStyle=1)  # -> Curve, Length, Domain
polar_array = PolarArray(Geometry=interpolate_2.Curve, Plane=PlaneXY(0, 0, 0), Count=Slider(4, range=0..10), Angle=6.283185307)  # -> Geometry, Transform
explode_tree = ExplodeTree(Data=graft(polar_array.Geometry))  # -> _0000, _0001, _0002, _0003
# rc
# Full multiplicity knots at start
# Simple knots
# Full multiplicity knots at end
# P1
# A=0.2*P1+ 0.8*P2
# D=0.2*A + 0.8*B
# P2
# B=0.47*P2 + 0.53*P3
# Full multiplicity knots at start
# E=0.7*B + 0.3*C
# P3
# Full multiplicity knots in the middle
# C=0.8*P3 + 0.2*P4
# P4
# Full multiplicity knots at end
edge_surface = EdgeSurface(CurveA=explode_tree._0000, CurveB=explode_tree._0001, CurveC=explode_tree._0002, CurveD=explode_tree._0003)

# ----
# SPLINE AND TANGENT VECTORS
number_slider_3 = Slider(0.2, range=0..1)
construct_domain = ConstructDomain(DomainStart=number_slider_3, DomainEnd=Slider(0.8, range=0..1))
circle = Circle(Plane=PlaneXY(0, 0, 0), Radius=Slider(12, range=0..100))
sub_curve = SubCurve(BaseCurve=reparameterize(circle), Domain=construct_domain)  # -> reparameterize(Curve)
number_slider_4 = Slider(7.36, range=0..10)
evaluate_curve = EvaluateCurve(Curve=reparameterize(sub_curve), Parameter=Slider(0.32, range=0..1))  # -> Point, Tangent, Angle
evaluate_curve_2 = EvaluateCurve(Curve=reparameterize(sub_curve), Parameter=Slider(0.64, range=0..1))  # -> Point, Tangent, Angle
amplitude = Amplitude(Vector=evaluate_curve.Tangent, Amplitude=number_slider_4)
amplitude_2 = Amplitude(Vector=evaluate_curve_2.Tangent, Amplitude=number_slider_4)
vector_display = VectorDisplay(Anchor=evaluate_curve_2.Point, Vector=amplitude_2)
vector_display_2 = VectorDisplay(Anchor=evaluate_curve.Point, Vector=amplitude)

# ----
# B-SPLINE AND CONTROL POINTS
number_slider_5 = Slider(0.2, range=0..1)
construct_domain_2 = ConstructDomain(DomainStart=number_slider_5, DomainEnd=Slider(0.8, range=0..1))
circle_2 = Circle(Plane=PlaneXY(0, 0, 0), Radius=Slider(12, range=0..100))
populate_3d_2 = Populate3D(
    Region={Plane=PlaneXY(0, 0, 0), X=Domain(0, 10), Y=Domain(0, 10), Z=Domain(0, 2)},
    Count=Slider(8, range=0..10),
    Seed=Slider(12, range=0..100))
sub_curve_2 = SubCurve(BaseCurve=reparameterize(circle_2), Domain=construct_domain_2)  # -> reparameterize(Curve)
interpolate_3 = Interpolate(Vertices=populate_3d_2, Degree=3, Periodic=False, KnotStyle=1)  # -> Curve, Length, Domain
control_points = ControlPoints(Curve=reparameterize(sub_curve_2))  # -> Points, Weights, Knots
point = Point(control_points.Points)
move_3 = Move(Geometry=point, Motion=Vector(0, 0, 10))  # -> Geometry, Transform
panel = Panel(control_points.Weights)
panel_2 = Panel(control_points.Knots)
line = Line(StartPoint=point, EndPoint=move_3.Geometry)
text_tag_3d = TextTag3D(Location=point, Text=panel, Size=1, Justification=7)
text_tag_3d_2 = TextTag3D(Location=move_3.Geometry, Text=panel_2, Size=1, Justification=7)

# ----
# INTERPOLATE/NURBS/POLY LINE
# TANGENT CURVE
number_slider_6 = Slider(26, range=0..100)
number_slider_7 = Slider(4, range=0..10)
center_box_2 = CenterBox(Base=PlaneXY(0, 0, 0), X=number_slider_6, Y=number_slider_6, Z=number_slider_6)
populate_3d_3 = Populate3D(Region=center_box_2, Count=number_slider_7, Seed=Slider(58, range=0..100))
populate_3d_4 = Populate3D(Region=center_box_2, Count=number_slider_7, Seed=Slider(41, range=0..100))
interpolate_4 = Interpolate(Vertices=populate_3d_4, Degree=3, Periodic=False, KnotStyle=1)  # -> Curve, Length, Domain
interpolate_5 = Interpolate(Vertices=populate_3d_3, Degree=3, Periodic=False, KnotStyle=1)  # -> Curve, Length, Domain
nurbs_curve = NurbsCurve(Vertices=populate_3d_3, Degree=3, Periodic=False)  # -> Curve, Length, Domain
polyline = PolyLine(Vertices=populate_3d_3, Closed=False)
evaluate_curve_3 = EvaluateCurve(
    Curve=reparameterize(interpolate_5.Curve),
    Parameter=[Slider(0.02, range=0..1), Slider(0.36, range=0..1), Slider(0.43, range=0..1), Slider(0.41, range=0..1)])  # -> Point, Tangent, Angle
# Compare knot spacing
tangent_curve = TangentCurve(Vertices=populate_3d_3, Tangents=evaluate_curve_3.Tangent, Blend=0.5, Degree=3)  # -> Curve, Length, Domain

kinky_curve = KinkyCurve(Vertices=populate_3d_3, Degree=3, Angle=0.1745329252)  # -> Curve, Length, Domain
