# Grasshopper definition Sets147CURVES.gh (Grasshopper 1.0.7)
# Copyright: Wickerson Studios
# plug-ins: Bifocals

# 1001 GRASSHOPPER DEFINITIONS
# Wickerson Studio
# 
# created by: Michael Wickerson
# 
# Grasshopper for Rhino 3D Algorithmic Modeling
# 
# www.wickersonstudios.com
# www.michaelwickerson.com
# https://www.youtube.com/channel/UC7J48Ppcsa6oncp6d29R0xw
# https://github.com/mwickerson
# https://www.facebook.com/michael.wickerson
# https://www.linkedin.com/in/michael-wickerson-696a80156/
# https://www.grasshopper3d.com/profile/MichaelWickerson
image_sampler = ImageSampler(
    FilePath="C:\Users\Sculpture\Documents\2020Grasshopper\ScreenShots2019\Screenshots2020\SurfaceEditAlgorithm.PNG",
    Filter="Value",
    Interpolate=False,
    Umax=1,
    Umin=0,
    Vmax=1,
    Vmin=0,
    Wrap=1)

# ----
# CURVE NODES:
# DECONSTRUCT ARC/RECTANGLE
number_slider = Slider(0.922, range=0..1)
number_slider_2 = Slider(59, range=0..100)
construct_domain = ConstructDomain(DomainStart=Slider(0.16, range=0..1), DomainEnd=number_slider)
circle = Circle(Plane=PlaneXY(0, 0, 0), Radius=1)
negative = Negative(Value=number_slider_2)
sub_curve = SubCurve(BaseCurve=reparameterize(circle), Domain=construct_domain)
construct_domain_2 = ConstructDomain(DomainStart=negative, DomainEnd=number_slider_2)
construct_point = ConstructPoint(XCoordinate=0, YCoordinate=0, ZCoordinate=0)
deconstruct_arc = DeconstructArc(Arc=sub_curve)  # -> BasePlane, Radius, Angle
rectangle = Rectangle(Plane=PlaneXY(0, 0, 0), XSize=construct_domain_2, YSize=construct_domain_2, Radius=0)  # -> Rectangle, Length
end_points = EndPoints(Curve=sub_curve)  # -> Start, End
number_slider_3 = Slider(1, range=0..1)
plane = Plane(deconstruct_arc.BasePlane)
panel = Panel(deconstruct_arc.Radius)
panel_2 = Panel(deconstruct_arc.Angle)
deconstuct_rectangle = DeconstuctRectangle(Rectangle=rectangle.Rectangle)  # -> BasePlane, XInterval, YInterval
vector_2pt = Vector2Pt(PointA=construct_point, PointB=end_points.Start, Unitize=number_slider_3)  # -> Vector, Length
vector_2pt_2 = Vector2Pt(PointA=construct_point, PointB=end_points.End, Unitize=number_slider_3)  # -> Vector, Length
panel_3 = Panel(deconstuct_rectangle.XInterval)
plane_2 = Plane(deconstuct_rectangle.BasePlane)
angle = Angle(VectorA=vector_2pt.Vector, VectorB=vector_2pt_2.Vector)  # -> Angle, Reflex
line = Line(StartPoint=construct_point, EndPoint=end_points.Start)
line_2 = Line(StartPoint=construct_point, EndPoint=end_points.End)
end_points_2 = EndPoints(Curve=[line, line_2])  # -> Start, End
number_slider_4 = Slider(0.1, range=0..0.1)
division = Division(A=number_slider_4, B="2")
sphere = Sphere(Base=[end_points_2.End, end_points_2.Start], Radius=number_slider_4)
# Full multiplicity knots at start
# Simple knots
# Full multiplicity knots at end
# P1
# A=0.2*P1+ 0.8*P2
# D=0.2*A + 0.8*B
# P2
# B=0.47*P2 + 0.53*P3
# Full multiplicity knots at start
# E=0.7*B + 0.3*C
# P3
# Full multiplicity knots in the middle
# C=0.8*P3 + 0.2*P4
# P4
# Full multiplicity knots at end
# Compare knot spacing
pipe = Pipe(Curve=[sub_curve, line_2, line], Radius=division, Caps=0)
# rc
text_tag_3d = TextTag3D(Location=end_points_2.End, Text=angle.Angle, Size=Slider(0.29, range=0..1), Justification=7)

# ----
# CURVE NODES:
# CONTROL POLYGON
gene_pool = GenePool(
    Decimals=0,
    Maximum=20,
    Minimum=3,
    Value=[19.4397777, 19.10924859, 18.50537671, 12.33244171, 17.64748258, 11.12661644, 16.62530427, 16.37268154, 15.26523472, 10.36663607])
polygon = Polygon(Plane=PlaneXY(0, 0, 0), Radius=3, Segments=gene_pool, FilletRadius=0)  # -> flatten(Polygon), Length
list_item = ListItem(List=polygon.Polygon, Index=Slider(7, range=0..10), Wrap=True)
control_polygon = ControlPolygon(Curve=list_item)  # -> Polygon, Points
polygon_center = PolygonCenter(Polyline=control_polygon.Polygon)  # -> CenterV, CenterE, CenterA
point = Point(control_polygon.Points)
point_2 = Point(polygon_center.CenterV)
point_3 = Point(polygon_center.CenterE)
point_4 = Point(polygon_center.CenterA)

# ----
# CURVE NODES: CONTROL POINTS
number_slider_5 = Slider(12, range=0..100)
populate_3d = Populate3D(Region={Plane=PlaneXY(0, 0, 0), X=Domain(0, 10), Y=Domain(0, 10), Z=Domain(0, 2)}, Count=number_slider_5, Seed=1)
interpolate = Interpolate(Vertices=populate_3d, Degree=3, Periodic=False, KnotStyle=1)  # -> Curve, Length, Domain
nurbs_curve = NurbsCurve(Vertices=populate_3d, Degree=3, Periodic=False)  # -> Curve, Length, Domain
polyline = PolyLine(Vertices=populate_3d, Closed=False)
# MATH 147/1001 CURVES
control_points = ControlPoints(Curve=polyline)  # -> Points, Weights, Knots
control_points_2 = ControlPoints(Curve=interpolate.Curve)  # -> Points, Weights, Knots
control_points_3 = ControlPoints(Curve=nurbs_curve.Curve)  # -> Points, Weights, Knots
point_5 = Point(control_points_2.Points)
point_6 = Point(control_points.Points)
point_7 = Point(control_points_3.Points)
panel_5 = Panel(control_points.Weights)
panel_6 = Panel(control_points_2.Weights)
panel_7 = Panel(control_points_3.Weights)
panel_8 = Panel(control_points.Knots)
panel_9 = Panel(control_points_2.Knots)
panel_10 = Panel(control_points_3.Knots)
