# Grasshopper definition Sets149CURVES.gh (Grasshopper 1.0.7)
# Copyright: Wickerson Studios
# plug-ins: Bifocals

# 1001 GRASSHOPPER DEFINITIONS
# Wickerson Studio
# 
# created by: Michael Wickerson
# 
# Grasshopper for Rhino 3D Algorithmic Modeling
# 
# www.wickersonstudios.com
# www.michaelwickerson.com
# https://www.youtube.com/channel/UC7J48Ppcsa6oncp6d29R0xw
# https://github.com/mwickerson
# https://www.facebook.com/michael.wickerson
# https://www.linkedin.com/in/michael-wickerson-696a80156/
# https://www.grasshopper3d.com/profile/MichaelWickerson
image_sampler = ImageSampler(
    FilePath="C:\Users\Sculpture\Documents\2020Grasshopper\ScreenShots2019\Screenshots2020\SurfaceEditAlgorithm.PNG",
    Filter="Value",
    Interpolate=False,
    Umax=1,
    Umin=0,
    Vmax=1,
    Vmin=0,
    Wrap=1)
# CURVE NODES:
# PLANAR
planar = Planar()  # -> Planar, Plane, Deviation
is_planar = IsPlanar(Interior=True)  # -> Planar, Plane

# ----
# CURVE NODES:
# PROXIMITY/EXTREMES
number_slider = Slider(3, range=3..10)
populate_3d = Populate3D(
    Region={Plane=PlaneXY(0, 0, 0), X=Domain(0, 10), Y=Domain(0, 10), Z=Domain(0, 2)},
    Count=number_slider,
    Seed=Slider(90, range=0..100))
unit_z = UnitZ(Factor=Slider(5.63, range=0..10))
populate_3d_2 = Populate3D(
    Region={Plane=PlaneXY(0, 0, 0), X=Domain(0, 10), Y=Domain(0, 10), Z=Domain(0, 2)},
    Count=number_slider,
    Seed=Slider(52, range=0..100))
move = Move(Geometry=populate_3d, Motion=unit_z)  # -> Geometry, Transform
interpolate = Interpolate(Vertices=populate_3d_2, Degree=3, Periodic=Slider(1, range=0..1), KnotStyle=1)  # -> reparameterize(Curve), Length, Domain
interpolate_2 = Interpolate(Vertices=move.Geometry, Degree=3, Periodic=Slider(1, range=0..1), KnotStyle=1)  # -> reparameterize(Curve), Length, Domain
curve_proximity = CurveProximity(CurveA=interpolate.Curve, CurveB=interpolate_2.Curve)  # -> PointA, PointB, Distance
panel = Panel(curve_proximity.Distance)
extremes = Extremes(Curve=interpolate.Curve, Plane=PlaneXY(0, 0, 0))  # -> Highest, Lowest
extremes_2 = Extremes(Curve=interpolate_2.Curve, Plane=PlaneXY(0, 0, 0))  # -> Highest, Lowest
line = Line(StartPoint=extremes.Highest, EndPoint=extremes_2.Highest)
line_2 = Line(StartPoint=extremes.Lowest, EndPoint=extremes_2.Lowest)
patch = Patch(Curves=graft([interpolate.Curve, interpolate_2.Curve]), Spans=20, Flexibility=1, Trim=Slider(1, range=0..1))
loft = Loft(Curves=[line, line_2], Options={Adjust=True, Closed=False, LoftEnds=0, LoftSimp=0, LoftType=0, Rebuild=10, Refit=0.01})
merge = Merge(Data1=loft, Data2=patch)  # -> flatten(Result)
surface = Surface(merge)
number_slider_2 = Slider(2, range=0..2)
number = Number(curve_proximity.Distance)

# ---- group: Isotrim
md_slider = MDSlider(
    SliderMode=0,
    slider_value=Point(0.5647732804, 0.5101281143, 0.5),
    x_domain=Domain(0, 1),
    y_domain=Domain(0, 1),
    z_domain=Domain(0, 1))
construct_domain = ConstructDomain(DomainU=md_slider, DomainV=md_slider)
isotrim = Isotrim(Surface=reparameterize(surface), Domain=construct_domain)

# ----
# CURVE NODES: CLOSEST POINT/OBJECT
number_slider_3 = Slider(8.99, range=0..20)  # disabled
number_slider_4 = Slider(4, range=3..10)  # disabled
number_slider_5 = Slider(34, range=0..100)  # disabled
number_slider_6 = Slider(0.72, range=0..10)  # disabled
negative = Negative(Value=number_slider_3)  # disabled
sphere = Sphere(Base=PlaneXY(0, 0, 0), Radius=number_slider_6)  # disabled
vector_xyz = VectorXYZ(XComponent=number_slider_3, YComponent=0, ZComponent=negative)  # -> Vector, Length; disabled
number_slider_7 = Slider(1, range=0..1)  # disabled
populate_3d_3 = Populate3D(
    Region={Plane=PlaneXY(0, 0, 0), X=Domain(0, 10), Y=Domain(0, 10), Z=Domain(0, 2)},
    Count=number_slider_4,
    Seed=number_slider_5)  # disabled
number_slider_8 = Slider(4, range=3..10)  # disabled
move_2 = Move(Geometry=sphere, Motion=vector_xyz.Vector)  # -> Geometry, Transform; disabled
# MATH 149/1001 CURVES
interpolate_3 = Interpolate(Vertices=populate_3d_3, Degree=3, Periodic=number_slider_7, KnotStyle=1)  # -> reparameterize(Curve), Length, Domain; disabled
polar_array = PolarArray(Geometry=move_2.Geometry, Plane=PlaneXY(0, 0, 0), Count=number_slider_8, Angle=6.283185307)  # -> Geometry, Transform; disabled
curve_nearest_object = CurveNearestObject(Curve=interpolate_3.Curve, Geometry=graft(polar_array.Geometry))  # -> PointA, PointB, Index; disabled
line_3 = Line(StartPoint=curve_nearest_object.PointA, EndPoint=curve_nearest_object.PointB)  # disabled
merge_2 = Merge(Data1=line_3, Data2=interpolate_3.Curve)  # disabled
patch_2 = Patch(Curves=interpolate_3.Curve, Spans=20, Flexibility=1, Trim=True)  # disabled
surface_2 = Surface(patch_2)  # disabled
panel_2 = Panel("2")  # disabled
number_slider_9 = Slider(2.993, range=0..4)  # disabled
pipe = Pipe(Curve=merge_2, Radius=1, Caps=2)  # disabled
# rc
geometry = Geometry(polar_array.Geometry)  # disabled

# ---- group: Isotrim
md_slider_2 = MDSlider(
    SliderMode=0,
    slider_value=Point(0.5647732804, 0.5101281143, 0.5),
    x_domain=Domain(0, 1),
    y_domain=Domain(0, 1),
    z_domain=Domain(0, 1))  # disabled
construct_domain_2 = ConstructDomain(DomainU=md_slider_2, DomainV=md_slider_2)  # disabled
isotrim_2 = Isotrim(Surface=reparameterize(surface_2), Domain=construct_domain_2)  # disabled

# ----
deconstruct_brep = DeconstructBrep(Brep=isotrim)  # -> Faces, Edges, Vertices
list_item = ListItem(List=deconstruct_brep.Vertices, Index="2", Wrap=True)

surface_closest_point = SurfaceClosestPoint(Point=list_item, Surface=surface)  # -> Point, UVPoint, Distance
evaluate_surface = EvaluateSurface(Surface=surface, Point=surface_closest_point.UVPoint)  # -> Point, Normal, UDirection, VDirection, Frame

amplitude = Amplitude(Vector=evaluate_surface.Normal, Amplitude=number)
multiplication = Multiplication(A=evaluate_surface.Normal, B=number)
vector_display = VectorDisplay(Anchor=evaluate_surface.Point, Vector=amplitude)
# Full multiplicity knots at start
# Simple knots
# Full multiplicity knots at end
# P1
# A=0.2*P1+ 0.8*P2
# D=0.2*A + 0.8*B
# P2
# B=0.47*P2 + 0.53*P3
# Full multiplicity knots at start
# E=0.7*B + 0.3*C
# P3
# Full multiplicity knots in the middle
# C=0.8*P3 + 0.2*P4
# P4
# Full multiplicity knots at end
# Compare knot spacing
extrude = Extrude(Base=surface, Direction=multiplication)

deconstruct_brep_2 = DeconstructBrep(Brep=isotrim_2)  # -> Faces, Edges, Vertices; disabled
list_item_2 = ListItem(List=deconstruct_brep_2.Vertices, Index=panel_2, Wrap=True)  # disabled

surface_closest_point_2 = SurfaceClosestPoint(Point=list_item_2, Surface=surface_2)  # -> Point, UVPoint, Distance; disabled
evaluate_surface_2 = EvaluateSurface(Surface=surface_2, Point=surface_closest_point_2.UVPoint)  # -> Point, Normal, UDirection, VDirection, Frame; disabled

amplitude_2 = Amplitude(Vector=evaluate_surface_2.Normal, Amplitude=number_slider_9)  # disabled
multiplication_2 = Multiplication(A=evaluate_surface_2.Normal, B=number_slider_9)  # disabled
vector_display_2 = VectorDisplay(Anchor=evaluate_surface_2.Point, Vector=amplitude_2)  # disabled
extrude_2 = Extrude(Base=surface_2, Direction=multiplication_2)  # disabled
