# Grasshopper definition Sets150CURVES.gh (Grasshopper 1.0.7)
# Copyright: Wickerson Studios
# plug-ins: Bifocals

# 1001 GRASSHOPPER DEFINITIONS
# Wickerson Studio
# 
# created by: Michael Wickerson
# 
# Grasshopper for Rhino 3D Algorithmic Modeling
# 
# www.wickersonstudios.com
# www.michaelwickerson.com
# https://www.youtube.com/channel/UC7J48Ppcsa6oncp6d29R0xw
# https://github.com/mwickerson
# https://www.facebook.com/michael.wickerson
# https://www.linkedin.com/in/michael-wickerson-696a80156/
# https://www.grasshopper3d.com/profile/MichaelWickerson
image_sampler = ImageSampler(
    FilePath="C:\Users\Sculpture\Documents\2020Grasshopper\ScreenShots2019\Screenshots2020\SurfaceEditAlgorithm.PNG",
    Filter="Value",
    Interpolate=False,
    Umax=1,
    Umin=0,
    Vmax=1,
    Vmin=0,
    Wrap=1)
md_slider = MDSlider(SliderMode=0, slider_value=Point(0.5, 0.5, 0.5), x_domain=Domain(0, 1), y_domain=Domain(0, 1), z_domain=Domain(0, 1))

# ----
# CURVE NODES:
# PROXIMITY/EXTREMES
number_slider = Slider(3, range=3..10)
populate_3d = Populate3D(
    Region={Plane=PlaneXY(0, 0, 0), X=Domain(0, 10), Y=Domain(0, 10), Z=Domain(0, 2)},
    Count=number_slider,
    Seed=Slider(90, range=0..100))
unit_z = UnitZ(Factor=Slider(5.63, range=0..10))
populate_3d_2 = Populate3D(
    Region={Plane=PlaneXY(0, 0, 0), X=Domain(0, 10), Y=Domain(0, 10), Z=Domain(0, 2)},
    Count=number_slider,
    Seed=Slider(52, range=0..100))
move = Move(Geometry=populate_3d, Motion=unit_z)  # -> Geometry, Transform
interpolate = Interpolate(Vertices=populate_3d_2, Degree=3, Periodic=Slider(1, range=0..1), KnotStyle=1)  # -> reparameterize(Curve), Length, Domain
interpolate_2 = Interpolate(Vertices=move.Geometry, Degree=3, Periodic=Slider(1, range=0..1), KnotStyle=1)  # -> reparameterize(Curve), Length, Domain
curve_proximity = CurveProximity(CurveA=interpolate.Curve, CurveB=interpolate_2.Curve)  # -> PointA, PointB, Distance
panel = Panel(curve_proximity.Distance)
extremes = Extremes(Curve=interpolate.Curve, Plane=PlaneXY(0, 0, 0))  # -> Highest, Lowest
extremes_2 = Extremes(Curve=interpolate_2.Curve, Plane=PlaneXY(0, 0, 0))  # -> Highest, Lowest
line = Line(StartPoint=extremes.Highest, EndPoint=extremes_2.Highest)
line_2 = Line(StartPoint=extremes.Lowest, EndPoint=extremes_2.Lowest)
patch = Patch(Curves=graft([interpolate.Curve, interpolate_2.Curve]), Spans=20, Flexibility=1, Trim=Slider(1, range=0..1))
loft = Loft(Curves=[line, line_2], Options={Adjust=True, Closed=False, LoftEnds=0, LoftSimp=0, LoftType=0, Rebuild=10, Refit=0.01})
merge = Merge(Data1=loft, Data2=patch)  # -> flatten(Result)
surface = Surface(merge)
number_slider_2 = Slider(2, range=0..2)
number = Number(curve_proximity.Distance)

# ---- group: Isotrim
md_slider_2 = MDSlider(
    SliderMode=0,
    slider_value=Point(0.5647732804, 0.5101281143, 0.5),
    x_domain=Domain(0, 1),
    y_domain=Domain(0, 1),
    z_domain=Domain(0, 1))
construct_domain = ConstructDomain(DomainU=md_slider_2, DomainV=md_slider_2)
isotrim = Isotrim(Surface=reparameterize(surface), Domain=construct_domain)

# ----
# CURVE NODES: CLOSEST POINT/OBJECT
number_slider_3 = Slider(8.99, range=0..20)
negative = Negative(Value=number_slider_3)
sphere = Sphere(Base=PlaneXY(0, 0, 0), Radius=Slider(0.72, range=0..10))
vector_xyz = VectorXYZ(XComponent=number_slider_3, YComponent=0, ZComponent=negative)  # -> Vector, Length
populate_3d_3 = Populate3D(
    Region={Plane=PlaneXY(0, 0, 0), X=Domain(0, 10), Y=Domain(0, 10), Z=Domain(0, 2)},
    Count=Slider(4, range=3..10),
    Seed=Slider(34, range=0..100))
move_2 = Move(Geometry=sphere, Motion=vector_xyz.Vector)  # -> Geometry, Transform
# MATH 150/1001 CURVES
interpolate_3 = Interpolate(Vertices=populate_3d_3, Degree=3, Periodic=Slider(1, range=0..1), KnotStyle=1)  # -> reparameterize(Curve), Length, Domain
polar_array = PolarArray(Geometry=move_2.Geometry, Plane=PlaneXY(0, 0, 0), Count=Slider(4, range=3..10), Angle=6.283185307)  # -> Geometry, Transform
curve_nearest_object = CurveNearestObject(Curve=interpolate_3.Curve, Geometry=graft(polar_array.Geometry))  # -> PointA, PointB, Index
line_3 = Line(StartPoint=curve_nearest_object.PointA, EndPoint=curve_nearest_object.PointB)
merge_2 = Merge(Data1=line_3, Data2=interpolate_3.Curve)
patch_2 = Patch(Curves=interpolate_3.Curve, Spans=20, Flexibility=1, Trim=True)
surface_2 = Surface(patch_2)
number_slider_4 = Slider(2.993, range=0..4)
pipe = Pipe(Curve=merge_2, Radius=1, Caps=2)
# rc
geometry = Geometry(polar_array.Geometry)

# ---- group: Isotrim
md_slider_3 = MDSlider(
    SliderMode=0,
    slider_value=Point(0.5647732804, 0.5101281143, 0.5),
    x_domain=Domain(0, 1),
    y_domain=Domain(0, 1),
    z_domain=Domain(0, 1))
construct_domain_2 = ConstructDomain(DomainU=md_slider_3, DomainV=md_slider_3)
isotrim_2 = Isotrim(Surface=reparameterize(surface_2), Domain=construct_domain_2)

# ----
# CURVE NODES:
# PLANAR
number_slider_5 = Slider(10, range=0..10)
cylinder = Cylinder(Base=PlaneXY(0, 0, 0), Radius=number_slider_5, Length=number_slider_5)
md_slider_4 = MDSlider(
    SliderMode=0,
    slider_value=Point(0.5286278912, 0.5082457007, 0.5),
    x_domain=Domain(0, 1),
    y_domain=Domain(0, 1),
    z_domain=Domain(0, 1))
surface_3 = Surface(reparameterize(cylinder))
range = Range(Domain=Slider(1.1, range=0..2), Steps=Slider(3, range=0..10))
cap_holes = CapHoles(Brep=cylinder)
construct_point = ConstructPoint(XCoordinate=0, YCoordinate=0, ZCoordinate=0)
unit_x = UnitX(Factor=1)
evaluate_surface = EvaluateSurface(Surface=surface_3, Point=md_slider_4)  # -> Point, Normal, UDirection, VDirection, Frame
pi = Pi(Factor=range)
move_3 = Move(Geometry=construct_point, Motion=unit_x)  # -> Geometry, Transform
rotate_3d = Rotate3D(Geometry=cap_holes, Angle=pi, Center=evaluate_surface.Point, Axis=move_3.Geometry)  # -> Geometry, Transform
deconstruct_brep = DeconstructBrep(Brep=rotate_3d.Geometry)  # -> Faces, Edges, Vertices
curve = Curve(reparameterize(deconstruct_brep.Edges))
is_planar = IsPlanar(Surface=reparameterize(flatten(deconstruct_brep.Faces)), Interior=True)  # -> Planar, Plane
planar = Planar(Curve=flatten(curve))  # -> Planar, Plane, Deviation
cull_pattern = CullPattern(List=deconstruct_brep.Faces, CullPattern=is_planar.Planar)
cull_pattern_2 = CullPattern(List=deconstruct_brep.Edges, CullPattern=planar.Planar)
panel_2 = Panel(is_planar.Planar)
surface_4 = Surface(cull_pattern)
number_slider_6 = Slider(2.922, range=0..6)
pipe_2 = Pipe(Curve=cull_pattern_2, Radius=1, Caps=0)

# ---- group: Isotrim
md_slider_5 = MDSlider(
    SliderMode=0,
    slider_value=Point(0.5647732804, 0.5101281143, 0.5),
    x_domain=Domain(0, 1),
    y_domain=Domain(0, 1),
    z_domain=Domain(0, 1))
construct_domain_3 = ConstructDomain(DomainU=md_slider_5, DomainV=md_slider_5)
isotrim_3 = Isotrim(Surface=reparameterize(surface_4), Domain=construct_domain_3)

# ----
deconstruct_brep_2 = DeconstructBrep(Brep=isotrim)  # -> Faces, Edges, Vertices
list_item = ListItem(List=deconstruct_brep_2.Vertices, Index="2", Wrap=True)

surface_closest_point = SurfaceClosestPoint(Point=list_item, Surface=surface)  # -> Point, UVPoint, Distance
evaluate_surface_2 = EvaluateSurface(Surface=surface, Point=surface_closest_point.UVPoint)  # -> Point, Normal, UDirection, VDirection, Frame

amplitude = Amplitude(Vector=evaluate_surface_2.Normal, Amplitude=number)
multiplication = Multiplication(A=evaluate_surface_2.Normal, B=number)
vector_display = VectorDisplay(Anchor=evaluate_surface_2.Point, Vector=amplitude)
extrude = Extrude(Base=surface, Direction=multiplication)

deconstruct_brep_3 = DeconstructBrep(Brep=isotrim_2)  # -> Faces, Edges, Vertices
list_item_2 = ListItem(List=deconstruct_brep_3.Vertices, Index="2", Wrap=True)

surface_closest_point_2 = SurfaceClosestPoint(Point=list_item_2, Surface=surface_2)  # -> Point, UVPoint, Distance
evaluate_surface_3 = EvaluateSurface(Surface=surface_2, Point=surface_closest_point_2.UVPoint)  # -> Point, Normal, UDirection, VDirection, Frame

amplitude_2 = Amplitude(Vector=evaluate_surface_3.Normal, Amplitude=number_slider_4)
multiplication_2 = Multiplication(A=evaluate_surface_3.Normal, B=number_slider_4)
vector_display_2 = VectorDisplay(Anchor=evaluate_surface_3.Point, Vector=amplitude_2)
extrude_2 = Extrude(Base=surface_2, Direction=multiplication_2)

deconstruct_brep_4 = DeconstructBrep(Brep=isotrim_3)  # -> Faces, Edges, Vertices
list_item_3 = ListItem(List=deconstruct_brep_4.Vertices, Index="2", Wrap=True)

surface_closest_point_3 = SurfaceClosestPoint(Point=list_item_3, Surface=surface_4)  # -> Point, UVPoint, Distance
evaluate_surface_4 = EvaluateSurface(Surface=surface_4, Point=surface_closest_point_3.UVPoint)  # -> Point, Normal, UDirection, VDirection, Frame

amplitude_3 = Amplitude(Vector=evaluate_surface_4.Normal, Amplitude=number_slider_6)
multiplication_3 = Multiplication(A=evaluate_surface_4.Normal, B=number_slider_6)
vector_display_3 = VectorDisplay(Anchor=evaluate_surface_4.Point, Vector=amplitude_3)

negative_2 = Negative(Value=multiplication_3)

extrude_3 = Extrude(Base=surface_4, Direction=[multiplication_3, negative_2])
# Full multiplicity knots at start
# Simple knots
# Full multiplicity knots at end
# P1
# A=0.2*P1+ 0.8*P2
# D=0.2*A + 0.8*B
# P2
# B=0.47*P2 + 0.53*P3
# Full multiplicity knots at start
# E=0.7*B + 0.3*C
# P3
# Full multiplicity knots in the middle
# C=0.8*P3 + 0.2*P4
# P4
# Full multiplicity knots at end
# Compare knot spacing
merge_3 = Merge(Data1=pipe_2, Data2=extrude_3)
