# Grasshopper definition Sets151CURVES.gh (Grasshopper 1.0.7)
# Copyright: Wickerson Studios
# plug-ins: Bifocals

# 1001 GRASSHOPPER DEFINITIONS
# Wickerson Studio
# 
# created by: Michael Wickerson
# 
# Grasshopper for Rhino 3D Algorithmic Modeling
# 
# www.wickersonstudios.com
# www.michaelwickerson.com
# https://www.youtube.com/channel/UC7J48Ppcsa6oncp6d29R0xw
# https://github.com/mwickerson
# https://www.facebook.com/michael.wickerson
# https://www.linkedin.com/in/michael-wickerson-696a80156/
# https://www.grasshopper3d.com/profile/MichaelWickerson
image_sampler = ImageSampler(
    FilePath="C:\Users\Sculpture\Documents\2020Grasshopper\ScreenShots2019\Screenshots2020\SurfaceEditAlgorithm.PNG",
    Filter="Value",
    Interpolate=False,
    Umax=1,
    Umin=0,
    Vmax=1,
    Vmin=0,
    Wrap=1)
number_slider = Slider(10, range=0..10)
md_slider = MDSlider(SliderMode=0, slider_value=Point(0.5, 0.5, 0.5), x_domain=Domain(0, 1), y_domain=Domain(0, 1), z_domain=Domain(0, 1))
center_box = CenterBox(Base=PlaneXY(0, 0, 0), X=number_slider, Y=number_slider, Z=number_slider)
populate_3d = Populate3D(Region=center_box, Count=Slider(4, range=0..10), Seed=Slider(43, range=0..100))
number_slider_2 = Slider(0.66, range=0..1)
nurbs_curve = NurbsCurve(Vertices=populate_3d, Degree=3, Periodic=False)  # -> Curve, Length, Domain
interpolate = Interpolate(Vertices=populate_3d, Degree=3, Periodic=False, KnotStyle=1)  # -> Curve, Length, Domain
derivatives = Derivatives()  # -> Point, FirstDerivative
evaluate_curve = EvaluateCurve()  # -> Point, Tangent, Angle
torsion = Torsion()  # -> Point, Torsion
construct_domain = ConstructDomain(DomainStart=Slider(0.18, range=0..1), DomainEnd=Slider(1, range=0..1))
perp_frame = PerpFrame()
join_curves = JoinCurves(Curves=[interpolate.Curve, nurbs_curve.Curve], Preserve=False)
range = Range(Domain=construct_domain, Steps=Slider(3, range=0..10))
patch = Patch(Curves=join_curves, Spans=20, Flexibility=1, Trim=True)
curve_frame = CurveFrame(Curve=reparameterize(interpolate.Curve), Parameter=range)
curve_frame_2 = CurveFrame(Curve=reparameterize(nurbs_curve.Curve), Parameter=range)
sphere = Sphere(Base=curve_frame_2, Radius=1)
sphere_2 = Sphere(Base=curve_frame, Radius=1)

# ----
# CURVE NODES:
# PROXIMITY/EXTREMES
number_slider_3 = Slider(3, range=3..10)
populate_3d_2 = Populate3D(
    Region={Plane=PlaneXY(0, 0, 0), X=Domain(0, 10), Y=Domain(0, 10), Z=Domain(0, 2)},
    Count=number_slider_3,
    Seed=Slider(90, range=0..100))
unit_z = UnitZ(Factor=Slider(5.63, range=0..10))
populate_3d_3 = Populate3D(
    Region={Plane=PlaneXY(0, 0, 0), X=Domain(0, 10), Y=Domain(0, 10), Z=Domain(0, 2)},
    Count=number_slider_3,
    Seed=Slider(52, range=0..100))
move = Move(Geometry=populate_3d_2, Motion=unit_z)  # -> Geometry, Transform
interpolate_2 = Interpolate(Vertices=populate_3d_3, Degree=3, Periodic=Slider(1, range=0..1), KnotStyle=1)  # -> reparameterize(Curve), Length, Domain
interpolate_3 = Interpolate(Vertices=move.Geometry, Degree=3, Periodic=Slider(1, range=0..1), KnotStyle=1)  # -> reparameterize(Curve), Length, Domain
curve_proximity = CurveProximity(CurveA=interpolate_2.Curve, CurveB=interpolate_3.Curve)  # -> PointA, PointB, Distance
panel = Panel(curve_proximity.Distance)
extremes = Extremes(Curve=interpolate_2.Curve, Plane=PlaneXY(0, 0, 0))  # -> Highest, Lowest
extremes_2 = Extremes(Curve=interpolate_3.Curve, Plane=PlaneXY(0, 0, 0))  # -> Highest, Lowest
line = Line(StartPoint=extremes.Highest, EndPoint=extremes_2.Highest)
line_2 = Line(StartPoint=extremes.Lowest, EndPoint=extremes_2.Lowest)
patch_2 = Patch(Curves=graft([interpolate_2.Curve, interpolate_3.Curve]), Spans=20, Flexibility=1, Trim=Slider(1, range=0..1))
loft = Loft(Curves=[line, line_2], Options={Adjust=True, Closed=False, LoftEnds=0, LoftSimp=0, LoftType=0, Rebuild=10, Refit=0.01})
merge = Merge(Data1=loft, Data2=patch_2)  # -> flatten(Result)
surface = Surface(merge)
number_slider_4 = Slider(2, range=0..2)
number = Number(curve_proximity.Distance)

# ---- group: Isotrim
md_slider_2 = MDSlider(
    SliderMode=0,
    slider_value=Point(0.5647732804, 0.5101281143, 0.5),
    x_domain=Domain(0, 1),
    y_domain=Domain(0, 1),
    z_domain=Domain(0, 1))
construct_domain_2 = ConstructDomain(DomainU=md_slider_2, DomainV=md_slider_2)
isotrim = Isotrim(Surface=reparameterize(surface), Domain=construct_domain_2)

# ----
# CURVE NODES: CLOSEST POINT/OBJECT
number_slider_5 = Slider(8.99, range=0..20)
negative = Negative(Value=number_slider_5)
sphere_3 = Sphere(Base=PlaneXY(0, 0, 0), Radius=Slider(0.72, range=0..10))
vector_xyz = VectorXYZ(XComponent=number_slider_5, YComponent=0, ZComponent=negative)  # -> Vector, Length
populate_3d_4 = Populate3D(
    Region={Plane=PlaneXY(0, 0, 0), X=Domain(0, 10), Y=Domain(0, 10), Z=Domain(0, 2)},
    Count=Slider(4, range=2..10),
    Seed=Slider(60, range=0..100))
move_2 = Move(Geometry=sphere_3, Motion=vector_xyz.Vector)  # -> Geometry, Transform
# MATH 151/1001 CURVES
interpolate_4 = Interpolate(Vertices=populate_3d_4, Degree=3, Periodic=Slider(1, range=0..1), KnotStyle=1)  # -> reparameterize(Curve), Length, Domain
polar_array = PolarArray(Geometry=move_2.Geometry, Plane=PlaneXY(0, 0, 0), Count=Slider(4, range=3..10), Angle=6.283185307)  # -> Geometry, Transform
curve_nearest_object = CurveNearestObject(Curve=interpolate_4.Curve, Geometry=graft(polar_array.Geometry))  # -> PointA, PointB, Index
line_3 = Line(StartPoint=curve_nearest_object.PointA, EndPoint=curve_nearest_object.PointB)
merge_2 = Merge(Data1=line_3, Data2=interpolate_4.Curve)
patch_3 = Patch(Curves=interpolate_4.Curve, Spans=20, Flexibility=1, Trim=True)
surface_2 = Surface(patch_3)
number_slider_6 = Slider(2.993, range=0..4)
pipe = Pipe(Curve=merge_2, Radius=1, Caps=2)
geometry = Geometry(polar_array.Geometry)

# ---- group: Isotrim
md_slider_3 = MDSlider(
    SliderMode=0,
    slider_value=Point(0.5647732804, 0.5101281143, 0.5),
    x_domain=Domain(0, 1),
    y_domain=Domain(0, 1),
    z_domain=Domain(0, 1))
construct_domain_3 = ConstructDomain(DomainU=md_slider_3, DomainV=md_slider_3)
isotrim_2 = Isotrim(Surface=reparameterize(surface_2), Domain=construct_domain_3)

# ----
# CURVE NODES:
# CURVATURE
number_slider_7 = Slider(1.204, range=0..3)
gene_pool = GenePool(
    Decimals=3,
    Maximum=1,
    Minimum=0.2,
    Value=[0.5119061192, 0.9706090927, 0.8815151661, 0.7281091376, 0.2854224597, 0.3941804023, 0.2872636084, 0.2535765596, 0.2243205872, 0.8875074464])
circle = Circle(Plane=PlaneXY(0, 0, 0), Radius=number_slider_7)
curvature = Curvature(Curve=reparameterize(circle), Parameter=gene_pool)  # -> Point, Curvature, Curvature_2
number_slider_8 = Slider(4, range=0..10)
vector = Vector(curvature.Curvature_2)
vector_2 = Vector(curvature.Curvature)
amplitude = Amplitude(Vector=vector_2, Amplitude=number_slider_8)
amplitude_2 = Amplitude(Vector=vector, Amplitude=number_slider_8)
list_length = ListLength(List=amplitude)
construct_domain_4 = ConstructDomain(DomainStart=Slider(0.2, range=0..1), DomainEnd=Slider(2, range=0.3..2))
vector_display = VectorDisplay(Anchor=curvature.Point, Vector=amplitude)
vector_display_2 = VectorDisplay(Anchor=curvature.Point, Vector=amplitude_2)
range_2 = Range(Domain=construct_domain_4, Steps=list_length)
point = Point(curvature.Point)
line_sdl = LineSDL(Start=point, Direction=amplitude, Length=range_2)
unit_z_2 = UnitZ(Factor=range_2)
move_3 = Move(Geometry=line_sdl, Motion=unit_z_2)  # -> Geometry, Transform
loft_2 = Loft(Curves=move_3.Geometry, Options={Adjust=False, Closed=False, LoftEnds=0, LoftSimp=0, LoftType=0, Rebuild=10, Refit=0.01})
surface_3 = Surface(loft_2)
number_slider_9 = Slider(0.096, range=0..0.2)
pi = Pi(Factor=Slider(1, range=0..1))
unit_x = UnitX(Factor=Slider(1.52, range=0..10))
negative_2 = Negative(Value=unit_x)
unit_x_2 = UnitX(Factor=1)
unit_z_3 = UnitZ(Factor=Slider(0.2, range=0..1))

# ---- group: Isotrim
md_slider_4 = MDSlider(
    SliderMode=0,
    slider_value=Point(0.5647732804, 0.5101281143, 0.5),
    x_domain=Domain(0, 1),
    y_domain=Domain(0, 1),
    z_domain=Domain(0, 1))
construct_domain_5 = ConstructDomain(DomainU=md_slider_4, DomainV=md_slider_4)
isotrim_3 = Isotrim(Surface=reparameterize(surface_3), Domain=construct_domain_5)

# ----
# CURVE NODES:
# PLANAR
number_slider_10 = Slider(10, range=0..10)
cylinder = Cylinder(Base=PlaneXY(0, 0, 0), Radius=number_slider_10, Length=number_slider_10)
md_slider_5 = MDSlider(
    SliderMode=0,
    slider_value=Point(0.5286278912, 0.5082457007, 0.5),
    x_domain=Domain(0, 1),
    y_domain=Domain(0, 1),
    z_domain=Domain(0, 1))
surface_4 = Surface(reparameterize(cylinder))
range_3 = Range(Domain=Slider(1.1, range=0..2), Steps=Slider(3, range=0..10))
cap_holes = CapHoles(Brep=cylinder)
construct_point = ConstructPoint(XCoordinate=0, YCoordinate=0, ZCoordinate=0)
unit_x_3 = UnitX(Factor=1)
evaluate_surface = EvaluateSurface(Surface=surface_4, Point=md_slider_5)  # -> Point, Normal, UDirection, VDirection, Frame
pi_2 = Pi(Factor=range_3)
move_4 = Move(Geometry=construct_point, Motion=unit_x_3)  # -> Geometry, Transform
rotate_3d = Rotate3D(Geometry=cap_holes, Angle=pi_2, Center=evaluate_surface.Point, Axis=move_4.Geometry)  # -> Geometry, Transform
deconstruct_brep = DeconstructBrep(Brep=rotate_3d.Geometry)  # -> Faces, Edges, Vertices
curve = Curve(reparameterize(deconstruct_brep.Edges))
is_planar = IsPlanar(Surface=reparameterize(flatten(deconstruct_brep.Faces)), Interior=True)  # -> Planar, Plane
planar = Planar(Curve=flatten(curve))  # -> Planar, Plane, Deviation
cull_pattern = CullPattern(List=deconstruct_brep.Faces, CullPattern=is_planar.Planar)
cull_pattern_2 = CullPattern(List=deconstruct_brep.Edges, CullPattern=planar.Planar)
panel_2 = Panel(is_planar.Planar)
surface_5 = Surface(cull_pattern)
number_slider_11 = Slider(2.922, range=0..6)
pipe_2 = Pipe(Curve=cull_pattern_2, Radius=1, Caps=0)

# ---- group: Isotrim
md_slider_6 = MDSlider(
    SliderMode=0,
    slider_value=Point(0.5647732804, 0.5101281143, 0.5),
    x_domain=Domain(0, 1),
    y_domain=Domain(0, 1),
    z_domain=Domain(0, 1))
construct_domain_6 = ConstructDomain(DomainU=md_slider_6, DomainV=md_slider_6)
isotrim_4 = Isotrim(Surface=reparameterize(surface_5), Domain=construct_domain_6)

# ----
surface_6 = Surface(patch)
number_slider_12 = Slider(4, range=0..4)

# ---- group: Isotrim
md_slider_7 = MDSlider(
    SliderMode=0,
    slider_value=Point(0.5647732804, 0.5101281143, 0.5),
    x_domain=Domain(0, 1),
    y_domain=Domain(0, 1),
    z_domain=Domain(0, 1))
construct_domain_7 = ConstructDomain(DomainU=md_slider_7, DomainV=md_slider_7)
isotrim_5 = Isotrim(Surface=reparameterize(surface_6), Domain=construct_domain_7)

# ----
deconstruct_brep_2 = DeconstructBrep(Brep=isotrim)  # -> Faces, Edges, Vertices
list_item = ListItem(List=deconstruct_brep_2.Vertices, Index="2", Wrap=True)

surface_closest_point = SurfaceClosestPoint(Point=list_item, Surface=surface)  # -> Point, UVPoint, Distance
evaluate_surface_2 = EvaluateSurface(Surface=surface, Point=surface_closest_point.UVPoint)  # -> Point, Normal, UDirection, VDirection, Frame

amplitude_3 = Amplitude(Vector=evaluate_surface_2.Normal, Amplitude=number)
multiplication = Multiplication(A=evaluate_surface_2.Normal, B=number)
vector_display_3 = VectorDisplay(Anchor=evaluate_surface_2.Point, Vector=amplitude_3)
extrude = Extrude(Base=surface, Direction=multiplication)

deconstruct_brep_3 = DeconstructBrep(Brep=isotrim_5)  # -> Faces, Edges, Vertices
list_item_2 = ListItem(List=deconstruct_brep_3.Vertices, Index="2", Wrap=True)

surface_closest_point_2 = SurfaceClosestPoint(Point=list_item_2, Surface=surface_6)  # -> Point, UVPoint, Distance
evaluate_surface_3 = EvaluateSurface(Surface=surface_6, Point=surface_closest_point_2.UVPoint)  # -> Point, Normal, UDirection, VDirection, Frame

amplitude_4 = Amplitude(Vector=evaluate_surface_3.Normal, Amplitude=number_slider_12)
multiplication_2 = Multiplication(A=evaluate_surface_3.Normal, B=number_slider_12)
extrude_2 = Extrude(Base=surface_6, Direction=multiplication_2)
vector_display_4 = VectorDisplay(Anchor=evaluate_surface_3.Point, Vector=amplitude_4)

solid_difference = SolidDifference(BrepsA=extrude_2, BrepsB=sphere_2)
solid_difference_2 = SolidDifference(BrepsA=solid_difference, BrepsB=sphere)

deconstruct_brep_4 = DeconstructBrep(Brep=isotrim_2)  # -> Faces, Edges, Vertices
list_item_3 = ListItem(List=deconstruct_brep_4.Vertices, Index="2", Wrap=True)

surface_closest_point_3 = SurfaceClosestPoint(Point=list_item_3, Surface=surface_2)  # -> Point, UVPoint, Distance
evaluate_surface_4 = EvaluateSurface(Surface=surface_2, Point=surface_closest_point_3.UVPoint)  # -> Point, Normal, UDirection, VDirection, Frame

amplitude_5 = Amplitude(Vector=evaluate_surface_4.Normal, Amplitude=number_slider_6)
multiplication_3 = Multiplication(A=evaluate_surface_4.Normal, B=number_slider_6)
vector_display_5 = VectorDisplay(Anchor=evaluate_surface_4.Point, Vector=amplitude_5)
extrude_3 = Extrude(Base=surface_2, Direction=multiplication_3)

deconstruct_brep_5 = DeconstructBrep(Brep=isotrim_4)  # -> Faces, Edges, Vertices
list_item_4 = ListItem(List=deconstruct_brep_5.Vertices, Index="2", Wrap=True)

surface_closest_point_4 = SurfaceClosestPoint(Point=list_item_4, Surface=surface_5)  # -> Point, UVPoint, Distance
evaluate_surface_5 = EvaluateSurface(Surface=surface_5, Point=surface_closest_point_4.UVPoint)  # -> Point, Normal, UDirection, VDirection, Frame

deconstruct_brep_6 = DeconstructBrep(Brep=isotrim_3)  # -> Faces, Edges, Vertices
list_item_5 = ListItem(List=deconstruct_brep_6.Vertices, Index="2", Wrap=True)

surface_closest_point_5 = SurfaceClosestPoint(Point=list_item_5, Surface=surface_3)  # -> Point, UVPoint, Distance
evaluate_surface_6 = EvaluateSurface(Surface=surface_3, Point=surface_closest_point_5.UVPoint)  # -> Point, Normal, UDirection, VDirection, Frame

amplitude_6 = Amplitude(Vector=evaluate_surface_6.Normal, Amplitude=number_slider_9)
multiplication_4 = Multiplication(A=evaluate_surface_6.Normal, B=number_slider_9)
vector_display_6 = VectorDisplay(Anchor=evaluate_surface_6.Point, Vector=amplitude_6)
extrude_4 = Extrude(Base=surface_3, Direction=multiplication_4)
rotate_3d_2 = Rotate3D(Geometry=extrude_4, Angle=pi, Center=Point(0, 0, 0), Axis=Vector(0, 0, 1))  # -> Geometry, Transform
deconstruct_brep_7 = DeconstructBrep(Brep=extrude_4)  # -> Faces, Edges, Vertices
deconstruct_brep_8 = DeconstructBrep(Brep=rotate_3d_2.Geometry)  # -> Faces, Edges, Vertices
list_item_6 = ListItem(List=deconstruct_brep_7.Edges, Index="1", Wrap=True)
list_item_7 = ListItem(List=deconstruct_brep_8.Edges, Index="1", Wrap=True)
curve_2 = Curve(list_item_6)
curve_3 = Curve(list_item_7)
move_5 = Move(Geometry=curve_2, Motion=unit_x)  # -> Geometry, Transform
move_6 = Move(Geometry=curve_3, Motion=negative_2)  # -> Geometry, Transform
flip_curve = FlipCurve(Curve=move_6.Geometry)  # -> Curve, Flag
loft_3 = Loft(
    Curves=[flip_curve.Curve, move_5.Geometry],
    Options={Adjust=True, Closed=False, LoftEnds=0, LoftSimp=0, LoftType=0, Rebuild=10, Refit=0.01})
extrude_5 = Extrude(Base=loft_3, Direction=unit_z_3)
# rc
# Full multiplicity knots at start
# Simple knots
# Full multiplicity knots at end
# P1
# A=0.2*P1+ 0.8*P2
# D=0.2*A + 0.8*B
# P2
# B=0.47*P2 + 0.53*P3
# Full multiplicity knots at start
# E=0.7*B + 0.3*C
# P3
# Full multiplicity knots in the middle
# C=0.8*P3 + 0.2*P4
# P4
# Full multiplicity knots at end
# Compare knot spacing
merge_3 = Merge(Data1=extrude_4, Data2=rotate_3d_2.Geometry, Data3=extrude_5)

amplitude_7 = Amplitude(Vector=evaluate_surface_5.Normal, Amplitude=number_slider_11)
multiplication_5 = Multiplication(A=evaluate_surface_5.Normal, B=number_slider_11)
vector_display_7 = VectorDisplay(Anchor=evaluate_surface_5.Point, Vector=amplitude_7)

negative_3 = Negative(Value=multiplication_5)

extrude_6 = Extrude(Base=surface_5, Direction=[multiplication_5, negative_3])
merge_4 = Merge(Data1=pipe_2, Data2=extrude_6)
