# Grasshopper definition Sets152CURVES.gh (Grasshopper 1.0.7)
# Copyright: Wickerson Studios
# plug-ins: Bifocals

# 1001 GRASSHOPPER DEFINITIONS
# Wickerson Studio
# 
# created by: Michael Wickerson
# 
# Grasshopper for Rhino 3D Algorithmic Modeling
# 
# www.wickersonstudios.com
# www.michaelwickerson.com
# https://www.youtube.com/channel/UC7J48Ppcsa6oncp6d29R0xw
# https://github.com/mwickerson
# https://www.facebook.com/michael.wickerson
# https://www.linkedin.com/in/michael-wickerson-696a80156/
# https://www.grasshopper3d.com/profile/MichaelWickerson
image_sampler = ImageSampler(
    FilePath="C:\Users\Sculpture\Documents\2020Grasshopper\ScreenShots2019\Screenshots2020\SurfaceEditAlgorithm.PNG",
    Filter="Value",
    Interpolate=False,
    Umax=1,
    Umin=0,
    Vmax=1,
    Vmin=0,
    Wrap=1)  # disabled

# ----
# CURVE NODES:
# DERIVATIVES
number_slider = Slider(6, range=0..10)  # disabled
pi = Pi(Factor=number_slider)  # disabled
number_slider_2 = Slider(100, range=0..100)  # disabled
construct_domain = ConstructDomain(DomainStart=0, DomainEnd=pi)  # disabled
range = Range(Domain=construct_domain, Steps=number_slider_2)  # disabled
expression = Expression(Expression="Format(\"{0}, {1}\", x, y)")  # disabled
evaluate = Evaluate()  # disabled
cosine = Cosine(Value=range)  # disabled
sine = Sine(Value=range)  # disabled
ghpython_script = GhPythonScript()  # -> Out, A; disabled
construct_point = ConstructPoint(XCoordinate=range, YCoordinate=sine, ZCoordinate=cosine)  # disabled
number_slider_3 = Slider(0, range=0..1)  # disabled
interpolate = Interpolate(Vertices=construct_point, Degree=3, Periodic=False, KnotStyle=1)  # -> Curve, Length, Domain; disabled
gene_pool = GenePool(
    Decimals=2,
    Maximum=1,
    Minimum=0,
    Value=[0.50912711, 0.3093710376, 0.2942614068, 0.232748909, 0.9330904176, 0.8424027571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])  # disabled
derivatives = Derivatives(Curve=reparameterize(interpolate.Curve), Parameter=gene_pool)  # -> Point, FirstDerivative, SecondDerivative, ThirdDerivative; disabled
vector = Vector(derivatives.FirstDerivative)  # disabled
point = Point(derivatives.Point)  # disabled
vector_2 = Vector(derivatives.SecondDerivative)  # disabled
vector_3 = Vector(derivatives.ThirdDerivative)  # disabled
vector_display = VectorDisplay(Anchor=point, Vector=vector_3)  # disabled
vector_display_2 = VectorDisplay(Anchor=point, Vector=vector)  # disabled
vector_display_3 = VectorDisplay(Anchor=point, Vector=vector_2)  # disabled
number_slider_4 = Slider(41, range=0..100)  # disabled
line_sdl = LineSDL(Start=point, Direction=vector, Length=number_slider_4)  # disabled
line_sdl_2 = LineSDL(Start=point, Direction=vector_2, Length=number_slider_4)  # disabled
line_sdl_3 = LineSDL(Start=point, Direction=vector_3, Length=number_slider_4)  # disabled
blend_curve = BlendCurve(CurveA=line_sdl, CurveB=line_sdl_3, BulgeA=1, BulgeB=1, Continuity=2)  # disabled
blend_curve_2 = BlendCurve(CurveA=line_sdl, CurveB=line_sdl_2, BulgeA=1, BulgeB=1, Continuity=2)  # disabled
blend_curve_3 = BlendCurve(CurveA=line_sdl_2, CurveB=line_sdl_3, BulgeA=1, BulgeB=1, Continuity=2)  # disabled
range_2 = Range(Domain=Domain(0, 1), Steps=10)  # disabled
merge = Merge(Data1=blend_curve_2, Data2=blend_curve, Data3=blend_curve_3)  # disabled
graph_mapper = GraphMapper(range_2, x0=0, x1=1, y0=0, y1=1, container_name="Sine", Equation_px=[0, 1], Equation_py=[0, 1])  # disabled
pipe = Pipe(Curve=[blend_curve_2, blend_curve, blend_curve_3], Radius=1, Caps=0)  # disabled
pipe_variable = PipeVariable(Curve=reparameterize(merge), Parameters=range_2, Radii=graph_mapper, Caps=2)  # disabled

md_slider = MDSlider(SliderMode=0, slider_value=Point(0.5, 0.5, 0.5), x_domain=Domain(0, 1), y_domain=Domain(0, 1), z_domain=Domain(0, 1))  # disabled

# ----
# CURVE NODES:
# PROXIMITY/EXTREMES
number_slider_5 = Slider(3, range=3..10)  # disabled
number_slider_6 = Slider(52, range=0..100)  # disabled
number_slider_7 = Slider(90, range=0..100)  # disabled
number_slider_8 = Slider(5.63, range=0..10)  # disabled
populate_3d = Populate3D(
    Region={Plane=PlaneXY(0, 0, 0), X=Domain(0, 10), Y=Domain(0, 10), Z=Domain(0, 2)},
    Count=number_slider_5,
    Seed=number_slider_7)  # disabled
unit_z = UnitZ(Factor=number_slider_8)  # disabled
number_slider_9 = Slider(1, range=0..1)  # disabled
populate_3d_2 = Populate3D(
    Region={Plane=PlaneXY(0, 0, 0), X=Domain(0, 10), Y=Domain(0, 10), Z=Domain(0, 2)},
    Count=number_slider_5,
    Seed=number_slider_6)  # disabled
number_slider_10 = Slider(1, range=0..1)  # disabled
move = Move(Geometry=populate_3d, Motion=unit_z)  # -> Geometry, Transform; disabled
interpolate_2 = Interpolate(Vertices=populate_3d_2, Degree=3, Periodic=number_slider_9, KnotStyle=1)  # -> reparameterize(Curve), Length, Domain; disabled
interpolate_3 = Interpolate(Vertices=move.Geometry, Degree=3, Periodic=number_slider_10, KnotStyle=1)  # -> reparameterize(Curve), Length, Domain; disabled
curve_proximity = CurveProximity(CurveA=interpolate_2.Curve, CurveB=interpolate_3.Curve)  # -> PointA, PointB, Distance; disabled
panel = Panel(curve_proximity.Distance)  # disabled
extremes = Extremes(Curve=interpolate_2.Curve, Plane=PlaneXY(0, 0, 0))  # -> Highest, Lowest; disabled
extremes_2 = Extremes(Curve=interpolate_3.Curve, Plane=PlaneXY(0, 0, 0))  # -> Highest, Lowest; disabled
number_slider_11 = Slider(1, range=0..1)  # disabled
line = Line(StartPoint=extremes.Highest, EndPoint=extremes_2.Highest)  # disabled
line_2 = Line(StartPoint=extremes.Lowest, EndPoint=extremes_2.Lowest)  # disabled
patch = Patch(Curves=graft([interpolate_2.Curve, interpolate_3.Curve]), Spans=20, Flexibility=1, Trim=number_slider_11)  # disabled
loft = Loft(Curves=[line, line_2], Options={Adjust=True, Closed=False, LoftEnds=0, LoftSimp=0, LoftType=0, Rebuild=10, Refit=0.01})  # disabled
merge_2 = Merge(Data1=loft, Data2=patch)  # -> flatten(Result); disabled
surface = Surface(merge_2)  # disabled
panel_2 = Panel("2")  # disabled
number_slider_12 = Slider(2, range=0..2)  # disabled
number = Number(curve_proximity.Distance)  # disabled

# ---- group: Isotrim
md_slider_2 = MDSlider(
    SliderMode=0,
    slider_value=Point(0.5647732804, 0.5101281143, 0.5),
    x_domain=Domain(0, 1),
    y_domain=Domain(0, 1),
    z_domain=Domain(0, 1))  # disabled
construct_domain_2 = ConstructDomain(DomainU=md_slider_2, DomainV=md_slider_2)  # disabled
isotrim = Isotrim(Surface=reparameterize(surface), Domain=construct_domain_2)  # disabled

# ----
# CURVE NODES: CLOSEST POINT/OBJECT
number_slider_13 = Slider(8.99, range=0..20)  # disabled
number_slider_14 = Slider(4, range=2..10)  # disabled
number_slider_15 = Slider(60, range=0..100)  # disabled
number_slider_16 = Slider(0.72, range=0..10)  # disabled
negative = Negative(Value=number_slider_13)  # disabled
sphere = Sphere(Base=PlaneXY(0, 0, 0), Radius=number_slider_16)  # disabled
vector_xyz = VectorXYZ(XComponent=number_slider_13, YComponent=0, ZComponent=negative)  # -> Vector, Length; disabled
number_slider_17 = Slider(1, range=0..1)  # disabled
populate_3d_3 = Populate3D(
    Region={Plane=PlaneXY(0, 0, 0), X=Domain(0, 10), Y=Domain(0, 10), Z=Domain(0, 2)},
    Count=number_slider_14,
    Seed=number_slider_15)  # disabled
number_slider_18 = Slider(4, range=3..10)  # disabled
move_2 = Move(Geometry=sphere, Motion=vector_xyz.Vector)  # -> Geometry, Transform; disabled
# MATH 153/1001 CURVES
interpolate_4 = Interpolate(Vertices=populate_3d_3, Degree=3, Periodic=number_slider_17, KnotStyle=1)  # -> reparameterize(Curve), Length, Domain; disabled
polar_array = PolarArray(Geometry=move_2.Geometry, Plane=PlaneXY(0, 0, 0), Count=number_slider_18, Angle=6.283185307)  # -> Geometry, Transform; disabled
curve_nearest_object = CurveNearestObject(Curve=interpolate_4.Curve, Geometry=graft(polar_array.Geometry))  # -> PointA, PointB, Index; disabled
line_3 = Line(StartPoint=curve_nearest_object.PointA, EndPoint=curve_nearest_object.PointB)  # disabled
merge_3 = Merge(Data1=line_3, Data2=interpolate_4.Curve)  # disabled
patch_2 = Patch(Curves=interpolate_4.Curve, Spans=20, Flexibility=1, Trim=True)  # disabled
surface_2 = Surface(patch_2)  # disabled
panel_3 = Panel("2")  # disabled
number_slider_19 = Slider(2.993, range=0..4)  # disabled
pipe_2 = Pipe(Curve=merge_3, Radius=1, Caps=2)  # disabled
geometry = Geometry(polar_array.Geometry)  # disabled

# ---- group: Isotrim
md_slider_3 = MDSlider(
    SliderMode=0,
    slider_value=Point(0.5647732804, 0.5101281143, 0.5),
    x_domain=Domain(0, 1),
    y_domain=Domain(0, 1),
    z_domain=Domain(0, 1))  # disabled
construct_domain_3 = ConstructDomain(DomainU=md_slider_3, DomainV=md_slider_3)  # disabled
isotrim_2 = Isotrim(Surface=reparameterize(surface_2), Domain=construct_domain_3)  # disabled

# ----
# CURVE NODES:
# CURVATURE
number_slider_20 = Slider(1.204, range=0..3)  # disabled
gene_pool_2 = GenePool(
    Decimals=3,
    Maximum=1,
    Minimum=0.2,
    Value=[0.5119061192, 0.9706090927, 0.8815151661, 0.7281091376, 0.2854224597, 0.3941804023, 0.2872636084, 0.2535765596, 0.2243205872, 0.8875074464])  # disabled
circle = Circle(Plane=PlaneXY(0, 0, 0), Radius=number_slider_20)  # disabled
curvature = Curvature(Curve=reparameterize(circle), Parameter=gene_pool_2)  # -> Point, Curvature, Curvature_2; disabled
number_slider_21 = Slider(4, range=0..10)  # disabled
number_slider_22 = Slider(2, range=0.3..2)  # disabled
number_slider_23 = Slider(0.2, range=0..1)  # disabled
vector_4 = Vector(curvature.Curvature_2)  # disabled
vector_5 = Vector(curvature.Curvature)  # disabled
amplitude = Amplitude(Vector=vector_5, Amplitude=number_slider_21)  # disabled
amplitude_2 = Amplitude(Vector=vector_4, Amplitude=number_slider_21)  # disabled
list_length = ListLength(List=amplitude)  # disabled
construct_domain_4 = ConstructDomain(DomainStart=number_slider_23, DomainEnd=number_slider_22)  # disabled
vector_display_4 = VectorDisplay(Anchor=curvature.Point, Vector=amplitude)  # disabled
vector_display_5 = VectorDisplay(Anchor=curvature.Point, Vector=amplitude_2)  # disabled
range_3 = Range(Domain=construct_domain_4, Steps=list_length)  # disabled
point_2 = Point(curvature.Point)  # disabled
line_sdl_4 = LineSDL(Start=point_2, Direction=amplitude, Length=range_3)  # disabled
unit_z_2 = UnitZ(Factor=range_3)  # disabled
move_3 = Move(Geometry=line_sdl_4, Motion=unit_z_2)  # -> Geometry, Transform; disabled
loft_2 = Loft(Curves=move_3.Geometry, Options={Adjust=False, Closed=False, LoftEnds=0, LoftSimp=0, LoftType=0, Rebuild=10, Refit=0.01})  # disabled
surface_3 = Surface(loft_2)  # disabled
panel_4 = Panel("2")  # disabled
number_slider_24 = Slider(0.096, range=0..0.2)  # disabled
number_slider_25 = Slider(1, range=0..1)  # disabled
pi_2 = Pi(Factor=number_slider_25)  # disabled
number_slider_26 = Slider(1.52, range=0..10)  # disabled
panel_5 = Panel("1")  # disabled
unit_x = UnitX(Factor=number_slider_26)  # disabled
negative_2 = Negative(Value=unit_x)  # disabled
unit_x_2 = UnitX(Factor=1)  # disabled
number_slider_27 = Slider(0.2, range=0..1)  # disabled
unit_z_3 = UnitZ(Factor=number_slider_27)  # disabled

# ---- group: Isotrim
md_slider_4 = MDSlider(
    SliderMode=0,
    slider_value=Point(0.5647732804, 0.5101281143, 0.5),
    x_domain=Domain(0, 1),
    y_domain=Domain(0, 1),
    z_domain=Domain(0, 1))  # disabled
construct_domain_5 = ConstructDomain(DomainU=md_slider_4, DomainV=md_slider_4)  # disabled
isotrim_3 = Isotrim(Surface=reparameterize(surface_3), Domain=construct_domain_5)  # disabled

# ----
# CURVE NODES:
# CURVE FRAME
number_slider_28 = Slider(10, range=0..10)  # disabled
number_slider_29 = Slider(4, range=0..10)  # disabled
number_slider_30 = Slider(43, range=0..100)  # disabled
center_box = CenterBox(Base=PlaneXY(0, 0, 0), X=number_slider_28, Y=number_slider_28, Z=number_slider_28)  # disabled
populate_3d_4 = Populate3D(Region=center_box, Count=number_slider_29, Seed=number_slider_30)  # disabled
number_slider_31 = Slider(0.66, range=0..1)  # disabled
number_slider_32 = Slider(0.18, range=0..1)  # disabled
number_slider_33 = Slider(1, range=0..1)  # disabled
nurbs_curve = NurbsCurve(Vertices=populate_3d_4, Degree=3, Periodic=False)  # -> Curve, Length, Domain; disabled
interpolate_5 = Interpolate(Vertices=populate_3d_4, Degree=3, Periodic=False, KnotStyle=1)  # -> Curve, Length, Domain; disabled
number_slider_34 = Slider(3, range=0..10)  # disabled
construct_domain_6 = ConstructDomain(DomainStart=number_slider_32, DomainEnd=number_slider_33)  # disabled
join_curves = JoinCurves(Curves=[interpolate_5.Curve, nurbs_curve.Curve], Preserve=False)  # disabled
range_4 = Range(Domain=construct_domain_6, Steps=number_slider_34)  # disabled
patch_3 = Patch(Curves=join_curves, Spans=20, Flexibility=1, Trim=True)  # disabled
curve_frame = CurveFrame(Curve=reparameterize(interpolate_5.Curve), Parameter=range_4)  # disabled
curve_frame_2 = CurveFrame(Curve=reparameterize(nurbs_curve.Curve), Parameter=range_4)  # disabled
panel_6 = Panel("2")  # disabled
sphere_2 = Sphere(Base=curve_frame_2, Radius=1)  # disabled
sphere_3 = Sphere(Base=curve_frame, Radius=1)  # disabled

# ----
# CURVE NODES:
# PLANAR
number_slider_35 = Slider(10, range=0..10)  # disabled
number_slider_36 = Slider(1.1, range=0..2)  # disabled
cylinder = Cylinder(Base=PlaneXY(0, 0, 0), Radius=number_slider_35, Length=number_slider_35)  # disabled
number_slider_37 = Slider(3, range=0..10)  # disabled
md_slider_5 = MDSlider(
    SliderMode=0,
    slider_value=Point(0.5286278912, 0.5082457007, 0.5),
    x_domain=Domain(0, 1),
    y_domain=Domain(0, 1),
    z_domain=Domain(0, 1))  # disabled
surface_4 = Surface(reparameterize(cylinder))  # disabled
range_5 = Range(Domain=number_slider_36, Steps=number_slider_37)  # disabled
cap_holes = CapHoles(Brep=cylinder)  # disabled
construct_point_2 = ConstructPoint(XCoordinate=0, YCoordinate=0, ZCoordinate=0)  # disabled
unit_x_3 = UnitX(Factor=1)  # disabled
evaluate_surface = EvaluateSurface(Surface=surface_4, Point=md_slider_5)  # -> Point, Normal, UDirection, VDirection, Frame; disabled
pi_3 = Pi(Factor=range_5)  # disabled
move_4 = Move(Geometry=construct_point_2, Motion=unit_x_3)  # -> Geometry, Transform; disabled
rotate_3d = Rotate3D(Geometry=cap_holes, Angle=pi_3, Center=evaluate_surface.Point, Axis=move_4.Geometry)  # -> Geometry, Transform; disabled
deconstruct_brep = DeconstructBrep(Brep=rotate_3d.Geometry)  # -> Faces, Edges, Vertices; disabled
curve = Curve(reparameterize(deconstruct_brep.Edges))  # disabled
is_planar = IsPlanar(Surface=reparameterize(flatten(deconstruct_brep.Faces)), Interior=True)  # -> Planar, Plane; disabled
planar = Planar(Curve=flatten(curve))  # -> Planar, Plane, Deviation; disabled
cull_pattern = CullPattern(List=deconstruct_brep.Faces, CullPattern=is_planar.Planar)  # disabled
cull_pattern_2 = CullPattern(List=deconstruct_brep.Edges, CullPattern=planar.Planar)  # disabled
panel_7 = Panel(is_planar.Planar)  # disabled
surface_5 = Surface(cull_pattern)  # disabled
panel_8 = Panel("2")  # disabled
number_slider_38 = Slider(2.922, range=0..6)  # disabled
pipe_3 = Pipe(Curve=cull_pattern_2, Radius=1, Caps=0)  # disabled

# ---- group: Isotrim
md_slider_6 = MDSlider(
    SliderMode=0,
    slider_value=Point(0.5647732804, 0.5101281143, 0.5),
    x_domain=Domain(0, 1),
    y_domain=Domain(0, 1),
    z_domain=Domain(0, 1))  # disabled
construct_domain_7 = ConstructDomain(DomainU=md_slider_6, DomainV=md_slider_6)  # disabled
isotrim_4 = Isotrim(Surface=reparameterize(surface_5), Domain=construct_domain_7)  # disabled

# ----
# CURVE NODES:
# TORTION
number_slider_39 = Slider(110, range=0..110)  # disabled
number_slider_40 = Slider(4, range=0..10)  # disabled
number_slider_41 = Slider(1, range=0..100)  # disabled
number_slider_42 = Slider(0.6, range=0..1)  # disabled
number_slider_43 = Slider(0.5, range=0..1)  # disabled
center_box_2 = CenterBox(Base=PlaneXY(0, 0, 0), X=number_slider_39, Y=number_slider_39, Z=number_slider_39)  # disabled
populate_3d_5 = Populate3D(Region=center_box_2, Count=number_slider_40, Seed=number_slider_41)  # disabled
construct_domain_8 = ConstructDomain(DomainStart=number_slider_43, DomainEnd=number_slider_42)  # disabled
interpolate_6 = Interpolate(Vertices=populate_3d_5, Degree=3, Periodic=False, KnotStyle=1)  # -> Curve, Length, Domain; disabled
range_6 = Range(Domain=construct_domain_8, Steps=10)  # disabled
torsion = Torsion(Curve=reparameterize(interpolate_6.Curve), Parameter=range_6)  # -> Point, Torsion; disabled
evaluate_curve = EvaluateCurve(Curve=reparameterize(interpolate_6.Curve), Parameter=range_6)  # -> Point, Tangent, Angle; disabled
number_slider_44 = Slider(10000, range=0..10000)  # disabled
point_3 = Point(torsion.Point)  # disabled
multiplication = Multiplication(A=torsion.Torsion, B=evaluate_curve.Tangent)  # disabled
multiplication_2 = Multiplication(A=multiplication, B=number_slider_44)  # disabled
deconstruct_vector = DeconstructVector(Vector=multiplication_2)  # -> XComponent, YComponent, ZComponent; disabled
deconstruct_vector_2 = DeconstructVector(Vector=multiplication_2)  # -> XComponent, YComponent, ZComponent; disabled
deconstruct_vector_3 = DeconstructVector(Vector=multiplication_2)  # -> XComponent, YComponent, ZComponent; disabled
vector_xyz_2 = VectorXYZ(
    XComponent=deconstruct_vector.XComponent,
    YComponent=deconstruct_vector.ZComponent,
    ZComponent=deconstruct_vector.YComponent)  # -> Vector, Length; disabled
vector_xyz_3 = VectorXYZ(
    XComponent=deconstruct_vector_2.YComponent,
    YComponent=deconstruct_vector_2.XComponent,
    ZComponent=deconstruct_vector_2.ZComponent)  # -> Vector, Length; disabled
vector_xyz_4 = VectorXYZ(
    XComponent=deconstruct_vector_3.ZComponent,
    YComponent=deconstruct_vector_3.YComponent,
    ZComponent=deconstruct_vector_3.XComponent)  # -> Vector, Length; disabled
move_5 = Move(Geometry=point_3, Motion=vector_xyz_2.Vector)  # -> Geometry, Transform; disabled
move_6 = Move(Geometry=point_3, Motion=vector_xyz_3.Vector)  # -> Geometry, Transform; disabled
move_7 = Move(Geometry=point_3, Motion=vector_xyz_4.Vector)  # -> Geometry, Transform; disabled
line_4 = Line(StartPoint=point_3, EndPoint=move_5.Geometry)  # -> flatten(Line); disabled
line_5 = Line(StartPoint=point_3, EndPoint=move_6.Geometry)  # -> flatten(Line); disabled
line_6 = Line(StartPoint=point_3, EndPoint=move_7.Geometry)  # -> flatten(Line); disabled
loft_3 = Loft(Curves=line_5, Options={Adjust=False, Closed=False, LoftEnds=0, LoftSimp=0, LoftType=0, Rebuild=10, Refit=0.01})  # disabled
loft_4 = Loft(Curves=line_4, Options={Adjust=False, Closed=False, LoftEnds=0, LoftSimp=0, LoftType=0, Rebuild=10, Refit=0.01})  # disabled
loft_5 = Loft(Curves=line_6, Options={Adjust=False, Closed=False, LoftEnds=0, LoftSimp=0, LoftType=0, Rebuild=10, Refit=0.01})  # disabled
merge_4 = Merge(Data1=loft_4, Data2=loft_3, Data3=loft_5)  # -> flatten(Result); disabled
surface_6 = Surface(merge_4)  # disabled
panel_9 = Panel("2")  # disabled
number_slider_45 = Slider(3, range=0..3)  # disabled

# ---- group: Isotrim
md_slider_7 = MDSlider(
    SliderMode=0,
    slider_value=Point(0.5647732804, 0.5101281143, 0.5),
    x_domain=Domain(0, 1),
    y_domain=Domain(0, 1),
    z_domain=Domain(0, 1))  # disabled
construct_domain_9 = ConstructDomain(DomainU=md_slider_7, DomainV=md_slider_7)  # disabled
isotrim_5 = Isotrim(Surface=reparameterize(surface_6), Domain=construct_domain_9)  # disabled

# ----
surface_7 = Surface(patch_3)  # disabled
number_slider_46 = Slider(4, range=0..4)  # disabled

# ---- group: Isotrim
md_slider_8 = MDSlider(
    SliderMode=0,
    slider_value=Point(0.5647732804, 0.5101281143, 0.5),
    x_domain=Domain(0, 1),
    y_domain=Domain(0, 1),
    z_domain=Domain(0, 1))  # disabled
construct_domain_10 = ConstructDomain(DomainU=md_slider_8, DomainV=md_slider_8)  # disabled
isotrim_6 = Isotrim(Surface=reparameterize(surface_7), Domain=construct_domain_10)  # disabled

# ----
deconstruct_brep_2 = DeconstructBrep(Brep=isotrim_6)  # -> Faces, Edges, Vertices; disabled
list_item = ListItem(List=deconstruct_brep_2.Vertices, Index=panel_6, Wrap=True)  # disabled

surface_closest_point = SurfaceClosestPoint(Point=list_item, Surface=surface_7)  # -> Point, UVPoint, Distance; disabled
evaluate_surface_2 = EvaluateSurface(Surface=surface_7, Point=surface_closest_point.UVPoint)  # -> Point, Normal, UDirection, VDirection, Frame; disabled

amplitude_3 = Amplitude(Vector=evaluate_surface_2.Normal, Amplitude=number_slider_46)  # disabled
multiplication_3 = Multiplication(A=evaluate_surface_2.Normal, B=number_slider_46)  # disabled
extrude = Extrude(Base=surface_7, Direction=multiplication_3)  # disabled
vector_display_6 = VectorDisplay(Anchor=evaluate_surface_2.Point, Vector=amplitude_3)  # disabled

solid_difference = SolidDifference(BrepsA=extrude, BrepsB=sphere_3)  # disabled
solid_difference_2 = SolidDifference(BrepsA=solid_difference, BrepsB=sphere_2)  # disabled

deconstruct_brep_3 = DeconstructBrep(Brep=isotrim)  # -> Faces, Edges, Vertices; disabled
list_item_2 = ListItem(List=deconstruct_brep_3.Vertices, Index=panel_2, Wrap=True)  # disabled

surface_closest_point_2 = SurfaceClosestPoint(Point=list_item_2, Surface=surface)  # -> Point, UVPoint, Distance; disabled
evaluate_surface_3 = EvaluateSurface(Surface=surface, Point=surface_closest_point_2.UVPoint)  # -> Point, Normal, UDirection, VDirection, Frame; disabled

amplitude_4 = Amplitude(Vector=evaluate_surface_3.Normal, Amplitude=number)  # disabled
multiplication_4 = Multiplication(A=evaluate_surface_3.Normal, B=number)  # disabled
vector_display_7 = VectorDisplay(Anchor=evaluate_surface_3.Point, Vector=amplitude_4)  # disabled
extrude_2 = Extrude(Base=surface, Direction=multiplication_4)  # disabled

deconstruct_brep_4 = DeconstructBrep(Brep=isotrim_2)  # -> Faces, Edges, Vertices; disabled
list_item_3 = ListItem(List=deconstruct_brep_4.Vertices, Index=panel_3, Wrap=True)  # disabled

surface_closest_point_3 = SurfaceClosestPoint(Point=list_item_3, Surface=surface_2)  # -> Point, UVPoint, Distance; disabled
evaluate_surface_4 = EvaluateSurface(Surface=surface_2, Point=surface_closest_point_3.UVPoint)  # -> Point, Normal, UDirection, VDirection, Frame; disabled

amplitude_5 = Amplitude(Vector=evaluate_surface_4.Normal, Amplitude=number_slider_19)  # disabled
multiplication_5 = Multiplication(A=evaluate_surface_4.Normal, B=number_slider_19)  # disabled
vector_display_8 = VectorDisplay(Anchor=evaluate_surface_4.Point, Vector=amplitude_5)  # disabled
extrude_3 = Extrude(Base=surface_2, Direction=multiplication_5)  # disabled

deconstruct_brep_5 = DeconstructBrep(Brep=isotrim_4)  # -> Faces, Edges, Vertices; disabled
list_item_4 = ListItem(List=deconstruct_brep_5.Vertices, Index=panel_8, Wrap=True)  # disabled

surface_closest_point_4 = SurfaceClosestPoint(Point=list_item_4, Surface=surface_5)  # -> Point, UVPoint, Distance; disabled
evaluate_surface_5 = EvaluateSurface(Surface=surface_5, Point=surface_closest_point_4.UVPoint)  # -> Point, Normal, UDirection, VDirection, Frame; disabled

deconstruct_brep_6 = DeconstructBrep(Brep=isotrim_3)  # -> Faces, Edges, Vertices; disabled
list_item_5 = ListItem(List=deconstruct_brep_6.Vertices, Index=panel_4, Wrap=True)  # disabled

surface_closest_point_5 = SurfaceClosestPoint(Point=list_item_5, Surface=surface_3)  # -> Point, UVPoint, Distance; disabled
evaluate_surface_6 = EvaluateSurface(Surface=surface_3, Point=surface_closest_point_5.UVPoint)  # -> Point, Normal, UDirection, VDirection, Frame; disabled

amplitude_6 = Amplitude(Vector=evaluate_surface_6.Normal, Amplitude=number_slider_24)  # disabled
multiplication_6 = Multiplication(A=evaluate_surface_6.Normal, B=number_slider_24)  # disabled
vector_display_9 = VectorDisplay(Anchor=evaluate_surface_6.Point, Vector=amplitude_6)  # disabled
extrude_4 = Extrude(Base=surface_3, Direction=multiplication_6)  # disabled
rotate_3d_2 = Rotate3D(Geometry=extrude_4, Angle=pi_2, Center=Point(0, 0, 0), Axis=Vector(0, 0, 1))  # -> Geometry, Transform; disabled
deconstruct_brep_7 = DeconstructBrep(Brep=extrude_4)  # -> Faces, Edges, Vertices; disabled
deconstruct_brep_8 = DeconstructBrep(Brep=rotate_3d_2.Geometry)  # -> Faces, Edges, Vertices; disabled
list_item_6 = ListItem(List=deconstruct_brep_7.Edges, Index=panel_5, Wrap=True)  # disabled
list_item_7 = ListItem(List=deconstruct_brep_8.Edges, Index=panel_5, Wrap=True)  # disabled
curve_2 = Curve(list_item_6)  # disabled
curve_3 = Curve(list_item_7)  # disabled
move_8 = Move(Geometry=curve_2, Motion=unit_x)  # -> Geometry, Transform; disabled
move_9 = Move(Geometry=curve_3, Motion=negative_2)  # -> Geometry, Transform; disabled
flip_curve = FlipCurve(Curve=move_9.Geometry)  # -> Curve, Flag; disabled
loft_6 = Loft(
    Curves=[flip_curve.Curve, move_8.Geometry],
    Options={Adjust=True, Closed=False, LoftEnds=0, LoftSimp=0, LoftType=0, Rebuild=10, Refit=0.01})  # disabled
extrude_5 = Extrude(Base=loft_6, Direction=unit_z_3)  # disabled
# rc
# Full multiplicity knots at start
# Simple knots
# Full multiplicity knots at end
# P1
# A=0.2*P1+ 0.8*P2
# D=0.2*A + 0.8*B
# P2
# B=0.47*P2 + 0.53*P3
# Full multiplicity knots at start
# E=0.7*B + 0.3*C
# P3
# Full multiplicity knots in the middle
# C=0.8*P3 + 0.2*P4
# P4
# Full multiplicity knots at end
# Compare knot spacing
merge_5 = Merge(Data1=extrude_4, Data2=rotate_3d_2.Geometry, Data3=extrude_5)  # disabled

amplitude_7 = Amplitude(Vector=evaluate_surface_5.Normal, Amplitude=number_slider_38)  # disabled
multiplication_7 = Multiplication(A=evaluate_surface_5.Normal, B=number_slider_38)  # disabled
vector_display_10 = VectorDisplay(Anchor=evaluate_surface_5.Point, Vector=amplitude_7)  # disabled

negative_3 = Negative(Value=multiplication_7)  # disabled

extrude_6 = Extrude(Base=surface_5, Direction=[multiplication_7, negative_3])  # disabled
merge_6 = Merge(Data1=pipe_3, Data2=extrude_6)  # disabled

deconstruct_brep_9 = DeconstructBrep(Brep=isotrim_5)  # -> Faces, Edges, Vertices; disabled
list_item_8 = ListItem(List=deconstruct_brep_9.Vertices, Index=panel_9, Wrap=True)  # disabled

surface_closest_point_6 = SurfaceClosestPoint(Point=list_item_8, Surface=surface_6)  # -> Point, UVPoint, Distance; disabled
evaluate_surface_7 = EvaluateSurface(Surface=surface_6, Point=surface_closest_point_6.UVPoint)  # -> Point, Normal, UDirection, VDirection, Frame; disabled

amplitude_8 = Amplitude(Vector=evaluate_surface_7.Normal, Amplitude=number_slider_45)  # disabled
multiplication_8 = Multiplication(A=evaluate_surface_7.Normal, B=number_slider_45)  # disabled
negative_4 = Negative(Value=multiplication_8)  # disabled
vector_display_11 = VectorDisplay(Anchor=evaluate_surface_7.Point, Vector=amplitude_8)  # disabled
extrude_7 = Extrude(Base=surface_6, Direction=[multiplication_8, negative_4])  # disabled
