# Grasshopper definition Sets156MyFovoriteScripts.gh (Grasshopper 1.0.7)
# Copyright: Wickerson Studios
# plug-ins: Firefly.X, Bifocals

# 1001 GRASSHOPPER DEFINITIONS
# Wickerson Studio
# 
# created by: Michael Wickerson
# 
# Grasshopper for Rhino 3D Algorithmic Modeling
# 
# www.wickersonstudios.com
# www.michaelwickerson.com
# https://www.youtube.com/channel/UC7J48Ppcsa6oncp6d29R0xw
# https://github.com/mwickerson
# https://www.facebook.com/michael.wickerson
# https://www.linkedin.com/in/michael-wickerson-696a80156/
# https://www.grasshopper3d.com/profile/MichaelWickerson
image_sampler = ImageSampler(
    FilePath="C:\Users\Sculpture\Documents\2020Grasshopper\ScreenShots2019\Screenshots2020\SurfaceEditAlgorithm.PNG",
    Filter="Value",
    Interpolate=False,
    Umax=1,
    Umin=0,
    Vmax=1,
    Vmin=0,
    Wrap=1)  # disabled

timer = Timer(TimerInterval=50, Target=sound_capture)
sound_capture = SoundCapture(TimePeriod=Slider(0.5, range=0..1), StartStopSoundCapture=Toggle(False))  # -> WavePressureSamplesFromLeftChannel, WavePressureSamplesFromRightChannel, Volume
# FIREFLY FORM GENERATOR 101
number_slider = Slider(2, range=0..10)
panel = Panel(sound_capture.Volume)
data_recorder = DataRecorder(sound_capture.Volume, DataLimit=20, RecordData=True)
series = Series(Start=number_slider, Step=number_slider, Count=Slider(20, range=0..20))
multiplication = Multiplication(A=data_recorder, B=Slider(0.03, range=0..1))
panel_2 = Panel(data_recorder)
unit_z = UnitZ(Factor=multiplication)
# MATH 156/1001 MY FAVORITE SCRIPTS
polygon = Polygon(Plane=PlaneXY(0, 0, 0), Radius=series, Segments=Slider(3, range=0..10), FilletRadius=0)  # -> Polygon, Length
pi = Pi(Factor=multiplication)
panel_3 = Panel(pi)
move = Move(Geometry=reverse(polygon.Polygon), Motion=unit_z)  # -> Geometry, Transform; disabled
xz_plane = XZPlane(Origin=Point(0, 0, 0))
xy_plane = XYPlane(Origin=Point(0, 0, 0))
yz_plane = YZPlane(Origin=Point(0, 0, 0))
rectangle = Rectangle(Plane=[xz_plane, xy_plane, yz_plane], XSize=Domain(-1, 1), YSize=series, Radius=0)  # -> Rectangle, Length
rotate = Rotate(Geometry=rectangle.Rectangle, Angle=pi, Plane=[xz_plane, xy_plane, yz_plane])  # -> Geometry, Transform
deconstruct_brep = DeconstructBrep(Brep=rotate.Geometry)  # -> Faces, Edges, Vertices
number_slider_2 = Slider(4, range=3..10)
list_item = ListItem(List=deconstruct_brep.Faces, Index=Slider(1, range=0..10), Wrap=True)
# rc
# Full multiplicity knots at start
# Simple knots
# Full multiplicity knots at end
# P1
# A=0.2*P1+ 0.8*P2
# D=0.2*A + 0.8*B
# P2
# B=0.47*P2 + 0.53*P3
# Full multiplicity knots at start
# E=0.7*B + 0.3*C
# P3
# Full multiplicity knots in the middle
# C=0.8*P3 + 0.2*P4
# P4
# Full multiplicity knots at end
# Compare knot spacing
mesh_sphere = MeshSphere(Base=list_item, Radius=pi, UCount=number_slider_2, VCount=number_slider_2)
