# Grasshopper definition Sets157MyFovoriteScripts.gh (Grasshopper 1.0.7)
# Copyright: Wickerson Studios
# plug-ins: Bifocals

# 1001 GRASSHOPPER DEFINITIONS
# Wickerson Studio
# 
# created by: Michael Wickerson
# 
# Grasshopper for Rhino 3D Algorithmic Modeling
# 
# www.wickersonstudios.com
# www.michaelwickerson.com
# https://www.youtube.com/channel/UC7J48Ppcsa6oncp6d29R0xw
# https://github.com/mwickerson
# https://www.facebook.com/michael.wickerson
# https://www.linkedin.com/in/michael-wickerson-696a80156/
# https://www.grasshopper3d.com/profile/MichaelWickerson
image_sampler = ImageSampler(
    FilePath="C:\Users\Sculpture\Documents\2020Grasshopper\ScreenShots2019\Screenshots2020\SurfaceEditAlgorithm.PNG",
    Filter="Value",
    Interpolate=False,
    Umax=1,
    Umin=0,
    Vmax=1,
    Vmin=0,
    Wrap=1)  # disabled

# ----
# Polynomial Ring Generator
number_slider = Slider(0, range=0..2)
pi = Pi(Factor=Slider(2, range=0..2))
pi_2 = Pi(Factor=number_slider)
construct_domain = ConstructDomain(DomainStart=pi_2, DomainEnd=pi)
range = Range(Domain=construct_domain, Steps=Slider(10, range=0..10))

# ----
# MATH 157/1001 MY FAVORITE SCRIPTS
number_slider_2 = Slider(0.726, range=0..1)
sine = Sine(Value=range)
cosine = Cosine(Value=range)
natural_logarithm = NaturalLogarithm(Value=range)
sinc = Sinc(Value=range)
circle = Circle(Plane=PlaneXY(0, 0, 0), Radius=Slider(7, range=0..30))
multiplication = Multiplication(A=number_slider_2, B=sine)
horizontal_frames = HorizontalFrames(Curve=circle, Count=10)  # -> graft(Frames), Parameters
construct_point = ConstructPoint(XCoordinate=0, YCoordinate=multiplication, ZCoordinate=range)
construct_point_2 = ConstructPoint(XCoordinate=0, YCoordinate=0, ZCoordinate=0)
orient = Orient(Geometry=construct_point, Source=construct_point_2, Target=horizontal_frames.Frames)  # -> Geometry, Transform
interpolate = Interpolate(Vertices=orient.Geometry, Degree=3, Periodic=False, KnotStyle=1)  # -> flatten(Curve), Length, Domain
loft = Loft(
    Curves=interpolate.Curve,
    Options={Adjust=False, Closed=True, LoftEnds=0, LoftSimp=0, LoftType=0, Rebuild=10, Refit=0.01})

surface = Surface(reparameterize(loft))
construct_domain_2 = ConstructDomain(DomainStart=0, DomainEnd=Slider(0.5, range=0..1))
construct_domain_3 = ConstructDomain(DomainU=construct_domain_2, DomainV=construct_domain_2)
isotrim = Isotrim(Surface=reparameterize(surface), Domain=construct_domain_3)
deconstruct_brep = DeconstructBrep(Brep=isotrim)  # -> Faces, Edges, Vertices
list_item = ListItem(List=deconstruct_brep.Vertices, Index="2", Wrap=True)
surface_closest_point = SurfaceClosestPoint(Point=list_item, Surface=reparameterize(surface))  # -> Point, UVPoint, Distance
evaluate_surface = EvaluateSurface(Surface=reparameterize(surface), Point=surface_closest_point.UVPoint)  # -> Point, Normal, UDirection, VDirection, Frame
# rc
# Full multiplicity knots at start
# Simple knots
# Full multiplicity knots at end
# P1
# A=0.2*P1+ 0.8*P2
# D=0.2*A + 0.8*B
# P2
# B=0.47*P2 + 0.53*P3
# Full multiplicity knots at start
# E=0.7*B + 0.3*C
# P3
# Full multiplicity knots in the middle
# C=0.8*P3 + 0.2*P4
# P4
# Full multiplicity knots at end
# Compare knot spacing
multiplication_2 = Multiplication(A=Slider(1.12, range=0..10), B=evaluate_surface.Normal)

extrude = Extrude(Base=surface, Direction=multiplication_2)
