# Grasshopper definition Sets158MyFovoriteScripts.gh (Grasshopper 1.0.7)
# Copyright: Wickerson Studios
# plug-ins: Bifocals

# 1001 GRASSHOPPER DEFINITIONS
# Wickerson Studio
# 
# created by: Michael Wickerson
# 
# Grasshopper for Rhino 3D Algorithmic Modeling
# 
# www.wickersonstudios.com
# www.michaelwickerson.com
# https://www.youtube.com/channel/UC7J48Ppcsa6oncp6d29R0xw
# https://github.com/mwickerson
# https://www.facebook.com/michael.wickerson
# https://www.linkedin.com/in/michael-wickerson-696a80156/
# https://www.grasshopper3d.com/profile/MichaelWickerson
image_sampler = ImageSampler(
    FilePath="C:\Users\Sculpture\Documents\2020Grasshopper\ScreenShots2019\Screenshots2020\SurfaceEditAlgorithm.PNG",
    Filter="Value",
    Interpolate=False,
    Umax=1,
    Umin=0,
    Vmax=1,
    Vmin=0,
    Wrap=1)  # disabled

construct_point = ConstructPoint(XCoordinate=Slider(0.631, range=0..1), YCoordinate=Slider(0.56, range=0..1), ZCoordinate=Slider(0.808, range=0..1))
panel = Panel(construct_point)

number_slider = Slider(1, range=0..1)
number_slider_2 = Slider(12, range=0..100)
construct_domain = ConstructDomain(DomainStart=Slider(0, range=0..1), DomainEnd=number_slider)
range = Range(Domain=construct_domain, Steps=number_slider_2)
panel_2 = Panel(range)
construct_point_2 = ConstructPoint(XCoordinate=range, YCoordinate=range, ZCoordinate=range)
panel_3 = Panel(construct_point_2)

# ----
# Point Generator Scripts
point = Point(Point(1, 4.027350676, 0))
# MATH 157/1001 MY FAVORITE SCRIPTS
point_2 = Point(Point(1, 4.027350676, 1.993352585))
panel_4 = Panel(point_2)

series = Series(Start=number_slider, Step=number_slider, Count=number_slider_2)
panel_5 = Panel(series)
construct_point_3 = ConstructPoint(XCoordinate=series, YCoordinate=series, ZCoordinate=series)
panel_6 = Panel(construct_point_3)

deconstruct = Deconstruct(Point=construct_point_2)  # -> XComponent, YComponent, ZComponent
number_slider_3 = Slider(4.824, range=0..10)
sine = Sine(Value=deconstruct.YComponent)
cosine = Cosine(Value=deconstruct.ZComponent)
multiplication = Multiplication(A=number_slider_3, B=cosine)
multiplication_2 = Multiplication(A=number_slider_3, B=sine)
construct_point_4 = ConstructPoint(XCoordinate=deconstruct.XComponent, YCoordinate=multiplication_2, ZCoordinate=multiplication)
interpolate = Interpolate(Vertices=construct_point_4, Degree=3, Periodic=False, KnotStyle=1)  # -> Curve, Length, Domain

deconstruct_2 = Deconstruct(Point=construct_point_3)  # -> XComponent, YComponent, ZComponent
number_slider_4 = Slider(4.824, range=0..10)
sine_2 = Sine(Value=deconstruct_2.YComponent)
cosine_2 = Cosine(Value=deconstruct_2.ZComponent)
multiplication_3 = Multiplication(A=number_slider_4, B=cosine_2)
multiplication_4 = Multiplication(A=number_slider_4, B=sine_2)
construct_point_5 = ConstructPoint(XCoordinate=deconstruct_2.XComponent, YCoordinate=multiplication_4, ZCoordinate=multiplication_3)
interpolate_2 = Interpolate(Vertices=construct_point_5, Degree=3, Periodic=False, KnotStyle=1)  # -> Curve, Length, Domain

# ----
# Curve Generator Scripts
number_slider_5 = Slider(9.11, range=0..10)
center_box = CenterBox(Base=point_2, X=number_slider_5, Y=number_slider_5, Z=number_slider_5)
populate_3d = Populate3D(Region=center_box, Count=Slider(8, range=0..10), Seed=Slider(27, range=0..100))
interpolate_3 = Interpolate(Vertices=populate_3d, Degree=3, Periodic=Toggle(True), KnotStyle=1)  # -> Curve, Length, Domain

number_slider_6 = Slider(0.5, range=0..1)
# Surface Generator Script
pipe = Pipe(Curve=interpolate_2.Curve, Radius=1, Caps=0)
deconstruct_brep = DeconstructBrep(Brep=pipe)  # -> Faces, Edges, Vertices
construct_domain² = ConstructDomain²(DomainU=number_slider_6, DomainV=number_slider_6)
number_slider_7 = Slider(10, range=0..10)
isotrim = Isotrim(Surface=reparameterize(deconstruct_brep.Faces), Domain=construct_domain²)
divide_surface = DivideSurface(Surface=isotrim, UCount=number_slider_7, VCount=number_slider_7)  # -> Points, Normals, Parameters
move = Move(Geometry=divide_surface.Points, Motion=divide_surface.Normals)  # -> flatten(Geometry), Transform
addition = Addition(A=number_slider_7, B="1")

surface_from_points = SurfaceFromPoints(Points=move.Geometry, UCount=addition, Interpolate=False)
# Solid Generator Script
deconstruct_brep_2 = DeconstructBrep(Brep=isotrim)  # -> Faces, flatten(Edges), Vertices
deconstruct_brep_3 = DeconstructBrep(Brep=surface_from_points)  # -> Faces, flatten(Edges), Vertices
list_item = ListItem(List=deconstruct_brep_2.Edges, Index=0, Wrap=True)  # -> Item, Item1, Item2, Item3
list_item_2 = ListItem(List=deconstruct_brep_3.Edges, Index=0, Wrap=True)  # -> Item, Item1, Item2, Item3
curve = Curve(list_item_2.Item1)
loft = Loft(
    Curves=[list_item.Item, list_item_2.Item],
    Options={Adjust=False, Closed=False, LoftEnds=0, LoftSimp=0, LoftType=0, Rebuild=10, Refit=0.01})
loft_2 = Loft(
    Curves=[list_item.Item1, list_item_2.Item1],
    Options={Adjust=False, Closed=False, LoftEnds=0, LoftSimp=0, LoftType=0, Rebuild=10, Refit=0.01})
loft_3 = Loft(
    Curves=[list_item.Item2, list_item_2.Item2],
    Options={Adjust=False, Closed=False, LoftEnds=0, LoftSimp=0, LoftType=0, Rebuild=10, Refit=0.01})
loft_4 = Loft(
    Curves=[list_item.Item3, list_item_2.Item3],
    Options={Adjust=False, Closed=False, LoftEnds=0, LoftSimp=0, LoftType=0, Rebuild=10, Refit=0.01})
# rc
# Full multiplicity knots at start
# Simple knots
# Full multiplicity knots at end
# P1
# A=0.2*P1+ 0.8*P2
# D=0.2*A + 0.8*B
# P2
# B=0.47*P2 + 0.53*P3
# Full multiplicity knots at start
# E=0.7*B + 0.3*C
# P3
# Full multiplicity knots in the middle
# C=0.8*P3 + 0.2*P4
# P4
# Full multiplicity knots at end
# Compare knot spacing
merge = Merge(Data1=loft, Data2=loft_2, Data3=loft_3, Data4=loft_4, Data5=surface_from_points, Data6=isotrim)
