# Grasshopper definition Sets159MyFavoriteScripts.gh (Grasshopper 1.0.7)
# Copyright: Wickerson Studios
# plug-ins: Firefly.X, Bifocals

# 1001 GRASSHOPPER DEFINITIONS
# Wickerson Studio
# 
# created by: Michael Wickerson
# 
# Grasshopper for Rhino 3D Algorithmic Modeling
# 
# www.wickersonstudios.com
# www.michaelwickerson.com
# https://www.youtube.com/channel/UC7J48Ppcsa6oncp6d29R0xw
# https://github.com/mwickerson
# https://www.facebook.com/michael.wickerson
# https://www.linkedin.com/in/michael-wickerson-696a80156/
# https://www.grasshopper3d.com/profile/MichaelWickerson
image_sampler = ImageSampler(
    FilePath="C:\Users\Sculpture\Documents\2020Grasshopper\ScreenShots2019\Screenshots2020\SurfaceEditAlgorithm.PNG",
    Filter="Value",
    Interpolate=False,
    Umax=1,
    Umin=0,
    Vmax=1,
    Vmin=0,
    Wrap=1)  # disabled

# ----
# Popular Script
number_slider = Slider(10, range=0..100)
number_slider_2 = Slider(60, range=0..60)
construct_domain = ConstructDomain(DomainStart=0, DomainEnd=number_slider)
range = Range(Domain=construct_domain, Steps=number_slider_2)
jitter = Jitter(List=range, Jitter=Slider(0.74, range=0..1), Seed=2)  # -> Values, Indices
construct_domain_2 = ConstructDomain(DomainStart=0, DomainEnd=Slider(100, range=0..100))
sphere = Sphere(Base=PlaneXY(0, 0, 0), Radius=jitter.Values)
cylinder = Cylinder(Base=PlaneXY(0, 0, 0), Radius=jitter.Values, Length=Slider(3, range=0..100))
range_2 = Range(Domain=construct_domain_2, Steps=number_slider_2)
cap_holes = CapHoles(Brep=sphere)
unit_x = UnitX(Factor=range_2)
construct_domain_3 = ConstructDomain(DomainStart=0, DomainEnd=Slider(1.68, range=0..2))
param_viewer = ParamViewer(cap_holes)
jitter_2 = Jitter(List=unit_x, Jitter=Slider(0.05, range=0..1), Seed=2)  # -> Values, Indices
range_3 = Range(Domain=construct_domain_3, Steps=number_slider_2)
move = Move(Geometry=cap_holes, Motion=jitter_2.Values)  # -> Geometry, Transform
pi = Pi(Factor=range_3)
construct_point = ConstructPoint(XCoordinate=0, YCoordinate=0, ZCoordinate=0)
param_viewer_2 = ParamViewer(move.Geometry)
jitter_3 = Jitter(List=pi, Jitter=Slider(0.13, range=0..1), Seed=2)  # -> Values, Indices
construct_domain_4 = ConstructDomain(DomainStart=0, DomainEnd=Slider(100, range=0..100))
rotate_3d = Rotate3D(Geometry=move.Geometry, Angle=jitter_3.Values, Center=construct_point, Axis=Vector(0, 0, 1))  # -> Geometry, Transform
range_4 = Range(Domain=construct_domain_4, Steps=number_slider_2)
param_viewer_3 = ParamViewer(rotate_3d.Geometry)
unit_z = UnitZ(Factor=range_4)
jitter_4 = Jitter(List=unit_z, Jitter=Slider(0.04, range=0..1), Seed=2)  # -> Values, Indices
move_2 = Move(Geometry=rotate_3d.Geometry, Motion=jitter_4.Values)  # -> Geometry, Transform
construct_domain_5 = ConstructDomain(DomainStart=0, DomainEnd=Slider(2, range=0..2))
volume = Volume(Geometry=move_2.Geometry)  # -> Volume, Centroid
range_5 = Range(Domain=construct_domain_5, Steps=number_slider_2)
unit_x_2 = UnitX(Factor=1)
pi_2 = Pi(Factor=range_5)
line_sdl = LineSDL(Start=volume.Centroid, Direction=unit_x_2, Length=Slider(12, range=0..100))
param_viewer_4 = ParamViewer(move_2.Geometry)
jitter_5 = Jitter(List=pi_2, Jitter=Slider(0.96, range=0..1), Seed=2)  # -> Values, Indices
rotate_3d_2 = Rotate3D(Geometry=move_2.Geometry, Angle=jitter_5.Values, Center=volume.Centroid, Axis=line_sdl)  # -> Geometry, Transform
param_viewer_5 = ParamViewer(rotate_3d_2.Geometry)
polar_array = PolarArray(Geometry=rotate_3d_2.Geometry, Plane=PlaneXY(0, 0, 0), Count=Slider(3, range=0..10), Angle=6.283185307)  # -> Geometry, Transform
list_item = ListItem(List=polar_array.Geometry, Index=Slider(9, range=0..10), Wrap=True)
# rc
# Full multiplicity knots at start
# Simple knots
# Full multiplicity knots at end
# P1
# A=0.2*P1+ 0.8*P2
# D=0.2*A + 0.8*B
# P2
# B=0.47*P2 + 0.53*P3
# Full multiplicity knots at start
# E=0.7*B + 0.3*C
# P3
# Full multiplicity knots in the middle
# C=0.8*P3 + 0.2*P4
# P4
# Full multiplicity knots at end
# Compare knot spacing
param_viewer_6 = ParamViewer(polar_array.Geometry)

# ----
# Kaleidoscipe
curve = Curve(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)
curve_2 = Curve(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)
number_slider_3 = Slider(28, range=0..100)
curve_3 = Curve(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)
rectangular_array = RectangularArray(Geometry=curve_3, Cell=curve_2, XCount=number_slider_3, YCount=number_slider_3)  # -> Geometry, Transform
curve_array = CurveArray(Geometry=curve_2, Curve=curve, Count=number_slider_3)  # -> Geometry, Transform
rectangle_mapping = RectangleMapping()  # -> Geometry, Transform
polar_array_2 = PolarArray(Geometry=curve_3, Plane=PlaneXY(0, 0, 0), Count=number_slider_3, Angle=6.283185307)  # -> Geometry, Transform
plane = Plane(PlaneXY(3.601357617, 4.050969343, 0))
kaleidoscope = Kaleidoscope(Geometry=polar_array_2.Geometry, Plane=plane, Segments=Slider(8, range=0..10))  # -> Geometry, Transform
divide_curve = DivideCurve(Curve=kaleidoscope.Geometry, Count=Slider(10, range=0..10), Kinks=False)  # -> flatten(Points), Tangents, Parameters
voronoi = Voronoi(Points=divide_curve.Points, Radius=Slider(2.31, range=0..10), BruteForceOverride=False)

# ---- group: REFERENCED GEOMETRY
pt = Point(Point(17.74078036, 23.80470616, 19.01252493))
brep = Brep(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)
srf = Surface(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)
crv = Curve(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)

# ----
# Network Surfaces
number_slider_4 = Slider(3, range=0..10)
curve_4 = Curve(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)
curve_5 = Curve(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)
curve_6 = Curve(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)
curve_7 = Curve(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)
curve_8 = Curve(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)
curve_9 = Curve(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)
curve_10 = Curve(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)
merge = Merge(Data1=curve_7, Data2=curve_4, Data3=curve_8, Data4=curve_9)
network_surface = NetworkSurface(CurvesU=merge, CurvesV=[curve_10, curve_5, curve_6], Continuity=number_slider_4)
xz_plane = XZPlane(Origin=Point(0, 0, 0))
mirror = Mirror(Geometry=network_surface, Plane=xz_plane)  # -> Geometry, Transform

# ----
# LOGIC
number_slider_5 = Slider(44, range=0..100)  # disabled
populate_2d = Populate2D(Region={Plane=PlaneXY(0, 0, 0), Size=Domain2(u=0..20, v=0..10)}, Count=100, Seed=1)  # disabled
list_length = ListLength(List=populate_2d)  # disabled
list_item_2 = ListItem(List=populate_2d, Index=number_slider_5, Wrap=True)  # disabled
point = Point(list_item_2)  # disabled
point_2 = Point(populate_2d)  # disabled
number_slider_6 = Slider(5.36, range=0..10)  # disabled
distance = Distance(PointA=point_2, PointB=point)  # disabled
smaller_than = SmallerThan(FirstNumber=distance, SecondNumber=number_slider_6)  # -> SmallerThan, OrEqualTo; disabled
larger_than = LargerThan(FirstNumber=distance, SecondNumber=number_slider_6)  # -> LargerThan, OrEqualTo; disabled
cull_pattern = CullPattern(List=point_2, CullPattern=larger_than.LargerThan)  # disabled
cull_pattern_2 = CullPattern(List=point_2, CullPattern=smaller_than.SmallerThan)  # disabled
line = Line(StartPoint=cull_pattern_2, EndPoint=point)  # disabled
line_2 = Line(StartPoint=cull_pattern, EndPoint=point)  # disabled

# ----
# Optional Gene Pool
# for Dispatch Pattern
gene_pool = GenePool(
    Decimals=0,
    Maximum=1,
    Minimum=0,
    Value=[0.1016146117, 0.1933914671, 0.3456139091, 0.2262482751, 0.8090761648, 0.700994063, 0.7747656041, 0.6660769669, 0.5805381199, 0.7147953914])

# ---- group: GEOMETRY MANIPULATION
pdecon = Deconstruct(Point=pt)  # -> XComponent, YComponent, ZComponent
debrep = DeconstructBrep(Brep=brep)  # -> Faces, Edges, Vertices
flip = FlipCurve(Curve=crv)  # -> Curve, Flag
pt_2 = ConstructPoint(XCoordinate=pdecon.XComponent, YCoordinate=pdecon.YComponent, ZCoordinate=pdecon.ZComponent)
join = BrepJoin(Breps=debrep.Faces)  # -> Breps, Closed
debrep_2 = DeconstructBrep(Brep=srf)  # -> Faces, Edges, Vertices

# ---- group: DATA OUTPUT TO FILE
output = DataOutput(
    A=flip.Curve,
    B=pt_2,
    C=join.Breps,
    D=debrep_2.Faces,
    Destination="C:\Users\Sculpture\Downloads\data.ghdata",
    RelativePath="C:\Users\Sculpture\Downloads\data.ghdata|..\..\..\Downloads\data.ghdata")

# ----
# Input Output nodes
# Make changes to your geometry
# Open a Data file you saved from Data Output Component
# Save Data file to your disk
input = DataInput(
    Destination="C:\Users\Sculpture\Downloads\data.ghdata",
    RelativePath="C:\Users\Sculpture\Downloads\data.ghdata|..\..\..\Downloads\data.ghdata",
    UpdateDelay=5)  # -> A, B, C, D
crv_2 = Curve(input.A)
pt_3 = Point(input.B)
brep_2 = Brep(input.C)
srf_2 = Surface(input.D)
panel = Panel(pt_3)
panel_2 = Panel(brep_2)
# MATH 158/1001 MY FAVORITE SCRIPTS
panel_3 = Panel(crv_2)
panel_4 = Panel(srf_2)

# ----
# FIREFLY
webcam_video_stream = WebCamVideoStream()  # disabled
number_slider_7 = Slider(0, range=0..100)  # disabled
number_slider_8 = Slider(4, range=0..100)  # disabled
number_slider_9 = Slider(2, range=0..100)  # disabled
sound_capture = SoundCapture(TimePeriod=Slider(0.2, range=0..1), StartStopSoundCapture=Toggle(True))  # -> WavePressureSamplesFromLeftChannel, WavePressureSamplesFromRightChannel, Volume
color_correction = ColorCorrection(
    BitmapToModify=webcam_video_stream,
    AlphaMultiplier=1,
    RedMultiplier=number_slider_7,
    GreenMultiplier=number_slider_8,
    BlueMultiplier=number_slider_9)  # disabled
timer = Timer(TimerInterval=20, Target=sound_capture)
construct_domain_6 = ConstructDomain(DomainStart=0, DomainEnd=Slider(11, range=0..100))
video_averages = VideoAverages(BitmapToModify=color_correction, MinimumPointOfBoundingArea=Point(0, 0, 0), MaximumPointOfBoundingArea=Point(1, 1, 0))  # -> AverageColor, AverageMovementVector, CentroidOfMovement, CentroidOfRedPixels, CentroidOfGreenPixels, CentroidOfBluePixels; disabled
range_6 = Range(Domain=construct_domain_6, Steps=Slider(59, range=0..100))
graph_mapper = GraphMapper(
    range_6,
    x0=0,
    x1=11,
    y0=0,
    y1=1,
    Ox=0.5286316276,
    Oy=0.2361504436,
    Px=0.8431215882,
    Py=0.4113506675,
    container_name="Parabola")
panel_5 = Panel(sound_capture.Volume)
graph_mapper_2 = GraphMapper(
    graph_mapper,
    x0=0,
    x1=11,
    y0=0,
    y1=1,
    container_name="Bezier",
    cpx=[0, 0.04908847809, 1, 1],
    cpy=[0, 0.8569073081, 0, 1])
expression = Expression(x=range_6, Expression="sin(x)")
evaluate = Evaluate(Expression="2*sin(x)", x=range_6)
vb_script = VBScript()  # -> Out, A
c_script = CSharpScript()  # -> Out, A
ghpython_script = GhPythonScript()  # -> Out, A
param_viewer_7 = ParamViewer(sound_capture.Volume)  # disabled
panel_6 = Panel(sound_capture.Volume)  # disabled
multiplication = Multiplication(A=Slider(3, range=0..100), B=sound_capture.Volume)
panel_7 = Panel(evaluate)
number_slider_10 = Slider(2, range=0..10)
panel_8 = Panel(multiplication)  # disabled
multiplication_2 = Multiplication(A=multiplication, B=range_6)
construct_point_2 = ConstructPoint(XCoordinate=0, YCoordinate=0, ZCoordinate=0)
unit_z_2 = UnitZ(Factor=1)
line_sdl_2 = LineSDL(Start=construct_point_2, Direction=unit_z_2, Length=Slider(1, range=0..1))

sine = Sine(Value=range_6)

addition = Addition(A=Slider(11, range=0..100), B=sine)
construct_point_3 = ConstructPoint(XCoordinate=addition, YCoordinate=addition, ZCoordinate=multiplication_2)
interpolate = Interpolate(Vertices=construct_point_3, Degree=3, Periodic=False, KnotStyle=1)  # -> Curve, Length, Domain
revolution = Revolution(Curve=interpolate.Curve, Axis=line_sdl_2, Domain=Domain(0, 6.283185307))
cap_holes_2 = CapHoles(Brep=revolution)

# ----
# Surface Edit for Zahner
# Bake me in to RHINO!
# Parameters to Play with!
uv_point_count = Slider(15, range=0..500)
height_map = Slider(1.18, range=0..2)
thickness_of_zinc = Slider(0.86, range=0..10)
optional_seed_for_jitter_node = Slider(25, range=0..100)
width = Slider(10, range=0..10)
rectangle = Rectangle(Plane=PlaneXY(0, 0, 0), XSize=uv_point_count, YSize=width, Radius=0)  # -> Rectangle, Length
divide_surface = DivideSurface(Surface=rectangle.Rectangle, UCount=uv_point_count, VCount=uv_point_count)  # -> flatten(Points), Normals, Parameters
construct_domain_7 = ConstructDomain(DomainStart=0, DomainEnd=height_map)
dispatch = Dispatch(List=divide_surface.Points, DispatchPattern=gene_pool)  # -> ListA, ListB
surface_from_points = SurfaceFromPoints(Points=divide_surface.Points, UCount=expr("x+1", uv_point_count), Interpolate=False)
list_length_2 = ListLength(List=dispatch.ListA)  # -> flatten(Length)
range_7 = Range(Domain=construct_domain_7, Steps=expr("x-1", list_length_2))
unit_z_3 = UnitZ(Factor=range_7)
unit_z_4 = UnitZ(Factor=thickness_of_zinc)
number_slider_11 = Slider(198, range=-1..1000)
vec = VectorXYZ(XComponent=number_slider_11, YComponent=number_slider_11, ZComponent=0)  # -> Vector, Length

# ----
# Optional Jitter
# Node for
# SEED
jitter_6 = Jitter(List=unit_z_3, Jitter=1, Seed=optional_seed_for_jitter_node)  # -> Values, Indices

point_deform = PointDeform(Geometry=surface_from_points, Points=dispatch.ListA, Motion=jitter_6.Values)
scale = Scale(Geometry=point_deform, Center=Point(0, 0, 0), Factor=Slider(17, range=0..20))  # -> Geometry, Transform
move_3 = Move(Geometry=scale.Geometry, Motion=vec.Vector)  # -> Geometry, Transform

extrude = Extrude(Base=point_deform, Direction=unit_z_4)
