# Grasshopper definition Sets160boffTheCuff.gh (Grasshopper 1.0.7)
# Copyright: Wickerson Studios
# plug-ins: Bifocals

number_slider = Slider(5, range=1..11)
series = Series(Start=0, Step=1, Count=number_slider)
graph_mapper = GraphMapper(
    series,
    x0=0,
    x1=11,
    y0=0,
    y1=11,
    container_name="Sine",
    Equation_px=[0.009565712884, 0.4185507894],
    Equation_py=[0.1852169037, 0.8257968426])
populate_3d = Populate3D(
    Region={Plane=PlaneXY(0, 0, 0), X=Domain(0, 10), Y=Domain(0, 10), Z=Domain(0, 2)},
    Count=number_slider,
    Seed=Slider(54, range=0..100))
point = Point(populate_3d)
construct_point = ConstructPoint(XCoordinate=series, YCoordinate=0, ZCoordinate=graph_mapper)
param_viewer = ParamViewer(construct_point)
interpolate = Interpolate(Vertices=construct_point, Degree=3, Periodic=False, KnotStyle=1)  # -> Curve, Length, Domain
# Tutorials 160/1001 OFF THE CUFF
param_viewer_2 = ParamViewer(point)
construct_point_2 = ConstructPoint(XCoordinate=0, YCoordinate=0, ZCoordinate=0)
range = Range(Domain=Slider(2, range=0..2), Steps=expr("x-1", number_slider))
orient = Orient(Geometry=interpolate.Curve, Source=construct_point_2, Target=point)  # -> Geometry, Transform
pi = Pi(Factor=range)
rotate_3d = Rotate3D(Geometry=orient.Geometry, Angle=pi, Center=Point(0, 0, 0), Axis=Vector(0, 0, 1))  # -> Geometry, Transform
loft = Loft(
    Curves=rotate_3d.Geometry,
    Options={Adjust=False, Closed=True, LoftEnds=0, LoftSimp=0, LoftType=0, Rebuild=10, Refit=0.01})

# ----
# 1001 GRASSHOPPER DEFINITIONS
# Wickerson Studio
# 
# created by: Michael Wickerson
# 
# Grasshopper for Rhino 3D Algorithmic Modeling
# 
# www.wickersonstudios.com
# www.michaelwickerson.com
# https://www.youtube.com/channel/UC7J48Ppcsa6oncp6d29R0xw
# https://github.com/mwickerson
# https://www.facebook.com/michael.wickerson
# https://www.linkedin.com/in/michael-wickerson-696a80156/
# https://www.grasshopper3d.com/profile/MichaelWickerson
image_sampler = ImageSampler(
    FilePath="C:\Users\Sculpture\Documents\2020Grasshopper\ScreenShots2019\Screenshots2020\SurfaceEditAlgorithm.PNG",
    Filter="Value",
    Interpolate=False,
    Umax=1,
    Umin=0,
    Vmax=1,
    Vmin=0,
    Wrap=1)  # disabled

number_slider_2 = Slider(10, range=0..10)
divide_surface = DivideSurface(Surface=loft, UCount=number_slider_2, VCount=number_slider_2)  # -> Points, Normals, Parameters
amplitude = Amplitude(Vector=divide_surface.Normals, Amplitude=Slider(4.96, range=0..10))
move = Move(Geometry=divide_surface.Points, Motion=amplitude)  # -> flatten(Geometry), Transform
addition = Addition(A=number_slider_2, B="1")
surface_from_points = SurfaceFromPoints(Points=move.Geometry, UCount=addition, Interpolate=Slider(0, range=0..1))
number_slider_3 = Slider(2, range=0..2)
deconstruct_brep = DeconstructBrep(Brep=surface_from_points)  # -> Faces, Edges, Vertices
deconstruct_brep_2 = DeconstructBrep(Brep=loft)  # -> Faces, Edges, Vertices
list_item = ListItem(List=deconstruct_brep.Edges, Index=number_slider_3, Wrap=True)
list_item_2 = ListItem(List=deconstruct_brep_2.Edges, Index=number_slider_3, Wrap=True)
divide_curve = DivideCurve(Curve=list_item, Count=10, Kinks=False)  # -> Points, Tangents, Parameters
divide_curve_2 = DivideCurve(Curve=list_item_2, Count=10, Kinks=False)  # -> Points, Tangents, Parameters
list_item_3 = ListItem(List=deconstruct_brep_2.Edges, Index=0, Wrap=True)
list_item_4 = ListItem(List=deconstruct_brep.Edges, Index=0, Wrap=True)
line = Line(StartPoint=divide_curve.Points, EndPoint=divide_curve_2.Points)  # -> flatten(Line)
patch = Patch(Curves=list_item_4, Spans=20, Flexibility=1, Trim=True)
patch_2 = Patch(Curves=list_item_3, Spans=20, Flexibility=1, Trim=True)
network_surface = NetworkSurface(CurvesU=flatten([list_item, list_item_2]), CurvesV=line, Continuity=2)
# rc
# Full multiplicity knots at start
# Simple knots
# Full multiplicity knots at end
# P1
# A=0.2*P1+ 0.8*P2
# D=0.2*A + 0.8*B
# P2
# B=0.47*P2 + 0.53*P3
# Full multiplicity knots at start
# E=0.7*B + 0.3*C
# P3
# Full multiplicity knots in the middle
# C=0.8*P3 + 0.2*P4
# P4
# Full multiplicity knots at end
# Compare knot spacing
merge = Merge(Data1=network_surface, Data2=patch, Data3=patch_2, Data4=surface_from_points, Data5=loft)
