# Grasshopper definition Sets161boffTheCuff.gh (Grasshopper 1.0.7)
# Copyright: Wickerson Studios
# plug-ins: Bifocals

# 1001 GRASSHOPPER DEFINITIONS
# Wickerson Studio
# 
# created by: Michael Wickerson
# 
# Grasshopper for Rhino 3D Algorithmic Modeling
# 
# www.wickersonstudios.com
# www.michaelwickerson.com
# https://www.youtube.com/channel/UC7J48Ppcsa6oncp6d29R0xw
# https://github.com/mwickerson
# https://www.facebook.com/michael.wickerson
# https://www.linkedin.com/in/michael-wickerson-696a80156/
# https://www.grasshopper3d.com/profile/MichaelWickerson
image_sampler = ImageSampler(
    FilePath="C:\Users\Sculpture\Documents\2020Grasshopper\ScreenShots2019\Screenshots2020\SurfaceEditAlgorithm.PNG",
    Filter="Value",
    Interpolate=False,
    Umax=1,
    Umin=0,
    Vmax=1,
    Vmin=0,
    Wrap=1)  # disabled
number_slider = Slider(2, range=0..10)
number_slider_2 = Slider(4.46, range=0..10)
series = Series(Start=0, Step=Slider(1, range=0..1), Count=Slider(10, range=0..10))
square = Square(Plane=PlaneXY(0, 0, 0), Size=Slider(10, range=0..10), ExtentX=number_slider, ExtentY=number_slider)  # -> Cells, simplify(Points)
sine = Sine(Value=series)
cosine = Cosine(Value=series)
multiplication = Multiplication(A=number_slider_2, B=series)
multiplication_2 = Multiplication(A=cosine, B=number_slider_2)
multiplication_3 = Multiplication(A=sine, B=number_slider_2)
# Tutorials 161/1001 OFF THE CUFF
point = Point(graft(square.Points))
construct_point = ConstructPoint(XCoordinate=0, YCoordinate=0, ZCoordinate=0)
construct_point_2 = ConstructPoint(XCoordinate=multiplication_3, YCoordinate=multiplication_2, ZCoordinate=multiplication)
orient = Orient(Geometry=point, Source=construct_point, Target=construct_point_2)  # -> Geometry, Transform
simplify_tree = SimplifyTree(Tree=orient.Geometry, Front=False)
path_mapper = PathMapper(simplify_tree, source="{A;B}(i)", target="{A;B}(i)")
path_mapper_2 = PathMapper(simplify_tree, source="{A;B}(i)", target="{A;B}(i)")
panel = Panel("{0;1}(2)")
panel_2 = Panel("{0;2}(3)")
panel_3 = Panel("{2;2}(3)")
panel_4 = Panel("{0;1}(0)")
panel_5 = Panel("{1;2}(3)")
panel_6 = Panel("{0;1}(3)")
param_viewer = ParamViewer(path_mapper_2)
relative_item = RelativeItem(Tree=path_mapper_2, Offset="{0;0}(5)", WrapPaths=False, WrapItems=False)  # -> ItemA, ItemB
interpolate = Interpolate(Vertices=path_mapper, Degree=3, Periodic=False, KnotStyle=1)  # -> Curve, Length, Domain
# rc
# Full multiplicity knots at start
# Simple knots
# Full multiplicity knots at end
# P1
# A=0.2*P1+ 0.8*P2
# D=0.2*A + 0.8*B
# P2
# B=0.47*P2 + 0.53*P3
# Full multiplicity knots at start
# E=0.7*B + 0.3*C
# P3
# Full multiplicity knots in the middle
# C=0.8*P3 + 0.2*P4
# P4
# Full multiplicity knots at end
# Compare knot spacing
interpolate_2 = Interpolate(Vertices=relative_item.ItemA, Degree=3, Periodic=False, KnotStyle=1)  # -> Curve, Length, Domain
