# Grasshopper definition Sets161doffTheCuff.gh (Grasshopper 1.0.7)
# Copyright: Wickerson Studios
# plug-ins: Bifocals

# 1001 GRASSHOPPER DEFINITIONS
# Wickerson Studio
# 
# created by: Michael Wickerson
# 
# Grasshopper for Rhino 3D Algorithmic Modeling
# 
# www.wickersonstudios.com
# www.michaelwickerson.com
# https://www.youtube.com/channel/UC7J48Ppcsa6oncp6d29R0xw
# https://github.com/mwickerson
# https://www.facebook.com/michael.wickerson
# https://www.linkedin.com/in/michael-wickerson-696a80156/
# https://www.grasshopper3d.com/profile/MichaelWickerson
image_sampler = ImageSampler(
    FilePath="C:\Users\Sculpture\Documents\2020Grasshopper\ScreenShots2019\Screenshots2020\SurfaceEditAlgorithm.PNG",
    Filter="Value",
    Interpolate=False,
    Umax=1,
    Umin=0,
    Vmax=1,
    Vmin=0,
    Wrap=1)  # disabled

number_slider = Slider(10, range=0..10)
number_slider_2 = Slider(2, range=0..10)
series = Series(Start=0, Step=Slider(1, range=0..1), Count=Slider(10, range=0..10))
number_slider_3 = Slider(4.5, range=0..10)
square = Square(Plane=PlaneXY(0, 0, 0), Size=number_slider, ExtentX=number_slider_2, ExtentY=number_slider_2)  # -> Cells, simplify(Points)
sine = Sine(Value=series)
cosine = Cosine(Value=series)
construct_point = ConstructPoint(XCoordinate=0, YCoordinate=0, ZCoordinate=0)
flip_matrix = FlipMatrix(Data=square.Points)
multiplication = Multiplication(A=number_slider_3, B=sine)
multiplication_2 = Multiplication(A=number_slider_3, B=cosine)
multiplication_3 = Multiplication(A=number_slider_3, B=series)
# Tutorials 161/1001 OFF THE CUFF
region_union = RegionUnion(Curves=flatten(square.Cells))
point = Point(graft(flip_matrix))
construct_point_2 = ConstructPoint(XCoordinate=multiplication, YCoordinate=multiplication_2, ZCoordinate=multiplication_3)
orient = Orient(Geometry=point, Source=construct_point, Target=construct_point_2)  # -> Geometry, Transform
simplify_tree = SimplifyTree(Tree=orient.Geometry, Front=False)
panel = Panel("{0;1}(0)")
panel_2 = Panel("{0;0}(5)")
panel_3 = Panel("{0;1}(2)")
panel_4 = Panel("{1;2}(3)")
panel_5 = Panel("{0;1}(3)")
path_mapper = PathMapper(simplify_tree, source="{A;B}(i)", target="{A;B}(i)")
path_mapper_2 = PathMapper(simplify_tree, source="{A;B}(i)", target="{A;B}(i)")
interpolate = Interpolate(Vertices=path_mapper_2, Degree=3, Periodic=False, KnotStyle=1)  # -> Curve, Length, Domain
param_viewer = ParamViewer(path_mapper)
relative_item = RelativeItem(Tree=path_mapper, Offset="{2;0}(3)", WrapPaths=False, WrapItems=False)  # -> ItemA, ItemB
relative_item_2 = RelativeItem(Tree=path_mapper, Offset="{0;2}(3)", WrapPaths=False, WrapItems=False)  # -> ItemA, ItemB
boundary_surfaces = BoundarySurfaces(Edges=region_union)
interpolate_2 = Interpolate(Vertices=relative_item.ItemA, Degree=3, Periodic=False, KnotStyle=1)  # -> Curve, Length, Domain
interpolate_3 = Interpolate(Vertices=relative_item_2.ItemA, Degree=3, Periodic=False, KnotStyle=1)  # -> Curve, Length, Domain
interpolate_4 = Interpolate(Vertices=flip_matrix, Degree=3, Periodic=False, KnotStyle=1)  # -> Curve, Length, Domain
interpolate_5 = Interpolate(Vertices=square.Points, Degree=3, Periodic=False, KnotStyle=1)  # -> Curve, Length, Domain
curve = Curve(interpolate_3.Curve)
curve_2 = Curve(interpolate_2.Curve)
sweep1 = Sweep1(Rail=interpolate_4.Curve, Sections=curve, Miter=1)

subtraction = Subtraction(A=number_slider, B="1")

division = Division(A=subtraction, B="2")
unit_y = UnitY(Factor=division)
move = Move(Geometry=interpolate_5.Curve, Motion=unit_y)  # -> Geometry, Transform
sweep1_2 = Sweep1(Rail=move.Geometry, Sections=curve_2, Miter=1)
unit_y_2 = UnitY(Factor=division)
merge = Merge(Data1=sweep1_2, Data2=sweep1)
move_2 = Move(Geometry=boundary_surfaces, Motion=unit_y_2)  # -> Geometry, Transform
# rc
# Full multiplicity knots at start
# Simple knots
# Full multiplicity knots at end
# P1
# A=0.2*P1+ 0.8*P2
# D=0.2*A + 0.8*B
# P2
# B=0.47*P2 + 0.53*P3
# Full multiplicity knots at start
# E=0.7*B + 0.3*C
# P3
# Full multiplicity knots in the middle
# C=0.8*P3 + 0.2*P4
# P4
# Full multiplicity knots at end
# Compare knot spacing
surface = Surface(reparameterize(merge))
