# Grasshopper definition Sets161doffTheCuffPart2.gh (Grasshopper 1.0.7)
# Copyright: Wickerson Studios
# plug-ins: Bifocals

# 1001 GRASSHOPPER DEFINITIONS
# Wickerson Studio
# 
# created by: Michael Wickerson
# 
# Grasshopper for Rhino 3D Algorithmic Modeling
# 
# www.wickersonstudios.com
# www.michaelwickerson.com
# https://www.youtube.com/channel/UC7J48Ppcsa6oncp6d29R0xw
# https://github.com/mwickerson
# https://www.facebook.com/michael.wickerson
# https://www.linkedin.com/in/michael-wickerson-696a80156/
# https://www.grasshopper3d.com/profile/MichaelWickerson
image_sampler = ImageSampler(
    FilePath="C:\Users\Sculpture\Documents\2020Grasshopper\ScreenShots2019\Screenshots2020\SurfaceEditAlgorithm.PNG",
    Filter="Value",
    Interpolate=False,
    Umax=1,
    Umin=0,
    Vmax=1,
    Vmin=0,
    Wrap=1)  # disabled

number_slider = Slider(5, range=0..10)
number_slider_2 = Slider(10, range=0..10)
series = Series(Start=0, Step=Slider(1, range=0..1), Count=Slider(10, range=0..10))
number_slider_3 = Slider(9.6, range=0..10)
square = Square(Plane=PlaneXY(0, 0, 0), Size=number_slider_2, ExtentX=number_slider, ExtentY=number_slider)  # -> Cells, simplify(Points)
sine = Sine(Value=series)
cosine = Cosine(Value=series)
construct_point = ConstructPoint(XCoordinate=0, YCoordinate=0, ZCoordinate=0)
multiplication = Multiplication(A=number_slider_3, B=sine)
multiplication_2 = Multiplication(A=number_slider_3, B=cosine)
multiplication_3 = Multiplication(A=number_slider_3, B=series)
construct_point_2 = ConstructPoint(XCoordinate=multiplication, YCoordinate=multiplication_2, ZCoordinate=multiplication_3)
panel = Panel("{0;0}(5)")
panel_2 = Panel("{0;1}(2)")
panel_3 = Panel("{1;2}(3)")
panel_4 = Panel("{0;1}(3)")
panel_5 = Panel("{0;1}(0)")
division = Division(A=number_slider_2, B="2")
unit_y = UnitY(Factor=division)
unit_y_2 = UnitY(Factor=division)

radial = Radial(Plane=PlaneXY(0, 0, 0), Size=number_slider_2, ExtentR=number_slider, ExtentP=20)  # -> Cells, simplify(Points)

flip_matrix = FlipMatrix(Data=radial.Points)
# Tutorials 161/1001 OFF THE CUFF
region_union = RegionUnion(Curves=flatten(radial.Cells))
point = Point(graft(flip_matrix))
orient = Orient(Geometry=point, Source=construct_point, Target=construct_point_2)  # -> Geometry, Transform
simplify_tree = SimplifyTree(Tree=orient.Geometry, Front=False)
path_mapper = PathMapper(simplify_tree, source="{A;B}(i)", target="{A;B}(i)")
path_mapper_2 = PathMapper(simplify_tree, source="{A;B}(i)", target="{A;B}(i)")
interpolate = Interpolate(Vertices=path_mapper_2, Degree=3, Periodic=False, KnotStyle=1)  # -> Curve, Length, Domain
param_viewer = ParamViewer(path_mapper)
relative_item = RelativeItem(Tree=path_mapper, Offset="{2;0}(3)", WrapPaths=False, WrapItems=False)  # -> ItemA, ItemB
relative_item_2 = RelativeItem(Tree=path_mapper, Offset="{0;2}(3)", WrapPaths=False, WrapItems=False)  # -> ItemA, ItemB
boundary_surfaces = BoundarySurfaces(Edges=region_union)
interpolate_2 = Interpolate(Vertices=relative_item.ItemA, Degree=3, Periodic=False, KnotStyle=1)  # -> Curve, Length, Domain
interpolate_3 = Interpolate(Vertices=relative_item_2.ItemA, Degree=3, Periodic=False, KnotStyle=1)  # -> Curve, Length, Domain
interpolate_4 = Interpolate(Vertices=flip_matrix, Degree=3, Periodic=False, KnotStyle=1)  # -> Curve, Length, Domain
interpolate_5 = Interpolate(Vertices=radial.Points, Degree=3, Periodic=False, KnotStyle=1)  # -> Curve, Length, Domain
curve = Curve(interpolate_3.Curve)
curve_2 = Curve(interpolate_2.Curve)
move = Move(Geometry=interpolate_5.Curve, Motion=unit_y)  # -> Geometry, Transform
sweep1 = Sweep1(Rail=interpolate_4.Curve, Sections=curve, Miter=1)
sweep1_2 = Sweep1(Rail=move.Geometry, Sections=curve_2, Miter=1)
merge = Merge(Data1=sweep1_2, Data2=sweep1)  # -> flatten(Result)
move_2 = Move(Geometry=boundary_surfaces, Motion=unit_y_2)  # -> Geometry, Transform
surface = Surface(reparameterize(merge))

surface_2 = Surface(surface)

unit_z = UnitZ(Factor=Slider(2, range=0..10))
negative = Negative(Value=unit_z)
move_3 = Move(Motion=Vector(0, 0, 10))  # -> Geometry, Transform
extrude = Extrude(Base=move_2.Geometry, Direction=negative)

number_slider_4 = Slider(10, range=0..10)
number_slider_5 = Slider(10, range=0..10)
number_slider_6 = Slider(10, range=0..10)
number_slider_7 = Slider(10, range=0..10)
number_slider_8 = Slider(10, range=0..10)
number_slider_9 = Slider(10, range=0..10)
list_item = ListItem(List=surface_2, Index=Slider(2, range=0..5), Wrap=True)
list_item_2 = ListItem(List=surface_2, Index=0, Wrap=True)
list_item_3 = ListItem(List=surface_2, Index=Slider(4, range=0..5), Wrap=True)
list_item_4 = ListItem(List=surface_2, Index=Slider(3, range=0..5), Wrap=True)
list_item_5 = ListItem(List=surface_2, Index=Slider(1, range=0..5), Wrap=True)
list_item_6 = ListItem(List=surface_2, Index=Slider(5, range=0..5), Wrap=True)
divide_surface = DivideSurface(Surface=list_item, UCount=number_slider_4, VCount=number_slider_4)  # -> Points, Normals, Parameters
divide_surface_2 = DivideSurface(Surface=list_item_2, UCount=number_slider_5, VCount=number_slider_5)  # -> Points, Normals, Parameters
divide_surface_3 = DivideSurface(Surface=list_item_3, UCount=number_slider_6, VCount=number_slider_6)  # -> Points, Normals, Parameters
divide_surface_4 = DivideSurface(Surface=list_item_4, UCount=number_slider_7, VCount=number_slider_7)  # -> Points, Normals, Parameters
divide_surface_5 = DivideSurface(Surface=list_item_5, UCount=number_slider_8, VCount=number_slider_8)  # -> Points, Normals, Parameters
divide_surface_6 = DivideSurface(Surface=list_item_6, UCount=number_slider_9, VCount=number_slider_9)  # -> Points, Normals, Parameters
negative_2 = Negative(Value=divide_surface_5.Normals)
negative_3 = Negative(Value=divide_surface_6.Normals)
negative_4 = Negative(Value=divide_surface_3.Normals)
move_4 = Move(Geometry=divide_surface.Points, Motion=divide_surface.Normals)  # -> flatten(Geometry), Transform
move_5 = Move(Geometry=divide_surface_2.Points, Motion=divide_surface_2.Normals)  # -> flatten(Geometry), Transform
move_6 = Move(Geometry=divide_surface_3.Points, Motion=negative_4)  # -> flatten(Geometry), Transform
move_7 = Move(Geometry=divide_surface_4.Points, Motion=divide_surface_4.Normals)  # -> flatten(Geometry), Transform
move_8 = Move(Geometry=divide_surface_5.Points, Motion=negative_2)  # -> flatten(Geometry), Transform
move_9 = Move(Geometry=divide_surface_6.Points, Motion=negative_3)  # -> flatten(Geometry), Transform
addition = Addition(A=number_slider_4, B="1")
addition_2 = Addition(A=number_slider_5, B="1")
addition_3 = Addition(A=number_slider_6, B="1")
addition_4 = Addition(A=number_slider_7, B="1")
addition_5 = Addition(A=number_slider_8, B="1")
addition_6 = Addition(A=number_slider_9, B="1")
surface_from_points = SurfaceFromPoints(Points=move_4.Geometry, UCount=addition, Interpolate=False)
surface_from_points_2 = SurfaceFromPoints(Points=move_5.Geometry, UCount=addition_2, Interpolate=False)
surface_from_points_3 = SurfaceFromPoints(Points=move_6.Geometry, UCount=addition_3, Interpolate=False)
surface_from_points_4 = SurfaceFromPoints(Points=move_7.Geometry, UCount=addition_4, Interpolate=False)
surface_from_points_5 = SurfaceFromPoints(Points=move_8.Geometry, UCount=addition_5, Interpolate=False)
surface_from_points_6 = SurfaceFromPoints(Points=move_9.Geometry, UCount=addition_6, Interpolate=False)
deconstruct_brep = DeconstructBrep(Brep=surface_from_points)  # -> Faces, Edges, Vertices
deconstruct_brep_2 = DeconstructBrep(Brep=list_item)  # -> Faces, Edges, Vertices
deconstruct_brep_3 = DeconstructBrep(Brep=surface_from_points_2)  # -> Faces, Edges, Vertices
deconstruct_brep_4 = DeconstructBrep(Brep=surface_from_points_3)  # -> Faces, Edges, Vertices
deconstruct_brep_5 = DeconstructBrep(Brep=list_item_2)  # -> Faces, Edges, Vertices
deconstruct_brep_6 = DeconstructBrep(Brep=list_item_3)  # -> Faces, Edges, Vertices
deconstruct_brep_7 = DeconstructBrep(Brep=surface_from_points_4)  # -> Faces, Edges, Vertices
deconstruct_brep_8 = DeconstructBrep(Brep=list_item_4)  # -> Faces, Edges, Vertices
deconstruct_brep_9 = DeconstructBrep(Brep=surface_from_points_5)  # -> Faces, Edges, Vertices
deconstruct_brep_10 = DeconstructBrep(Brep=surface_from_points_6)  # -> Faces, Edges, Vertices
deconstruct_brep_11 = DeconstructBrep(Brep=list_item_5)  # -> Faces, Edges, Vertices
deconstruct_brep_12 = DeconstructBrep(Brep=list_item_6)  # -> Faces, Edges, Vertices
list_item_7 = ListItem(List=deconstruct_brep_2.Edges, Index=0, Wrap=True)  # -> Item, Item1, Item2, Item3
list_item_8 = ListItem(List=deconstruct_brep.Edges, Index=0, Wrap=True)  # -> Item, Item1, Item2, Item3
list_item_9 = ListItem(List=deconstruct_brep_5.Edges, Index=0, Wrap=True)  # -> Item, Item1, Item2, Item3
list_item_10 = ListItem(List=deconstruct_brep_6.Edges, Index=0, Wrap=True)  # -> Item, Item1, Item2, Item3
list_item_11 = ListItem(List=deconstruct_brep_3.Edges, Index=0, Wrap=True)  # -> Item, Item1, Item2, Item3
list_item_12 = ListItem(List=deconstruct_brep_4.Edges, Index=0, Wrap=True)  # -> Item, Item1, Item2, Item3
list_item_13 = ListItem(List=deconstruct_brep_8.Edges, Index=0, Wrap=True)  # -> Item, Item1, Item2, Item3
list_item_14 = ListItem(List=deconstruct_brep_7.Edges, Index=0, Wrap=True)  # -> Item, Item1, Item2, Item3
list_item_15 = ListItem(List=deconstruct_brep_11.Edges, Index=0, Wrap=True)  # -> Item, Item1, Item2, Item3
list_item_16 = ListItem(List=deconstruct_brep_12.Edges, Index=0, Wrap=True)  # -> Item, Item1, Item2, Item3
list_item_17 = ListItem(List=deconstruct_brep_9.Edges, Index=0, Wrap=True)  # -> Item, Item1, Item2, Item3
list_item_18 = ListItem(List=deconstruct_brep_10.Edges, Index=0, Wrap=True)  # -> Item, Item1, Item2, Item3
loft = Loft(
    Curves=[list_item_7.Item, list_item_8.Item],
    Options={Adjust=False, Closed=False, LoftEnds=0, LoftSimp=0, LoftType=0, Rebuild=10, Refit=0.01})
loft_2 = Loft(
    Curves=[list_item_7.Item1, list_item_8.Item1],
    Options={Adjust=False, Closed=False, LoftEnds=0, LoftSimp=0, LoftType=0, Rebuild=10, Refit=0.01})
loft_3 = Loft(
    Curves=[list_item_7.Item2, list_item_8.Item2],
    Options={Adjust=False, Closed=False, LoftEnds=0, LoftSimp=0, LoftType=0, Rebuild=10, Refit=0.01})
loft_4 = Loft(
    Curves=[list_item_7.Item3, list_item_8.Item3],
    Options={Adjust=False, Closed=False, LoftEnds=0, LoftSimp=0, LoftType=0, Rebuild=10, Refit=0.01})
loft_5 = Loft(
    Curves=[list_item_9.Item, list_item_11.Item],
    Options={Adjust=False, Closed=False, LoftEnds=0, LoftSimp=0, LoftType=0, Rebuild=10, Refit=0.01})
loft_6 = Loft(
    Curves=[list_item_9.Item1, list_item_11.Item1],
    Options={Adjust=False, Closed=False, LoftEnds=0, LoftSimp=0, LoftType=0, Rebuild=10, Refit=0.01})
loft_7 = Loft(
    Curves=[list_item_9.Item2, list_item_11.Item2],
    Options={Adjust=False, Closed=False, LoftEnds=0, LoftSimp=0, LoftType=0, Rebuild=10, Refit=0.01})
loft_8 = Loft(
    Curves=[list_item_9.Item3, list_item_11.Item3],
    Options={Adjust=False, Closed=False, LoftEnds=0, LoftSimp=0, LoftType=0, Rebuild=10, Refit=0.01})
loft_9 = Loft(
    Curves=[list_item_10.Item, list_item_12.Item],
    Options={Adjust=False, Closed=False, LoftEnds=0, LoftSimp=0, LoftType=0, Rebuild=10, Refit=0.01})
loft_10 = Loft(
    Curves=[list_item_10.Item1, list_item_12.Item1],
    Options={Adjust=False, Closed=False, LoftEnds=0, LoftSimp=0, LoftType=0, Rebuild=10, Refit=0.01})
loft_11 = Loft(
    Curves=[list_item_10.Item2, list_item_12.Item2],
    Options={Adjust=False, Closed=False, LoftEnds=0, LoftSimp=0, LoftType=0, Rebuild=10, Refit=0.01})
loft_12 = Loft(
    Curves=[list_item_10.Item3, list_item_12.Item3],
    Options={Adjust=False, Closed=False, LoftEnds=0, LoftSimp=0, LoftType=0, Rebuild=10, Refit=0.01})
loft_13 = Loft(
    Curves=[list_item_13.Item, list_item_14.Item],
    Options={Adjust=False, Closed=False, LoftEnds=0, LoftSimp=0, LoftType=0, Rebuild=10, Refit=0.01})
loft_14 = Loft(
    Curves=[list_item_13.Item1, list_item_14.Item1],
    Options={Adjust=False, Closed=False, LoftEnds=0, LoftSimp=0, LoftType=0, Rebuild=10, Refit=0.01})
loft_15 = Loft(
    Curves=[list_item_13.Item2, list_item_14.Item2],
    Options={Adjust=False, Closed=False, LoftEnds=0, LoftSimp=0, LoftType=0, Rebuild=10, Refit=0.01})
loft_16 = Loft(
    Curves=[list_item_13.Item3, list_item_14.Item3],
    Options={Adjust=False, Closed=False, LoftEnds=0, LoftSimp=0, LoftType=0, Rebuild=10, Refit=0.01})
loft_17 = Loft(
    Curves=[list_item_15.Item, list_item_17.Item],
    Options={Adjust=False, Closed=False, LoftEnds=0, LoftSimp=0, LoftType=0, Rebuild=10, Refit=0.01})
loft_18 = Loft(
    Curves=[list_item_15.Item1, list_item_17.Item1],
    Options={Adjust=False, Closed=False, LoftEnds=0, LoftSimp=0, LoftType=0, Rebuild=10, Refit=0.01})
loft_19 = Loft(
    Curves=[list_item_15.Item2, list_item_17.Item2],
    Options={Adjust=False, Closed=False, LoftEnds=0, LoftSimp=0, LoftType=0, Rebuild=10, Refit=0.01})
loft_20 = Loft(
    Curves=[list_item_15.Item3, list_item_17.Item3],
    Options={Adjust=False, Closed=False, LoftEnds=0, LoftSimp=0, LoftType=0, Rebuild=10, Refit=0.01})
loft_21 = Loft(
    Curves=[list_item_16.Item, list_item_18.Item],
    Options={Adjust=False, Closed=False, LoftEnds=0, LoftSimp=0, LoftType=0, Rebuild=10, Refit=0.01})
loft_22 = Loft(
    Curves=[list_item_16.Item1, list_item_18.Item1],
    Options={Adjust=False, Closed=False, LoftEnds=0, LoftSimp=0, LoftType=0, Rebuild=10, Refit=0.01})
loft_23 = Loft(
    Curves=[list_item_16.Item2, list_item_18.Item2],
    Options={Adjust=False, Closed=False, LoftEnds=0, LoftSimp=0, LoftType=0, Rebuild=10, Refit=0.01})
loft_24 = Loft(
    Curves=[list_item_16.Item3, list_item_18.Item3],
    Options={Adjust=False, Closed=False, LoftEnds=0, LoftSimp=0, LoftType=0, Rebuild=10, Refit=0.01})
merge_2 = Merge(Data1=loft_13, Data2=loft_14, Data3=loft_15, Data4=loft_16, Data5=surface_from_points_4, Data6=list_item_4)
merge_3 = Merge(Data1=loft_5, Data2=loft_6, Data3=loft_7, Data4=loft_8, Data5=surface_from_points_2, Data6=list_item_2)
merge_4 = Merge(Data1=loft_17, Data2=loft_18, Data3=loft_19, Data4=loft_20, Data5=surface_from_points_5, Data6=list_item_5)
merge_5 = Merge(Data1=loft, Data2=loft_2, Data3=loft_3, Data4=loft_4, Data5=surface_from_points, Data6=list_item)
merge_6 = Merge(Data1=loft_9, Data2=loft_10, Data3=loft_11, Data4=loft_12, Data5=surface_from_points_3, Data6=list_item_3)
merge_7 = Merge(Data1=loft_21, Data2=loft_22, Data3=loft_23, Data4=loft_24, Data5=surface_from_points_6, Data6=list_item_6)
merge_8 = Merge(Data1=extrude, Data2=merge_3, Data3=merge_4, Data4=merge_5, Data5=merge_2, Data6=merge_6, Data7=merge_7)  # -> flatten(Result)

# ----
# rc
# Full multiplicity knots at start
# Simple knots
# Full multiplicity knots at end
# P1
# A=0.2*P1+ 0.8*P2
# D=0.2*A + 0.8*B
# P2
# B=0.47*P2 + 0.53*P3
# Full multiplicity knots at start
# E=0.7*B + 0.3*C
# P3
# Full multiplicity knots in the middle
# C=0.8*P3 + 0.2*P4
# P4
# Full multiplicity knots at end
# Compare knot spacing
brep_join = BrepJoin(Breps=merge_8)  # -> Breps, Closed
