# Grasshopper definition Sets162boffTheCuff.gh (Grasshopper 1.0.7)
# Copyright: Wickerson Studios
# plug-ins: HoopSnake, Bifocals, LunchBox

# 1001 GRASSHOPPER DEFINITIONS
# Wickerson Studio
# 
# created by: Michael Wickerson
# 
# Grasshopper for Rhino 3D Algorithmic Modeling
# 
# www.wickersonstudios.com
# www.michaelwickerson.com
# https://www.youtube.com/channel/UC7J48Ppcsa6oncp6d29R0xw
# https://github.com/mwickerson
# https://www.facebook.com/michael.wickerson
# https://www.linkedin.com/in/michael-wickerson-696a80156/
# https://www.grasshopper3d.com/profile/MichaelWickerson
image_sampler = ImageSampler(
    FilePath="C:\Users\Sculpture\Documents\2020Grasshopper\ScreenShots2019\Screenshots2020\SurfaceEditAlgorithm.PNG",
    Filter="Value",
    Interpolate=False,
    Umax=1,
    Umin=0,
    Vmax=1,
    Vmin=0,
    Wrap=1)  # disabled
# Tutorials 162/1001 OFF THE CUFF
# Wickerson Studio
# created by: Michael Wickerson
# Grasshopper for Rhino 3D Algorithmic Modeling
# www.wickersonstudios.com
# www.michaelwickerson.com
# https://www.youtube.com/channel/UC7J48Ppcsa6oncp6d29R0xw
# https://github.com/mwickerson
# https://www.facebook.com/michael.wickerson
# https://www.linkedin.com/in/michael-wickerson-696a80156/
# https://www.grasshopper3d.com/profile/MichaelWickerson
number_slider = Slider(12, range=0..20)
# Params Geometry 001/1001
series = Series(Start=0, Step=1, Count=number_slider)
expression = Expression(x=series, Expression="sin(x²)")
expression_2 = Expression(x=series, Expression="cos(x²)")
construct_point = ConstructPoint(XCoordinate=expression, YCoordinate=expression_2, ZCoordinate=0)
list_length = ListLength(List=construct_point)
sort_list = SortList(Keys=construct_point, ValuesValuesA=construct_point)  # -> Keys, ValuesValuesA
panel = Panel(list_length)
nurbs_curve = NurbsCurve(Vertices=construct_point, Degree=3, Periodic=False)  # -> Curve, Length, Domain
nurbs_curve_2 = NurbsCurve(Vertices=sort_list.ValuesValuesA, Degree=3, Periodic=False)  # -> Curve, Length, Domain
unit_z = UnitZ(Factor=Slider(0.78, range=0..1))
negative = Negative(Value=unit_z)
move = Move(Geometry=nurbs_curve.Curve, Motion=unit_z)  # -> Geometry, Transform
move_2 = Move(Geometry=nurbs_curve_2.Curve, Motion=negative)  # -> Geometry, Transform
divide_curve = DivideCurve(Curve=move.Geometry, Count=10, Kinks=False)  # -> Points, Tangents, Parameters
divide_curve_2 = DivideCurve(Curve=move_2.Geometry, Count=10, Kinks=False)  # -> Points, Tangents, Parameters
boolean_toggle = BooleanToggle(True)
hoopsnake = HoopSnake(
    StartingData=Slider(0, range=0..100),
    Data=expression_3,
    TerminationCondition=Slider(9, range=0..100),
    Hoopsnake_Data_autoUpdate=False,
    Hoopsnake_Data_dataLimit=2147483647,
    Hoopsnake_Data_resetCounter=True,
    Hoopsnake_Data_updateView=True)  # -> Feedback, FeedbackHistory, LoopsCounter, IterationsCounter
expression_3 = Expression(x=hoopsnake.Feedback, Expression="x+5")
panel_2 = Panel(hoopsnake.LoopsCounter)
panel_3 = Panel(hoopsnake.Feedback)
panel_4 = Panel(hoopsnake.FeedbackHistory)
panel_5 = Panel(hoopsnake.IterationsCounter)
addition = Addition(A=hoopsnake.Feedback, B="1")
list_item = ListItem(List=divide_curve_2.Points, Index=addition, Wrap=True)
list_item_2 = ListItem(List=divide_curve.Points, Index=hoopsnake.Feedback, Wrap=True)
line = Line(StartPoint=list_item_2, EndPoint=list_item)
revolution = Revolution(Curve=move.Geometry, Axis=line, Domain=Domain(0, 6.283185307))
revolution_2 = Revolution(Curve=move_2.Geometry, Axis=line, Domain=Domain(0, 6.283185307))
# rc
# Full multiplicity knots at start
# Simple knots
# Full multiplicity knots at end
# P1
# A=0.2*P1+ 0.8*P2
# D=0.2*A + 0.8*B
# P2
# B=0.47*P2 + 0.53*P3
# Full multiplicity knots at start
# E=0.7*B + 0.3*C
# P3
# Full multiplicity knots in the middle
# C=0.8*P3 + 0.2*P4
# P4
# Full multiplicity knots at end
# Compare knot spacing
object_bake = ObjectBake(
    BakeToggle=boolean_toggle,
    GeometryObjects=revolution_2,
    Layer="GH_Bake",
    ObjectName="GH_Obj",
    ObjectColor=RGB(255, 255, 255),
    LayerColor=RGB(255, 255, 255))
object_bake_2 = ObjectBake(
    BakeToggle=boolean_toggle,
    GeometryObjects=revolution,
    Layer="GH_Bake",
    ObjectName="GH_Obj",
    ObjectColor=RGB(255, 255, 255),
    LayerColor=RGB(255, 255, 255))
