# Grasshopper definition Sets163offTheCuff.gh (Grasshopper 1.0.7)
# Copyright: Wickerson Studios
# plug-ins: Bifocals

# 1001 GRASSHOPPER DEFINITIONS
# Wickerson Studio
# 
# created by: Michael Wickerson
# 
# Grasshopper for Rhino 3D Algorithmic Modeling
# 
# www.wickersonstudios.com
# www.michaelwickerson.com
# https://www.youtube.com/channel/UC7J48Ppcsa6oncp6d29R0xw
# https://github.com/mwickerson
# https://www.facebook.com/michael.wickerson
# https://www.linkedin.com/in/michael-wickerson-696a80156/
# https://www.grasshopper3d.com/profile/MichaelWickerson
image_sampler = ImageSampler(
    FilePath="C:\Users\Sculpture\Documents\2020Grasshopper\ScreenShots2019\Screenshots2020\SurfaceEditAlgorithm.PNG",
    Filter="Value",
    Interpolate=False,
    Umax=1,
    Umin=0,
    Vmax=1,
    Vmin=0,
    Wrap=1)  # disabled
similarity = Similarity(Threshold=0.1)  # -> Similarity, AbsoluteDifference
larger_than = LargerThan(SecondNumber=0)  # -> LargerThan, OrEqualTo
equality = Equality()  # -> Equality, Inequality
smaller_than = SmallerThan(SecondNumber=0)  # -> SmallerThan, OrEqualTo
# Tutorials 163/1001 OFF THE CUFF
# Wickerson Studio
# created by: Michael Wickerson
# Grasshopper for Rhino 3D Algorithmic Modeling
# www.wickersonstudios.com
# www.michaelwickerson.com
# https://www.youtube.com/channel/UC7J48Ppcsa6oncp6d29R0xw
# https://github.com/mwickerson
# https://www.facebook.com/michael.wickerson
# https://www.linkedin.com/in/michael-wickerson-696a80156/
# https://www.grasshopper3d.com/profile/MichaelWickerson
number_slider = Slider(12, range=0..100)
# Params Geometry
construct_domain = ConstructDomain(DomainStart=0, DomainEnd=number_slider)
gate_xor = GateXor()
gate_and = GateAnd()
number_slider_2 = Slider(7.29, range=0..10)
gate_not = GateNot()
gate_or = GateOr()
range = Range(Domain=construct_domain, Steps=10)
sine = Sine(Value=range)
cosine = Cosine(Value=range)
gate_nor = GateNor()
gate_nand = GateNand()
gate_xnor = GateXnor()
gate_majority = GateMajority()
multiplication = Multiplication(A=sine, B=number_slider_2)
multiplication_2 = Multiplication(A=cosine, B=number_slider_2)
construct_point = ConstructPoint(XCoordinate=range, YCoordinate=multiplication, ZCoordinate=multiplication_2)
construct_point_2 = ConstructPoint(XCoordinate=range, YCoordinate=cosine, ZCoordinate=sine)
yz_plane = YZPlane(Origin=Point(0, 0, 0))
interpolate = Interpolate(Vertices=construct_point, Degree=3, Periodic=False, KnotStyle=1)  # -> Curve, Length, Domain
curve_closest_point = CurveClosestPoint(Point=construct_point, Curve=reparameterize(interpolate.Curve))  # -> Point, Parameter, Distance
interpolate_2 = Interpolate(Vertices=construct_point_2, Degree=3, Periodic=False, KnotStyle=1)  # -> Curve, Length, Domain
curve_closest_point_2 = CurveClosestPoint(Point=construct_point_2, Curve=reparameterize(interpolate_2.Curve))  # -> Point, Parameter, Distance
line = Line(StartPoint=curve_closest_point.Point, EndPoint=curve_closest_point_2.Point)
line_2 = Line(line)

curve = Curve(interpolate.Curve)
curve_2 = Curve(interpolate_2.Curve)

number_slider_3 = Slider(2, range=0..10)
polar_array = PolarArray(Geometry=curve, Plane=yz_plane, Count=number_slider_3, Angle=6.283185307)  # -> Geometry, Transform
polar_array_2 = PolarArray(Geometry=curve_2, Plane=yz_plane, Count=number_slider_3, Angle=6.283185307)  # -> Geometry, Transform

curve_3 = Curve(polar_array.Geometry)
curve_4 = Curve(polar_array_2.Geometry)

loft = Loft(Curves=line_2, Options={Adjust=False, Closed=False, LoftEnds=0, LoftSimp=0, LoftType=0, Rebuild=10, Refit=0.01})
loft_2 = Loft(
    Curves=[curve, curve_2],
    Options={Adjust=False, Closed=False, LoftEnds=0, LoftSimp=0, LoftType=0, Rebuild=10, Refit=0.01})
loft_3 = Loft(
    Curves=[curve_3, curve_4],
    Options={Adjust=False, Closed=False, LoftEnds=0, LoftSimp=0, LoftType=0, Rebuild=10, Refit=0.01})
md_slider = MDSlider(SliderMode=0, slider_value=Point(0.5, 0.5, 0.5), x_domain=Domain(0, 1), y_domain=Domain(0, 1), z_domain=Domain(0, 1))
md_slider_2 = MDSlider(
    SliderMode=0,
    slider_value=Point(0.7418644603, 0.8737919505, 0.5),
    x_domain=Domain(0, 1),
    y_domain=Domain(0, 1),
    z_domain=Domain(0, 1))
evaluate_surface = EvaluateSurface(Surface=reparameterize(loft_2), Point=md_slider)  # -> Point, Normal, UDirection, VDirection, Frame
evaluate_surface_2 = EvaluateSurface(Surface=reparameterize(loft), Point=md_slider_2)  # -> Point, Normal, UDirection, VDirection, Frame
point = Point(evaluate_surface.Point)
point_2 = Point(evaluate_surface_2.Point)
vector_display = VectorDisplay(Anchor=point, Vector=evaluate_surface.Normal)
vector_display_2 = VectorDisplay(Anchor=point, Vector=evaluate_surface.UDirection)
vector_display_3 = VectorDisplay(Anchor=point, Vector=evaluate_surface.VDirection)
vector_display_4 = VectorDisplay(Anchor=point_2, Vector=evaluate_surface_2.Normal)
vector_display_5 = VectorDisplay(Anchor=point_2, Vector=evaluate_surface_2.UDirection)
vector_display_6 = VectorDisplay(Anchor=point_2, Vector=evaluate_surface_2.VDirection)
plane = Plane(evaluate_surface.Frame)
# rc
# Full multiplicity knots at start
# Simple knots
# Full multiplicity knots at end
# P1
# A=0.2*P1+ 0.8*P2
# D=0.2*A + 0.8*B
# P2
# B=0.47*P2 + 0.53*P3
# Full multiplicity knots at start
# E=0.7*B + 0.3*C
# P3
# Full multiplicity knots in the middle
# C=0.8*P3 + 0.2*P4
# P4
# Full multiplicity knots at end
# Compare knot spacing
plane_2 = Plane(evaluate_surface_2.Frame)
