# Grasshopper definition Sets164offTheCuff.gh (Grasshopper 1.0.7)
# Copyright: Wickerson Studios
# plug-ins: Bifocals

# 1001 GRASSHOPPER DEFINITIONS
# Wickerson Studio
# 
# created by: Michael Wickerson
# 
# Grasshopper for Rhino 3D Algorithmic Modeling
# 
# www.wickersonstudios.com
# www.michaelwickerson.com
# https://www.youtube.com/channel/UC7J48Ppcsa6oncp6d29R0xw
# https://github.com/mwickerson
# https://www.facebook.com/michael.wickerson
# https://www.linkedin.com/in/michael-wickerson-696a80156/
# https://www.grasshopper3d.com/profile/MichaelWickerson
# Wickerson Studio
# created by: Michael Wickerson
# Grasshopper for Rhino 3D Algorithmic Modeling
# www.wickersonstudios.com
# www.michaelwickerson.com
# https://www.youtube.com/channel/UC7J48Ppcsa6oncp6d29R0xw
# https://github.com/mwickerson
# https://www.facebook.com/michael.wickerson
# https://www.linkedin.com/in/michael-wickerson-696a80156/
# https://www.grasshopper3d.com/profile/MichaelWickerson
image_sampler = ImageSampler(
    FilePath="C:\Users\Sculpture\Documents\2020Grasshopper\ScreenShots2019\Screenshots2020\SurfaceEditAlgorithm.PNG",
    Filter="Value",
    Interpolate=False,
    Umax=1,
    Umin=0,
    Vmax=1,
    Vmin=0,
    Wrap=1)  # disabled
# Tutorials 164/1001 OFF THE CUFF
# GATES
number_slider = Slider(3, range=0..10)
construct_domain = ConstructDomain(DomainStart=0, DomainEnd=number_slider)
range = Range(Domain=construct_domain, Steps=Slider(100, range=0..100))
graph_mapper = GraphMapper(
    range,
    x0=0,
    x1=1,
    y0=0,
    y1=1,
    container_name="Sine",
    Equation_px=[0, 0.3591308594],
    Equation_py=[0.04070955515, 0.9826084971])
multiplication = Multiplication(A=Slider(2, range=0..10), B=graph_mapper)
construct_point = ConstructPoint(XCoordinate=range, YCoordinate=0, ZCoordinate=multiplication)
interpolate = Interpolate(Vertices=construct_point, Degree=3, Periodic=False, KnotStyle=1)  # -> Curve, Length, Domain
end_points = EndPoints(Curve=interpolate.Curve)  # -> Start, End
line = Line(StartPoint=end_points.Start, EndPoint=end_points.End)
divide_curve = DivideCurve(Curve=line, Count=10, Kinks=False)  # -> Points, Tangents, Parameters
deconstruct = Deconstruct(Point=divide_curve.Points)  # -> XComponent, YComponent, ZComponent
deconstruct_2 = Deconstruct(Point=construct_point)  # -> XComponent, YComponent, ZComponent
smaller_than = SmallerThan(FirstNumber=construct_point, SecondNumber=deconstruct.ZComponent)  # -> SmallerThan, OrEqualTo
larger_than = LargerThan(FirstNumber=construct_point, SecondNumber=deconstruct.ZComponent)  # -> LargerThan, OrEqualTo
cull_pattern = CullPattern(List=deconstruct_2.ZComponent, CullPattern=smaller_than.SmallerThan)
cull_pattern_2 = CullPattern(List=deconstruct_2.ZComponent, CullPattern=larger_than.LargerThan)
panel = Panel(smaller_than.SmallerThan)
multiplication_2 = Multiplication(A=deconstruct_2.ZComponent, B=cull_pattern)
multiplication_3 = Multiplication(A=deconstruct_2.ZComponent, B=cull_pattern_2)
construct_point_2 = ConstructPoint(XCoordinate=deconstruct_2.XComponent, YCoordinate=deconstruct_2.YComponent, ZCoordinate=multiplication_2)
construct_point_3 = ConstructPoint(XCoordinate=deconstruct_2.XComponent, YCoordinate=deconstruct_2.YComponent, ZCoordinate=multiplication_3)
interpolate_2 = Interpolate(Vertices=construct_point_3, Degree=3, Periodic=False, KnotStyle=1)  # -> Curve, Length, Domain
interpolate_3 = Interpolate(Vertices=construct_point_2, Degree=3, Periodic=False, KnotStyle=1)  # -> Curve, Length, Domain
construct_domain_2 = ConstructDomain(DomainStart=0, DomainEnd=Slider(0.9, range=0..1))
sub_curve = SubCurve(BaseCurve=reparameterize([interpolate_2.Curve, interpolate_3.Curve]), Domain=construct_domain_2)
boundary_surfaces = BoundarySurfaces(Edges=[interpolate_2.Curve, interpolate_3.Curve])
unit_y = UnitY(Factor=Slider(-0.2, range=-0.3..0.7))
cylinder = Cylinder(Base=PlaneXY(0, 0, 0), Radius=Slider(5.714, range=0..10), Length=1)
extrude = Extrude(Base=boundary_surfaces, Direction=unit_y)
deconstruct_brep = DeconstructBrep(Brep=cylinder)  # -> Faces, Edges, Vertices
pipe = Pipe(Curve=sub_curve, Radius=Slider(0.068, range=0..0.1), Caps=0)
list_item = ListItem(List=deconstruct_brep.Edges, Index=0, Wrap=True)
# rc
# Full multiplicity knots at start
# Simple knots
# Full multiplicity knots at end
# P1
# A=0.2*P1+ 0.8*P2
# D=0.2*A + 0.8*B
# P2
# B=0.47*P2 + 0.53*P3
# Full multiplicity knots at start
# E=0.7*B + 0.3*C
# P3
# Full multiplicity knots in the middle
# C=0.8*P3 + 0.2*P4
# P4
# Full multiplicity knots at end
# Compare knot spacing
flow = Flow(Geometry=[extrude, pipe], Base=line, Target=list_item, ReverseBase=False, ReverseTarget=False, Stretch=True, Rigid=False)
