# Grasshopper definition Sets167DODO.gh (Grasshopper 1.0.7)
# Copyright: bernhard muller bijoutiers
# plug-ins: Dodo

# Input
# Parameter
boolean_toggle = BooleanToggle(False)
series = Series(Start=0, Step=1, Count=10)
square = Square(Plane=PlaneXY(0, 0, 0), Size=1, ExtentX=5, ExtentY=5)  # -> Cells, Points
dancing_banana = DancingBanana(Sing=boolean_toggle)
run_executable = RunExecutable(Run=False, ExitCode=False)
group_numbers = GroupNumbers(Number=Slider(6, range=0..10))  # -> Keys, Indices
sort_curves = SortCurves()  # -> Curves, Order
series_from_list = SeriesFromList(List=series, Start=0, Step=1)
generate_graph = GenerateGraph(Curves=square.Cells)  # -> DodoGraph, Connections, NakedNodes
unsupervised_training_nn = UnsupervisedTrainingNN()
supervised_training_nn = SupervisedTrainingNN()
run_neural_network = RunNeuralNetwork()  # -> Data, Weights, Threshold
# grasshopper tools for jewelers
# by Ralph Schroetter and Bernhard Muller
# WebSite: http://ara-jewelry-studio.com
# Email: arajewelrystudiocom@gmail.com
# Grasshopper
# Process
panel = Panel(dancing_banana)
sgd_optimization = SGDOptimization()
nl_optimization = NLOptimization()
swarm_optimization = SwarmOptimization()
# Input
# Input
# Grasshopper
# Grasshopper
# Output
# Output
# Process
# Process
# Parameter
# Parameter
panel_2 = Panel(group_numbers.Keys)
panel_3 = Panel(group_numbers.Indices)
# Input
# Grasshopper
# Output
# Output
# Process
# Parameter
panel_4 = Panel(generate_graph.NakedNodes)
