# Grasshopper definition Sets168cDODO.gh (Grasshopper 1.0.7)
# plug-ins: Kangaroo Components, Dodo, Bifocals

barth_sextic = Panel("4*(1.61803^2*x^2-y^2)*(1.61803^2*y^2-z^2)*(1.61803^2*z^2-x^2)-(1+2*1.61803)*(x^2+y^2+z^2-30^2)^2 * 30^2")
torus = Panel("(sqrt(x*x+z*z)-20)*(sqrt(x*x+z*z)-20) + y*y - 80")
clebsch_cubic = Panel("81*(x^3 + y^3 + z^3) - 189*(x^2*y + x^2*z + y^2*x + y^2*z + z^2*x + z^2*y) + 54*(x*y*z) + 126*(x*y + x*z + y*z) - 9*(x^2 + y^2 + z^2) - 9*(x + y + z) + 1")
box = Box({Plane=PlaneXY(0, 0, 0), X=Domain(-99.86438434, 99.80018982), Y=Domain(-98.53806098, 103.9182039), Z=Domain(-96.48672907, 99.38063158)})
cylinder = Panel("0.0000003 * (x*x + y*y)")
pop3d = Populate3D(Region=box, Count=100, Seed=1)
lng = ListLength(List=pop3d)
random = Random(Range=Domain(-1, 1), Number=lng, Seed=2)
pcharge = PointCharge(Point=pop3d, Charge=random, Decay=2)
mergef = MergeFields(Fields=pcharge)
voxels = Voxels(Box=box, Number=Slider(20, range=0..100), F=mergef)
voxels_2 = Voxels(Box=box, Number=Slider(20, range=0..100), F=mergef)
voxels_3 = Voxels(Box=box, Number=Slider(10, range=0..100), F=mergef)
number_slider = Slider(2013, range=0..10000)
nickname = MarchingTetrahedra(Voxels=voxels_3, Isolevel=Slider(0.00165, range=0..0.01), TetrahedraCubes=Toggle(False))
nickname_2 = MarchingTetrahedra(Voxels=voxels_2, Isolevel=Slider(0.0038, range=0..0.01), TetrahedraCubes=True)
nickname_3 = MarchingTetrahedra(Voxels=voxels, Isolevel=Slider(0.00148, range=0..0.01), TetrahedraCubes=True)
cluster = Cluster(M=nickname_2)
cluster_2 = Cluster(M=nickname_3)
cluster_3 = Cluster(M=nickname)

# ----
# Let's sum the cyilinder field to the point field
voxels_4 = Voxels(Box=box, Number=Slider(40, range=0..100), F=mergef)
nickname_4 = MarchingTetrahedra(Voxels=voxels_4, Isolevel=Slider(0.00178, range=0..0.01), TetrahedraCubes=Toggle(False))

disjoint = DisjointMesh(Mesh=nickname_4)
clean = CombineClean(Meshes=graft(disjoint))  # -> flatten(Mesh)

cluster_4 = Cluster(M=clean)

# ==== cluster Cluster
M = ClusterInput()
demesh = DeconstructMesh(Mesh=M)  # -> Vertices, Faces, Colours, Normals
vlen = VectorLength(Vector=demesh.Vertices)
bnd = Bounds(Numbers=vlen)
dedomain = DeconstructDomain(Domain=bnd)  # -> Start, End
gradient = Gradient(
    LowerLimit=0,
    UpperLimit=dedomain.End,
    Parameter=vlen,
    stops=[0: RGB(243, 57, 0), 0.1: RGB(236, 27, 60), 0.2: RGB(210, 0, 118), 0.3: RGB(103, 0, 120), 0.4: RGB(39, 72, 161), 0.5: RGB(1, 192, 229), 0.6: RGB(18, 178, 90), 0.7: RGB(79, 186, 8), 0.8: RGB(220, 237, 32), 0.9: RGB(247, 159, 20), 1: RGB(243, 57, 0)])
conmesh = ConstructMesh(Vertices=demesh.Vertices, Faces=demesh.Faces, Colours=gradient)
