# Grasshopper definition SetsDataTrees117(118).gh (Grasshopper 1.0.7)
# Copyright: Wickerson Studios
# plug-ins: Bifocals

# 1001 GRASSHOPPER DEFINITIONS
# Wickerson Studio
# 
# created by: Michael Wickerson
# 
# Grasshopper for Rhino 3D Algorithmic Modeling
# 
# www.wickersonstudios.com
# www.michaelwickerson.com
# https://www.youtube.com/channel/UC7J48Ppcsa6oncp6d29R0xw
# https://github.com/mwickerson
# https://www.facebook.com/michael.wickerson
# https://www.linkedin.com/in/michael-wickerson-696a80156/
# https://www.grasshopper3d.com/profile/MichaelWickerson
image_sampler = ImageSampler(
    FilePath="C:\Users\Sculpture\Documents\2020Grasshopper\ScreenShots2019\Screenshots2020\SurfaceEditAlgorithm.PNG",
    Filter="Value",
    Interpolate=False,
    Umax=1,
    Umin=0,
    Vmax=1,
    Vmin=0,
    Wrap=1)

number_slider = Slider(4, range=0..20)
# SETS PATHMAPPER 117/1001 NODE: VISUALIZING DATA TREES
# Wickerson Studio
# created by: Michael Wickerson
# Grasshopper for Rhino 3D Algorithmic Modeling
# www.wickersonstudios.com
# www.michaelwickerson.com
# https://www.youtube.com/channel/UC7J48Ppcsa6oncp6d29R0xw
# https://github.com/mwickerson
# https://www.facebook.com/michael.wickerson
# https://www.linkedin.com/in/michael-wickerson-696a80156/
# https://www.grasshopper3d.com/profile/MichaelWickerson
number_slider_2 = Slider(4, range=0..10)
square = Square(Plane=PlaneXY(0, 0, 0), Size=number_slider_2, ExtentX=number_slider, ExtentY=number_slider)  # -> Cells, simplify(Points)
point = Point(square.Points)
param_viewer = ParamViewer(square.Points)
path_mapper = PathMapper(point, source="{A}(i)", target="{A/path_count*i}(i)")
point_2 = Point(path_mapper)
param_viewer_2 = ParamViewer(path_mapper)
path_mapper_2 = PathMapper(point_2, source="{A}(i)", target="{A}(i/item_count*i)")
point_3 = Point(path_mapper_2)
param_viewer_3 = ParamViewer(point_3)
division = Division(A=number_slider, B=Slider(2, range=0..10))
clean_tree = CleanTree(RemoveNulls=True, RemoveInvalid=True, RemoveEmpty=False, Tree=point_3)
construct_domain = ConstructDomain(DomainStart=division, DomainEnd=number_slider)
list_length = ListLength(List=clean_tree)
param_viewer_4 = ParamViewer(clean_tree)
range = Range(Domain=construct_domain, Steps=expr("x-1", list_length))
unit_z = UnitZ(Factor=range)
jitter = Jitter(List=unit_z, Jitter=Slider(0.38, range=0..1), Seed=2)  # -> Values, Indices
range_2 = Range(Domain=Domain(0, 1), Steps=10)
move = Move(Geometry=clean_tree, Motion=jitter.Values)  # -> Geometry, Transform
graph_mapper = GraphMapper(
    range_2,
    x0=0,
    x1=1,
    y0=0,
    y1=1,
    Ox=0.5571112037,
    Oy=0.1653919816,
    Px=0.727615118,
    Py=0.1858529449,
    container_name="Parabola")
line = Line(StartPoint=clean_tree, EndPoint=move.Geometry)
end_points = EndPoints(Curve=line)  # -> Start, End
pipe_variable = PipeVariable(Curve=reparameterize(line), Parameters=range_2, Radii=graph_mapper, Caps=0)

point_4 = Point(end_points.End)

division_2 = Division(A=number_slider_2, B=Slider(2, range=0..10))
unit_x = UnitX(Factor=division_2)
vector_xyz = VectorXYZ(XComponent=unit_x, YComponent=0, ZComponent=unit_x)  # -> Vector, Length
construct_domain_2 = ConstructDomain(DomainStart=Slider(3, range=0..10), DomainEnd=Slider(30, range=0..30))
range_3 = Range(Domain=construct_domain_2, Steps=10)  # -> graft(Range)
division_3 = Division(A=vector_xyz.Vector, B=number_slider_2)
move_2 = Move(Geometry=point_4, Motion=division_3)  # -> Geometry, Transform
move_3 = Move(Geometry=point_4, Motion=unit_x)  # -> Geometry, Transform
integer = Integer(range_3)
jitter_2 = Jitter(List=integer, Jitter=1, Seed=2)  # -> simplify(Values), Indices
range_4 = Range(Domain=Domain(0, 1), Steps=10)
polar_array = PolarArray(Geometry=move_3.Geometry, Plane=point_4, Count=jitter_2.Values, Angle=6.283185307)  # -> simplify(Geometry), Transform
polar_array_2 = PolarArray(Geometry=move_2.Geometry, Plane=point_4, Count=jitter_2.Values, Angle=6.283185307)  # -> Geometry, Transform
point_5 = Point(graft(point_4))
graph_mapper_2 = GraphMapper(
    range_4,
    x0=0,
    x1=1,
    y0=0,
    y1=1,
    Ox=0.5354782343,
    Oy=0.1419996023,
    Px=0.8244805932,
    Py=0.1880723238,
    container_name="Parabola")
param_viewer_5 = ParamViewer(polar_array_2.Geometry)
param_viewer_6 = ParamViewer(polar_array.Geometry)
arc_3pt = Arc3Pt(PointA=point_5, PointB=polar_array_2.Geometry, PointC=polar_array.Geometry)  # -> Arc, Plane, Radius
pipe_variable_2 = PipeVariable(Curve=reparameterize(arc_3pt.Arc), Parameters=range_4, Radii=graph_mapper_2, Caps=2)  # -> simplify(Pipe)
param_viewer_7 = ParamViewer(pipe_variable_2)
end_points_2 = EndPoints(Curve=arc_3pt.Arc)  # -> Start, End

# ----
# Skeleton Mesh
mesh = Mesh(<mesh referenced from the Rhino model>)

point_6 = Point(simplify(end_points_2.End))

path_mapper_3 = PathMapper(point_6, source="{A;B}(i)", target="{A;B}(i)")
param_viewer_8 = ParamViewer(point_6)
split_tree = SplitTree(Data=path_mapper_3, Masks=flatten("{0,2,...;1,3,...}[1,3,...]"))  # -> Positive, Negative
point_7 = Point(split_tree.Positive)
construct_domain_3 = ConstructDomain(DomainStart=Slider(0.5, range=0..1), DomainEnd=Slider(0.61, range=0..1))
construct_domain_4 = ConstructDomain(DomainStart=Slider(0, range=0..10), DomainEnd=Slider(2, range=0..10))
clean_tree_2 = CleanTree(RemoveNulls=True, RemoveInvalid=True, RemoveEmpty=Slider(1, range=0..1), Tree=point_7)
list_length_2 = ListLength(List=clean_tree_2)
# rs
construct_point = ConstructPoint(XCoordinate=0, YCoordinate=0, ZCoordinate=0)
range_5 = Range(Domain=construct_domain_3, Steps=expr("x-1", list_length_2))
range_6 = Range(Domain=construct_domain_4, Steps=expr("x-1", list_length_2))
scale = Scale(Geometry=mesh, Center=construct_point, Factor=range_5)  # -> Geometry, Transform
# GH solution
# VB
# C#
# Python with RhinoCommon Only
# Pythong with RhinoScriptSyntax
# GH solution
# VB
# C#
# Python
# VB
pi = Pi(Factor=range_6)
rotate_3d = Rotate3D(Geometry=scale.Geometry, Angle=pi, Center=construct_point, Axis=Vector(0, 0, 1))  # -> Geometry, Transform
jitter_3 = Jitter(List=rotate_3d.Geometry, Jitter=Slider(1, range=0..1), Seed=2)  # -> Values, Indices

# ----
# rc
# Full multiplicity knots at start
# Simple knots
# Full multiplicity knots at end
# P1
# A=0.2*P1+ 0.8*P2
# D=0.2*A + 0.8*B
# P2
# B=0.47*P2 + 0.53*P3
# Full multiplicity knots at start
# E=0.7*B + 0.3*C
# P3
# Full multiplicity knots in the middle
# C=0.8*P3 + 0.2*P4
# P4
# Full multiplicity knots at end
# Compare knot spacing
orient = Orient(Geometry=jitter_3.Values, Source=construct_point, Target=clean_tree_2)  # -> Geometry, Transform
