# Grasshopper definition Vectors115b.gh (Grasshopper 1.0.7)
# Copyright: Wickerson Studios
# plug-ins: Bifocals

# 1001 GRASSHOPPER DEFINITIONS
# Wickerson Studio
# 
# created by: Michael Wickerson
# 
# Grasshopper for Rhino 3D Algorithmic Modeling
# 
# www.wickersonstudios.com
# www.michaelwickerson.com
# https://www.youtube.com/channel/UC7J48Ppcsa6oncp6d29R0xw
# https://github.com/mwickerson
# https://www.facebook.com/michael.wickerson
# https://www.linkedin.com/in/michael-wickerson-696a80156/
# https://www.grasshopper3d.com/profile/MichaelWickerson
image_sampler = ImageSampler(
    FilePath="C:\Users\Sculpture\Documents\2020Grasshopper\ScreenShots2019\Screenshots2020\SurfaceEditAlgorithm.PNG",
    Filter="Value",
    Interpolate=False,
    Umax=1,
    Umin=0,
    Vmax=1,
    Vmin=0,
    Wrap=1)

# ----
# VECTOR POINT 115/1001 NODE: Points
# Wickerson Studio
# created by: Michael Wickerson
# Grasshopper for Rhino 3D Algorithmic Modeling
# www.wickersonstudios.com
# www.michaelwickerson.com
# https://www.youtube.com/channel/UC7J48Ppcsa6oncp6d29R0xw
# https://github.com/mwickerson
# https://www.facebook.com/michael.wickerson
# https://www.linkedin.com/in/michael-wickerson-696a80156/
# https://www.grasshopper3d.com/profile/MichaelWickerson
number_slider = Slider(10, range=0..10)
construct_domain = ConstructDomain(DomainStart=0, DomainEnd=number_slider)
steps = Steps(2)
panel = Panel(steps)
range = Range(Domain=construct_domain, Steps=steps)
mask = Mask(11)
mask_2 = Mask(6)
mask_3 = Mask(1)
panel_2 = Panel(range)
panel_3 = Panel(mask_3)
panel_4 = Panel(mask_2)
panel_5 = Panel(mask)
numbers_to_points = NumbersToPoints(Numbers=panel_2, Mask=panel_3)
numbers_to_points_2 = NumbersToPoints(Numbers=panel_2, Mask=panel_4)
numbers_to_points_3 = NumbersToPoints(Numbers=panel_2, Mask=panel_5)
merge = Merge(Data1=numbers_to_points, Data2=numbers_to_points_2, Data3=numbers_to_points_3)
path_mapper = PathMapper(merge, source="{A;B;C}(i)", target="{A;B;C}(i)")
panel_6 = Panel(merge)
param_viewer = ParamViewer(path_mapper)
split_tree = SplitTree(Data=path_mapper, Masks=flatten("{0;0;0}[1,4,7,...]"))  # -> Positive, Negative
split_tree_2 = SplitTree(Data=path_mapper, Masks=flatten("{0;0;0}[2,5,8,...]"))  # -> Positive, Negative
clean_tree = CleanTree(RemoveNulls=True, RemoveInvalid=True, RemoveEmpty=False, Tree=split_tree.Positive)
clean_tree_2 = CleanTree(RemoveNulls=True, RemoveInvalid=True, RemoveEmpty=False, Tree=split_tree_2.Positive)
line = Line(StartPoint=graft(clean_tree), EndPoint=clean_tree_2)  # -> simplify(Line)
shift_list = ShiftList(List=clean_tree_2, Shift=Slider(1, range=0..2), Wrap=True)
direction = Direction(Vector(0, 13, 15))
pipe = Pipe(Curve=line, Radius=Slider(4, range=0..4), Caps=2)
amplitude = Amplitude(Vector=direction, Amplitude=Slider(-0.833, range=-10..11))
linear_array = LinearArray(Geometry=pipe, Direction=amplitude, Count=Slider(3, range=0..10))  # -> Geometry, Transform
orient = Orient(Geometry=linear_array.Geometry, Source=clean_tree_2, Target=shift_list)  # -> Geometry, Transform
param_viewer_2 = ParamViewer(orient.Geometry)
polar_array = PolarArray(Geometry=orient.Geometry, Plane=PlaneXY(0, 0, 0), Count=Slider(7, range=0..10), Angle=6.283185307)  # -> Geometry, Transform
# rs
param_viewer_3 = ParamViewer(polar_array.Geometry)
# rc
# Full multiplicity knots at start
# Simple knots
# Full multiplicity knots at end
# P1
# A=0.2*P1+ 0.8*P2
# D=0.2*A + 0.8*B
# P2
# B=0.47*P2 + 0.53*P3
# Full multiplicity knots at start
# E=0.7*B + 0.3*C
# P3
# Full multiplicity knots in the middle
# C=0.8*P3 + 0.2*P4
# P4
# Full multiplicity knots at end
# Compare knot spacing
# GH solution
# VB
# C#
# Python with RhinoCommon Only
# Pythong with RhinoScriptSyntax
# GH solution
# VB
# C#
# Python
# VB
param_viewer_4 = ParamViewer(polar_array.Geometry)
