# Grasshopper definition Vectors116.gh (Grasshopper 1.0.7)
# Copyright: Wickerson Studios
# plug-ins: Bifocals

# Wickerson Studio
# 
# created by: Michael Wickerson
# 
# Grasshopper for Rhino 3D Algorithmic Modeling
# 
# www.wickersonstudios.com
# www.michaelwickerson.com
# https://www.youtube.com/channel/UC7J48Ppcsa6oncp6d29R0xw
# https://github.com/mwickerson
# https://www.facebook.com/michael.wickerson
# https://www.linkedin.com/in/michael-wickerson-696a80156/
# https://www.grasshopper3d.com/profile/MichaelWickerson
image_sampler = ImageSampler(
    FilePath="C:\Users\Sculpture\Documents\2020Grasshopper\ScreenShots2019\Screenshots2020\SurfaceEditAlgorithm.PNG",
    Filter="Value",
    Interpolate=False,
    Umax=1,
    Umin=0,
    Vmax=1,
    Vmin=0,
    Wrap=1)

# ----
# VECTOR POINT 116/1001 NODE: Barycentric
# Wickerson Studio
# created by: Michael Wickerson
# Grasshopper for Rhino 3D Algorithmic Modeling
# www.wickersonstudios.com
# www.michaelwickerson.com
# https://www.youtube.com/channel/UC7J48Ppcsa6oncp6d29R0xw
# https://github.com/mwickerson
# https://www.facebook.com/michael.wickerson
# https://www.linkedin.com/in/michael-wickerson-696a80156/
# https://www.grasshopper3d.com/profile/MichaelWickerson
number_slider = Slider(3, range=0..10)
md_slider = MDSlider(
    SliderMode=0,
    slider_value=Point(0.3258078971, 0.3933246892, 0.5),
    x_domain=Domain(0, 1),
    y_domain=Domain(0, 1),
    z_domain=Domain(0, 1))
md_slider_2 = MDSlider(
    SliderMode=0,
    slider_value=Point(0.5915184951, 0.6316059392, 0.5),
    x_domain=Domain(0, 1),
    y_domain=Domain(0, 1),
    z_domain=Domain(0, 1))
md_slider_3 = MDSlider(
    SliderMode=0,
    slider_value=Point(0.8109294612, 0.8822870022, 0.5),
    x_domain=Domain(0, 1),
    y_domain=Domain(0, 1),
    z_domain=Domain(0, 1))
# 1001 GRASSHOPPER DEFINITIONS
cylinder = Cylinder(Base=PlaneXY(0, 0, 0), Radius=0.5, Length=1)
evaluate_surface = EvaluateSurface(Surface=reparameterize(cylinder), Point=md_slider_2)  # -> Point, Normal, UDirection, VDirection, Frame
evaluate_surface_2 = EvaluateSurface(Surface=reparameterize(cylinder), Point=md_slider_3)  # -> Point, Normal, UDirection, VDirection, Frame
evaluate_surface_3 = EvaluateSurface(Surface=reparameterize(cylinder), Point=md_slider)  # -> Point, Normal, UDirection, VDirection, Frame
populate_geometry = PopulateGeometry(Geometry=cylinder, Count=number_slider, Seed=1)  # -> flatten(Population)
list_item = ListItem(List=populate_geometry, Index=0, Wrap=True)  # -> Item, Item1, Item2
barycentric = Barycentric(
    PointA=list_item.Item,
    PointB=list_item.Item1,
    PointC=list_item.Item2,
    CoordinateU=[evaluate_surface.UDirection, evaluate_surface.VDirection],
    CoordinateV=[evaluate_surface_2.UDirection, evaluate_surface_2.VDirection],
    CoordinateW=[evaluate_surface_3.UDirection, evaluate_surface_3.VDirection])
vector = Vector([evaluate_surface.Normal, evaluate_surface_2.Normal, evaluate_surface_3.Normal])
panel = Panel(barycentric)
point = Point(barycentric)
amplitude = Amplitude(Vector=vector, Amplitude=Slider(3, range=0..3))
point_2 = Point([evaluate_surface_3.Point, evaluate_surface.Point, evaluate_surface_2.Point])
move = Move(Geometry=point_2, Motion=amplitude)  # -> Geometry, Transform
line = Line(StartPoint=point, EndPoint=[evaluate_surface.Point, evaluate_surface_2.Point, evaluate_surface_3.Point])
end_points = EndPoints(Curve=line)  # -> Start, End
range = Range(Domain=Domain(0, 1), Steps=Slider(2, range=0..10))
arc_3pt = Arc3Pt(PointA=point, PointB=end_points.End, PointC=move.Geometry)  # -> Arc, Plane, Radius
graph_mapper = GraphMapper(
    range,
    x0=0,
    x1=1,
    y0=0,
    y1=1,
    container_name="Sine",
    Equation_px=[0.008824445307, 0.482742101],
    Equation_py=[0.1832779646, 0.6962324381])
# rs
# rc
# Full multiplicity knots at start
# Simple knots
# Full multiplicity knots at end
# P1
# A=0.2*P1+ 0.8*P2
# D=0.2*A + 0.8*B
# P2
# B=0.47*P2 + 0.53*P3
# Full multiplicity knots at start
# E=0.7*B + 0.3*C
# P3
# Full multiplicity knots in the middle
# C=0.8*P3 + 0.2*P4
# P4
# Full multiplicity knots at end
# Compare knot spacing
# GH solution
# VB
# C#
# Python with RhinoCommon Only
# Pythong with RhinoScriptSyntax
# GH solution
# VB
# C#
# Python
# VB
pipe_variable = PipeVariable(Curve=reparameterize(arc_3pt.Arc), Parameters=range, Radii=graph_mapper, Caps=2)
