# Grasshopper definition Vectors116b.gh (Grasshopper 1.0.7)
# Copyright: Wickerson Studios
# plug-ins: Bifocals

image_sampler = ImageSampler(
    FilePath="C:\Users\Sculpture\Documents\2020Grasshopper\ScreenShots2019\Screenshots2020\SurfaceEditAlgorithm.PNG",
    Filter="Value",
    Interpolate=False,
    Umax=1,
    Umin=0,
    Vmax=1,
    Vmin=0,
    Wrap=1)
# Wickerson Studio
# created by: Michael Wickerson
# Grasshopper for Rhino 3D Algorithmic Modeling
# www.wickersonstudios.com
# www.michaelwickerson.com
# https://www.youtube.com/channel/UC7J48Ppcsa6oncp6d29R0xw
# https://github.com/mwickerson
# https://www.facebook.com/michael.wickerson
# https://www.linkedin.com/in/michael-wickerson-696a80156/
# https://www.grasshopper3d.com/profile/MichaelWickerson
cone = Cone(Base=PlaneXY(0, 0, 0), Radius=0.5, Length=1)  # -> Cone, Tip
cylinder = Cylinder(Base=PlaneXY(0, 0, 0), Radius=0.5, Length=1)

# ----
# 1001 GRASSHOPPER DEFINITIONS
# Wickerson Studio
# 
# created by: Michael Wickerson
# 
# Grasshopper for Rhino 3D Algorithmic Modeling
# 
# www.wickersonstudios.com
# www.michaelwickerson.com
# https://www.youtube.com/channel/UC7J48Ppcsa6oncp6d29R0xw
# https://github.com/mwickerson
# https://www.facebook.com/michael.wickerson
# https://www.linkedin.com/in/michael-wickerson-696a80156/
# https://www.grasshopper3d.com/profile/MichaelWickerson
# VECTOR POINT 116/1001 NODE: Barycentric
sphere = Sphere(Base=PlaneXY(0, 0, 0), Radius=1)
md_slider = MDSlider(
    SliderMode=0,
    slider_value=Point(0.9304385302, 0.8689284906, 0.5),
    x_domain=Domain(0, 1),
    y_domain=Domain(0, 1),
    z_domain=Domain(0, 1))
md_slider_2 = MDSlider(
    SliderMode=0,
    slider_value=Point(0.776984238, 0.3318072063, 0.5),
    x_domain=Domain(0, 1),
    y_domain=Domain(0, 1),
    z_domain=Domain(0, 1))
md_slider_3 = MDSlider(
    SliderMode=0,
    slider_value=Point(0.5310267006, 0.6360123797, 0.5),
    x_domain=Domain(0, 1),
    y_domain=Domain(0, 1),
    z_domain=Domain(0, 1))
evaluate_surface = EvaluateSurface(Surface=reparameterize(cylinder), Point=md_slider)  # -> Point, Normal, UDirection, VDirection, Frame
evaluate_surface_2 = EvaluateSurface(Surface=reparameterize(cylinder), Point=md_slider_2)  # -> Point, Normal, UDirection, VDirection, Frame
evaluate_surface_3 = EvaluateSurface(Surface=reparameterize(cylinder), Point=md_slider_3)  # -> Point, Normal, UDirection, VDirection, Frame
barycentric = Barycentric(
    PointA=evaluate_surface.Point,
    PointB=evaluate_surface_2.Point,
    PointC=evaluate_surface_3.Point,
    CoordinateU=[evaluate_surface.UDirection, evaluate_surface.VDirection],
    CoordinateV=[evaluate_surface_2.UDirection, evaluate_surface_2.VDirection],
    CoordinateW=[evaluate_surface_3.UDirection, evaluate_surface_3.VDirection])
vector = Vector([evaluate_surface.Normal, evaluate_surface_2.Normal, evaluate_surface_3.Normal])
point = Point([evaluate_surface_3.Point, evaluate_surface.Point, evaluate_surface_2.Point])
point_2 = Point(barycentric)
amplitude = Amplitude(Vector=vector, Amplitude=Slider(3, range=0..3))
line = Line(StartPoint=point_2, EndPoint=[evaluate_surface.Point, evaluate_surface_2.Point, evaluate_surface_3.Point])
end_points = EndPoints(Curve=line)  # -> Start, End
move = Move(Geometry=point, Motion=amplitude)  # -> Geometry, Transform
panel = Panel(barycentric)
range = Range(Domain=Domain(0, 1), Steps=Slider(2, range=0..10))
arc_3pt = Arc3Pt(PointA=point_2, PointB=end_points.End, PointC=move.Geometry)  # -> Arc, Plane, Radius
# VB
graph_mapper = GraphMapper(
    range,
    x0=0,
    x1=1,
    y0=0,
    y1=1,
    container_name="Sine",
    Equation_px=[0.008824445307, 0.482742101],
    Equation_py=[0.1832779646, 0.6962324381])
# rs
# rc
# Full multiplicity knots at start
# Simple knots
# Full multiplicity knots at end
# P1
# A=0.2*P1+ 0.8*P2
# D=0.2*A + 0.8*B
# P2
# B=0.47*P2 + 0.53*P3
# Full multiplicity knots at start
# E=0.7*B + 0.3*C
# P3
# Full multiplicity knots in the middle
# C=0.8*P3 + 0.2*P4
# P4
# Full multiplicity knots at end
# Compare knot spacing
# GH solution
# VB
# C#
# Python with RhinoCommon Only
# Pythong with RhinoScriptSyntax
# GH solution
# VB
# C#
# Python
pipe_variable = PipeVariable(Curve=reparameterize(arc_3pt.Arc), Parameters=range, Radii=graph_mapper, Caps=2)
