# Grasshopper definition Vectors119.gh (Grasshopper 1.0.7)
# Copyright: Wickerson Studios
# plug-ins: Bifocals

# Wickerson Studio
# 
# created by: Michael Wickerson
# 
# Grasshopper for Rhino 3D Algorithmic Modeling
# 
# www.wickersonstudios.com
# www.michaelwickerson.com
# https://www.youtube.com/channel/UC7J48Ppcsa6oncp6d29R0xw
# https://github.com/mwickerson
# https://www.facebook.com/michael.wickerson
# https://www.linkedin.com/in/michael-wickerson-696a80156/
# https://www.grasshopper3d.com/profile/MichaelWickerson
image_sampler = ImageSampler(
    FilePath="C:\Users\Sculpture\Documents\2020Grasshopper\ScreenShots2019\Screenshots2020\SurfaceEditAlgorithm.PNG",
    Filter="Value",
    Interpolate=False,
    Umax=1,
    Umin=0,
    Vmax=1,
    Vmin=0,
    Wrap=1)
xz_plane = XZPlane(Origin=Point(0, 0, 0))

# ----
# VECTORS 119/1001 NODE: To Polar
# Wickerson Studio
# created by: Michael Wickerson
# Grasshopper for Rhino 3D Algorithmic Modeling
# www.wickersonstudios.com
# www.michaelwickerson.com
# https://www.youtube.com/channel/UC7J48Ppcsa6oncp6d29R0xw
# https://github.com/mwickerson
# https://www.facebook.com/michael.wickerson
# https://www.linkedin.com/in/michael-wickerson-696a80156/
# https://www.grasshopper3d.com/profile/MichaelWickerson
number_slider = Slider(0.1, range=0.1..1)
number_slider_2 = Slider(3.55, range=0..10)
number_slider_3 = Slider(1.37, range=0..10)
number_slider_4 = Slider(2.63, range=0..10)
# 1001 GRASSHOPPER DEFINITIONS
construct_point = ConstructPoint(XCoordinate=number_slider, YCoordinate=number_slider, ZCoordinate=number_slider)
to_polar = ToPolar(Point=construct_point, System=xz_plane)  # -> Phi, Theta, Radius
unit_x = UnitX(Factor=to_polar.Phi)
unit_z = UnitZ(Factor=to_polar.Radius)
unit_y = UnitY(Factor=to_polar.Theta)
amplitude = Amplitude(Vector=unit_y, Amplitude=number_slider_2)
amplitude_2 = Amplitude(Vector=unit_z, Amplitude=number_slider_2)
amplitude_3 = Amplitude(Vector=unit_x, Amplitude=number_slider_2)
move = Move(Geometry=construct_point, Motion=amplitude_3)  # -> Geometry, Transform
move_2 = Move(Geometry=construct_point, Motion=amplitude_2)  # -> Geometry, Transform
move_3 = Move(Geometry=construct_point, Motion=amplitude)  # -> Geometry, Transform
line = Line(StartPoint=construct_point, EndPoint=move.Geometry)
line_2 = Line(StartPoint=construct_point, EndPoint=move_3.Geometry)
line_3 = Line(StartPoint=construct_point, EndPoint=move_2.Geometry)
end_points = EndPoints(Curve=line)  # -> Start, End
end_points_2 = EndPoints(Curve=line_2)  # -> Start, End
end_points_3 = EndPoints(Curve=line_3)  # -> Start, End
cross_reference = CrossReference(ListListA=end_points.End, ListListB=end_points_2.End, ListA=end_points_3.End, CrossMode=1)  # -> ListListA, ListListB, ListA
line_4 = Line(StartPoint=cross_reference.ListListA, EndPoint=cross_reference.ListListB)
line_5 = Line(StartPoint=cross_reference.ListListA, EndPoint=cross_reference.ListA)
line_6 = Line(StartPoint=cross_reference.ListListB, EndPoint=cross_reference.ListA)
merge = Merge(Data1=line, Data2=line_2, Data3=line_3, Data4=line_4, Data5=line_5, Data6=line_6)
# rs
# rc
# Full multiplicity knots at start
# Simple knots
# Full multiplicity knots at end
# P1
# A=0.2*P1+ 0.8*P2
# D=0.2*A + 0.8*B
# P2
# B=0.47*P2 + 0.53*P3
# Full multiplicity knots at start
# E=0.7*B + 0.3*C
# P3
# Full multiplicity knots in the middle
# C=0.8*P3 + 0.2*P4
# P4
# Full multiplicity knots at end
# Compare knot spacing
# GH solution
# VB
# C#
# Python with RhinoCommon Only
# Pythong with RhinoScriptSyntax
# GH solution
# VB
# C#
# Python
# VB
pipe = Pipe(Curve=merge, Radius=Slider(0.098, range=0..1), Caps=2)

xy_plane = XYPlane(Origin=Point(0, 0, 0))
