# Grasshopper definition Vectors120.gh (Grasshopper 1.0.7)
# Copyright: Wickerson Studios

# 1001 GRASSHOPPER DEFINITIONS
# Wickerson Studio
# 
# created by: Michael Wickerson
# 
# Grasshopper for Rhino 3D Algorithmic Modeling
# 
# www.wickersonstudios.com
# www.michaelwickerson.com
# https://www.youtube.com/channel/UC7J48Ppcsa6oncp6d29R0xw
# https://github.com/mwickerson
# https://www.facebook.com/michael.wickerson
# https://www.linkedin.com/in/michael-wickerson-696a80156/
# https://www.grasshopper3d.com/profile/MichaelWickerson
image_sampler = ImageSampler(
    FilePath="C:\Users\Sculpture\Documents\2020Grasshopper\ScreenShots2019\Screenshots2020\SurfaceEditAlgorithm.PNG",
    Filter="Value",
    Interpolate=False,
    Umax=1,
    Umin=0,
    Vmax=1,
    Vmin=0,
    Wrap=1)
# VECTORS 120/1001 NODE: Closest Point
# Wickerson Studio
# created by: Michael Wickerson
# Grasshopper for Rhino 3D Algorithmic Modeling
# www.wickersonstudios.com
# www.michaelwickerson.com
# https://www.youtube.com/channel/UC7J48Ppcsa6oncp6d29R0xw
# https://github.com/mwickerson
# https://www.facebook.com/michael.wickerson
# https://www.linkedin.com/in/michael-wickerson-696a80156/
# https://www.grasshopper3d.com/profile/MichaelWickerson
number_slider = Slider(4, range=0.1..10)
negative = Negative(Value=number_slider)
construct_domain = ConstructDomain(DomainStart=negative, DomainEnd=number_slider)
range = Range(Domain=construct_domain, Steps="1")
number_slider_2 = Slider(10, range=0..10)
number_slider_3 = Slider(40, range=0..100)
circle = Circle(Plane=PlaneXY(0, 0, 0), Radius=1)
cylinder = Cylinder(Base=PlaneXY(0, 0, 0), Radius=range, Length=range)
sphere = Sphere(Base=PlaneXY(0, 0, 0), Radius=range)
populate_geometry = PopulateGeometry(Geometry=circle, Count=number_slider_2, Seed=number_slider_3)
populate_geometry_2 = PopulateGeometry(Geometry=cylinder, Count=number_slider_2, Seed=number_slider_3)
closest_point = ClosestPoint(Point=populate_geometry, Cloud=populate_geometry_2)  # -> ClosestPoint, CPIndex, Distance
dispatch = Dispatch(List=flatten(populate_geometry_2), DispatchPattern=[True, False])  # -> ListA, ListB
point = Point(dispatch.ListB)
point_2 = Point(dispatch.ListA)
arc_3pt = Arc3Pt(PointA=point, PointB=point_2, PointC=closest_point.ClosestPoint)  # -> Arc, Plane, Radius
# rs
# rc
# Full multiplicity knots at start
# Simple knots
# Full multiplicity knots at end
# P1
# A=0.2*P1+ 0.8*P2
# D=0.2*A + 0.8*B
# P2
# B=0.47*P2 + 0.53*P3
# Full multiplicity knots at start
# E=0.7*B + 0.3*C
# P3
# Full multiplicity knots in the middle
# C=0.8*P3 + 0.2*P4
# P4
# Full multiplicity knots at end
# Compare knot spacing
# GH solution
# VB
# C#
# Python with RhinoCommon Only
# Pythong with RhinoScriptSyntax
# GH solution
# VB
# C#
# Python
# VB
pipe = Pipe(Curve=arc_3pt.Arc, Radius=Slider(0.45, range=0..10), Caps=2)
