# Grasshopper definition offTheCuff169b.gh (Grasshopper 1.0.7)
# Copyright: Wickerson Studios
# plug-ins: Dodo, Bifocals

# 1001 GRASSHOPPER DEFINITIONS
# Wickerson Studio
# 
# created by: Michael Wickerson
# 
# Grasshopper for Rhino 3D Algorithmic Modeling
# 
# www.wickersonstudios.com
# www.michaelwickerson.com
# https://www.youtube.com/channel/UC7J48Ppcsa6oncp6d29R0xw
# https://github.com/mwickerson
# https://www.facebook.com/michael.wickerson
# https://www.linkedin.com/in/michael-wickerson-696a80156/
# https://www.grasshopper3d.com/profile/MichaelWickerson
image_sampler = ImageSampler(
    FilePath="C:\Users\Sculpture\Documents\2020Grasshopper\ScreenShots2019\Screenshots2020\SurfaceEditAlgorithm.PNG",
    Filter="Value",
    Interpolate=False,
    Umax=1,
    Umin=0,
    Vmax=1,
    Vmin=0,
    Wrap=1)  # disabled
number_slider = Slider(100, range=0..100)
unit_y = UnitY(Factor=1)
unit_x = UnitX(Factor=1)
construct_point = ConstructPoint(XCoordinate=0, YCoordinate=0, ZCoordinate=0)
# Tutorials 169/1001 following: Horikawa Hollowed Weave + Dodo 0043
# https://www.youtube.com/watch?v=TiHO4-cUHuY
# Wickerson Studio
# created by: Michael Wickerson
# Grasshopper for Rhino 3D Algorithmic Modeling
# www.wickersonstudios.com
# www.michaelwickerson.com
# https://www.youtube.com/channel/UC7J48Ppcsa6oncp6d29R0xw
# https://github.com/mwickerson
# https://www.facebook.com/michael.wickerson
# https://www.linkedin.com/in/michael-wickerson-696a80156/
# https://www.grasshopper3d.com/profile/MichaelWickerson
number_slider_2 = Slider(4, range=0..10)
range = Range(Domain=number_slider, Steps=number_slider_2)
line_sdl = LineSDL(Start=construct_point, Direction=unit_x, Length=number_slider)
line_sdl_2 = LineSDL(Start=construct_point, Direction=unit_y, Length=number_slider)
unit_y_2 = UnitY(Factor=range)
unit_x_2 = UnitX(Factor=range)
move = Move(Geometry=line_sdl, Motion=unit_y_2)  # -> Geometry, Transform
move_2 = Move(Geometry=line_sdl_2, Motion=unit_x_2)  # -> Geometry, Transform
merge = Merge(Data1=move.Geometry, Data2=move_2.Geometry)
divide_curve = DivideCurve(Curve=merge, Count=number_slider_2, Kinks=False)  # -> simplify(Points), Tangents, Parameters
dispatch = Dispatch(List=divide_curve.Points, DispatchPattern=[True, False])  # -> simplify(ListA), simplify(ListB)
unit_z = UnitZ(Factor=Slider(21.63, range=0..100))
negative = Negative(Value=unit_z)
move_3 = Move(Geometry=dispatch.ListA, Motion=unit_z)  # -> Geometry, Transform
move_4 = Move(Geometry=dispatch.ListA, Motion=negative)  # -> Geometry, Transform
weave = Weave(Pattern=[0, 1], Stream0=move_3.Geometry, Stream1=move_4.Geometry, NullGaps=False)
group = Group(Objects=weave)  # -> flatten(Group)
list_length = ListLength(List=move.Geometry)
split_list = SplitList(List=group, Index=list_length)  # -> ListA, ListB
dispatch_2 = Dispatch(List=split_list.ListB, DispatchPattern=[True, False])  # -> ListA, ListB
dispatch_3 = Dispatch(List=split_list.ListA, DispatchPattern=[True, False])  # -> ListA, ListB
ungroup = Ungroup(Group=dispatch_2.ListB)  # -> simplify(Objects)
ungroup_2 = Ungroup(Group=dispatch_3.ListA)  # -> simplify(Objects)
deconstruct = Deconstruct(Point=ungroup_2)  # -> XComponent, YComponent, ZComponent
deconstruct_2 = Deconstruct(Point=ungroup)  # -> XComponent, YComponent, ZComponent
negative_2 = Negative(Value=deconstruct.ZComponent)
negative_3 = Negative(Value=deconstruct_2.ZComponent)
construct_point_2 = ConstructPoint(XCoordinate=deconstruct.XComponent, YCoordinate=deconstruct.YComponent, ZCoordinate=negative_2)
construct_point_3 = ConstructPoint(XCoordinate=deconstruct_2.XComponent, YCoordinate=deconstruct_2.YComponent, ZCoordinate=negative_3)
group_2 = Group(Objects=construct_point_2)  # -> flatten(Group)
group_3 = Group(Objects=construct_point_3)  # -> flatten(Group)
weave_2 = Weave(Pattern=[0, 1], Stream0=group_2, Stream1=dispatch_3.ListB, NullGaps=False)
weave_3 = Weave(Pattern=[0, 1], Stream0=dispatch_2.ListA, Stream1=group_3, NullGaps=False)
ungroup_3 = Ungroup(Group=weave_2)
ungroup_4 = Ungroup(Group=weave_3)
nurbs_curve = NurbsCurve(Vertices=ungroup_4, Degree=3, Periodic=False)  # -> Curve, Length, Domain
nurbs_curve_2 = NurbsCurve(Vertices=ungroup_3, Degree=3, Periodic=False)  # -> Curve, Length, Domain
interpolate = Interpolate(Vertices=ungroup_3, Degree=3, Periodic=False, KnotStyle=1)  # -> Curve, Length, Domain
interpolate_2 = Interpolate(Vertices=ungroup_4, Degree=3, Periodic=False, KnotStyle=1)  # -> Curve, Length, Domain
merge_2 = Merge(Data1=nurbs_curve_2.Curve, Data2=nurbs_curve.Curve)
merge_3 = Merge(Data1=interpolate.Curve, Data2=interpolate_2.Curve)
division = Division(A=number_slider, B="2")
construct_point_4 = ConstructPoint(XCoordinate=division, YCoordinate=division, ZCoordinate=0)
center_box = CenterBox(Base=construct_point_4, X=division, Y=division, Z=division)
voxels = Voxels(Box=center_box, Number=Slider(30, range=0..100))
# rc
# Full multiplicity knots at start
# Simple knots
# Full multiplicity knots at end
# P1
# A=0.2*P1+ 0.8*P2
# D=0.2*A + 0.8*B
# P2
# B=0.47*P2 + 0.53*P3
# Full multiplicity knots at start
# E=0.7*B + 0.3*C
# P3
# Full multiplicity knots in the middle
# C=0.8*P3 + 0.2*P4
# P4
# Full multiplicity knots at end
# Compare knot spacing
iso_mesh = IsoMesh(Voxels=voxels, Isolevel=Slider(1, range=0..1), TetrahedraCubes=Toggle(False))
